# Grasshopper definition Agreeability Tests - backup before changing connection length goals to tension goals.gh (Grasshopper 1.0.8)

# ----
# Base Shape Parameters
intermittend_offset = Slider(30, range=0..100)
column_height = Slider(6, range=0..10)
column_sides = Slider(4, range=0..10)

# ----
# Internal Parameters
number_slider = Slider(-2, range=-4..4)
basic_ht = Slider(60, range=0..100)
number_slider_2 = Slider(300, range=0..1000)

panel = Panel("""0.4
0.6""")

# ----
# Base Shape
X = UnitX(Factor=Slider(300, range=0..1000))
pt = Point(Point(-3713.054933, 3860.083293, 0))
move = Move(Geometry=pt, Motion=X)  # -> Geometry, Transform
xy = XYPlane(Origin=Point(0, 0, 0))
poledge = PolygonEdge(EdgeStart=pt, EdgeEnd=move.Geometry, PlanePoint=xy, Segments=column_sides)  # -> Polygon, Centre, CornerRadius, EdgeRadius
explode = Explode(Curve=poledge.Polygon, Recursive=True)  # -> Segments, Vertices
end = EndPoints(Curve=explode.Segments)  # -> Start, End
Z = UnitZ(Factor=number_slider_2)
move_2 = Move(Geometry=end.End, Motion=Z)  # -> Geometry, Transform
merge = Merge(Data1=graft(end.Start), Data2=graft(move_2.Geometry))  # -> simplify(Result)
Z_2 = UnitZ(Factor=number_slider_2)
midpt = CurveMiddle(Curve=explode.Segments)
move_3 = Move(Geometry=merge, Motion=Z_2)  # -> reverse(Geometry), Transform
vec2pt = Vector2Pt(PointA=poledge.Centre, PointB=midpt, Unitize=False)  # -> Vector, Length
merge_2 = Merge(Data1=merge, Data2=move_3.Geometry)
amp = Amplitude(Vector=vec2pt.Vector, Amplitude=intermittend_offset)  # -> graft(Vector)
addition = Addition(A=intermittend_offset, B=number_slider_2)
pline = PolyLine(Vertices=merge_2, Closed=True)
move_4 = Move(Geometry=pline, Motion=amp)  # -> Geometry, Transform
Z_3 = UnitZ(Factor=addition)
arrlinear = LinearArray(Geometry=move_4.Geometry, Direction=Z_3, Count=column_height)  # -> simplify(Geometry), Transform

# ----
# Shape Detailing
flip = FlipMatrix(Data=arrlinear.Geometry)
tstat = TreeStatistics(Tree=flip)  # -> Paths, Length, Count
dispatch = Dispatch(List=tstat.Paths, DispatchPattern=[True, False])  # -> ListA, ListB
split = SplitTree(Data=flip, Masks=flatten(dispatch.ListB))  # -> Positive, Negative
explode_2 = Explode(Curve=split.Positive, Recursive=True)  # -> Segments, Vertices
explode_3 = Explode(Curve=split.Negative, Recursive=True)  # -> Segments, Vertices
shift = ShiftList(List=explode_3.Segments, Shift=number_slider, Wrap=True)
trim = TrimTree(Tree=shift, Depth=1)
merge_3 = Merge(Data1=explode_2.Segments, Data2=trim)
item = ListItem(List=merge_3, Index=1, Wrap=True)  # -> Item, Item1
flip_2 = FlipCurve(Curve=item.Item)  # -> Curve, Flag
merge_4 = Merge(Data1=flip_2.Curve, Data2=item.Item1)
eval = EvaluateLength(Curve=merge_4, Length=basic_ht, Normalized=False)  # -> Point, Tangent, Parameter
shatter = Shatter(Curve=merge_4, Parameters=eval.Parameter)
pline_2 = PolyLine(Vertices=eval.Point, Closed=False)
item_2 = ListItem(List=shatter, Index=1, Wrap=True)
end_2 = EndPoints(Curve=merge_4)  # -> Start, End
trim_2 = TrimTree(Tree=item_2, Depth=1)
item_3 = ListItem(List=trim_2, Index=0, Wrap=True)  # -> Item, Item1
item_4 = ListItem(List=merge_3, Index=3, Wrap=True)  # -> Item, Item1
pline_3 = PolyLine(Vertices=end_2.End, Closed=False)
flip_3 = FlipCurve(Curve=item_3.Item)  # -> Curve, Flag
weave = Weave(
    Pattern=[0, 1, 2, 3, 4, 5],
    Stream0=item_4.Item1,
    Stream1=flip_3.Curve,
    Stream2=pline_2,
    Stream3=item_3.Item1,
    Stream4=item_4.Item,
    Stream5=pline_3,
    NullGaps=False)

subtraction = Subtraction(A=column_height, B=2)
geo = Geometry(merge_4)
multiplication = Multiplication(A=column_sides, B=subtraction)
item_5 = ListItem(List=geo, Index=0, Wrap=True)
repeat = RepeatData(Data=False, Length=column_sides)  # -> flatten(Data)
repeat_2 = RepeatData(Data=True, Length=multiplication)  # -> flatten(Data)
merge_5 = Merge(Data1=repeat, Data2=repeat_2, Data3=repeat)
tstat_2 = TreeStatistics(Tree=item_5)  # -> Paths, Length, Count
dispatch_2 = Dispatch(List=tstat_2.Paths, DispatchPattern=merge_5)  # -> ListA, ListB
split_2 = SplitTree(Data=item_5, Masks=flatten(dispatch_2.ListA))  # -> Positive, Negative
repeat_3 = RepeatData(Data=graft(["True", "False"]), Length=column_sides)  # -> flatten(Data)
tstat_3 = TreeStatistics(Tree=split_2.Positive)  # -> Paths, Length, Count
item_6 = ListItem(List=weave, Index=1, Wrap=True)
dispatch_3 = Dispatch(List=tstat_3.Paths, DispatchPattern=repeat_3)  # -> ListA, ListB
split_3 = SplitTree(Data=item_6, Masks=flatten(dispatch_2.ListA))  # -> Positive, Negative
partition = PartitionList(List=dispatch_3.ListA, Size=column_sides)
subtraction_2 = Subtraction(A=column_sides, B=1)
split_4 = SplitTree(Data=split_2.Positive, Masks=flatten(dispatch_3.ListA))  # -> Positive, Negative
split_5 = SplitTree(Data=split_3.Positive, Masks=flatten(dispatch_3.ListA))  # -> Positive, Negative
shift_2 = ShiftList(List=partition, Shift=subtraction_2, Wrap=True)  # -> flatten(List)
geo_2 = Geometry(split_4.Positive)
geo_3 = Geometry(split_4.Negative)
geo_4 = Geometry(split_5.Positive)
geo_5 = Geometry(split_5.Negative)
replace = ReplacePaths(Data=geo_3, Search=dispatch_3.ListB, Replace=shift_2)
replace_2 = ReplacePaths(Data=geo_5, Search=dispatch_3.ListB, Replace=shift_2)
eval_2 = EvaluateCurve(Curve=reparameterize(geo_2), Parameter=panel)  # -> Point, Tangent, Angle
end_3 = EndPoints(Curve=geo_4)  # -> Start, End
end_4 = EndPoints(Curve=replace_2)  # -> Start, End
crv_cp = CurveClosestPoint(Point=eval_2.Point, Curve=replace)  # -> Point, Parameter, Distance
merge_6 = Merge(Data1=eval_2.Point, Data2=end_3.Start, Data3=end_3.End)
merge_7 = Merge(Data1=crv_cp.Point, Data2=end_4.Start, Data3=end_4.End)
ln = Line(StartPoint=eval_2.Point, EndPoint=crv_cp.Point)
colinear = CoLinear(Points=merge_6, Strength=1)  # -> flatten(CoLinear)
length_line = LengthLine(Line=ln, Strength=10)  # -> flatten(Spring)
colinear_2 = CoLinear(Points=merge_7, Strength=1)  # -> flatten(CoLinear)

geo_6 = Geometry(weave)
item_7 = ListItem(List=geo_6, Index=0, Wrap=True)
repeat_4 = RepeatData(Data=graft(["True", "False"]), Length=column_sides)  # -> flatten(Data)
tstat_4 = TreeStatistics(Tree=item_7)  # -> Paths, Length, Count
dispatch_4 = Dispatch(List=tstat_4.Paths, DispatchPattern=repeat_4)  # -> ListA, ListB
partition_2 = PartitionList(List=dispatch_4.ListA, Size=column_sides)
subtraction_3 = Subtraction(A=column_sides, B=0)
split_6 = SplitTree(Data=item_7, Masks=flatten(dispatch_4.ListA))  # -> Positive, Negative
shift_3 = ShiftList(List=partition_2, Shift=subtraction_3, Wrap=True)  # -> flatten(List)
geo_7 = Geometry(split_6.Positive)
geo_8 = Geometry(split_6.Negative)
replace_3 = ReplacePaths(Data=geo_8, Search=dispatch_4.ListB, Replace=shift_3)
eval_3 = EvaluateCurve(Curve=reparameterize(geo_7), Parameter=panel)  # -> Point, Tangent, Angle
end_5 = EndPoints(Curve=geo_7)  # -> Start, End
crv_cp_2 = CurveClosestPoint(Point=eval_3.Point, Curve=replace_3)  # -> Point, Parameter, Distance
end_6 = EndPoints(Curve=replace_3)  # -> Start, End
merge_8 = Merge(Data1=eval_3.Point, Data2=end_5.Start, Data3=end_5.End)
merge_9 = Merge(Data1=crv_cp_2.Point, Data2=end_6.Start, Data3=end_6.End)
ln_2 = Line(StartPoint=eval_3.Point, EndPoint=crv_cp_2.Point)
colinear_3 = CoLinear(Points=merge_8, Strength=1)  # -> flatten(CoLinear)
length_line_2 = LengthLine(Line=ln_2, Strength=10)  # -> flatten(Spring)
colinear_4 = CoLinear(Points=merge_9, Strength=1)  # -> flatten(CoLinear)

geo_9 = Geometry(merge_4)
item_8 = ListItem(List=geo_9, Index=1, Wrap=True)
split_7 = SplitTree(Data=item_8, Masks=flatten(dispatch_2.ListA))  # -> Positive, Negative
repeat_5 = RepeatData(Data=graft(["True", "False"]), Length=column_sides)  # -> flatten(Data)
tstat_5 = TreeStatistics(Tree=split_7.Positive)  # -> Paths, Length, Count
dispatch_5 = Dispatch(List=tstat_5.Paths, DispatchPattern=repeat_5)  # -> ListA, ListB
item_9 = ListItem(List=weave, Index=3, Wrap=True)
partition_3 = PartitionList(List=dispatch_5.ListA, Size=column_sides)
subtraction_4 = Subtraction(A=column_sides, B=0)
split_8 = SplitTree(Data=split_7.Positive, Masks=flatten(dispatch_5.ListA))  # -> Positive, Negative
shift_4 = ShiftList(List=partition_3, Shift=subtraction_4, Wrap=True)  # -> flatten(List)
split_9 = SplitTree(Data=item_9, Masks=flatten(dispatch_5.ListA))  # -> Positive, Negative
geo_10 = Geometry(split_8.Positive)
geo_11 = Geometry(split_8.Negative)
geo_12 = Geometry(split_9.Positive)
geo_13 = Geometry(split_9.Negative)
replace_4 = ReplacePaths(Data=geo_11, Search=dispatch_5.ListB, Replace=shift_4)
replace_5 = ReplacePaths(Data=geo_13, Search=dispatch_5.ListB, Replace=shift_4)
eval_4 = EvaluateCurve(Curve=reparameterize(geo_10), Parameter=panel)  # -> Point, Tangent, Angle
end_7 = EndPoints(Curve=geo_12)  # -> Start, End
end_8 = EndPoints(Curve=replace_5)  # -> Start, End
crv_cp_3 = CurveClosestPoint(Point=eval_4.Point, Curve=replace_4)  # -> Point, Parameter, Distance
merge_10 = Merge(Data1=eval_4.Point, Data2=end_7.Start, Data3=end_7.End)
merge_11 = Merge(Data1=crv_cp_3.Point, Data2=end_8.Start, Data3=end_8.End)
ln_3 = Line(StartPoint=eval_4.Point, EndPoint=crv_cp_3.Point)
colinear_5 = CoLinear(Points=merge_10, Strength=1)  # -> flatten(CoLinear)
length_line_3 = LengthLine(Line=ln_3, Strength=10)  # -> flatten(Spring)
colinear_6 = CoLinear(Points=merge_11, Strength=1)  # -> flatten(CoLinear)

item_10 = ListItem(List=weave, Index=4, Wrap=True)
repeat_6 = RepeatData(Data=graft(["True", "False"]), Length=column_sides)  # -> flatten(Data)
tstat_6 = TreeStatistics(Tree=item_10)  # -> Paths, Length, Count
dispatch_6 = Dispatch(List=tstat_6.Paths, DispatchPattern=repeat_6)  # -> ListA, ListB
partition_4 = PartitionList(List=dispatch_6.ListA, Size=column_sides)
subtraction_5 = Subtraction(A=column_sides, B=1)
split_10 = SplitTree(Data=item_10, Masks=flatten(dispatch_6.ListA))  # -> Positive, Negative
shift_5 = ShiftList(List=partition_4, Shift=subtraction_5, Wrap=True)  # -> flatten(List)
geo_14 = Geometry(split_10.Positive)
geo_15 = Geometry(split_10.Negative)
replace_6 = ReplacePaths(Data=geo_15, Search=dispatch_6.ListB, Replace=shift_5)
eval_5 = EvaluateCurve(Curve=reparameterize(geo_14), Parameter=panel)  # -> Point, Tangent, Angle
end_9 = EndPoints(Curve=geo_14)  # -> Start, End
crv_cp_4 = CurveClosestPoint(Point=eval_5.Point, Curve=replace_6)  # -> Point, Parameter, Distance
end_10 = EndPoints(Curve=replace_6)  # -> Start, End
merge_12 = Merge(Data1=eval_5.Point, Data2=end_9.Start, Data3=end_9.End)
merge_13 = Merge(Data1=crv_cp_4.Point, Data2=end_10.Start, Data3=end_10.End)
ln_4 = Line(StartPoint=eval_5.Point, EndPoint=crv_cp_4.Point)
colinear_7 = CoLinear(Points=merge_12, Strength=1)  # -> flatten(CoLinear)
length_line_4 = LengthLine(Line=ln_4, Strength=10)  # -> flatten(Spring)
colinear_8 = CoLinear(Points=merge_13, Strength=1)  # -> flatten(CoLinear)

# ----
# Basic Deformations
number_slider_3 = Slider(0.85, range=0..1)
subtraction_6 = Subtraction(A=2, B=number_slider_3)
dom = ConstructDomain(DomainStart=number_slider_3, DomainEnd=subtraction_6)
panel_2 = Panel(dom)
geo_16 = Geometry(weave)
tstat_7 = TreeStatistics(Tree=geo_16)  # -> Paths, simplify(graft(Length)), Count
series = Series(Start=0, Step=1, Count=tstat_7.Count)  # -> simplify(graft(Series))
random = Random(Range=dom, Number=tstat_7.Length, Seed=series)  # -> simplify(Random)
len = Length(Curve=geo_16)
multiplication_2 = Multiplication(A=len, B=random)
length_line_5 = LengthLine(Line=geo_16, Length=multiplication_2, Strength=10)  # -> flatten(Spring)

# ----
# Potential: Use for vertices connections - able to stretch to a limit, but not beyond
pl = PlasticLength(Limit=1, Strength=1)

number_slider_4 = Slider(0.5, range=0..1)
cull_i = CullIndex(List=weave, Indices=-1, Wrap=True)
item_11 = ListItem(List=eval_5.Point, Index=0, Wrap=True)  # -> Item, Item1
end_11 = EndPoints(Curve=cull_i)  # -> Start, End
vec2pt_2 = Vector2Pt(PointA=item_11.Item, PointB=item_11.Item1, Unitize=False)  # -> Vector, Length
pt_2 = Point(end_11.End)
move_5 = Move(Geometry=eval_5.Point, Motion=ln_4)  # -> Geometry, Transform
move_6 = Move(Geometry=item_11.Item, Motion=vec2pt_2.Vector)  # -> Geometry, Transform
transform = Transform(P0=eval_5.Point, P1=move_5.Geometry, T=move_5.Transform, Strength=number_slider_4)  # -> flatten(Transform)
transform_2 = Transform(P0=item_11.Item, P1=move_6.Geometry, T=move_6.Transform, Strength=number_slider_4)  # -> flatten(Transform)
floor = Floor(Strength=1)  # -> flatten(Floor)
coplanar = CoPlanar(Points=pt_2, Strength=1)  # -> flatten(Coplanar)
merge_14 = Merge(
    Data1=floor,
    Data2=length_line_5,
    Data3=coplanar,
    Data4=colinear_7,
    Data5=colinear_8,
    Data6=length_line_4,
    Data7=colinear,
    Data8=colinear_2,
    Data9=length_line,
    Data10=colinear_5,
    Data11=length_line_3,
    Data12=colinear_6,
    Data13=colinear_3,
    Data14=length_line_2,
    Data15=colinear_4,
    Data16=transform)
bouncysolver = BouncySolver(
    GoalObjects=merge_14,
    Reset=Button(),
    Threshold=1e-15,
    Tolerance=0.0001,
    Damping=Slider(0.01, range=0.01..1),
    Iterations=10,
    On=Toggle(False))  # -> I, V, O
geo_17 = Geometry(bouncysolver.O)
