# Grasshopper definition Agreeability Tests [Jul-02 '26, 1548].gh (Grasshopper 1.0.8)

# ----
# Base Shape Parameters
intermittend_offset = Slider(30, range=0..100)
column_height = Slider(4, range=2..10)
column_sides = Slider(3, range=0..10)

# ----
# Internal Parameters
number_slider = Slider(-2, range=-4..4)
basic_ht = Slider(60, range=0..100)
number_slider_2 = Slider(600, range=0..1000)

panel = Panel("""0.4
0.6""")

# ----
# Base Shape
X = UnitX(Factor=Slider(600, range=0..1000))
pt = Point(Point(-3713.054933, 3860.083293, 0))
move = Move(Geometry=pt, Motion=X)  # -> Geometry, Transform
xy = XYPlane(Origin=Point(0, 0, 0))
poledge = PolygonEdge(EdgeStart=pt, EdgeEnd=move.Geometry, PlanePoint=xy, Segments=column_sides)  # -> Polygon, Centre, CornerRadius, EdgeRadius
explode = Explode(Curve=poledge.Polygon, Recursive=True)  # -> Segments, Vertices
end = EndPoints(Curve=explode.Segments)  # -> Start, End
Z = UnitZ(Factor=number_slider_2)
move_2 = Move(Geometry=end.End, Motion=Z)  # -> Geometry, Transform
merge = Merge(Data1=graft(end.Start), Data2=graft(move_2.Geometry))  # -> simplify(Result)
Z_2 = UnitZ(Factor=number_slider_2)
midpt = CurveMiddle(Curve=explode.Segments)
move_3 = Move(Geometry=merge, Motion=Z_2)  # -> reverse(Geometry), Transform
vec2pt = Vector2Pt(PointA=poledge.Centre, PointB=midpt, Unitize=False)  # -> Vector, Length
merge_2 = Merge(Data1=merge, Data2=move_3.Geometry)
amp = Amplitude(Vector=vec2pt.Vector, Amplitude=intermittend_offset)  # -> graft(Vector)
addition = Addition(A=intermittend_offset, B=number_slider_2)
pline = PolyLine(Vertices=merge_2, Closed=True)
move_4 = Move(Geometry=pline, Motion=amp)  # -> Geometry, Transform
Z_3 = UnitZ(Factor=addition)
arrlinear = LinearArray(Geometry=move_4.Geometry, Direction=Z_3, Count=column_height)  # -> simplify(Geometry), Transform

# ----
# Shape Detailing
flip = FlipMatrix(Data=arrlinear.Geometry)
tstat = TreeStatistics(Tree=flip)  # -> Paths, Length, Count
dispatch = Dispatch(List=tstat.Paths, DispatchPattern=[True, False])  # -> ListA, ListB
split = SplitTree(Data=flip, Masks=flatten(dispatch.ListB))  # -> Positive, Negative
explode_2 = Explode(Curve=split.Positive, Recursive=True)  # -> Segments, Vertices
explode_3 = Explode(Curve=split.Negative, Recursive=True)  # -> Segments, Vertices
shift = ShiftList(List=explode_3.Segments, Shift=number_slider, Wrap=True)
trim = TrimTree(Tree=shift, Depth=1)
merge_3 = Merge(Data1=explode_2.Segments, Data2=trim)
item = ListItem(List=merge_3, Index=1, Wrap=True)  # -> Item, Item1
flip_2 = FlipCurve(Curve=item.Item)  # -> Curve, Flag
merge_4 = Merge(Data1=flip_2.Curve, Data2=item.Item1)
eval = EvaluateLength(Curve=merge_4, Length=basic_ht, Normalized=False)  # -> Point, Tangent, Parameter
shatter = Shatter(Curve=merge_4, Parameters=eval.Parameter)
pline_2 = PolyLine(Vertices=eval.Point, Closed=False)
item_2 = ListItem(List=shatter, Index=1, Wrap=True)
# Potentially, the connections can be improved further by constraining at least one point on each side to an end point of the given line, ensuring the connection remains roughly in the same spot.
end_2 = EndPoints(Curve=merge_4)  # -> Start, End
trim_2 = TrimTree(Tree=item_2, Depth=1)
item_3 = ListItem(List=trim_2, Index=0, Wrap=True)  # -> Item, Item1
item_4 = ListItem(List=merge_3, Index=3, Wrap=True)  # -> Item, Item1
pline_3 = PolyLine(Vertices=end_2.End, Closed=False)
flip_3 = FlipCurve(Curve=item_3.Item)  # -> Curve, Flag
weave = Weave(
    Pattern=[0, 1, 2, 3, 4, 5],
    Stream0=item_4.Item1,
    Stream1=flip_3.Curve,
    Stream2=pline_2,
    Stream3=item_3.Item1,
    Stream4=item_4.Item,
    Stream5=pline_3,
    NullGaps=False)

geo = Geometry(weave)
item_5 = ListItem(List=geo, Index=0, Wrap=True)
repeat = RepeatData(Data=graft(["True", "False"]), Length=column_sides)  # -> flatten(Data)
tstat_2 = TreeStatistics(Tree=item_5)  # -> Paths, Length, Count
dispatch_2 = Dispatch(List=tstat_2.Paths, DispatchPattern=repeat)  # -> ListA, ListB
partition = PartitionList(List=dispatch_2.ListA, Size=column_sides)
subtraction = Subtraction(A=column_sides, B=0)
split_2 = SplitTree(Data=item_5, Masks=flatten(dispatch_2.ListA))  # -> Positive, Negative
shift_2 = ShiftList(List=partition, Shift=subtraction, Wrap=True)  # -> flatten(List)
geo_2 = Geometry(split_2.Positive)
geo_3 = Geometry(split_2.Negative)
replace = ReplacePaths(Data=geo_3, Search=dispatch_2.ListB, Replace=shift_2)
eval_2 = EvaluateCurve(Curve=reparameterize(geo_2), Parameter=panel)  # -> Point, Tangent, Angle
end_3 = EndPoints(Curve=geo_2)  # -> Start, End
item_6 = ListItem(List=eval_2.Point, Index=0, Wrap=True)  # -> Item, Item1
crv_cp = CurveClosestPoint(Point=eval_2.Point, Curve=replace)  # -> Point, Parameter, Distance
end_4 = EndPoints(Curve=replace)  # -> Start, End
vec2pt_2 = Vector2Pt(PointA=item_6.Item, PointB=item_6.Item1, Unitize=False)  # -> Vector, Length
move_5 = Move(Geometry=item_6.Item, Motion=vec2pt_2.Vector)  # -> Geometry, Transform
merge_5 = Merge(Data1=eval_2.Point, Data2=end_3.Start, Data3=end_3.End)
merge_6 = Merge(Data1=crv_cp.Point, Data2=end_4.Start, Data3=end_4.End)
ln = Line(StartPoint=eval_2.Point, EndPoint=crv_cp.Point)
move_6 = Move(Geometry=eval_2.Point, Motion=ln)  # -> Geometry, Transform
ct = ConstantTension(Line=ln, Strength=1)  # -> flatten(ConstantTension)
colinear = CoLinear(Points=merge_5, Strength=1)  # -> flatten(CoLinear)
colinear_2 = CoLinear(Points=merge_6, Strength=1)  # -> flatten(CoLinear)
transform = Transform(P0=eval_2.Point, P1=move_6.Geometry, T=move_6.Transform, Strength=1)  # -> flatten(Transform)
transform_2 = Transform(P0=item_6.Item, P1=move_5.Geometry, T=move_5.Transform, Strength=1)  # -> flatten(Transform)
oncurve = OnCurve(Points=eval_2.Point, Curve=geo_2, Strength=1)  # -> flatten(P)

# ----
# Basic Deformations - Random
number_slider_3 = Slider(0.85, range=0..1)
subtraction_2 = Subtraction(A=2, B=number_slider_3)
dom = ConstructDomain(DomainStart=number_slider_3, DomainEnd=subtraction_2)
panel_2 = Panel(dom)
geo_4 = Geometry(weave)
tstat_3 = TreeStatistics(Tree=geo_4)  # -> Paths, simplify(graft(Length)), Count
series = Series(Start=0, Step=1, Count=tstat_3.Count)  # -> simplify(graft(Series))
random = Random(Range=dom, Number=tstat_3.Length, Seed=series)  # -> simplify(Random)
len = Length(Curve=geo_4)
multiplication = Multiplication(A=len, B=random)
length_line = LengthLine(Line=geo_4, Length=multiplication, Strength=10)  # -> flatten(Spring)

number_slider_4 = Slider(1, range=1..100)

subtraction_3 = Subtraction(A=column_height, B=2)
geo_5 = Geometry(merge_4)
multiplication_2 = Multiplication(A=column_sides, B=subtraction_3)
item_7 = ListItem(List=geo_5, Index=0, Wrap=True)
repeat_2 = RepeatData(Data=False, Length=column_sides)  # -> flatten(Data)
repeat_3 = RepeatData(Data=True, Length=multiplication_2)  # -> flatten(Data)
merge_7 = Merge(Data1=repeat_2, Data2=repeat_3, Data3=repeat_2)
tstat_4 = TreeStatistics(Tree=item_7)  # -> Paths, Length, Count
dispatch_3 = Dispatch(List=tstat_4.Paths, DispatchPattern=merge_7)  # -> ListA, ListB
split_3 = SplitTree(Data=item_7, Masks=flatten(dispatch_3.ListA))  # -> Positive, Negative
repeat_4 = RepeatData(Data=graft(["True", "False"]), Length=column_sides)  # -> flatten(Data)
tstat_5 = TreeStatistics(Tree=split_3.Positive)  # -> Paths, Length, Count
item_8 = ListItem(List=weave, Index=1, Wrap=True)
dispatch_4 = Dispatch(List=tstat_5.Paths, DispatchPattern=repeat_4)  # -> ListA, ListB
split_4 = SplitTree(Data=item_8, Masks=flatten(dispatch_3.ListA))  # -> Positive, Negative
partition_2 = PartitionList(List=dispatch_4.ListA, Size=column_sides)
subtraction_4 = Subtraction(A=column_sides, B=1)
split_5 = SplitTree(Data=split_3.Positive, Masks=flatten(dispatch_4.ListA))  # -> Positive, Negative
split_6 = SplitTree(Data=split_4.Positive, Masks=flatten(dispatch_4.ListA))  # -> Positive, Negative
shift_3 = ShiftList(List=partition_2, Shift=subtraction_4, Wrap=True)  # -> flatten(List)
geo_6 = Geometry(split_5.Positive)
geo_7 = Geometry(split_5.Negative)
geo_8 = Geometry(split_6.Positive)
geo_9 = Geometry(split_6.Negative)
replace_2 = ReplacePaths(Data=geo_7, Search=dispatch_4.ListB, Replace=shift_3)
replace_3 = ReplacePaths(Data=geo_9, Search=dispatch_4.ListB, Replace=shift_3)
eval_3 = EvaluateCurve(Curve=reparameterize(geo_6), Parameter=panel)  # -> Point, Tangent, Angle
end_5 = EndPoints(Curve=geo_8)  # -> Start, End
end_6 = EndPoints(Curve=replace_3)  # -> Start, End
item_9 = ListItem(List=eval_3.Point, Index=0, Wrap=True)  # -> Item, Item1
crv_cp_2 = CurveClosestPoint(Point=eval_3.Point, Curve=replace_2)  # -> Point, Parameter, Distance
vec2pt_3 = Vector2Pt(PointA=item_9.Item, PointB=item_9.Item1, Unitize=False)  # -> Vector, Length
move_7 = Move(Geometry=item_9.Item, Motion=vec2pt_3.Vector)  # -> Geometry, Transform
merge_8 = Merge(Data1=eval_3.Point, Data2=end_5.Start, Data3=end_5.End)
merge_9 = Merge(Data1=crv_cp_2.Point, Data2=end_6.Start, Data3=end_6.End)
ln_2 = Line(StartPoint=eval_3.Point, EndPoint=crv_cp_2.Point)
move_8 = Move(Geometry=eval_3.Point, Motion=ln_2)  # -> Geometry, Transform
ct_2 = ConstantTension(Line=ln_2, Strength=number_slider_4)  # -> flatten(ConstantTension)
transform_3 = Transform(P0=eval_3.Point, P1=move_8.Geometry, T=move_8.Transform, Strength=number_slider_4)  # -> flatten(Transform)
transform_4 = Transform(P0=item_9.Item, P1=move_7.Geometry, T=move_7.Transform, Strength=number_slider_4)  # -> flatten(Transform)
oncurve_2 = OnCurve(Points=eval_3.Point, Curve=geo_6, Strength=number_slider_4)  # -> flatten(P)
colinear_3 = CoLinear(Points=merge_8, Strength=number_slider_4)  # -> flatten(CoLinear)
colinear_4 = CoLinear(Points=merge_9, Strength=number_slider_4)  # -> flatten(CoLinear)

geo_10 = Geometry(merge_4)
item_10 = ListItem(List=geo_10, Index=1, Wrap=True)
split_7 = SplitTree(Data=item_10, Masks=flatten(dispatch_3.ListA))  # -> Positive, Negative
repeat_5 = RepeatData(Data=graft(["True", "False"]), Length=column_sides)  # -> flatten(Data)
tstat_6 = TreeStatistics(Tree=split_7.Positive)  # -> Paths, Length, Count
dispatch_5 = Dispatch(List=tstat_6.Paths, DispatchPattern=repeat_5)  # -> ListA, ListB
item_11 = ListItem(List=weave, Index=3, Wrap=True)
partition_3 = PartitionList(List=dispatch_5.ListA, Size=column_sides)
subtraction_5 = Subtraction(A=column_sides, B=0)
split_8 = SplitTree(Data=split_7.Positive, Masks=flatten(dispatch_5.ListA))  # -> Positive, Negative
shift_4 = ShiftList(List=partition_3, Shift=subtraction_5, Wrap=True)  # -> flatten(List)
split_9 = SplitTree(Data=item_11, Masks=flatten(dispatch_5.ListA))  # -> Positive, Negative
geo_11 = Geometry(split_8.Negative)
geo_12 = Geometry(split_8.Positive)
geo_13 = Geometry(split_9.Positive)
geo_14 = Geometry(split_9.Negative)
replace_4 = ReplacePaths(Data=geo_11, Search=dispatch_5.ListB, Replace=shift_4)
replace_5 = ReplacePaths(Data=geo_14, Search=dispatch_5.ListB, Replace=shift_4)
eval_4 = EvaluateCurve(Curve=reparameterize(geo_12), Parameter=panel)  # -> Point, Tangent, Angle
item_12 = ListItem(List=eval_4.Point, Index=0, Wrap=True)  # -> Item, Item1
end_7 = EndPoints(Curve=geo_13)  # -> Start, End
end_8 = EndPoints(Curve=replace_5)  # -> Start, End
crv_cp_3 = CurveClosestPoint(Point=eval_4.Point, Curve=replace_4)  # -> Point, Parameter, Distance
vec2pt_4 = Vector2Pt(PointA=item_12.Item, PointB=item_12.Item1, Unitize=False)  # -> Vector, Length
move_9 = Move(Geometry=item_12.Item, Motion=vec2pt_4.Vector)  # -> Geometry, Transform
merge_10 = Merge(Data1=eval_4.Point, Data2=end_7.Start, Data3=end_7.End)
merge_11 = Merge(Data1=crv_cp_3.Point, Data2=end_8.Start, Data3=end_8.End)
ln_3 = Line(StartPoint=eval_4.Point, EndPoint=crv_cp_3.Point)
move_10 = Move(Geometry=eval_4.Point, Motion=ln_3)  # -> Geometry, Transform
colinear_5 = CoLinear(Points=merge_10, Strength=number_slider_4)  # -> flatten(CoLinear)
ct_3 = ConstantTension(Line=ln_3, Strength=number_slider_4)  # -> flatten(ConstantTension)
colinear_6 = CoLinear(Points=merge_11, Strength=number_slider_4)  # -> flatten(CoLinear)
transform_5 = Transform(P0=eval_4.Point, P1=move_10.Geometry, T=move_10.Transform, Strength=number_slider_4)  # -> flatten(Transform)
transform_6 = Transform(P0=item_12.Item, P1=move_9.Geometry, T=move_9.Transform, Strength=number_slider_4)  # -> flatten(Transform)
oncurve_3 = OnCurve(Points=eval_4.Point, Curve=geo_12, Strength=number_slider_4)  # -> flatten(P)

item_13 = ListItem(List=weave, Index=4, Wrap=True)
repeat_6 = RepeatData(Data=graft(["True", "False"]), Length=column_sides)  # -> flatten(Data)
tstat_7 = TreeStatistics(Tree=item_13)  # -> Paths, Length, Count
dispatch_6 = Dispatch(List=tstat_7.Paths, DispatchPattern=repeat_6)  # -> ListA, ListB
partition_4 = PartitionList(List=dispatch_6.ListA, Size=column_sides)
subtraction_6 = Subtraction(A=column_sides, B=1)
split_10 = SplitTree(Data=item_13, Masks=flatten(dispatch_6.ListA))  # -> Positive, Negative
shift_5 = ShiftList(List=partition_4, Shift=subtraction_6, Wrap=True)  # -> flatten(List)
geo_15 = Geometry(split_10.Positive)
geo_16 = Geometry(split_10.Negative)
replace_6 = ReplacePaths(Data=geo_16, Search=dispatch_6.ListB, Replace=shift_5)
eval_5 = EvaluateCurve(Curve=reparameterize(geo_15), Parameter=panel)  # -> Point, Tangent, Angle
end_9 = EndPoints(Curve=geo_15)  # -> Start, End
item_14 = ListItem(List=eval_5.Point, Index=0, Wrap=True)  # -> Item, Item1
crv_cp_4 = CurveClosestPoint(Point=eval_5.Point, Curve=replace_6)  # -> Point, Parameter, Distance
end_10 = EndPoints(Curve=replace_6)  # -> Start, End
vec2pt_5 = Vector2Pt(PointA=item_14.Item, PointB=item_14.Item1, Unitize=False)  # -> Vector, Length
move_11 = Move(Geometry=item_14.Item, Motion=vec2pt_5.Vector)  # -> Geometry, Transform
merge_12 = Merge(Data1=eval_5.Point, Data2=end_9.Start, Data3=end_9.End)
merge_13 = Merge(Data1=crv_cp_4.Point, Data2=end_10.Start, Data3=end_10.End)
ln_4 = Line(StartPoint=eval_5.Point, EndPoint=crv_cp_4.Point)
move_12 = Move(Geometry=eval_5.Point, Motion=ln_4)  # -> Geometry, Transform
transform_7 = Transform(P0=eval_5.Point, P1=move_12.Geometry, T=move_12.Transform, Strength=number_slider_4)  # -> flatten(Transform)
transform_8 = Transform(P0=item_14.Item, P1=move_11.Geometry, T=move_11.Transform, Strength=number_slider_4)  # -> flatten(Transform)
oncurve_4 = OnCurve(Points=eval_5.Point, Curve=geo_15, Strength=number_slider_4)  # -> flatten(P)
colinear_7 = CoLinear(Points=merge_12, Strength=number_slider_4)  # -> flatten(CoLinear)
colinear_8 = CoLinear(Points=merge_13, Strength=number_slider_4)  # -> flatten(CoLinear)
ct_4 = ConstantTension(Line=ln_4, Strength=number_slider_4)  # -> flatten(ConstantTension)

# ----
# Vertical:
# 
# Connection between SS|SS
# 
# Connection between DT|DT
# Horizontal:
# 
# Connection between CS|CS
# 
# Connection between TT|TT
panel_3 = Panel("""0.4
0.6""")

# ----
# Potential: Use for vertices connections - able to stretch to a limit, but not beyond
pl = PlasticLength(Limit=1, Strength=1)

cull_i = CullIndex(List=weave, Indices=-1, Wrap=True)
end_11 = EndPoints(Curve=cull_i)  # -> Start, End
pt_2 = Point(end_11.End)
coplanar = CoPlanar(Points=pt_2, Strength=1)  # -> flatten(Coplanar)

item_15 = ListItem(List=eval_2.Point, Index=1, Wrap=True)
item_16 = ListItem(List=crv_cp.Point, Index=0, Wrap=True)
pt_3 = Point(end_3.End)
pt_4 = Point(end_4.End)
merge_14 = Merge(Data1=eval_5.Point, Data2=crv_cp_4.Point)

# ----
# Basic Deformations - FRAMED
full_filtered_point_set = Data(Tree({0}: [{Count=1, Count=5, Path="{0}", Coordinate=Point(3413.624797, 0, 2723.357114), Coordinate=Point(3966.64791, 0, 2764.438669), Coordinate=Point(3979.98006, 0, 2720.831172), Coordinate=Point(3582.020045, 0, 2189.275621), Coordinate=Point(3157.271884, 0, 2256.275621)}], {1}: [{Count=1, Count=5, Path="{0}", Coordinate=Point(4510.340923, 0, 2403.501935), Coordinate=Point(4778.90377, 0, 2754.685956), Coordinate=Point(4789.565206, 0, 2722.822282), Coordinate=Point(4582.020045, 0, 2189.275621), Coordinate=Point(4232.320531, 0, 2174.775621)}], {2}: [{Count=1, Count=5, Path="{0}", Coordinate=Point(7432.427282, 0, 2650.629071), Coordinate=Point(8019.772897, 0, 2775.018647), Coordinate=Point(8050.016567, 0, 2693.9781), Coordinate=Point(7582.020045, 0, 2189.275621), Coordinate=Point(7158.07052, 0, 2219.138646)}], {3}: [{Count=1, Count=5, Path="{0}", Coordinate=Point(8448.113804, 0, 2627.263199), Coordinate=Point(8970.236205, 0, 2795.282404), Coordinate=Point(8979.333941, 0, 2770.28658), Coordinate=Point(8582.020045, 0, 2189.275621), Coordinate=Point(8159.200934, 0, 2232.275621)}], {4}: [{Count=1, Count=5, Path="{0}", Coordinate=Point(9446.95774, 0, 2660.293852), Coordinate=Point(9993.261391, 0, 2765.394973), Coordinate=Point(10017.46977, 0, 2686.21294), Coordinate=Point(9582.020045, 0, 2189.275621), Coordinate=Point(9138.063121, 0, 2262.775621)}], {5}: [{Count=1, Count=5, Path="{0}", Coordinate=Point(11469.13533, 0, 2558.504887), Coordinate=Point(11945.69303, 0, 2779.27), Coordinate=Point(11955.85076, 0, 2749.769821), Coordinate=Point(11582.02004, 0, 2189.275621), Coordinate=Point(11141.75904, 0, 2246.775621)}]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))
ungroup = Ungroup(Group=full_filtered_point_set)  # -> simplify(Geometry)
pline_4 = PolyLine(Vertices=ungroup, Closed=True)
item_17 = ListItem(List=ungroup, Index=[0, 3], Wrap=True)
explode_4 = Explode(Curve=pline_4, Recursive=True)  # -> simplify(Segments), Vertices
pline_5 = PolyLine(Vertices=item_17, Closed=False)
shift_6 = ShiftList(List=explode_4.Segments, Shift=-1, Wrap=True)  # -> simplify(List)
len_2 = Length(Curve=pline_5)
geo_17 = Geometry(weave)
len_3 = Length(Curve=shift_6)
tstat_8 = TreeStatistics(Tree=geo_17)  # -> Paths, simplify(graft(Length)), Count
ins = InsertItems(List=len_3, Item=len_2, Indices=-1, Wrap=True)  # -> simplify(List)
tstat_9 = TreeStatistics(Tree=ins)  # -> Paths, Length, Count
subtraction_7 = Subtraction(A=tstat_9.Count, B=tstat_8.Count)
reduce = RandomReduce(List=tstat_9.Paths, Reduction=subtraction_7, Seed=Slider(14, range=0..100))
branch = TreeBranch(Tree=ins, Path=reduce, MaintainPaths=True)
replace_7 = ReplacePaths(Data=branch, Search=reduce, Replace=tstat_8.Paths)
length_line_2 = LengthLine(Line=geo_17, Length=replace_7, Strength=Slider(1, range=0..1))  # -> flatten(Spring)

item_18 = ListItem(List=explode_4.Segments, Index=0, Wrap=True)  # -> Item, Item1
item_19 = ListItem(List=geo_17, Index=1, Wrap=True)
item_20 = ListItem(List=geo_17, Index=2, Wrap=True)
flip_4 = FlipCurve(Curve=item_18.Item)  # -> Curve, Flag
end_12 = EndPoints(Curve=item_18.Item1)  # -> Start, End
angle = Angle(VectorA=item_18.Item, VectorB=item_18.Item1)  # -> Angle, Reflex
xz = XZPlane(Origin=end_12.Start)
subtraction_8 = Subtraction(A=angle.Reflex, B=3.141592654)
rotate = Rotate(Geometry=item_18.Item1, Angle=expr("-x", subtraction_8), Plane=xz)  # -> Geometry, Transform
branch_2 = TreeBranch(Tree=subtraction_8, Path=reduce, MaintainPaths=True)
replace_8 = ReplacePaths(Data=branch_2, Search=reduce, Replace=tstat_8.Paths)
angle_2 = Angle(LineA=item_19, LineB=item_20, RestAngle=replace_8, Strength=1)  # -> flatten(Angle)

item_21 = ListItem(List=flatten(geo_17), Index=3, Wrap=True)
item_22 = ListItem(List=crv_cp_4.Point, Index=1, Wrap=True)
item_23 = ListItem(List=eval_5.Point, Index=0, Wrap=True)
item_24 = ListItem(List=eval_3.Point, Index=1, Wrap=True)
item_25 = ListItem(List=crv_cp_2.Point, Index=0, Wrap=True)
pt_5 = Point(end_10.Start)
pt_6 = Point(end_9.Start)
pt_7 = Point(end_5.Start)
pt_8 = Point(end_6.Start)
item_26 = ListItem(List=eval_4.Point, Index=1, Wrap=True)
item_27 = ListItem(List=crv_cp_3.Point, Index=0, Wrap=True)
pt_9 = Point(end_7.End)
pt_10 = Point(end_8.End)
end_13 = EndPoints(Curve=item_21)  # -> Start, End
vec2pt_6 = Vector2Pt(PointA=pt_3, PointB=item_15, Unitize=False)  # -> Vector, Length
vec2pt_7 = Vector2Pt(PointA=pt_4, PointB=item_16, Unitize=False)  # -> Vector, Length
vec2pt_8 = Vector2Pt(PointA=pt_5, PointB=item_22, Unitize=False)  # -> Vector, Length
vec2pt_9 = Vector2Pt(PointA=pt_6, PointB=item_23, Unitize=False)  # -> Vector, Length
vec2pt_10 = Vector2Pt(PointA=pt_7, PointB=item_24, Unitize=False)  # -> Vector, Length
vec2pt_11 = Vector2Pt(PointA=pt_8, PointB=item_25, Unitize=False)  # -> Vector, Length
vec2pt_12 = Vector2Pt(PointA=pt_9, PointB=item_26, Unitize=False)  # -> Vector, Length
vec2pt_13 = Vector2Pt(PointA=pt_10, PointB=item_27, Unitize=False)  # -> Vector, Length
pt_11 = Point(end_13.Start)
floor = Floor(Strength=1)  # -> flatten(Floor)
transform_9 = Transform(vec2pt_6.Vector)
transform_10 = Transform(vec2pt_7.Vector)
transform_11 = Transform(vec2pt_8.Vector)
transform_12 = Transform(vec2pt_9.Vector)
transform_13 = Transform(vec2pt_10.Vector)
transform_14 = Transform(vec2pt_11.Vector)
transform_15 = Transform(vec2pt_12.Vector)
transform_16 = Transform(vec2pt_13.Vector)
anchor = Anchor(Point=pt_11, Strength=10000)
transform_17 = Transform(P0=pt_3, P1=item_15, T=transform_9, Strength=1)  # -> flatten(Transform)
transform_18 = Transform(P0=pt_4, P1=item_16, T=transform_10, Strength=1)  # -> flatten(Transform)
coplanar_2 = CoPlanar(Points=merge_14, Strength=number_slider_4)  # -> flatten(Coplanar)
transform_19 = Transform(P0=pt_5, P1=item_22, T=transform_11, Strength=number_slider_4)  # -> flatten(Transform)
transform_20 = Transform(P0=pt_6, P1=item_23, T=transform_12, Strength=number_slider_4)  # -> flatten(Transform)
transform_21 = Transform(P0=pt_7, P1=item_24, T=transform_13, Strength=number_slider_4)  # -> flatten(Transform)
transform_22 = Transform(P0=pt_8, P1=item_25, T=transform_14, Strength=number_slider_4)  # -> flatten(Transform)
transform_23 = Transform(P0=pt_9, P1=item_26, T=transform_15, Strength=number_slider_4)  # -> flatten(Transform)
transform_24 = Transform(P0=pt_10, P1=item_27, T=transform_16, Strength=number_slider_4)  # -> flatten(Transform)
merge_15 = Merge(Data1=colinear, Data2=ct, Data3=colinear_2, Data4=transform, Data5=transform_2, Data7=transform_17, Data8=transform_18)
merge_16 = Merge(
    Data1=colinear_3,
    Data2=ct_2,
    Data3=colinear_4,
    Data4=transform_3,
    Data5=transform_4,
    Data7=transform_21,
    Data8=transform_22)
merge_17 = Merge(
    Data1=colinear_7,
    Data2=ct_4,
    Data3=colinear_8,
    Data4=transform_7,
    Data5=transform_8,
    Data7=transform_19,
    Data8=transform_20,
    Data9=coplanar_2)
merge_18 = Merge(
    Data1=colinear_5,
    Data2=ct_3,
    Data3=colinear_6,
    Data4=transform_5,
    Data5=transform_6,
    Data7=transform_23,
    Data8=transform_24)

# ----
# Matching non-chamfered geometry
geo_18 = Geometry(flip)
explode_5 = Explode(Curve=geo_18, Recursive=True)  # -> simplify(Segments), Vertices
repeat_7 = RepeatData(Data=graft([True, False]), Length=column_sides)  # -> flatten(Data)
tstat_10 = TreeStatistics(Tree=explode_5.Segments)  # -> Paths, Length, Count
dispatch_7 = Dispatch(List=tstat_10.Paths, DispatchPattern=repeat_7)  # -> ListA, ListB
split_11 = SplitTree(Data=explode_5.Segments, Masks=flatten(dispatch_7.ListA))  # -> Positive, Negative
shift_7 = ShiftList(List=split_11.Positive, Shift=2, Wrap=True)
trim_3 = TrimTree(Tree=shift_7, Depth=1)
merge_19 = Merge(Data1=trim_3, Data2=split_11.Negative)
item_28 = ListItem(List=merge_19, Index=[0, 2], Wrap=True)
item_29 = ListItem(List=weave, Index=[0, 3], Wrap=True)

# ----
# Matching non-chamfered geometry
geo_19 = Geometry(flip)
explode_6 = Explode(Curve=geo_19, Recursive=True)  # -> simplify(Segments), Vertices
repeat_8 = RepeatData(Data=graft([True, False]), Length=column_sides)  # -> flatten(Data)
tstat_11 = TreeStatistics(Tree=explode_6.Segments)  # -> Paths, Length, Count
dispatch_8 = Dispatch(List=tstat_11.Paths, DispatchPattern=repeat_8)  # -> ListA, ListB
split_12 = SplitTree(Data=explode_6.Segments, Masks=flatten(dispatch_8.ListA))  # -> Positive, Negative
shift_8 = ShiftList(List=split_12.Positive, Shift=2, Wrap=True)
trim_4 = TrimTree(Tree=shift_8, Depth=1)
merge_20 = Merge(Data1=trim_4, Data2=split_12.Negative)
item_30 = ListItem(List=merge_20, Index=[3, 1], Wrap=True)
item_31 = ListItem(List=weave, Index=[4, 1], Wrap=True)

merge_21 = Merge(Data1=merge_17, Data2=merge_16, Data3=merge_18, Data4=merge_15)
merge_22 = Merge(Data1=floor, Data2=anchor, Data3=length_line_2, Data4=angle_2, Data5=coplanar, Data6=merge_21)

subtraction_9 = Subtraction(A=column_height, B=2)
multiplication_3 = Multiplication(A=column_sides, B=subtraction_9)
repeat_9 = RepeatData(Data=graft([False, True]), Length=column_sides)  # -> flatten(Data)
repeat_10 = RepeatData(Data=repeat_9, Length=multiplication_3)
equals = Equality(FirstNumber=repeat_10, SecondNumber=1)  # -> Equality, Inequality
repeat_11 = RepeatData(Data=True, Length=column_sides)
weave_2 = Weave(Pattern=[0, 1], Stream0=repeat_10, Stream1=equals.Inequality, NullGaps=False)
repeat_12 = RepeatData(Data=False, Length=column_sides)
merge_23 = Merge(Data1=flatten(repeat_11), Data2=flatten(weave_2), Data3=flatten(repeat_12))

bouncysolver = BouncySolver(
    GoalObjects=merge_22,
    Reset=Button(),
    Threshold=1e-15,
    Tolerance=0.0001,
    Damping=Slider(0.0001, range=0..0.0001),
    Iterations=Slider(1, range=1..100),
    On=Toggle(False))  # -> I, V, O

# ----
# Filter outer edges and insert non-chamfered where applicable
series_2 = Series(Start=[0, -1], Step=[1, -1], Count=column_sides)  # -> flatten(Series)
tstat_12 = TreeStatistics(Tree=item_29)  # -> Paths, Length, Count
cull_i_2 = CullIndex(List=tstat_12.Paths, Indices=series_2, Wrap=True)
split_13 = SplitTree(Data=item_29, Masks=flatten(cull_i_2))  # -> Positive, Negative
split_14 = SplitTree(Data=item_28, Masks=flatten(cull_i_2))  # -> Positive, Negative
cull_i_3 = CullIndex(List=split_13.Negative, Indices=-1, Wrap=True)  # -> simplify(List)
cull_i_4 = CullIndex(List=split_14.Negative, Indices=-1, Wrap=True)  # -> simplify(List)
merge_24 = Merge(Data1=split_13.Positive, Data2=cull_i_3)
merge_25 = Merge(Data1=split_14.Positive, Data2=cull_i_4)
path_mapper = PathMapper(merge_24, source="{A;B}(i)", target="{B;i}")
path_mapper_2 = PathMapper(merge_25, source="{A;B}(i)", target="{B;i}")
smaller = SmallerThan(FirstNumber=column_height, SecondNumber=4)  # -> SmallerThan, OrEqualTo
filter = StreamFilter(Gate=smaller.SmallerThan, Stream0=[True, False], Stream1=True)
tstat_13 = TreeStatistics(Tree=path_mapper)  # -> Paths, Length, Count
dispatch_9 = Dispatch(List=tstat_13.Paths, DispatchPattern=filter)  # -> ListA, ListB
split_15 = SplitTree(Data=path_mapper, Masks=flatten(dispatch_9.ListA))  # -> Positive, Negative
split_16 = SplitTree(Data=path_mapper_2, Masks=flatten(dispatch_9.ListA))  # -> Positive, Negative

# ----
# Filter outer edges and insert non-chamfered where applicable
series_3 = Series(Start=[0, -1], Step=[1, -1], Count=column_sides)  # -> flatten(Series)
tstat_14 = TreeStatistics(Tree=item_31)  # -> Paths, Length, Count
cull_i_5 = CullIndex(List=tstat_14.Paths, Indices=series_3, Wrap=True)
split_17 = SplitTree(Data=item_31, Masks=flatten(cull_i_5))  # -> Positive, Negative
split_18 = SplitTree(Data=item_30, Masks=flatten(cull_i_5))  # -> Positive, Negative
cull_i_6 = CullIndex(List=split_17.Negative, Indices=-1, Wrap=True)  # -> simplify(List)
cull_i_7 = CullIndex(List=split_18.Negative, Indices=-1, Wrap=True)  # -> simplify(List)
merge_26 = Merge(Data1=split_17.Positive, Data2=cull_i_6)
merge_27 = Merge(Data1=split_18.Positive, Data2=cull_i_7)

geo_20 = Geometry(bouncysolver.O)

# ----
# Basic Deformations - FRAMED
full_filtered_point_set_2 = Data(Tree({0}: [{Count=1, Count=5, Path="{0}", Coordinate=Point(3413.624797, 0, 2723.357114), Coordinate=Point(3966.64791, 0, 2764.438669), Coordinate=Point(3979.98006, 0, 2720.831172), Coordinate=Point(3582.020045, 0, 2189.275621), Coordinate=Point(3157.271884, 0, 2256.275621)}], {1}: [{Count=1, Count=5, Path="{0}", Coordinate=Point(4510.340923, 0, 2403.501935), Coordinate=Point(4778.90377, 0, 2754.685956), Coordinate=Point(4789.565206, 0, 2722.822282), Coordinate=Point(4582.020045, 0, 2189.275621), Coordinate=Point(4232.320531, 0, 2174.775621)}], {2}: [{Count=1, Count=5, Path="{0}", Coordinate=Point(7432.427282, 0, 2650.629071), Coordinate=Point(8019.772897, 0, 2775.018647), Coordinate=Point(8050.016567, 0, 2693.9781), Coordinate=Point(7582.020045, 0, 2189.275621), Coordinate=Point(7158.07052, 0, 2219.138646)}], {3}: [{Count=1, Count=5, Path="{0}", Coordinate=Point(8448.113804, 0, 2627.263199), Coordinate=Point(8970.236205, 0, 2795.282404), Coordinate=Point(8979.333941, 0, 2770.28658), Coordinate=Point(8582.020045, 0, 2189.275621), Coordinate=Point(8159.200934, 0, 2232.275621)}], {4}: [{Count=1, Count=5, Path="{0}", Coordinate=Point(9446.95774, 0, 2660.293852), Coordinate=Point(9993.261391, 0, 2765.394973), Coordinate=Point(10017.46977, 0, 2686.21294), Coordinate=Point(9582.020045, 0, 2189.275621), Coordinate=Point(9138.063121, 0, 2262.775621)}], {5}: [{Count=1, Count=5, Path="{0}", Coordinate=Point(11469.13533, 0, 2558.504887), Coordinate=Point(11945.69303, 0, 2779.27), Coordinate=Point(11955.85076, 0, 2749.769821), Coordinate=Point(11582.02004, 0, 2189.275621), Coordinate=Point(11141.75904, 0, 2246.775621)}]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))
ungroup_2 = Ungroup(Group=full_filtered_point_set_2)  # -> simplify(Geometry)
pline_6 = PolyLine(Vertices=ungroup_2, Closed=True)
item_32 = ListItem(List=ungroup_2, Index=[0, 3], Wrap=True)
explode_7 = Explode(Curve=pline_6, Recursive=True)  # -> simplify(Segments), Vertices
pline_7 = PolyLine(Vertices=item_32, Closed=False)
shift_9 = ShiftList(List=explode_7.Segments, Shift=-1, Wrap=True)  # -> simplify(List)
len_4 = Length(Curve=pline_7)
geo_21 = Geometry(weave)
len_5 = Length(Curve=shift_9)
tstat_15 = TreeStatistics(Tree=geo_21)  # -> Paths, simplify(graft(Length)), Count
ins_2 = InsertItems(List=len_5, Item=len_4, Indices=-1, Wrap=True)  # -> simplify(List)
tstat_16 = TreeStatistics(Tree=ins_2)  # -> Paths, Length, Count
subtraction_10 = Subtraction(A=tstat_16.Count, B=tstat_15.Count)
reduce_2 = RandomReduce(List=tstat_16.Paths, Reduction=subtraction_10, Seed=Slider(14, range=0..100))
branch_3 = TreeBranch(Tree=ins_2, Path=reduce_2, MaintainPaths=True)
replace_9 = ReplacePaths(Data=branch_3, Search=reduce_2, Replace=tstat_15.Paths)

tstat_17 = TreeStatistics(Tree=graft(merge_27))  # -> Paths, Length, Count
dispatch_10 = Dispatch(List=tstat_17.Paths, DispatchPattern=merge_23)  # -> ListA, ListB
split_19 = SplitTree(Data=graft(merge_26), Masks=flatten(dispatch_10.ListA))  # -> Positive, Negative
split_20 = SplitTree(Data=graft(merge_27), Masks=flatten(dispatch_10.ListA))  # -> Positive, Negative
partition_5 = PartitionList(List=dispatch_10.ListA, Size=column_sides)
subtraction_11 = Subtraction(A=column_sides, B=1)
shift_10 = ShiftList(List=partition_5, Shift=subtraction_11, Wrap=True)  # -> flatten(List)
eval_6 = EvaluateCurve(Curve=reparameterize(split_20.Positive), Parameter=panel_3)  # -> Point, Tangent, Angle
replace_10 = ReplacePaths(Data=split_19.Negative, Search=dispatch_10.ListB, Replace=shift_10)
replace_11 = ReplacePaths(Data=split_20.Negative, Search=dispatch_10.ListB, Replace=shift_10)
end_14 = EndPoints(Curve=split_19.Positive)  # -> Start, End
crv_cp_5 = CurveClosestPoint(Point=eval_6.Point, Curve=replace_11)  # -> Point, Parameter, Distance
end_15 = EndPoints(Curve=replace_10)  # -> Start, End
merge_28 = Merge(Data1=end_14.Start, Data2=end_14.End, Data3=eval_6.Point)
merge_29 = Merge(Data1=end_15.Start, Data2=end_15.End, Data3=crv_cp_5.Point)
ln_5 = Line(StartPoint=eval_6.Point, EndPoint=crv_cp_5.Point)

# ----
# Generating Lines and Point Sets
merge_30 = Merge(Data1=split_15.Positive, Data2=split_16.Negative)
partition_6 = PartitionList(List=merge_30, Size=2)
partition_7 = PartitionList(List=path_mapper, Size=2)
item_33 = ListItem(List=partition_6, Index=0, Wrap=True)  # -> Item, Item1
item_34 = ListItem(List=partition_7, Index=0, Wrap=True)  # -> Item, Item1
eval_7 = EvaluateCurve(Curve=reparameterize(item_33.Item), Parameter=panel_3)  # -> Point, Tangent, Angle
end_16 = EndPoints(Curve=item_34.Item)  # -> Start, End
end_17 = EndPoints(Curve=item_34.Item1)  # -> Start, End
crv_cp_6 = CurveClosestPoint(Point=eval_7.Point, Curve=item_33.Item1)  # -> Point, Parameter, Distance
merge_31 = Merge(Data1=end_16.Start, Data2=end_16.End, Data3=eval_7.Point)
merge_32 = Merge(Data1=end_17.Start, Data2=end_17.End, Data3=crv_cp_6.Point)
ln_6 = Line(StartPoint=eval_7.Point, EndPoint=crv_cp_6.Point)

item_35 = ListItem(List=explode_7.Segments, Index=0, Wrap=True)  # -> Item, Item1
item_36 = ListItem(List=geo_21, Index=1, Wrap=True)
item_37 = ListItem(List=geo_21, Index=2, Wrap=True)
flip_5 = FlipCurve(Curve=item_35.Item)  # -> Curve, Flag
end_18 = EndPoints(Curve=item_35.Item1)  # -> Start, End
angle_3 = Angle(VectorA=item_35.Item, VectorB=item_35.Item1)  # -> Angle, Reflex
xz_2 = XZPlane(Origin=end_18.Start)
subtraction_12 = Subtraction(A=angle_3.Reflex, B=3.141592654)
rotate_2 = Rotate(Geometry=item_35.Item1, Angle=expr("-x", subtraction_12), Plane=xz_2)  # -> Geometry, Transform
branch_4 = TreeBranch(Tree=subtraction_12, Path=reduce_2, MaintainPaths=True)
replace_12 = ReplacePaths(Data=branch_4, Search=reduce_2, Replace=tstat_15.Paths)

item_38 = ListItem(List=flatten(geo_21), Index=3, Wrap=True)
cull_i_8 = CullIndex(List=weave, Indices=-1, Wrap=True)
entwine = Entwine(Branch0X=merge_31, Branch1X=merge_32, Branch2X=merge_28, Branch3X=merge_29, FlattenInputs=False)
end_19 = EndPoints(Curve=item_38)  # -> Start, End
end_20 = EndPoints(Curve=cull_i_8)  # -> Start, End
item_39 = ListItem(List=entwine, Index=2, Wrap=True)
item_40 = ListItem(List=entwine, Index=3, Wrap=True)
entwine_2 = Entwine(Branch0X=ln_6, Branch1X=ln_5, FlattenInputs=False)
pt_12 = Point(end_19.Start)
pt_13 = Point(end_20.End)
vec2pt_14 = Vector2Pt(PointA=item_39, PointB=item_40, Unitize=False)  # -> Vector, Length
angle_4 = Angle(LineA=item_36, LineB=item_37, RestAngle=replace_12, Strength=1)  # -> flatten(Angle)
anchor_2 = Anchor(Point=pt_12, Strength=10000)  # -> flatten(A)
length_line_3 = LengthLine(Line=geo_21, Length=replace_9, Strength=Slider(10, range=1..20))  # -> flatten(Spring)
coplanar_3 = CoPlanar(Points=pt_13, Strength=1)  # -> flatten(Coplanar)
colinear_9 = CoLinear(Points=entwine, Strength=Slider(1, range=1..5))  # -> flatten(CoLinear)
length_line_4 = LengthLine(Line=entwine_2, Strength=Slider(20, range=1..20))  # -> flatten(Spring)
transform_25 = Transform(vec2pt_14.Vector)
transform_26 = Transform(P0=item_39, P1=item_40, T=transform_25, Strength=1)  # -> flatten(Transform)
merge_33 = Merge(
    Data1=length_line_3,
    Data2=angle_4,
    Data3=anchor_2,
    Data4=coplanar_3,
    Data5=colinear_9,
    Data6=transform_26,
    Data7=length_line_4)
bouncysolver_2 = BouncySolver(
    GoalObjects=merge_33,
    Reset=Button(),
    Threshold=1e-15,
    Tolerance=0.0001,
    Damping=Slider(0.0001, range=0..0.0001),
    Iterations=Slider(21, range=1..100),
    On=Toggle(False))  # -> I, V, O
geo_22 = Geometry(bouncysolver_2.O)
