# Grasshopper definition Agreeability Tests [Jul-03 '26, 1011].gh (Grasshopper 1.0.8)

# ----
# Base Shape Parameters
intermittend_offset = Slider(30, range=0..100)
column_height = Slider(4, range=2..10)
column_sides = Slider(3, range=0..10)

# ----
# Internal Parameters
number_slider = Slider(-2, range=-4..4)
basic_ht = Slider(60, range=0..100)
number_slider_2 = Slider(600, range=0..1000)

panel = Panel("""0.4
0.6""")

# ----
# Base Shape
X = UnitX(Factor=Slider(600, range=0..1000))
pt = Point(Point(-3713.054933, 3860.083293, 0))
move = Move(Geometry=pt, Motion=X)  # -> Geometry, Transform
xy = XYPlane(Origin=Point(0, 0, 0))
poledge = PolygonEdge(EdgeStart=pt, EdgeEnd=move.Geometry, PlanePoint=xy, Segments=column_sides)  # -> Polygon, Centre, CornerRadius, EdgeRadius
explode = Explode(Curve=poledge.Polygon, Recursive=True)  # -> Segments, Vertices
end = EndPoints(Curve=explode.Segments)  # -> Start, End
Z = UnitZ(Factor=number_slider_2)
move_2 = Move(Geometry=end.End, Motion=Z)  # -> Geometry, Transform
merge = Merge(Data1=graft(end.Start), Data2=graft(move_2.Geometry))  # -> simplify(Result)
Z_2 = UnitZ(Factor=number_slider_2)
midpt = CurveMiddle(Curve=explode.Segments)
move_3 = Move(Geometry=merge, Motion=Z_2)  # -> reverse(Geometry), Transform
vec2pt = Vector2Pt(PointA=poledge.Centre, PointB=midpt, Unitize=False)  # -> Vector, Length
merge_2 = Merge(Data1=merge, Data2=move_3.Geometry)
amp = Amplitude(Vector=vec2pt.Vector, Amplitude=intermittend_offset)  # -> graft(Vector)
addition = Addition(A=intermittend_offset, B=number_slider_2)
pline = PolyLine(Vertices=merge_2, Closed=True)
move_4 = Move(Geometry=pline, Motion=amp)  # -> Geometry, Transform
Z_3 = UnitZ(Factor=addition)
arrlinear = LinearArray(Geometry=move_4.Geometry, Direction=Z_3, Count=column_height)  # -> simplify(Geometry), Transform

# ----
# Shape Detailing
flip = FlipMatrix(Data=arrlinear.Geometry)
tstat = TreeStatistics(Tree=flip)  # -> Paths, Length, Count
dispatch = Dispatch(List=tstat.Paths, DispatchPattern=[True, False])  # -> ListA, ListB
split = SplitTree(Data=flip, Masks=flatten(dispatch.ListB))  # -> Positive, Negative
explode_2 = Explode(Curve=split.Positive, Recursive=True)  # -> Segments, Vertices
explode_3 = Explode(Curve=split.Negative, Recursive=True)  # -> Segments, Vertices
shift = ShiftList(List=explode_3.Segments, Shift=number_slider, Wrap=True)
trim = TrimTree(Tree=shift, Depth=1)
merge_3 = Merge(Data1=explode_2.Segments, Data2=trim)
item = ListItem(List=merge_3, Index=1, Wrap=True)  # -> Item, Item1
flip_2 = FlipCurve(Curve=item.Item)  # -> Curve, Flag
merge_4 = Merge(Data1=flip_2.Curve, Data2=item.Item1)
eval = EvaluateLength(Curve=merge_4, Length=basic_ht, Normalized=False)  # -> Point, Tangent, Parameter
shatter = Shatter(Curve=merge_4, Parameters=eval.Parameter)
pline_2 = PolyLine(Vertices=eval.Point, Closed=False)
item_2 = ListItem(List=shatter, Index=1, Wrap=True)
# Potentially, the connections can be improved further by constraining at least one point on each side to an end point of the given line, ensuring the connection remains roughly in the same spot.
end_2 = EndPoints(Curve=merge_4)  # -> Start, End
trim_2 = TrimTree(Tree=item_2, Depth=1)
item_3 = ListItem(List=trim_2, Index=0, Wrap=True)  # -> Item, Item1
item_4 = ListItem(List=merge_3, Index=3, Wrap=True)  # -> Item, Item1
pline_3 = PolyLine(Vertices=end_2.End, Closed=False)
flip_3 = FlipCurve(Curve=item_3.Item)  # -> Curve, Flag
weave = Weave(
    Pattern=[0, 1, 2, 3, 4, 5],
    Stream0=item_4.Item1,
    Stream1=flip_3.Curve,
    Stream2=pline_2,
    Stream3=item_3.Item1,
    Stream4=item_4.Item,
    Stream5=pline_3,
    NullGaps=False)

# ----
# Matching non-chamfered geometry
geo = Geometry(flip)
explode_4 = Explode(Curve=geo, Recursive=True)  # -> simplify(Segments), Vertices
repeat = RepeatData(Data=graft([True, False]), Length=column_sides)  # -> flatten(Data)
tstat_2 = TreeStatistics(Tree=explode_4.Segments)  # -> Paths, Length, Count
dispatch_2 = Dispatch(List=tstat_2.Paths, DispatchPattern=repeat)  # -> ListA, ListB
split_2 = SplitTree(Data=explode_4.Segments, Masks=flatten(dispatch_2.ListA))  # -> Positive, Negative
shift_2 = ShiftList(List=split_2.Positive, Shift=2, Wrap=True)
trim_3 = TrimTree(Tree=shift_2, Depth=1)
merge_5 = Merge(Data1=trim_3, Data2=split_2.Negative)
item_5 = ListItem(List=merge_5, Index=[0, 2], Wrap=True)
item_6 = ListItem(List=weave, Index=[0, 3], Wrap=True)

# ----
# Matching non-chamfered geometry
geo_2 = Geometry(flip)
explode_5 = Explode(Curve=geo_2, Recursive=True)  # -> simplify(Segments), Vertices
repeat_2 = RepeatData(Data=graft([True, False]), Length=column_sides)  # -> flatten(Data)
tstat_3 = TreeStatistics(Tree=explode_5.Segments)  # -> Paths, Length, Count
dispatch_3 = Dispatch(List=tstat_3.Paths, DispatchPattern=repeat_2)  # -> ListA, ListB
split_3 = SplitTree(Data=explode_5.Segments, Masks=flatten(dispatch_3.ListA))  # -> Positive, Negative
shift_3 = ShiftList(List=split_3.Positive, Shift=2, Wrap=True)
trim_4 = TrimTree(Tree=shift_3, Depth=1)
merge_6 = Merge(Data1=trim_4, Data2=split_3.Negative)
item_7 = ListItem(List=merge_6, Index=[3, 1], Wrap=True)
item_8 = ListItem(List=weave, Index=[4, 1], Wrap=True)

panel_2 = Panel("""0.4
0.6""")

subtraction = Subtraction(A=column_height, B=2)
multiplication = Multiplication(A=column_sides, B=subtraction)
repeat_3 = RepeatData(Data=graft([False, True]), Length=column_sides)  # -> flatten(Data)
repeat_4 = RepeatData(Data=repeat_3, Length=multiplication)
equals = Equality(FirstNumber=repeat_4, SecondNumber=1)  # -> Equality, Inequality
repeat_5 = RepeatData(Data=True, Length=column_sides)
weave_2 = Weave(Pattern=[0, 1], Stream0=repeat_4, Stream1=equals.Inequality, NullGaps=False)
repeat_6 = RepeatData(Data=False, Length=column_sides)
merge_7 = Merge(Data1=flatten(repeat_5), Data2=flatten(weave_2), Data3=flatten(repeat_6))

# ----
# Filter outer edges and insert non-chamfered where applicable
series = Series(Start=[0, -1], Step=[1, -1], Count=column_sides)  # -> flatten(Series)
tstat_4 = TreeStatistics(Tree=item_6)  # -> Paths, Length, Count
cull_i = CullIndex(List=tstat_4.Paths, Indices=series, Wrap=True)
split_4 = SplitTree(Data=item_6, Masks=flatten(cull_i))  # -> Positive, Negative
split_5 = SplitTree(Data=item_5, Masks=flatten(cull_i))  # -> Positive, Negative
cull_i_2 = CullIndex(List=split_4.Negative, Indices=-1, Wrap=True)  # -> simplify(List)
cull_i_3 = CullIndex(List=split_5.Negative, Indices=-1, Wrap=True)  # -> simplify(List)
merge_8 = Merge(Data1=split_4.Positive, Data2=cull_i_2)
merge_9 = Merge(Data1=split_5.Positive, Data2=cull_i_3)
path_mapper = PathMapper(merge_8, source="{A;B}(i)", target="{B;i}")
path_mapper_2 = PathMapper(merge_9, source="{A;B}(i)", target="{B;i}")
smaller = SmallerThan(FirstNumber=column_height, SecondNumber=4)  # -> SmallerThan, OrEqualTo
filter = StreamFilter(Gate=smaller.SmallerThan, Stream0=[True, False], Stream1=True)
tstat_5 = TreeStatistics(Tree=path_mapper)  # -> Paths, Length, Count
dispatch_4 = Dispatch(List=tstat_5.Paths, DispatchPattern=filter)  # -> ListA, ListB
split_6 = SplitTree(Data=path_mapper, Masks=flatten(dispatch_4.ListA))  # -> Positive, Negative
split_7 = SplitTree(Data=path_mapper_2, Masks=flatten(dispatch_4.ListA))  # -> Positive, Negative

# ----
# Filter outer edges and insert non-chamfered where applicable
series_2 = Series(Start=[0, -1], Step=[1, -1], Count=column_sides)  # -> flatten(Series)
tstat_6 = TreeStatistics(Tree=item_8)  # -> Paths, Length, Count
cull_i_4 = CullIndex(List=tstat_6.Paths, Indices=series_2, Wrap=True)
split_8 = SplitTree(Data=item_8, Masks=flatten(cull_i_4))  # -> Positive, Negative
split_9 = SplitTree(Data=item_7, Masks=flatten(cull_i_4))  # -> Positive, Negative
cull_i_5 = CullIndex(List=split_8.Negative, Indices=-1, Wrap=True)  # -> simplify(List)
cull_i_6 = CullIndex(List=split_9.Negative, Indices=-1, Wrap=True)  # -> simplify(List)
merge_10 = Merge(Data1=split_8.Positive, Data2=cull_i_5)
merge_11 = Merge(Data1=split_9.Positive, Data2=cull_i_6)

# ----
# Basic Deformations - FRAMED
full_filtered_point_set = Data(Tree({0}: [{Count=1, Count=5, Path="{0}", Coordinate=Point(3413.624797, 0, 2723.357114), Coordinate=Point(3966.64791, 0, 2764.438669), Coordinate=Point(3979.98006, 0, 2720.831172), Coordinate=Point(3582.020045, 0, 2189.275621), Coordinate=Point(3157.271884, 0, 2256.275621)}], {1}: [{Count=1, Count=5, Path="{0}", Coordinate=Point(4510.340923, 0, 2403.501935), Coordinate=Point(4778.90377, 0, 2754.685956), Coordinate=Point(4789.565206, 0, 2722.822282), Coordinate=Point(4582.020045, 0, 2189.275621), Coordinate=Point(4232.320531, 0, 2174.775621)}], {2}: [{Count=1, Count=5, Path="{0}", Coordinate=Point(7432.427282, 0, 2650.629071), Coordinate=Point(8019.772897, 0, 2775.018647), Coordinate=Point(8050.016567, 0, 2693.9781), Coordinate=Point(7582.020045, 0, 2189.275621), Coordinate=Point(7158.07052, 0, 2219.138646)}], {3}: [{Count=1, Count=5, Path="{0}", Coordinate=Point(8448.113804, 0, 2627.263199), Coordinate=Point(8970.236205, 0, 2795.282404), Coordinate=Point(8979.333941, 0, 2770.28658), Coordinate=Point(8582.020045, 0, 2189.275621), Coordinate=Point(8159.200934, 0, 2232.275621)}], {4}: [{Count=1, Count=5, Path="{0}", Coordinate=Point(9446.95774, 0, 2660.293852), Coordinate=Point(9993.261391, 0, 2765.394973), Coordinate=Point(10017.46977, 0, 2686.21294), Coordinate=Point(9582.020045, 0, 2189.275621), Coordinate=Point(9138.063121, 0, 2262.775621)}], {5}: [{Count=1, Count=5, Path="{0}", Coordinate=Point(11469.13533, 0, 2558.504887), Coordinate=Point(11945.69303, 0, 2779.27), Coordinate=Point(11955.85076, 0, 2749.769821), Coordinate=Point(11582.02004, 0, 2189.275621), Coordinate=Point(11141.75904, 0, 2246.775621)}]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))
ungroup = Ungroup(Group=full_filtered_point_set)  # -> simplify(Geometry)
pline_4 = PolyLine(Vertices=ungroup, Closed=True)
item_9 = ListItem(List=ungroup, Index=[0, 3], Wrap=True)
explode_6 = Explode(Curve=pline_4, Recursive=True)  # -> simplify(Segments), Vertices
pline_5 = PolyLine(Vertices=item_9, Closed=False)
shift_4 = ShiftList(List=explode_6.Segments, Shift=-1, Wrap=True)  # -> simplify(List)
len = Length(Curve=pline_5)
geo_3 = Geometry(weave)
len_2 = Length(Curve=shift_4)
tstat_7 = TreeStatistics(Tree=geo_3)  # -> Paths, simplify(graft(Length)), Count
ins = InsertItems(List=len_2, Item=len, Indices=-1, Wrap=True)  # -> simplify(List)
tstat_8 = TreeStatistics(Tree=ins)  # -> Paths, Length, Count
subtraction_2 = Subtraction(A=tstat_8.Count, B=tstat_7.Count)
reduce = RandomReduce(List=tstat_8.Paths, Reduction=subtraction_2, Seed=Slider(14, range=0..100))
branch = TreeBranch(Tree=ins, Path=reduce, MaintainPaths=True)
replace = ReplacePaths(Data=branch, Search=reduce, Replace=tstat_7.Paths)

tstat_9 = TreeStatistics(Tree=graft(merge_11))  # -> Paths, Length, Count
dispatch_5 = Dispatch(List=tstat_9.Paths, DispatchPattern=merge_7)  # -> ListA, ListB
split_10 = SplitTree(Data=graft(merge_10), Masks=flatten(dispatch_5.ListA))  # -> Positive, Negative
split_11 = SplitTree(Data=graft(merge_11), Masks=flatten(dispatch_5.ListA))  # -> Positive, Negative
partition = PartitionList(List=dispatch_5.ListA, Size=column_sides)
subtraction_3 = Subtraction(A=column_sides, B=1)
shift_5 = ShiftList(List=partition, Shift=subtraction_3, Wrap=True)  # -> flatten(List)
eval_2 = EvaluateCurve(Curve=reparameterize(split_11.Positive), Parameter=panel_2)  # -> Point, Tangent, Angle
replace_2 = ReplacePaths(Data=split_10.Negative, Search=dispatch_5.ListB, Replace=shift_5)
replace_3 = ReplacePaths(Data=split_11.Negative, Search=dispatch_5.ListB, Replace=shift_5)
end_3 = EndPoints(Curve=split_10.Positive)  # -> Start, End
crv_cp = CurveClosestPoint(Point=eval_2.Point, Curve=replace_3)  # -> Point, Parameter, Distance
end_4 = EndPoints(Curve=replace_2)  # -> Start, End
merge_12 = Merge(Data1=end_3.Start, Data2=end_3.End, Data3=eval_2.Point)
merge_13 = Merge(Data1=end_4.Start, Data2=end_4.End, Data3=crv_cp.Point)
ln = Line(StartPoint=eval_2.Point, EndPoint=crv_cp.Point)

# ----
# Generating Lines and Point Sets
merge_14 = Merge(Data1=split_6.Positive, Data2=split_7.Negative)
partition_2 = PartitionList(List=merge_14, Size=2)
partition_3 = PartitionList(List=path_mapper, Size=2)
item_10 = ListItem(List=partition_2, Index=0, Wrap=True)  # -> Item, Item1
item_11 = ListItem(List=partition_3, Index=0, Wrap=True)  # -> Item, Item1
eval_3 = EvaluateCurve(Curve=reparameterize(item_10.Item), Parameter=panel_2)  # -> Point, Tangent, Angle
end_5 = EndPoints(Curve=item_11.Item)  # -> Start, End
end_6 = EndPoints(Curve=item_11.Item1)  # -> Start, End
crv_cp_2 = CurveClosestPoint(Point=eval_3.Point, Curve=item_10.Item1)  # -> Point, Parameter, Distance
merge_15 = Merge(Data1=end_5.Start, Data2=end_5.End, Data3=eval_3.Point)
merge_16 = Merge(Data1=end_6.Start, Data2=end_6.End, Data3=crv_cp_2.Point)
ln_2 = Line(StartPoint=eval_3.Point, EndPoint=crv_cp_2.Point)

item_12 = ListItem(List=explode_6.Segments, Index=0, Wrap=True)  # -> Item, Item1
item_13 = ListItem(List=geo_3, Index=1, Wrap=True)
item_14 = ListItem(List=geo_3, Index=2, Wrap=True)
flip_4 = FlipCurve(Curve=item_12.Item)  # -> Curve, Flag
end_7 = EndPoints(Curve=item_12.Item1)  # -> Start, End
angle = Angle(VectorA=item_12.Item, VectorB=item_12.Item1)  # -> Angle, Reflex
xz = XZPlane(Origin=end_7.Start)
subtraction_4 = Subtraction(A=angle.Reflex, B=3.141592654)
rotate = Rotate(Geometry=item_12.Item1, Angle=expr("-x", subtraction_4), Plane=xz)  # -> Geometry, Transform
branch_2 = TreeBranch(Tree=subtraction_4, Path=reduce, MaintainPaths=True)
replace_4 = ReplacePaths(Data=branch_2, Search=reduce, Replace=tstat_7.Paths)

item_15 = ListItem(List=flatten(geo_3), Index=3, Wrap=True)
cull_i_7 = CullIndex(List=weave, Indices=-1, Wrap=True)
entwine = Entwine(Branch0X=merge_15, Branch1X=merge_16, Branch2X=merge_12, Branch3X=merge_13, FlattenInputs=False)
end_8 = EndPoints(Curve=item_15)  # -> Start, End
end_9 = EndPoints(Curve=cull_i_7)  # -> Start, End
item_16 = ListItem(List=entwine, Index=2, Wrap=True)
item_17 = ListItem(List=entwine, Index=3, Wrap=True)
entwine_2 = Entwine(Branch0X=ln_2, Branch1X=ln, FlattenInputs=False)
pt_2 = Point(end_8.Start)
pt_3 = Point(end_9.End)
vec2pt_2 = Vector2Pt(PointA=item_16, PointB=item_17, Unitize=False)  # -> Vector, Length
angle_2 = Angle(LineA=item_13, LineB=item_14, RestAngle=replace_4, Strength=Slider(10, range=1..20))  # -> flatten(Angle)
anchor = Anchor(Point=pt_2, Strength=10000)  # -> flatten(A)
length_line = LengthLine(Line=geo_3, Length=replace, Strength=Slider(10, range=1..20))  # -> flatten(Spring)
coplanar = CoPlanar(Points=pt_3, Strength=1)  # -> flatten(Coplanar)
length_line_2 = LengthLine(Line=entwine_2, Strength=Slider(20, range=1..20))  # -> flatten(Spring)
transform = Transform(vec2pt_2.Vector)
colinear = CoLinear(Points=entwine, Strength=Slider(1, range=1..5))  # -> flatten(CoLinear)
transform_2 = Transform(P0=item_16, P1=item_17, T=transform, Strength=1)  # -> flatten(Transform)
merge_17 = Merge(Data1=length_line, Data2=angle_2, Data3=anchor, Data4=coplanar, Data5=colinear, Data6=transform_2, Data7=length_line_2)
bouncysolver = BouncySolver(
    GoalObjects=merge_17,
    Reset=Button(),
    Threshold=1e-15,
    Tolerance=0.0001,
    Damping=Slider(0.0001, range=0..0.0001),
    Iterations=Slider(21, range=1..100),
    On=Toggle(False))  # -> I, V, O
geo_4 = Geometry(bouncysolver.O)
item_18 = ListItem(List=geo_4, Index=Slider(183, range=0..204), Wrap=True)
