# Grasshopper definition Agreeability Tests.gh (Grasshopper 1.0.8)
# plug-ins: Pufferfish

# ----
# Base Shape Parameters
intermittend_offset = Slider(30, range=0..100)
column_height = Slider(4, range=2..10)
column_sides = Slider(6, range=0..10)

# ----
# Internal Parameters
number_slider = Slider(-2, range=-4..4)
basic_ht = Slider(60, range=0..100)
number_slider_2 = Slider(600, range=0..1000)

panel = Panel("""0.4
0.6""")

# ----
# Base Shape
X = UnitX(Factor=Slider(600, range=0..1000))
pt = Point(Point(-3713.054933, 3860.083293, 0))
move = Move(Geometry=pt, Motion=X)  # -> Geometry, Transform
xy = XYPlane(Origin=Point(0, 0, 0))
poledge = PolygonEdge(EdgeStart=pt, EdgeEnd=move.Geometry, PlanePoint=xy, Segments=column_sides)  # -> Polygon, Centre, CornerRadius, EdgeRadius
explode = Explode(Curve=poledge.Polygon, Recursive=True)  # -> Segments, Vertices
end = EndPoints(Curve=explode.Segments)  # -> Start, End
Z = UnitZ(Factor=number_slider_2)
move_2 = Move(Geometry=end.End, Motion=Z)  # -> Geometry, Transform
merge = Merge(Data1=graft(end.Start), Data2=graft(move_2.Geometry))  # -> simplify(Result)
Z_2 = UnitZ(Factor=number_slider_2)
midpt = CurveMiddle(Curve=explode.Segments)
move_3 = Move(Geometry=merge, Motion=Z_2)  # -> reverse(Geometry), Transform
vec2pt = Vector2Pt(PointA=poledge.Centre, PointB=midpt, Unitize=False)  # -> Vector, Length
merge_2 = Merge(Data1=merge, Data2=move_3.Geometry)
amp = Amplitude(Vector=vec2pt.Vector, Amplitude=intermittend_offset)  # -> graft(Vector)
addition = Addition(A=intermittend_offset, B=number_slider_2)
pline = PolyLine(Vertices=merge_2, Closed=True)
move_4 = Move(Geometry=pline, Motion=amp)  # -> Geometry, Transform
Z_3 = UnitZ(Factor=addition)
arrlinear = LinearArray(Geometry=move_4.Geometry, Direction=Z_3, Count=column_height)  # -> simplify(Geometry), Transform

# ----
# Shape Detailing
flip = FlipMatrix(Data=arrlinear.Geometry)
tstat = TreeStatistics(Tree=flip)  # -> Paths, Length, Count
dispatch = Dispatch(List=tstat.Paths, DispatchPattern=[True, False])  # -> ListA, ListB
split = SplitTree(Data=flip, Masks=flatten(dispatch.ListB))  # -> Positive, Negative
explode_2 = Explode(Curve=split.Positive, Recursive=True)  # -> Segments, Vertices
explode_3 = Explode(Curve=split.Negative, Recursive=True)  # -> Segments, Vertices
shift = ShiftList(List=explode_3.Segments, Shift=number_slider, Wrap=True)
trim = TrimTree(Tree=shift, Depth=1)
merge_3 = Merge(Data1=explode_2.Segments, Data2=trim)
item = ListItem(List=merge_3, Index=1, Wrap=True)  # -> Item, Item1
flip_2 = FlipCurve(Curve=item.Item)  # -> Curve, Flag
merge_4 = Merge(Data1=flip_2.Curve, Data2=item.Item1)
eval = EvaluateLength(Curve=merge_4, Length=basic_ht, Normalized=False)  # -> Point, Tangent, Parameter
shatter = Shatter(Curve=merge_4, Parameters=eval.Parameter)
pline_2 = PolyLine(Vertices=eval.Point, Closed=False)
item_2 = ListItem(List=shatter, Index=1, Wrap=True)
# Potentially, the connections can be improved further by constraining at least one point on each side to an end point of the given line, ensuring the connection remains roughly in the same spot.
end_2 = EndPoints(Curve=merge_4)  # -> Start, End
trim_2 = TrimTree(Tree=item_2, Depth=1)
item_3 = ListItem(List=trim_2, Index=0, Wrap=True)  # -> Item, Item1
item_4 = ListItem(List=merge_3, Index=3, Wrap=True)  # -> Item, Item1
pline_3 = PolyLine(Vertices=end_2.End, Closed=False)
flip_3 = FlipCurve(Curve=item_3.Item)  # -> Curve, Flag
weave = Weave(
    Pattern=[0, 1, 2, 3, 4, 5],
    Stream0=item_4.Item1,
    Stream1=flip_3.Curve,
    Stream2=pline_2,
    Stream3=item_3.Item1,
    Stream4=item_4.Item,
    Stream5=pline_3,
    NullGaps=False)

# ----
# Matching non-chamfered geometry
geo = Geometry(flip)
explode_4 = Explode(Curve=geo, Recursive=True)  # -> simplify(Segments), Vertices
repeat = RepeatData(Data=graft([True, False]), Length=column_sides)  # -> flatten(Data)
tstat_2 = TreeStatistics(Tree=explode_4.Segments)  # -> Paths, Length, Count
dispatch_2 = Dispatch(List=tstat_2.Paths, DispatchPattern=repeat)  # -> ListA, ListB
split_2 = SplitTree(Data=explode_4.Segments, Masks=flatten(dispatch_2.ListA))  # -> Positive, Negative
shift_2 = ShiftList(List=split_2.Positive, Shift=2, Wrap=True)
trim_3 = TrimTree(Tree=shift_2, Depth=1)
merge_5 = Merge(Data1=trim_3, Data2=split_2.Negative)
item_5 = ListItem(List=merge_5, Index=[0, 2], Wrap=True)
item_6 = ListItem(List=weave, Index=[0, 3], Wrap=True)

# ----
# Matching non-chamfered geometry
geo_2 = Geometry(flip)
explode_5 = Explode(Curve=geo_2, Recursive=True)  # -> simplify(Segments), Vertices
repeat_2 = RepeatData(Data=graft([True, False]), Length=column_sides)  # -> flatten(Data)
tstat_3 = TreeStatistics(Tree=explode_5.Segments)  # -> Paths, Length, Count
dispatch_3 = Dispatch(List=tstat_3.Paths, DispatchPattern=repeat_2)  # -> ListA, ListB
split_3 = SplitTree(Data=explode_5.Segments, Masks=flatten(dispatch_3.ListA))  # -> Positive, Negative
shift_3 = ShiftList(List=split_3.Positive, Shift=2, Wrap=True)
trim_4 = TrimTree(Tree=shift_3, Depth=1)
merge_6 = Merge(Data1=trim_4, Data2=split_3.Negative)
item_7 = ListItem(List=merge_6, Index=[3, 1], Wrap=True)
item_8 = ListItem(List=weave, Index=[4, 1], Wrap=True)

panel_2 = Panel("""0.4
0.6""")

subtraction = Subtraction(A=column_height, B=2)
multiplication = Multiplication(A=column_sides, B=subtraction)
repeat_3 = RepeatData(Data=graft([False, True]), Length=column_sides)  # -> flatten(Data)
repeat_4 = RepeatData(Data=repeat_3, Length=multiplication)
equals = Equality(FirstNumber=repeat_4, SecondNumber=1)  # -> Equality, Inequality
repeat_5 = RepeatData(Data=True, Length=column_sides)
weave_2 = Weave(Pattern=[0, 1], Stream0=repeat_4, Stream1=equals.Inequality, NullGaps=False)
repeat_6 = RepeatData(Data=False, Length=column_sides)
merge_7 = Merge(Data1=flatten(repeat_5), Data2=flatten(weave_2), Data3=flatten(repeat_6))

# ----
# Filter outer edges and insert non-chamfered where applicable
series = Series(Start=[0, -1], Step=[1, -1], Count=column_sides)  # -> flatten(Series)
tstat_4 = TreeStatistics(Tree=item_6)  # -> Paths, Length, Count
cull_i = CullIndex(List=tstat_4.Paths, Indices=series, Wrap=True)
split_4 = SplitTree(Data=item_6, Masks=flatten(cull_i))  # -> Positive, Negative
split_5 = SplitTree(Data=item_5, Masks=flatten(cull_i))  # -> Positive, Negative
cull_i_2 = CullIndex(List=split_4.Negative, Indices=-1, Wrap=True)  # -> simplify(List)
cull_i_3 = CullIndex(List=split_5.Negative, Indices=-1, Wrap=True)  # -> simplify(List)
merge_8 = Merge(Data1=split_4.Positive, Data2=cull_i_2)
merge_9 = Merge(Data1=split_5.Positive, Data2=cull_i_3)
path_mapper = PathMapper(merge_8, source="{A;B}(i)", target="{B;i}")
path_mapper_2 = PathMapper(merge_9, source="{A;B}(i)", target="{B;i}")
smaller = SmallerThan(FirstNumber=column_height, SecondNumber=4)  # -> SmallerThan, OrEqualTo
filter = StreamFilter(Gate=smaller.SmallerThan, Stream0=[True, False], Stream1=True)
tstat_5 = TreeStatistics(Tree=path_mapper)  # -> Paths, Length, Count
dispatch_4 = Dispatch(List=tstat_5.Paths, DispatchPattern=filter)  # -> ListA, ListB
split_6 = SplitTree(Data=path_mapper, Masks=flatten(dispatch_4.ListA))  # -> Positive, Negative
split_7 = SplitTree(Data=path_mapper_2, Masks=flatten(dispatch_4.ListA))  # -> Positive, Negative

# ----
# Filter outer edges and insert non-chamfered where applicable
series_2 = Series(Start=[0, -1], Step=[1, -1], Count=column_sides)  # -> flatten(Series)
tstat_6 = TreeStatistics(Tree=item_8)  # -> Paths, Length, Count
cull_i_4 = CullIndex(List=tstat_6.Paths, Indices=series_2, Wrap=True)
split_8 = SplitTree(Data=item_8, Masks=flatten(cull_i_4))  # -> Positive, Negative
split_9 = SplitTree(Data=item_7, Masks=flatten(cull_i_4))  # -> Positive, Negative
cull_i_5 = CullIndex(List=split_8.Negative, Indices=-1, Wrap=True)  # -> simplify(List)
cull_i_6 = CullIndex(List=split_9.Negative, Indices=-1, Wrap=True)  # -> simplify(List)
merge_10 = Merge(Data1=split_8.Positive, Data2=cull_i_5)
merge_11 = Merge(Data1=split_9.Positive, Data2=cull_i_6)

# ----
# Basic Deformations - FRAMED
full_filtered_point_set = Data(Tree({0}: [{Count=1, Count=5, Path="{0}", Coordinate=Point(3413.624797, 0, 2723.357114), Coordinate=Point(3966.64791, 0, 2764.438669), Coordinate=Point(3979.98006, 0, 2720.831172), Coordinate=Point(3582.020045, 0, 2189.275621), Coordinate=Point(3157.271884, 0, 2256.275621)}], {1}: [{Count=1, Count=5, Path="{0}", Coordinate=Point(4510.340923, 0, 2403.501935), Coordinate=Point(4778.90377, 0, 2754.685956), Coordinate=Point(4789.565206, 0, 2722.822282), Coordinate=Point(4582.020045, 0, 2189.275621), Coordinate=Point(4232.320531, 0, 2174.775621)}], {2}: [{Count=1, Count=5, Path="{0}", Coordinate=Point(7432.427282, 0, 2650.629071), Coordinate=Point(8019.772897, 0, 2775.018647), Coordinate=Point(8050.016567, 0, 2693.9781), Coordinate=Point(7582.020045, 0, 2189.275621), Coordinate=Point(7158.07052, 0, 2219.138646)}], {3}: [{Count=1, Count=5, Path="{0}", Coordinate=Point(8448.113804, 0, 2627.263199), Coordinate=Point(8970.236205, 0, 2795.282404), Coordinate=Point(8979.333941, 0, 2770.28658), Coordinate=Point(8582.020045, 0, 2189.275621), Coordinate=Point(8159.200934, 0, 2232.275621)}], {4}: [{Count=1, Count=5, Path="{0}", Coordinate=Point(9446.95774, 0, 2660.293852), Coordinate=Point(9993.261391, 0, 2765.394973), Coordinate=Point(10017.46977, 0, 2686.21294), Coordinate=Point(9582.020045, 0, 2189.275621), Coordinate=Point(9138.063121, 0, 2262.775621)}], {5}: [{Count=1, Count=5, Path="{0}", Coordinate=Point(11469.13533, 0, 2558.504887), Coordinate=Point(11945.69303, 0, 2779.27), Coordinate=Point(11955.85076, 0, 2749.769821), Coordinate=Point(11582.02004, 0, 2189.275621), Coordinate=Point(11141.75904, 0, 2246.775621)}]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))
ungroup = Ungroup(Group=full_filtered_point_set)  # -> simplify(Geometry)
pline_4 = PolyLine(Vertices=ungroup, Closed=True)
item_9 = ListItem(List=ungroup, Index=[0, 3], Wrap=True)
explode_6 = Explode(Curve=pline_4, Recursive=True)  # -> simplify(Segments), Vertices
pline_5 = PolyLine(Vertices=item_9, Closed=False)
shift_4 = ShiftList(List=explode_6.Segments, Shift=-1, Wrap=True)  # -> simplify(List)
len = Length(Curve=pline_5)
geo_3 = Geometry(weave)
len_2 = Length(Curve=shift_4)
tstat_7 = TreeStatistics(Tree=geo_3)  # -> Paths, simplify(graft(Length)), Count
ins = InsertItems(List=len_2, Item=len, Indices=-1, Wrap=True)  # -> simplify(List)
tstat_8 = TreeStatistics(Tree=ins)  # -> Paths, Length, Count
subtraction_2 = Subtraction(A=tstat_8.Count, B=tstat_7.Count)
reduce = RandomReduce(List=tstat_8.Paths, Reduction=subtraction_2, Seed=Slider(14, range=0..100))
branch = TreeBranch(Tree=ins, Path=reduce, MaintainPaths=True)
replace = ReplacePaths(Data=branch, Search=reduce, Replace=tstat_7.Paths)

branch_2 = TreeBranch(Tree=weave, Path="0;0", MaintainPaths=True)
cull_i_7 = CullIndex(List=branch_2, Indices=-1, Wrap=True)

tstat_9 = TreeStatistics(Tree=graft(merge_11))  # -> Paths, Length, Count
dispatch_5 = Dispatch(List=tstat_9.Paths, DispatchPattern=merge_7)  # -> ListA, ListB
split_10 = SplitTree(Data=graft(merge_10), Masks=flatten(dispatch_5.ListA))  # -> Positive, Negative
split_11 = SplitTree(Data=graft(merge_11), Masks=flatten(dispatch_5.ListA))  # -> Positive, Negative
partition = PartitionList(List=dispatch_5.ListA, Size=column_sides)
subtraction_3 = Subtraction(A=column_sides, B=1)
shift_5 = ShiftList(List=partition, Shift=subtraction_3, Wrap=True)  # -> flatten(List)
eval_2 = EvaluateCurve(Curve=reparameterize(split_11.Positive), Parameter=panel_2)  # -> Point, Tangent, Angle
replace_2 = ReplacePaths(Data=split_10.Negative, Search=dispatch_5.ListB, Replace=shift_5)
replace_3 = ReplacePaths(Data=split_11.Negative, Search=dispatch_5.ListB, Replace=shift_5)
end_3 = EndPoints(Curve=split_10.Positive)  # -> Start, End
crv_cp = CurveClosestPoint(Point=eval_2.Point, Curve=replace_3)  # -> Point, Parameter, Distance
end_4 = EndPoints(Curve=replace_2)  # -> Start, End
merge_12 = Merge(Data1=end_3.Start, Data2=end_3.End, Data3=eval_2.Point)
merge_13 = Merge(Data1=end_4.Start, Data2=end_4.End, Data3=crv_cp.Point)
ln = Line(StartPoint=eval_2.Point, EndPoint=crv_cp.Point)

item_10 = ListItem(List=branch_2, Index=-1, Wrap=True)
shift_6 = ShiftList(List=cull_i_7, Shift=1, Wrap=True)
merge_14 = Merge(Data1=flatten(shift_6), Data2=flatten(item_10))
join = JoinCurves(Curves=cull_i_7, Preserve=False)
branch_3 = TreeBranch(Tree=ungroup, Path=Slider(44, range=0..100), MaintainPaths=True)
boundary = BoundarySurfaces(Edges=join)
item_11 = ListItem(List=merge_14, Index=3, Wrap=True)
item_12 = ListItem(List=branch_3, Index=3, Wrap=True)

tstat_10 = TreeStatistics(Tree=geo_3)  # -> Paths, Length, Count
series_3 = Series(Start=0, Step=1, Count=column_sides)
item_13 = ListItem(List=tstat_10.Paths, Index=series_3, Wrap=True)
branch_4 = TreeBranch(Tree=geo_3, Path=item_13, MaintainPaths=True)
item_14 = ListItem(List=branch_4, Index=3, Wrap=True)  # -> flatten(Item)
end_5 = EndPoints(Curve=item_14)  # -> Start, End
pt_2 = Point(end_5.Start)
split_12 = SplitList(List=pt_2, Index=1)  # -> ListA, ListB

pt_3 = Point(Point(2020, 2770, 0))
pln = Plane(boundary)

# ----
# Generating Lines and Point Sets
merge_15 = Merge(Data1=split_6.Positive, Data2=split_7.Negative)
partition_2 = PartitionList(List=merge_15, Size=2)
partition_3 = PartitionList(List=path_mapper, Size=2)
item_15 = ListItem(List=partition_2, Index=0, Wrap=True)  # -> Item, Item1
item_16 = ListItem(List=partition_3, Index=0, Wrap=True)  # -> Item, Item1
eval_3 = EvaluateCurve(Curve=reparameterize(item_15.Item), Parameter=panel_2)  # -> Point, Tangent, Angle
end_6 = EndPoints(Curve=item_16.Item)  # -> Start, End
end_7 = EndPoints(Curve=item_16.Item1)  # -> Start, End
crv_cp_2 = CurveClosestPoint(Point=eval_3.Point, Curve=item_15.Item1)  # -> Point, Parameter, Distance
merge_16 = Merge(Data1=end_6.Start, Data2=end_6.End, Data3=eval_3.Point)
merge_17 = Merge(Data1=end_7.Start, Data2=end_7.End, Data3=crv_cp_2.Point)
ln_2 = Line(StartPoint=eval_3.Point, EndPoint=crv_cp_2.Point)

Y = UnitY(Factor=1)
X_2 = UnitX(Factor=1)
end_8 = EndPoints(Curve=item_11)  # -> Start, End
xz = XZPlane(Origin=item_12)
pln_2 = Plane(pt_3)
deplane = DeconstructPlane(Plane=pln)  # -> Origin, XAxis, YAxis, ZAxis
xz_2 = XZPlane(Origin=Point(0, 0, 0))

item_17 = ListItem(List=explode_6.Segments, Index=0, Wrap=True)  # -> Item, Item1
item_18 = ListItem(List=geo_3, Index=1, Wrap=True)
item_19 = ListItem(List=geo_3, Index=2, Wrap=True)
angle = Angle(VectorA=item_17.Item, VectorB=item_17.Item1, Plane=xz_2)  # -> Angle, Reflex
branch_5 = TreeBranch(Tree=angle.Reflex, Path=reduce, MaintainPaths=True)
replace_4 = ReplacePaths(Data=branch_5, Search=reduce, Replace=tstat_7.Paths)

pl = ConstructPlane(Origin=pt_3, XAxis=Y, YAxis=X_2)
pl_2 = ConstructPlane(Origin=end_8.Start, XAxis=deplane.XAxis, YAxis=deplane.YAxis)
tstat_11 = TreeStatistics(Tree=item_18)  # -> Paths, Length, Count
flippln = FlipPlane(Plane=pl, FlipX=True, FlipY=True, FlipZ=False)  # -> Flipped, R
item_20 = ListItem(List=tstat_11.Paths, Index=Slider(10, range=0..30), Wrap=True)
orient = Orient(Geometry=merge_14, Source=pl_2, Target=flippln.Flipped)  # -> Geometry, Transform
orient_2 = Orient(Geometry=branch_3, Source=xz, Target=pln_2)  # -> Geometry, Transform
branch_6 = TreeBranch(Tree=item_18, Path=item_20, MaintainPaths=True)
branch_7 = TreeBranch(Tree=item_19, Path=item_20, MaintainPaths=True)
pline_6 = PolyLine(Vertices=orient_2.Geometry, Closed=True)
item_21 = ListItem(List=orient_2.Geometry, Index=[0, 3], Wrap=True)
number_slider_3 = Slider(10000, range=0..10000)
number_slider_4 = Slider(1000, range=0..1000)
explode_7 = Explode(Curve=pline_6, Recursive=True)  # -> flatten(Segments), Vertices
pline_7 = PolyLine(Vertices=item_21, Closed=False)  # -> flatten(Polyline)
merge_18 = Merge(Data1=explode_7.Segments, Data2=pline_7)
item_22 = ListItem(List=merge_18, Index=0, Wrap=True)  # -> Item, Item1
angle_2 = Angle(VectorA=item_22.Item, VectorB=item_22.Item1)  # -> Angle, Reflex
preview = CustomPreview(
    Geometry=merge_18,
    Material={diffuse=RGB(221, 160, 221), emission=RGB(66, 48, 66), shine=0.5, specular=RGB(255, 255, 255), transparency=0})
entwine = Entwine(Branch0X=merge_16, Branch1X=merge_17, Branch2X=merge_12, Branch3X=merge_13, FlattenInputs=False)
len_3 = Length(Curve=merge_18)
item_23 = ListItem(List=orient.Geometry, Index=0, Wrap=True)  # -> Item, Item1
merge_19 = Merge(Data1=eval_3.Point, Data2=crv_cp_2.Point)
merge_20 = Merge(Data1=eval_2.Point, Data2=crv_cp.Point)
number_slider_5 = Slider(1, range=1..20)
shift_7 = ShiftList(List=explode_7.Segments, Shift=1, Wrap=True)
entwine_2 = Entwine(Branch0X=ln_2, Branch1X=ln, FlattenInputs=False)
item_24 = ListItem(List=entwine, Index=2, Wrap=True)
item_25 = ListItem(List=entwine, Index=3, Wrap=True)
merge_21 = Merge(Data1=item_16.Item, Data2=item_16.Item1)  # -> graft(Result)
merge_22 = Merge(Data1=split_10.Positive, Data2=replace_2)  # -> graft(Result)
cull_i_8 = CullIndex(List=weave, Indices=-1, Wrap=True)
partition_4 = PartitionList(List=merge_19, Size=2)
partition_5 = PartitionList(List=merge_20, Size=2)
len_4 = Length(Curve=entwine_2)
angle_3 = Angle(VectorA=explode_7.Segments, VectorB=shift_7)  # -> Angle, Reflex
end_9 = EndPoints(Curve=cull_i_8)  # -> Start, End
vec2pt_2 = Vector2Pt(PointA=item_24, PointB=item_25, Unitize=False)  # -> Vector, Length
multiplication_2 = Multiplication(A=len_4, B=Slider(0.5, range=0..1))
multiplication_3 = Multiplication(A=len_4, B=Slider(6.98, range=0..10))
entwine_3 = Entwine(Branch0X=partition_4, Branch1X=partition_5, FlattenInputs=False)
entwine_4 = Entwine(Branch0X=merge_21, Branch1X=merge_22, FlattenInputs=False)
rad = Radians(Degrees=Slider(90, range=0..360))
angle_4 = Angle(LineA=item_18, LineB=item_19, RestAngle=replace_4, Strength="100000")  # -> flatten(Angle)
length_line = LengthLine(Line=geo_3, Length=replace, Strength=Slider(10, range=0..10))  # -> flatten(Spring)
angle_5 = Angle(LineA=item_23.Item, LineB=item_23.Item1, RestAngle=angle_2.Angle, Strength="100000")  # -> flatten(Angle)
anchor = Anchor(Point=pt_3, Strength=10000)  # -> flatten(A)
length_line_2 = LengthLine(Line=orient.Geometry, Length=len_3, Strength=10)  # -> flatten(Spring)
transform = Transform(vec2pt_2.Vector)
angle_6 = Angle(LineA=explode_7.Segments, LineB=shift_7, RestAngle=angle_3.Angle, Strength=1)  # -> flatten(Angle)
pt_4 = Point(end_9.End)
length_line_3 = LengthLine(Line=entwine_2, Strength=number_slider_3)  # -> flatten(Spring)
# Allows for some deformation but keeps connection together
clamplength = ClampLength(Line=entwine_2, LowerLimit=multiplication_2, UpperLimit=multiplication_3, Strength=number_slider_3)  # -> flatten(Clamp)
show = Show(G=entwine_2)  # -> flatten(G)
# Keeps connections in line with the respective frame line
colinear = CoLinear(Points=entwine, Strength=number_slider_3)  # -> flatten(CoLinear)
# Prevents the connections from leaving the frames
oncurve = OnCurve(Points=entwine_3, Curve=entwine_4, Strength=number_slider_3)  # -> flatten(P)
# Keeps connections equal distance from each other
transform_2 = Transform(P0=item_24, P1=item_25, T=transform, Strength=number_slider_3)  # -> flatten(Transform)
# Maintains planarity of the frames
coplanar = CoPlanar(Points=pt_4, Strength=1)  # -> flatten(Coplanar)
anchor_2 = Anchor(Point=split_12.ListA, Strength=10000)  # -> flatten(A)
# One point keeps the structure from 'exploding' out of view - the others keep it on the ground
anchorxyz = AnchorXYZ(Point=split_12.ListB, X=False, Y=False, Z=True, Strength=1000)  # -> flatten(A)
merge_23 = Merge(Data1=anchor, Data2=length_line_2, Data3=angle_5)
number_slider_6 = Slider(0.01, range=0..0.01)
bouncysolver = BouncySolver(
    GoalObjects=flatten(merge_23),
    Reset=Button(),
    Threshold=1e-15,
    Tolerance=0.0001,
    Damping=Slider(0.1, range=0..0.1),
    Iterations=Slider(100, range=1..100),
    On=Toggle(True))  # -> I, V, O
crv = Curve(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)
geo_4 = Geometry(bouncysolver.O)
divide = DivideCurve(Curve=crv, Count=10, Kinks=False)  # -> Points, Tangents, Parameters
item_26 = ListItem(List=geo_4, Index=Slider(1, range=0..10), Wrap=True)
item_27 = ListItem(List=geo_4, Index=Slider(2, range=0..10), Wrap=True)
pline_8 = PolyLine(Vertices=divide.Points, Closed=False)
angle_7 = Angle(VectorA=item_26, VectorB=item_27)  # -> Angle, Reflex
explode_8 = Explode(Curve=pline_8, Recursive=True)  # -> Segments, Vertices
len_5 = Length(Curve=explode_8.Segments)
panel_3 = Panel(angle_7.Angle)
panel_4 = Panel(angle_2.Angle)
cull_i_9 = CullIndex(List=explode_8.Segments, Indices=0, Wrap=True)
cull_i_10 = CullIndex(List=explode_8.Segments, Indices=-1, Wrap=True)
rad_2 = Radians(Degrees=Slider(90, range=0..360))
item_28 = ListItem(List=explode_8.Vertices, Index=0, Wrap=True)
angle_8 = Angle(LineA=cull_i_10, LineB=cull_i_9, RestAngle=rad_2, Strength=Slider(1000, range=1..1000))  # -> flatten(Angle)
anchor_3 = Anchor(Point=item_28, Strength=10000)  # -> flatten(A)
length_line_4 = LengthLine(Line=explode_8.Segments, Strength=10)  # -> flatten(Spring)
merge_24 = Merge(
    Data1=length_line,
    Data2=angle_4,
    Data3=anchor_2,
    Data4=anchorxyz,
    Data5=coplanar,
    Data6=colinear,
    Data7=transform_2,
    Data8=oncurve,
    Data9=clamplength,
    Data10=show)
num = Number("1e-20")
merge_25 = Merge(Data1=anchor_3, Data2=angle_8, Data3=length_line_4)
bouncysolver_2 = BouncySolver(
    GoalObjects=merge_24,
    Reset=Button(),
    Threshold=num,
    Tolerance=0.0001,
    Damping=Slider(0.06, range=0.01..0.99),
    Iterations=Slider(15, range=1..100),
    On=Toggle(False))  # -> I, V, O
bouncysolver_3 = BouncySolver(
    GoalObjects=flatten(merge_25),
    Reset=Button(),
    Threshold=1e-15,
    Tolerance=0.0001,
    Damping=0.99,
    Iterations=Slider(100, range=1..100),
    On=Toggle(False))  # -> I, V, O
multiplication_4 = Multiplication(A=column_sides, B=column_height, C=6)
geo_5 = Geometry(bouncysolver_2.O)
split_13 = SplitList(List=geo_5, Index=multiplication_4)  # -> ListA, ListB
partition_6 = PartitionList(List=split_13.ListA, Size=6)  # -> simplify(Chunks)
geo_6 = Geometry(split_13.ListB)
len_6 = Length(Curve=partition_6)
data = Data(replace)
match = MatchTree(Tree=len_6, Guide=data)

# ----
# Colour Threshold
number_slider_7 = Slider(0, range=0..1)

subtraction_4 = Subtraction(A=match, B=data)
abs = Absolute(Value=subtraction_4)
ma = MassAddition(Input=len_6)  # -> Result, PartialResults
ma_2 = MassAddition(Input=data)  # -> Result, PartialResults
dom = ConstructDomain(DomainStart=number_slider_7, DomainEnd=Slider(10, range=0..100))
remap = RemapNumbers(Value=abs, Source=dom, Target=Domain(0, 1))  # -> Mapped, Clipped
gradient = Gradient(LowerLimit=0, UpperLimit=1, Parameter=remap.Clipped, stops=[0: RGB(0, 128, 0), 0.5: RGB(255, 255, 0), 1: RGB(255, 0, 0)])

# ----
# Average Baseline Differential
# In Undeformed State
item_29 = ListItem(
    List=Tree({0;0}: [348.147328, 54.1836383, 14.02201188, 177.1993588, 140, 180], {0;1}: [377.002538, 53.91177844, 10.82201188, 85.74845769, 160, 162.8], {0;2}: [385.3565984, 31.8521719, 6.122011884, 137.9386493, 175, 125], {1;0}: [348.1478557, 16.16586102, 21.07798812, 161.9465863, 150, 145], {1;1}: [419.1010838, 61.5871167, 16.42201188, 35.98600779, 180, 180], {1;2}: [323.1253951, 13.81084554, 67.27798812, 153.1043209, 175, 55], {2;0}: [321.6669493, 43.13625792, 7.722011884, 100.1664282, 170, 41.7], {2;1}: [358.7220538, 4.993628498, 8.177988116, 127.1491, 196.06, 87.4], {2;2}: [480.4562337, 44.41952532, 11.37798812, 191.1495726, 231, 400], {3;0}: [313.4082853, 8.52306843, 45.57798812, 149.1679292, 170, 71.8], {3;1}: [298.8431178, 73.38927387, 76.57798812, 130.4728444, 185, 7.6], {3;2}: [387.2430667, 14.2162681, 0.3220118838, 121.8126471, 185, 140]),
    Index=0,
    Wrap=True)  # -> flatten(Item), flatten(Item1), flatten(Item2), flatten(Item3), flatten(Item4), flatten(Item5)
avr = Average(Input=item_29.Item)
avr_2 = Average(Input=item_29.Item1)
avr_3 = Average(Input=item_29.Item2)
avr_4 = Average(Input=item_29.Item3)
avr_5 = Average(Input=item_29.Item4)
avr_6 = Average(Input=item_29.Item5)
merge_26 = Merge(Data1=avr, Data2=avr_2, Data3=avr_3, Data4=avr_4, Data5=avr_5, Data6=avr_6)

# ----
# Average Difference Per
# Item
item_30 = ListItem(List=abs, Index=0, Wrap=True)  # -> flatten(Item), flatten(Item1), flatten(Item2), flatten(Item3), flatten(Item4), flatten(Item5)
avr_7 = Average(Input=item_30.Item)
avr_8 = Average(Input=item_30.Item1)
avr_9 = Average(Input=item_30.Item2)
avr_10 = Average(Input=item_30.Item3)
avr_11 = Average(Input=item_30.Item4)
avr_12 = Average(Input=item_30.Item5)
merge_27 = Merge(Data1=avr_7, Data2=avr_8, Data3=avr_9, Data4=avr_10, Data5=avr_11, Data6=avr_12)

preview_2 = CustomPreview(Geometry=partition_6, Material=gradient)
panel_5 = Panel(merge_26)
height_4_sides_3 = Data([171.7821037, 32.27768619, 55.67121561, 42.17194407, 83.48644814, 95.20203685])
panel_6 = Panel(height_4_sides_3)
panel_7 = Panel(merge_27)
