# Grasshopper definition Extractor Visualizer.gh (Grasshopper 1.0.8)

points_per_frame = Slider(10, range=0..500)
curve_samples = Slider(100, range=0..1000)
area_features = Slider(6, range=0..10)
stock_size = Slider(25, range=0..100)
max_step = Slider(25, range=0..100)
progress_max_t_size = Panel("2")

output_dims = Panel("""guide_curve_out
stock_geometry_out
stock_areas_out
stock_mask_out
current_out
progress_out""")
output_dims_2 = Panel("""32
64
24
16
16
8""")
item = ListItem(List=output_dims_2, Index=0, Wrap=True)  # -> Item, Item1, Item2, Item3, Item4, Item5

max_layer_length = Slider(25, range=0..100)
x_step = Slider(30, range=0..100)
z_step = Slider(30, range=0..100)
x_spacing = Slider(596, range=0..1000)
z_spacing = Slider(100, range=0..1000)
multiplication = Multiplication(A=curve_samples, B=2)

frame_embed_out = Panel("16")
cf_embed_out = Panel("16")
area_embed_out = Panel("16")

# ----
# guide curve
# stock geo
# current frame
# progress
# mask
# areas
pt = Point("8000,0,8000")
merge = Merge(
    Data1=multiplication,
    Data2=points_per_frame,
    Data3=points_per_frame,
    Data4=progress_max_t_size,
    Data5=stock_size,
    Data6=area_features)
max_layer_width = Data(max_layer_length)
x_step_2 = Data(x_step)
z_step_2 = Data(z_step)
spacing = Data(x_spacing)
spacing_2 = Data(z_spacing)
merge_2 = Merge(Data1=item.Item, Data2=frame_embed_out, Data3=cf_embed_out, Data4=item.Item5, Data5=item.Item3, Data6=area_embed_out)
ma = MassAddition(Input=output_dims_2)  # -> Result, PartialResults
input_dims = Data(merge)

repeat = RepeatData(Data=pt, Length=input_dims)
mod = Modulus(A=input_dims, B=max_layer_width)
integer_division = IntegerDivision(A=input_dims, B=max_layer_width)
partition = PartitionList(List=repeat, Size=max_layer_width)  # -> simplify(Chunks)
larger = LargerThan(FirstNumber=mod, SecondNumber=0)  # -> LargerThan, OrEqualTo
addition = Addition(A=integer_division, B=1)
p_n_c = PickNChoose(Pattern=larger.LargerThan, Stream0=integer_division, Stream1=addition)
series = Series(Start=0, Step=expr("-x", z_step_2), Count=p_n_c)  # -> simplify(graft(Series))
tstat = TreeStatistics(Tree=partition)  # -> Paths, simplify(graft(Length)), Count
repeat_2 = RepeatData(Data=series, Length=tstat.Length)  # -> simplify(Data)
lng = ListLength(List=repeat_2)
series_2 = Series(Start=0, Step=x_step_2, Count=lng)  # -> simplify(Series)
split = SplitTree(Data=series_2, Masks=flatten("{*;0}"))  # -> Positive, Negative
lng_2 = ListLength(List=split.Positive)
multiplication_2 = Multiplication(A=lng_2, B=x_step_2)
addition_2 = Addition(A=multiplication_2, B=spacing)  # -> flatten(Result)
ma_2 = MassAddition(Input=addition_2)  # -> Result, simplify(PartialResults)
cull_i = CullIndex(List=ma_2.PartialResults, Indices=-1, Wrap=True)
ins = InsertItems(List=cull_i, Item=0, Indices=0, Wrap=True)  # -> simplify(graft(List))
trim = TrimTree(Tree=series_2, Depth=1)
addition_3 = Addition(A=ins, B=trim)
partition_2 = PartitionList(List=addition_3, Size=max_layer_width)
vec = VectorXYZ(XComponent=partition_2, YComponent=0, ZComponent=repeat_2)  # -> Vector, Length
move = Move(Geometry=partition, Motion=vec.Vector)  # -> Geometry, Transform

split_2 = SplitTree(Data=move.Geometry, Masks=flatten("{*;0}"))  # -> Positive, Negative
multiplication_3 = Multiplication(A=p_n_c, B=z_step_2)
addition_4 = Addition(A=multiplication_3, B=spacing_2)  # -> graft(Result)
item_2 = ListItem(List=split_2.Positive, Index=[0, -1], Wrap=True)
Z = UnitZ(Factor=expr("-x", addition_4))

# ----
# hidden_dim size
input_size = Data(input_dims)
first_layer_output = Data(merge_2)
integer_division_2 = IntegerDivision(A=input_size, B=2)
larger_2 = LargerThan(FirstNumber=integer_division_2, SecondNumber=first_layer_output)  # -> LargerThan, OrEqualTo
p_n_c_2 = PickNChoose(Pattern=larger_2.LargerThan, Stream0=first_layer_output, Stream1=integer_division_2)

avr = Average(Input=item_2)
move_2 = Move(Geometry=avr, Motion=Z)  # -> Geometry, Transform
data = Data(simplify(move_2.Geometry))

repeat_3 = RepeatData(Data=data, Length=simplify(graft(p_n_c_2)))
mod_2 = Modulus(A=p_n_c_2, B=max_layer_width)
integer_division_3 = IntegerDivision(A=p_n_c_2, B=max_layer_width)
partition_3 = PartitionList(List=repeat_3, Size=max_layer_width)  # -> simplify(Chunks)
larger_3 = LargerThan(FirstNumber=mod_2, SecondNumber=0)  # -> LargerThan, OrEqualTo
addition_5 = Addition(A=integer_division_3, B=1)
p_n_c_3 = PickNChoose(Pattern=larger_3.LargerThan, Stream0=integer_division_3, Stream1=addition_5)
series_3 = Series(Start=0, Step=expr("-x", z_step_2), Count=p_n_c_3)  # -> simplify(graft(Series))
tstat_2 = TreeStatistics(Tree=partition_3)  # -> Paths, simplify(graft(Length)), Count
repeat_4 = RepeatData(Data=series_3, Length=tstat_2.Length)  # -> simplify(Data)
lng_3 = ListLength(List=repeat_4)
series_4 = Series(Start=0, Step=x_step_2, Count=lng_3)  # -> simplify(Series)
vec_2 = VectorXYZ(XComponent=series_4, YComponent=0, ZComponent=repeat_4)  # -> Vector, Length
move_3 = Move(Geometry=partition_3, Motion=vec_2.Vector)  # -> simplify(Geometry), Transform
split_3 = SplitTree(Data=move_3.Geometry, Masks=flatten("{*;0}"))  # -> Positive, Negative
item_3 = ListItem(List=split_3.Positive, Index=0, Wrap=True)  # -> Item1, Item
dist = Distance(PointA=item_3.Item1, PointB=item_3.Item)
division = Division(A=dist, B=2)
X = UnitX(Factor=expr("-x", division))  # -> simplify(UnitVector)
repeat_5 = RepeatData(Data=X, Length=graft(p_n_c_3))  # -> simplify(graft(Data))
move_4 = Move(Geometry=move_3.Geometry, Motion=repeat_5)  # -> Geometry, Transform

split_4 = SplitTree(Data=move_4.Geometry, Masks=flatten("{*;0}"))  # -> Positive, Negative
multiplication_4 = Multiplication(A=p_n_c_3, B=z_step_2)
addition_6 = Addition(A=multiplication_4, B=spacing_2)  # -> graft(Result)
item_4 = ListItem(List=split_4.Positive, Index=[0, -1], Wrap=True)
Z_2 = UnitZ(Factor=expr("-x", addition_6))
avr_2 = Average(Input=item_4)
move_5 = Move(Geometry=avr_2, Motion=Z_2)  # -> Geometry, Transform

repeat_6 = RepeatData(Data=move_5.Geometry, Length=simplify(graft(first_layer_output)))
mod_3 = Modulus(A=first_layer_output, B=max_layer_width)
integer_division_4 = IntegerDivision(A=first_layer_output, B=max_layer_width)
partition_4 = PartitionList(List=repeat_6, Size=max_layer_width)  # -> simplify(Chunks)
larger_4 = LargerThan(FirstNumber=mod_3, SecondNumber=0)  # -> LargerThan, OrEqualTo
addition_7 = Addition(A=integer_division_4, B=1)
p_n_c_4 = PickNChoose(Pattern=larger_4.LargerThan, Stream0=integer_division_4, Stream1=addition_7)
series_5 = Series(Start=0, Step=expr("-x", z_step_2), Count=p_n_c_4)  # -> simplify(graft(Series))
tstat_3 = TreeStatistics(Tree=partition_4)  # -> Paths, simplify(graft(Length)), Count
repeat_7 = RepeatData(Data=series_5, Length=tstat_3.Length)  # -> simplify(Data)
lng_4 = ListLength(List=repeat_7)
series_6 = Series(Start=0, Step=x_step_2, Count=lng_4)  # -> simplify(Series)
vec_3 = VectorXYZ(XComponent=series_6, YComponent=0, ZComponent=repeat_7)  # -> Vector, Length
move_6 = Move(Geometry=partition_4, Motion=vec_3.Vector)  # -> simplify(Geometry), Transform
split_5 = SplitTree(Data=move_6.Geometry, Masks=flatten("{*;0}"))  # -> Positive, Negative
item_5 = ListItem(List=split_5.Positive, Index=0, Wrap=True)  # -> Item1, Item
dist_2 = Distance(PointA=item_5.Item1, PointB=item_5.Item)
division_2 = Division(A=dist_2, B=2)
X_2 = UnitX(Factor=expr("-x", division_2))  # -> simplify(UnitVector)
repeat_8 = RepeatData(Data=X_2, Length=graft(p_n_c_4))  # -> simplify(graft(Data))
move_7 = Move(Geometry=move_6.Geometry, Motion=repeat_8)  # -> Geometry, Transform

split_6 = SplitTree(Data=move_7.Geometry, Masks=flatten("{*;0}"))  # -> Positive, Negative
tstat_4 = TreeStatistics(Tree=move_7.Geometry)  # -> Paths, Length, Count
item_6 = ListItem(List=split_6.Positive, Index=[0, -1], Wrap=True)
larger_5 = LargerThan(FirstNumber=p_n_c_4, SecondNumber=1)  # -> LargerThan, OrEqualTo
partition_5 = PartitionList(List=tstat_4.Paths, Size=p_n_c_4)  # -> simplify(Chunks)
avr_3 = Average(Input=item_6)  # -> simplify(flatten(ArithmeticMean))
item_7 = ListItem(List=partition_5, Index=-1, Wrap=True)  # -> flatten(Item)
and = GateAnd(A=larger_4.LargerThan, B=larger_5.LargerThan)  # -> simplify(Result)
dispatch = Dispatch(List=avr_3, DispatchPattern=and)  # -> ListA, ListB
dispatch_2 = Dispatch(List=item_7, DispatchPattern=and)  # -> ListA, ListB
split_7 = SplitTree(Data=move_7.Geometry, Masks=flatten(dispatch_2.ListA))  # -> Positive, Negative
pdecon = Deconstruct(Point=dispatch.ListA)  # -> XComponent, YComponent, ZComponent
item_8 = ListItem(List=split_7.Positive, Index=[0, -1], Wrap=True)
avr_4 = Average(Input=item_8)  # -> simplify(ArithmeticMean)
pdecon_2 = Deconstruct(Point=avr_4)  # -> XComponent, YComponent, ZComponent
subtraction = Subtraction(A=pdecon.XComponent, B=pdecon_2.XComponent)
X_3 = UnitX(Factor=subtraction)
move_8 = Move(Geometry=split_7.Positive, Motion=X_3)  # -> Geometry, Transform
merge_3 = Merge(Data1=move_8.Geometry, Data2=split_7.Negative)  # -> simplify(Result)

split_8 = SplitTree(Data=merge_3, Masks=flatten("{*;0}"))  # -> Positive, Negative
multiplication_5 = Multiplication(A=p_n_c_4, B=z_step_2)
trim_2 = TrimTree(Tree=merge_3, Depth=1)
addition_8 = Addition(A=multiplication_5, B=spacing_2)  # -> graft(Result)
item_9 = ListItem(List=split_8.Positive, Index=[0, -1], Wrap=True)
split_9 = SplitTree(Data=trim_2, Masks=flatten(["{1}", "{2}", "{5}"]))  # -> Positive, Negative
Z_3 = UnitZ(Factor=expr("-x", addition_8))
avr_5 = Average(Input=item_9)
merge_4 = Merge(Data1=stock_size, Data2=max_step, Data3=stock_size)  # -> graft(Result)
lng_5 = ListLength(List=split_9.Positive)
move_9 = Move(Geometry=avr_5, Motion=Z_3)  # -> simplify(Geometry), Transform
multiplication_6 = Multiplication(A=merge_4, B=lng_5)
split_10 = SplitTree(Data=move_9.Geometry, Masks=flatten(["{1}", "{2}", "{5}"]))  # -> Positive, Negative
addition_9 = Addition(A=lng_5, B=multiplication_6)

repeat_9 = RepeatData(Data=split_10.Positive, Length=simplify(graft(addition_9)))
mod_4 = Modulus(A=flatten(addition_9), B=max_layer_width)
integer_division_5 = IntegerDivision(A=flatten(addition_9), B=max_layer_width)
partition_6 = PartitionList(List=repeat_9, Size=max_layer_width)  # -> simplify(Chunks)
larger_6 = LargerThan(FirstNumber=mod_4, SecondNumber=0)  # -> LargerThan, OrEqualTo
addition_10 = Addition(A=integer_division_5, B=1)
p_n_c_5 = PickNChoose(Pattern=larger_6.LargerThan, Stream0=integer_division_5, Stream1=addition_10)
series_7 = Series(Start=0, Step=expr("-x", z_step_2), Count=p_n_c_5)  # -> simplify(graft(Series))
tstat_5 = TreeStatistics(Tree=partition_6)  # -> Paths, simplify(graft(Length)), Count
repeat_10 = RepeatData(Data=series_7, Length=tstat_5.Length)  # -> simplify(Data)
lng_6 = ListLength(List=repeat_10)
series_8 = Series(Start=0, Step=x_step_2, Count=lng_6)  # -> simplify(Series)
vec_4 = VectorXYZ(XComponent=series_8, YComponent=0, ZComponent=repeat_10)  # -> Vector, Length
move_10 = Move(Geometry=partition_6, Motion=vec_4.Vector)  # -> simplify(Geometry), Transform
split_11 = SplitTree(Data=move_10.Geometry, Masks=flatten("{*;0}"))  # -> Positive, Negative
item_10 = ListItem(List=split_11.Positive, Index=0, Wrap=True)  # -> Item1, Item
dist_3 = Distance(PointA=item_10.Item1, PointB=item_10.Item)
division_3 = Division(A=dist_3, B=2)
X_4 = UnitX(Factor=expr("-x", division_3))  # -> simplify(UnitVector)
repeat_11 = RepeatData(Data=X_4, Length=graft(p_n_c_5))  # -> simplify(graft(Data))
move_11 = Move(Geometry=move_10.Geometry, Motion=repeat_11)  # -> Geometry, Transform

split_12 = SplitTree(Data=move_11.Geometry, Masks=flatten("{*;0}"))  # -> Positive, Negative
tstat_6 = TreeStatistics(Tree=move_11.Geometry)  # -> Paths, Length, Count
item_11 = ListItem(List=split_12.Positive, Index=[0, -1], Wrap=True)
larger_7 = LargerThan(FirstNumber=p_n_c_5, SecondNumber=1)  # -> LargerThan, OrEqualTo
partition_7 = PartitionList(List=tstat_6.Paths, Size=p_n_c_5)  # -> simplify(Chunks)
avr_6 = Average(Input=item_11)  # -> simplify(flatten(ArithmeticMean))
item_12 = ListItem(List=partition_7, Index=-1, Wrap=True)  # -> flatten(Item)
and_2 = GateAnd(A=larger_6.LargerThan, B=larger_7.LargerThan)  # -> simplify(Result)
dispatch_3 = Dispatch(List=avr_6, DispatchPattern=and_2)  # -> ListA, ListB
dispatch_4 = Dispatch(List=item_12, DispatchPattern=and_2)  # -> ListA, ListB
split_13 = SplitTree(Data=move_11.Geometry, Masks=flatten(dispatch_4.ListA))  # -> Positive, Negative
pdecon_3 = Deconstruct(Point=dispatch_3.ListA)  # -> XComponent, YComponent, ZComponent
item_13 = ListItem(List=split_13.Positive, Index=[0, -1], Wrap=True)
avr_7 = Average(Input=item_13)  # -> simplify(flatten(ArithmeticMean))
pdecon_4 = Deconstruct(Point=avr_7)  # -> XComponent, YComponent, ZComponent
subtraction_2 = Subtraction(A=pdecon_3.XComponent, B=pdecon_4.XComponent)
X_5 = UnitX(Factor=subtraction_2)  # -> graft(UnitVector)
move_12 = Move(Geometry=split_13.Positive, Motion=X_5)  # -> Geometry, Transform
merge_5 = Merge(Data1=move_12.Geometry, Data2=split_13.Negative)  # -> simplify(Result)

split_14 = SplitTree(Data=merge_5, Masks=flatten("{*;0}"))  # -> Positive, Negative
multiplication_7 = Multiplication(A=p_n_c_5, B=z_step_2)
addition_11 = Addition(A=multiplication_7, B=spacing_2)  # -> graft(Result)
item_14 = ListItem(List=split_14.Positive, Index=[0, -1], Wrap=True)
Z_4 = UnitZ(Factor=expr("-x", addition_11))
avr_8 = Average(Input=item_14)
move_13 = Move(Geometry=avr_8, Motion=Z_4)  # -> simplify(Geometry), Transform
item_15 = ListItem(List=output_dims_2, Index=[1, 4, 2], Wrap=True)

repeat_12 = RepeatData(Data=move_13.Geometry, Length=simplify(graft(item_15)))
mod_5 = Modulus(A=flatten(item_15), B=max_layer_width)
integer_division_6 = IntegerDivision(A=flatten(item_15), B=max_layer_width)
partition_8 = PartitionList(List=repeat_12, Size=max_layer_width)  # -> simplify(Chunks)
larger_8 = LargerThan(FirstNumber=mod_5, SecondNumber=0)  # -> LargerThan, OrEqualTo
addition_12 = Addition(A=integer_division_6, B=1)
p_n_c_6 = PickNChoose(Pattern=larger_8.LargerThan, Stream0=integer_division_6, Stream1=addition_12)
series_9 = Series(Start=0, Step=expr("-x", z_step_2), Count=p_n_c_6)  # -> simplify(graft(Series))
tstat_7 = TreeStatistics(Tree=partition_8)  # -> Paths, simplify(graft(Length)), Count
repeat_13 = RepeatData(Data=series_9, Length=tstat_7.Length)  # -> simplify(Data)
lng_7 = ListLength(List=repeat_13)
series_10 = Series(Start=0, Step=x_step_2, Count=lng_7)  # -> simplify(Series)
vec_5 = VectorXYZ(XComponent=series_10, YComponent=0, ZComponent=repeat_13)  # -> Vector, Length
move_14 = Move(Geometry=partition_8, Motion=vec_5.Vector)  # -> simplify(Geometry), Transform
split_15 = SplitTree(Data=move_14.Geometry, Masks=flatten("{*;0}"))  # -> Positive, Negative
item_16 = ListItem(List=split_15.Positive, Index=0, Wrap=True)  # -> Item1, Item
dist_4 = Distance(PointA=item_16.Item1, PointB=item_16.Item)
division_4 = Division(A=dist_4, B=2)
X_6 = UnitX(Factor=expr("-x", division_4))  # -> simplify(UnitVector)
repeat_14 = RepeatData(Data=X_6, Length=graft(p_n_c_6))  # -> simplify(graft(Data))
move_15 = Move(Geometry=move_14.Geometry, Motion=repeat_14)  # -> Geometry, Transform

split_16 = SplitTree(Data=move_15.Geometry, Masks=flatten("{*;0}"))  # -> Positive, Negative
tstat_8 = TreeStatistics(Tree=move_15.Geometry)  # -> Paths, Length, Count
item_17 = ListItem(List=split_16.Positive, Index=[0, -1], Wrap=True)
larger_9 = LargerThan(FirstNumber=p_n_c_6, SecondNumber=1)  # -> LargerThan, OrEqualTo
partition_9 = PartitionList(List=tstat_8.Paths, Size=p_n_c_6)  # -> simplify(Chunks)
avr_9 = Average(Input=item_17)  # -> simplify(flatten(ArithmeticMean))
item_18 = ListItem(List=partition_9, Index=-1, Wrap=True)  # -> flatten(Item)
and_3 = GateAnd(A=larger_8.LargerThan, B=larger_9.LargerThan)  # -> simplify(Result)
dispatch_5 = Dispatch(List=avr_9, DispatchPattern=and_3)  # -> ListA, ListB
dispatch_6 = Dispatch(List=item_18, DispatchPattern=and_3)  # -> ListA, ListB
split_17 = SplitTree(Data=move_15.Geometry, Masks=flatten(dispatch_6.ListA))  # -> Positive, Negative
pdecon_5 = Deconstruct(Point=dispatch_5.ListA)  # -> XComponent, YComponent, ZComponent
item_19 = ListItem(List=split_17.Positive, Index=[0, -1], Wrap=True)
avr_10 = Average(Input=item_19)  # -> simplify(flatten(ArithmeticMean))
pdecon_6 = Deconstruct(Point=avr_10)  # -> XComponent, YComponent, ZComponent
subtraction_3 = Subtraction(A=pdecon_5.XComponent, B=pdecon_6.XComponent)
X_7 = UnitX(Factor=subtraction_3)  # -> graft(UnitVector)
move_16 = Move(Geometry=split_17.Positive, Motion=X_7)  # -> Geometry, Transform
merge_6 = Merge(Data1=move_16.Geometry, Data2=split_17.Negative)  # -> simplify(Result)

trim_3 = TrimTree(Tree=merge_6, Depth=1)
