# Grasshopper definition FRAMED_EXTRACTOR backup prior to filter application.gh (Grasshopper 1.0.8)
# plug-ins: LunchBox

# ----
# READ CSV
# Column Titles: Indexes
# Material=Steel
# Material=Aluminum
# Material=Titanium
# SSB_Include
# CSB_Include
# CS Length
# BB Drop
# Stack
# SS E
# ST Angle
# BB OD
# TT OD
# HT OD
# DT OD
# CS OD
# SS OD
# ST OD
# CS F
# HT LX
# ST UX
# HT UX
# HT Angle
# HT Length
# ST Length
# BB Length
# Dropout Offset
# SSB OD
# CSB OD
# SSB Offset
# CSB Offset
# SS Z
# SS Thickness
# CS Thickness
# TT Thickness
# BB Thickness
# HT Thickness
# ST Thickness
# DT Thickness
# DT Length
# valid
panel = Panel("C:\Users\rensh\Documents\Master Thesis\REP_STRUC RL\Datasets\FRAMED_V2_VALIDATED.csv")
z_table = ZTable()
file = ReadFile(File=panel, PerLineParse=True)
csv = ReadCSV(CSVString=file, Delimiter=",", DataStruct=False)  # -> Headers, Values

# ----
# IDX Tracking List
panel_2 = Panel("3953")
series = Series(Start=0, Step=1, Count=panel_2)

# ----
# Grid Rendering
single_base_point = Point(Point(3582.020045, 0, 2189.275621))
grid_x_and_y = Panel("""59
67""")
single_base_point_2 = Point(single_base_point)
single_base_point_3 = Point(single_base_point)
xz = XZPlane(Origin=single_base_point)
item = ListItem(List=grid_x_and_y, Index=0, Wrap=True)  # -> Item, Item1
xz_2 = XZPlane(Origin=single_base_point_2)
rectangle = Rectangle(Plane=xz_2, XSize=Slider(1000, range=0..1000), YSize=Slider(1000, range=0..1000), Radius=0)  # -> Rectangle, Length
arrrec = RectangularArray(Geometry=single_base_point_2, Cell=rectangle.Rectangle, XCount=item.Item, YCount=item.Item1)  # -> Geometry, Transform
xz_3 = XZPlane(Origin=arrrec.Geometry)
tag = TextTag3D(Location=xz_3, Text=series, Size=50, Justification=7)

# ----
# Empirical 95th Percentile
panel_3 = Panel("""10
90""")
remap = RemapNumbers(Value=panel_3, Source=Domain(0, 100), Target=panel_2)  # -> Mapped, Clipped
round = Round(Number=remap.Mapped)  # -> Nearest, Floor, Ceiling
item_2 = ListItem(List=round.Nearest, Index=0, Wrap=True)  # -> Item, Item1
subtraction = Subtraction(A=item_2.Item1, B=item_2.Item)
series_2 = Series(Start=item_2.Item, Step=1, Count=subtraction)

# ----
# Indices invalidated because the Z height of the down tube exceeded the length of the down tube, which is not geometrically possible.
invalid_indices = Data([11, 53, 54, 88, 109, 115, 121, 147, 173, 174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])

# ----
# Indices invalidated because the HT lower extension exceeded the HT total length
invalid_indices_2 = Data("2593")

# ----
# Indices invalidated because the HT Lower + Upper extension exceed the HT length - Which results in the DT and TT intersecting/crossing one another
ht_intersects = Data([84, 118, 146, 257, 285, 320, 460, 494, 560, 563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])

# ----
# Data has been constructed with the assumption that the SS E must be substracted from the unextended ST - These two indices where unable to converge under these circumstances. Critically, these indices are already excluded when filtering out the empirical 90% mean for the SS E values
excessive_ss_e_values = Data([1563, 1976])

# ----
# One indice which was missed, where the UX + LX is not > HT length, but exactly equal to it.
missed_ht_filter = Data(2957)

# ----
# Validity Filter
panel_4 = Panel("{40}")
split = SplitTree(Data=csv.Values, Masks=flatten(panel_4))  # -> Positive, Negative
equals = Equality(FirstNumber=split.Positive, SecondNumber=0)  # -> flatten(Equality), Inequality
dispatch = Dispatch(List=csv.Values, DispatchPattern=equals.Equality)  # -> ListA, ListB
cull_i = CullIndex(List=dispatch.ListA, Indices=invalid_indices, Wrap=True)  # -> simplify(List)
cull_i_2 = CullIndex(List=cull_i, Indices=invalid_indices_2, Wrap=True)  # -> simplify(List)
cull_i_3 = CullIndex(List=cull_i_2, Indices=ht_intersects, Wrap=True)  # -> simplify(List)
cull_i_4 = CullIndex(List=cull_i_3, Indices=excessive_ss_e_values, Wrap=True)  # -> simplify(List)
cull_i_5 = CullIndex(List=cull_i_4, Indices=missed_ht_filter, Wrap=True)  # -> simplify(List)

validated_set = Data(cull_i_5)

# ----
# Down Tube
panel_5 = Panel("""{23}
{19}
{21}
{8}
{39}""")
branch = TreeBranch(Tree=validated_set, Path=panel_5, MaintainPaths=True)
multiplication = Multiplication(A=branch, B=1000)
bang = ExplodeTree(Data=multiplication)  # -> Branch0, Branch1, Branch2, Branch3, Branch4
branch_2 = TreeBranch(Tree=validated_set, Path="{22}", MaintainPaths=True)
rad = Radians(Degrees=branch_2)
subtraction_2 = Subtraction(A=bang.Branch3, B=bang.Branch1)
down_tube_height = Expression(
    HT_Angle=rad,
    HT_Len=subtraction_2,
    HT_lx=bang.Branch1,
    Stack=bang.Branch0,
    Expression="Stack - (HT_Len - HT_lx) * sin(HT_Angle)")
dt_angle = Expression(DT_Height=down_tube_height, DT_Length=bang.Branch4, Expression="Asin(DT_height/DT_length)")
X = UnitX(Factor=1)
line = LineSDL(Start=arrrec.Geometry, Direction=X, Length=bang.Branch4)
rotate = Rotate(Geometry=line, Angle=dt_angle, Plane=xz_3)  # -> Geometry, Transform

# ----
# Seat Tube
panel_6 = Panel("""{10}
{20}
{24}""")
branch_3 = TreeBranch(Tree=validated_set, Path=panel_6, MaintainPaths=True)
num = Number(branch_3)
bang_2 = ExplodeTree(Data=num)  # -> Branch0, Branch1, Branch2
multiplication_2 = Multiplication(A=bang_2.Branch2, B=1000)
multiplication_3 = Multiplication(A=bang_2.Branch1, B=1000)
X_2 = UnitX(Factor=expr("-x", 1))
subtraction_3 = Subtraction(A=multiplication_2, B=multiplication_3)
neg = Negative(Value=bang_2.Branch0)
line_2 = LineSDL(Start=arrrec.Geometry, Direction=X_2, Length=multiplication_2)
unextended_st = Rotate(Geometry=line_2, Angle=degrees(neg), Plane=xz_3)  # -> Geometry, Transform
tt_x1 = EvaluateLength(Curve=unextended_st.Geometry, Length=subtraction_3, Normalized=False)  # -> Point, Tangent, Parameter

shatter = Shatter(Curve=simplify(graft(unextended_st.Geometry)), Parameters=simplify(graft(tt_x1.Parameter)))
item_3 = ListItem(List=shatter, Index=0, Wrap=True)  # -> flatten(Item)

# ----
# Seat Stay | Chain Stay
panel_7 = Panel("""{6}
{7}
{9}""")
branch_4 = TreeBranch(Tree=validated_set, Path=panel_7, MaintainPaths=True)
multiplication_4 = Multiplication(A=branch_4, B=1000)
bang_3 = ExplodeTree(Data=multiplication_4)  # -> Branch0, Branch1, Branch2
len = Length(Curve=item_3)
expression = Expression(x=bang_3.Branch1, y=bang_3.Branch0, Expression="Asin(x/y)")
X_3 = UnitX(Factor=expr("-x", 1))
subtraction_4 = Subtraction(A=len, B=bang_3.Branch2)
deg = Degrees(Radians=expression)
eval = EvaluateLength(Curve=item_3, Length=subtraction_4, Normalized=False)  # -> Point, Tangent, Parameter
line_3 = LineSDL(Start=arrrec.Geometry, Direction=X_3, Length=bang_3.Branch0)
rotate_2 = Rotate(Geometry=line_3, Angle=expr("-x", degrees(deg)), Plane=xz_3)  # -> Geometry, Transform
end = EndPoints(Curve=rotate_2.Geometry)  # -> Start, End
ln = Line(StartPoint=eval.Point, EndPoint=end.End)

end_2 = EndPoints(Curve=rotate.Geometry)  # -> Start, End
# Head Tube
X_4 = UnitX(Factor=expr("-x", 1))
line_4 = LineSDL(Start=end_2.End, Direction=X_4, Length=bang.Branch3)
xz_4 = XZPlane(Origin=end_2.End)
neg_2 = Negative(Value=rad)
unextended_head_tube = Rotate(Geometry=line_4, Angle=neg_2, Plane=xz_4)  # -> Geometry, Transform
neg_3 = Negative(Value=bang.Branch1)
ext = ExtendCurve(Curve=unextended_head_tube.Geometry, Type=0, Start=bang.Branch1, End=neg_3)
subtraction_5 = Subtraction(A=bang.Branch3, B=bang.Branch2)
eval_2 = EvaluateLength(Curve=ext, Length=subtraction_5, Normalized=False)  # -> Point, Tangent, Parameter

# ----
# Top Tube
ln_2 = Line(StartPoint=tt_x1.Point, EndPoint=eval_2.Point)

# ----
# Elaborated Line Representation
st = Line(unextended_st.Geometry)
tt = Line(ln_2)
ht = Line(ext)
dt = Line(rotate.Geometry)
cs = Line(rotate_2.Geometry)
ss = Line(ln)

# ----
# Base Point Representation
point = Point(end_2.End)  # "HT|DT"
point_2 = Point(arrrec.Geometry)  # "DT|CS"
cs_ss = Point(end.End)
point_3 = Point(tt_x1.Point)  # "ST|TT"
point_4 = Point(eval_2.Point)  # "TT|HT"

merge = Merge(Data1=graft(point_3), Data2=graft(point_4), Data3=graft(point), Data4=graft(point_2), Data5=graft(cs_ss))  # -> simplify(Result)
merge_2 = Merge(Data1=graft(st), Data2=graft(tt), Data3=graft(ht), Data4=graft(dt), Data5=graft(cs), Data6=graft(ss))  # -> simplify(Result)
pdecon = Deconstruct(Point=merge)  # -> XComponent, YComponent, ZComponent
pline = PolyLine(Vertices=merge, Closed=True)  # -> flatten(Polyline)
item_4 = ListItem(List=pdecon.XComponent, Index=3, Wrap=True)
item_5 = ListItem(List=pdecon.ZComponent, Index=3, Wrap=True)
subtraction_6 = Subtraction(A=pdecon.XComponent, B=item_4)
subtraction_7 = Subtraction(A=pdecon.ZComponent, B=item_5)
concat = Concatenate(FragmentA=subtraction_6, FragmentB=",", FragmentC=subtraction_7)
# Top Tube
# Head Tube
# Down Tube
# Chain Stay
# Seat Stay
# Seat Tube
panel_8 = Panel("""12
13
14
15
16
17""")
# Chain Stay
# Seat Stay
# Top Tube
# Head Tube
# Seat Tube
# Down Tube
panel_9 = Panel("""{32}
{33}
{34}
{36}
{37}
{38}""")
skew_discount = Slider(99.8, range=0..100)

# ----
# Simplified Frame Dimensional Analysis - 95% mean
number_slider = Slider(5, range=0..10)
explode = Explode(Curve=pline, Recursive=True)  # -> Segments, Vertices
len_2 = Length(Curve=explode.Segments)
division = Division(A="100", B=number_slider)
multiplication_5 = Multiplication(A="10", B=number_slider)
item_6 = ListItem(List=len_2, Index=0, Wrap=True)  # -> flatten(Item), flatten(Item1), flatten(Item2), flatten(Item3), flatten(Item4)
series_3 = Series(Start=0, Step=division, Count=multiplication_5)
z_table_2 = Data(["0.00003", "0.00003", "0.00004", "0.00004", "0.00004", "0.00004"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])
z_index = Data([-3.99, -3.98, -3.97, -3.96, -3.95, -3.94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])
cluster = Cluster(skew_discount=skew_discount, data=item_6.Item, z_table=z_table_2, z_index=z_index, segmentation=series_3)  # -> skew, _95_bounds, cv_ratio, simplify(probability_2)
cluster_2 = Cluster(skew_discount=skew_discount, data=item_6.Item2, z_table=z_table_2, z_index=z_index, segmentation=series_3)  # -> skew, _95_bounds, cv_ratio, simplify(probability_2)
cluster_3 = Cluster(skew_discount=skew_discount, data=item_6.Item3, z_table=z_table_2, z_index=z_index, segmentation=series_3)  # -> skew, _95_bounds, cv_ratio, simplify(probability_2)
cluster_4 = Cluster(skew_discount=skew_discount, data=item_6.Item4, z_table=z_table_2, z_index=z_index, segmentation=series_3)  # -> skew, _95_bounds, cv_ratio, simplify(probability_2)
merge_3 = Merge(Data1=cluster._95_bounds, Data2=cluster_2._95_bounds, Data3=cluster_3._95_bounds, Data4=cluster_4._95_bounds)  # -> simplify(graft(Result))
merge_4 = Merge(Data1=cluster.probability_2, Data2=cluster_2.probability_2, Data3=cluster_3.probability_2, Data4=cluster_4.probability_2)
flip = FlipMatrix(Data=merge_4)
cluster_5 = Cluster_2(
    _95_bounds=merge_3,
    base_point="200,0,200",
    L=series_3,
    x_axis_length=Slider(2000, range=0..10000),
    y_axis_length=Slider(800, range=0..10000),
    probabilities=flip)  # -> unmoved_points_2, _95_surface, line_4, y_axis

# ----
# HT Analysis + Empirical 90% Mean
number_slider_2 = Slider(5, range=0..10)
division_2 = Division(A="50", B=number_slider_2)
multiplication_6 = Multiplication(A="5", B=number_slider_2)
series_4 = Series(Start=-30, Step=division_2, Count=multiplication_6)
cluster_6 = Cluster(skew_discount=skew_discount, data=item_6.Item1, z_table=z_table_2, z_index=z_index, segmentation=series_4)  # -> skew, _95_bounds, cv_ratio, simplify(probability_2)
cull_i_6 = CullIndex(List=series_4, Indices=-1, Wrap=True)
cull_i_7 = CullIndex(List=series_4, Indices=0, Wrap=True)
dom = ConstructDomain(DomainStart=cull_i_6, DomainEnd=cull_i_7)  # -> graft(Domain)
inc = Includes(Value=item_6.Item1, Domain=dom)  # -> simplify(Includes), simplify(Deviation)
dispatch_2 = Dispatch(List=inc.Includes, DispatchPattern=inc.Includes)  # -> ListA, ListB
lng = ListLength(List=dispatch_2.ListA)  # -> flatten(Length)
cluster_7 = Cluster_2(
    _95_bounds=cluster_6._95_bounds,
    base_point="2400,0,200",
    L=series_4,
    x_axis_length=Slider(2000, range=0..10000),
    y_axis_length=Slider(800, range=0..10000),
    probabilities=flatten(cluster_6.probability_2))  # -> unmoved_points_2, _95_surface, line_4, y_axis
remap_2 = RemapNumbers(Value=lng, Source=Domain(0, 2000), Target=Domain(0, 800))  # -> Mapped, Clipped
pt = Point(cluster_7.unmoved_points_2)
cull_i_8 = CullIndex(List=pt, Indices=-1, Wrap=True)
Z = UnitZ(Factor=1)
line_5 = LineSDL(Start=cull_i_8, Direction=Z, Length=remap_2.Mapped)

# ----
# SS E Analysis + Empirical 90% Mean
number_slider_3 = Slider(5, range=0..10)
division_3 = Division(A="50", B=number_slider_3)
multiplication_7 = Multiplication(A="5", B=number_slider_3)
series_5 = Series(Start=-50, Step=division_3, Count=multiplication_7)
cluster_8 = Cluster(skew_discount=skew_discount, data=bang_3.Branch2, z_table=z_table_2, z_index=z_index, segmentation=series_5)  # -> skew, _95_bounds, cv_ratio, simplify(probability_2)
cull_i_9 = CullIndex(List=series_5, Indices=-1, Wrap=True)
cull_i_10 = CullIndex(List=series_5, Indices=0, Wrap=True)
dom_2 = ConstructDomain(DomainStart=cull_i_9, DomainEnd=cull_i_10)  # -> graft(Domain)
inc_2 = Includes(Value=bang_3.Branch2, Domain=dom_2)  # -> simplify(Includes), simplify(Deviation)
cluster_9 = Cluster_2(
    _95_bounds=cluster_8._95_bounds,
    base_point="200,0,1200",
    L=series_5,
    x_axis_length=Slider(2000, range=0..10000),
    y_axis_length=Slider(800, range=0..10000),
    probabilities=flatten(cluster_8.probability_2))  # -> unmoved_points_2, _95_surface, line_4, y_axis
dispatch_3 = Dispatch(List=inc_2.Includes, DispatchPattern=inc_2.Includes)  # -> ListA, ListB
lng_2 = ListLength(List=dispatch_3.ListA)  # -> flatten(Length)
remap_3 = RemapNumbers(Value=lng_2, Source=Domain(0, 2000), Target=Domain(0, 800))  # -> Mapped, Clipped
pt_2 = Point(cluster_9.unmoved_points_2)
cull_i_11 = CullIndex(List=pt_2, Indices=-1, Wrap=True)
Z_2 = UnitZ(Factor=1)
line_6 = LineSDL(Start=cull_i_11, Direction=Z_2, Length=remap_3.Mapped)

od = TreeBranch(Tree=validated_set, Path=panel_8, MaintainPaths=False)
thickness = TreeBranch(Tree=validated_set, Path=panel_9, MaintainPaths=True)
panel_10 = Panel("""{3}
{4}
{0}
{1}
{5}
{2}""")
replace = ReplacePaths(Data=thickness, Search=panel_9, Replace=panel_10)
multiplication_8 = Multiplication(A=od, B=1000)
multiplication_9 = Multiplication(A=replace, B=1000)
radius = Division(A=multiplication_8, B=2)
subtraction_8 = Subtraction(A=radius, B=multiplication_9)
number_slider_4 = Slider(2, range=0..10)
expression_2 = Expression(x=radius, Expression="pi*x^2")
expression_3 = Expression(x=subtraction_8, Expression="pi*x^2")
sort = SortList(Keys=bang_3.Branch2)  # -> Keys, ValuesA
data = Data(series_2)
subtraction_9 = Subtraction(A=expression_2, B=expression_3)
item_7 = ListItem(List=sort.Keys, Index=data, Wrap=True)
division_4 = Division(A="50", B=number_slider_4)
multiplication_10 = Multiplication(A="200", B=number_slider_4)
item_8 = ListItem(List=item_7, Index=0, Wrap=True)  # -> Item1, Item
cross_sectional_areas = Data(subtraction_9)
sort_2 = SortList(Keys=flatten(cross_sectional_areas))  # -> Keys, ValuesA
dom_3 = ConstructDomain(DomainStart=item_8.Item, DomainEnd=item_8.Item1)
bang_4 = ExplodeTree(Data=cross_sectional_areas)  # -> Branch0, Branch1, Branch2, Branch3, Branch4, Branch5
series_6 = Series(Start=0, Step=division_4, Count=multiplication_10)
inc_3 = Includes(Value=item_6.Item, Domain=cluster._95_bounds)  # -> Includes, Deviation
inc_4 = Includes(Value=item_6.Item1, Domain=cluster_6._95_bounds)  # -> Includes, Deviation
inc_5 = Includes(Value=item_6.Item2, Domain=cluster_2._95_bounds)  # -> Includes, Deviation
inc_6 = Includes(Value=item_6.Item3, Domain=cluster_3._95_bounds)  # -> Includes, Deviation
inc_7 = Includes(Value=item_6.Item4, Domain=cluster_4._95_bounds)  # -> Includes, Deviation
inc_8 = Includes(Value=bang_3.Branch2, Domain=dom_3)  # -> Includes, Deviation
item_9 = ListItem(List=sort_2.Keys, Index=0, Wrap=True)  # -> Item1, Item

# ----
# Filter out negative crosssectional areas - should not be possible.
# Further Mean 95% analysis:
# 
# Include the 95% mean of the diameters
# Maybe filter out excessive ST extensions
# 
# (this and the SS E extension filter serves to pick geometries most closely aligned to the simplified shape)
# Filter out oddly shaped geometries such as these:
panel_11 = Panel("""{3695}
{3755}""")
geo = Geometry(Tree({3695}: [Line((40582.02004, 0, 64189.27562), (40367.11792, 0, 64695.55329)), Line((40537.08596, 0, 64295.13368), (41018.72003, 0, 64702.80357)), Line((41069.34588, 0, 64555.77543), (41012.37145, 0, 64721.24118)), Line((40582.02004, 0, 64189.27562), (41059.57883, 0, 64584.14098)), Line((40582.02004, 0, 64189.27562), (40124.22642, 0, 64234.27562)), Line((40552.71521, 0, 64258.31349), (40124.22642, 0, 64234.27562))], {3755}: [Line((41582.02004, 0, 65189.27562), (41519.82039, 0, 65384.61175)), Line((41538.23755, 0, 65326.7732), (41834.40758, 0, 65785.3108)), Line((41866.32136, 0, 65705.8824), (41829.00163, 0, 65798.76538)), Line((41582.02004, 0, 65189.27562), (41848.68676, 0, 65749.77216)), Line((41582.02004, 0, 65189.27562), (41150.1798, 0, 65201.02328)), Line((41553.4082, 0, 65279.13024), (41150.1798, 0, 65201.02328))]))
branch_5 = TreeBranch(Tree=merge_2, Path=panel_11, MaintainPaths=True)

and = GateAnd(A=inc_3.Includes, B=inc_4.Includes, C=inc_5.Includes, D=inc_6.Includes, E=inc_7.Includes, F=inc_8.Includes)
idx_tracking_list = Data(series)
dispatch_4 = Dispatch(List=idx_tracking_list, DispatchPattern=and)  # -> ListA, ListB
logarithmic_deviation = LogarithmicDeviation(skew_discount=skew_discount, data=bang_4.Branch0, z_table=z_table_2, z_index=z_index, segmentation=series_6)  # -> skew, _95_bounds, cv_ratio, simplify(probability_2)
logarithmic_deviation_2 = LogarithmicDeviation(skew_discount=skew_discount, data=bang_4.Branch1, z_table=z_table_2, z_index=z_index, segmentation=series_6)  # -> skew, _95_bounds, cv_ratio, simplify(probability_2)
logarithmic_deviation_3 = LogarithmicDeviation(skew_discount=skew_discount, data=bang_4.Branch2, z_table=z_table_2, z_index=z_index, segmentation=series_6)  # -> skew, _95_bounds, cv_ratio, simplify(probability_2)
logarithmic_deviation_4 = LogarithmicDeviation(skew_discount=skew_discount, data=bang_4.Branch3, z_table=z_table_2, z_index=z_index, segmentation=series_6)  # -> skew, _95_bounds, cv_ratio, simplify(probability_2)
logarithmic_deviation_5 = LogarithmicDeviation(skew_discount=skew_discount, data=bang_4.Branch4, z_table=z_table_2, z_index=z_index, segmentation=series_6)  # -> skew, _95_bounds, cv_ratio, simplify(probability_2)
logarithmic_deviation_6 = LogarithmicDeviation(skew_discount=skew_discount, data=bang_4.Branch5, z_table=z_table_2, z_index=z_index, segmentation=series_6)  # -> skew, _95_bounds, cv_ratio, simplify(probability_2)
path = ConstructPath(Indices=graft(dispatch_4.ListA))  # -> flatten(Branch)
branch_6 = TreeBranch(Tree=merge_2, Path=path, MaintainPaths=True)
merge_5 = Merge(
    Data1=logarithmic_deviation._95_bounds,
    Data2=logarithmic_deviation_2._95_bounds,
    Data3=logarithmic_deviation_3._95_bounds,
    Data4=logarithmic_deviation_4._95_bounds,
    Data5=logarithmic_deviation_5._95_bounds,
    Data6=logarithmic_deviation_6._95_bounds)  # -> simplify(graft(Result))
replace_2 = ReplaceItems(List=series_6, Item=0.001, Indices=0, Wrap=False)
panel_12 = Panel(logarithmic_deviation_4._95_bounds)
expression_4 = Expression(x=replace_2, Expression="ln(x)")
logarithmic_graph = LogarithmicGraph(
    _95_bounds=logarithmic_deviation._95_bounds,
    base_point="2400,0,1200",
    x_axis_length=Slider(2000, range=0..10000),
    segments=expression_4,
    y_axis_length=Slider(800, range=0..10000),
    probabilities=flatten(logarithmic_deviation.probability_2))  # -> unmoved_points_2, _95_surface, line_3, y_axis

# ==== cluster ZTable
panel = Panel("""0.00005
0.00007
0.00011
0.00016
0.00023
0.00034
0.00048
0.00069
0.00097
0.00135
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""")
panel_2 = Panel("""0.00004
0.00006
0.0001
0.00014
0.00021
0.0003
0.00043
0.00062
0.00087
0.00122
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""")
panel_3 = Panel("""0.00004
0.00006
0.00009
0.00014
0.0002
0.00029
0.00042
0.0006
0.00084
0.00118
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""")
panel_4 = Panel("""0.00004
0.00006
0.00008
0.00013
0.00019
0.00027
0.00039
0.00056
0.00079
0.00111
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""")
panel_5 = Panel("""0.00003
0.00005
0.00008
0.00012
0.00017
0.00025
0.00036
0.00052
0.00074
0.00104
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""")
panel_6 = Panel("""0.00003
0.00005
0.00008
0.00011
0.00017
0.00024
0.00035
0.0005
0.00071
0.001
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""")
panel_7 = Panel("""0.00004
0.00005
0.00008
0.00012
0.00018
0.00026
0.00038
0.00054
0.00076
0.00107
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""")
panel_8 = Panel("""0.00005
0.00007
0.0001
0.00015
0.00022
0.00032
0.00047
0.00066
0.00094
0.00131
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""")
panel_9 = Panel("""0.00004
0.00007
0.0001
0.00015
0.00022
0.00031
0.00045
0.00064
0.0009
0.00126
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""")
panel_10 = Panel("""0.00004
0.00006
0.00009
0.00013
0.00019
0.00028
0.0004
0.00058
0.00082
0.00114
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""")
merge = Merge(
    Data1=panel,
    Data2=panel_8,
    Data3=panel_9,
    Data4=panel_2,
    Data5=panel_3,
    Data6=panel_10,
    Data7=panel_4,
    Data8=panel_7,
    Data9=panel_5,
    Data10=panel_6)
partition = PartitionList(List=merge, Size=80)  # -> simplify(Chunks)

# ==== cluster Cluster
skew_discount = ClusterInput()
data = ClusterInput()
skew_discount_2 = Data(skew_discount)
data_2 = Data(data)
subtraction = Subtraction(A=100, B=skew_discount_2)
avr = Average(Input=data_2)
merge = Merge(Data1=subtraction, Data2=skew_discount_2)
subtraction_2 = Subtraction(A=data_2, B=avr)
sqr = Square(Value=subtraction_2)
ma = MassAddition(Input=sqr)  # -> Result, PartialResults
lng = ListLength(List=data_2)
remap = RemapNumbers(Value=merge, Source=Domain(0, 100), Target=lng)  # -> Mapped, Clipped
round = Round(Number=remap.Mapped)  # -> Nearest, Floor, Ceiling
segmentation = ClusterInput()
item = ListItem(List=round.Nearest, Index=0, Wrap=True)  # -> Item, Item1
division = Division(A=ma.Result, B=lng)
subtraction_3 = Subtraction(A=item.Item1, B=item.Item)
segmentation_2 = Data(segmentation)
stand_deviation = SquareRoot(Value=division)
sort = SortList(Keys=data_2)  # -> Keys, ValuesA
series = Series(Start=item.Item, Step=1, Count=subtraction_3)
item_2 = ListItem(List=sort.Keys, Index=series, Wrap=True)
lng_2 = ListLength(List=series)
cull_i = CullIndex(List=segmentation_2, Indices=-1, Wrap=True)
cull_i_2 = CullIndex(List=segmentation_2, Indices=0, Wrap=True)
# 95% Bounds
multiplication = Multiplication(A=stand_deviation, B=2)
expression = Expression(x=item_2, m=avr, s=stand_deviation, Expression="((x - m) / s)^3")
division_2 = Division(A=stand_deviation, B=avr)
subtraction_4 = Subtraction(A=cull_i, B=avr)
subtraction_5 = Subtraction(A=cull_i_2, B=avr)
subtraction_6 = Subtraction(A=avr, B=multiplication)
addition = Addition(A=avr, B=multiplication)
z_index = ClusterInput()
z_table = ClusterInput()
division_3 = Division(A=subtraction_4, B=stand_deviation)
division_4 = Division(A=subtraction_5, B=stand_deviation)
dom = ConstructDomain(DomainStart=subtraction_6, DomainEnd=addition)
cv_ratio = ClusterOutput(division_2)
z_index_2 = Data(z_index)
z_table_2 = Data(z_table)
py3 = Python3Script(z1=division_3, z2=division_4)  # -> rounded_z1, rounded_z2; inputs z1: list, z2: list
# ---------- py3: Python ----------
decimals = 2
factor = 10 ** decimals
rounded_z1 = [int(v * factor + 0.5) / factor for v in z1]
rounded_z2 = [int(v * factor + 0.5) / factor for v in z2]
# ---------- end py3 ----------
ma_2 = MassAddition(Input=expression)  # -> Result, PartialResults
_95_bounds = ClusterOutput(dom)
expression_2 = Expression(x=ma_2.Result, N=lng_2, Expression="(1/N) * x")
smaller = SmallerThan(FirstNumber=py3.rounded_z1, SecondNumber=-3.99)  # -> graft(SmallerThan), OrEqualTo
larger = LargerThan(FirstNumber=py3.rounded_z1, SecondNumber=3.99)  # -> graft(LargerThan), OrEqualTo
mindex = MemberIndex(Set=z_index_2, Member=py3.rounded_z2)  # -> Index, Count
mindex_2 = MemberIndex(Set=z_index_2, Member=py3.rounded_z1)  # -> Index, Count
skew = ClusterOutput(expression_2)
smaller_2 = SmallerThan(FirstNumber=py3.rounded_z2, SecondNumber=-3.99)  # -> graft(SmallerThan), OrEqualTo
larger_2 = LargerThan(FirstNumber=py3.rounded_z2, SecondNumber=3.99)  # -> graft(LargerThan), OrEqualTo
item_3 = ListItem(List=z_table_2, Index=mindex.Index, Wrap=True)
item_4 = ListItem(List=z_table_2, Index=mindex_2.Index, Wrap=True)
weave = Weave(Pattern=smaller.SmallerThan, Stream0=item_4, Stream1=0, NullGaps=False)
weave_2 = Weave(Pattern=smaller_2.SmallerThan, Stream0=item_3, Stream1=0, NullGaps=False)
weave_3 = Weave(Pattern=larger.LargerThan, Stream0=weave, Stream1=1, NullGaps=False)
weave_4 = Weave(Pattern=larger_2.LargerThan, Stream0=weave_2, Stream1=1, NullGaps=False)
subtraction_7 = Subtraction(A=weave_4, B=weave_3)
probability = Data(subtraction_7)
probability_2 = ClusterOutput(probability)

# ==== cluster Cluster_2
base_point = ClusterInput()
x_axis_length = ClusterInput()
y_axis_length = ClusterInput()
base_point_2 = Point(base_point)
x_axis_length_2 = Data(x_axis_length)
y_axis_length_2 = Data(y_axis_length)
X = UnitX(Factor=1)
Z = UnitZ(Factor=1)
probabilities = ClusterInput()
line = LineSDL(Start=base_point_2, Direction=X, Length=x_axis_length_2)
line_2 = LineSDL(Start=base_point_2, Direction=Z, Length=y_axis_length_2)
L = ClusterInput()
_95_bounds = ClusterInput()
xz = XZPlane(Origin=Point(0, 0, 0))
lng = ListLength(List=L)
probabilities_2 = Data(probabilities)
_95_bounds_2 = Data(_95_bounds)
divide = DivideCurve(Curve=line, Count=expr("x-1", lng), Kinks=False)  # -> Points, Tangents, Parameters
remap = RemapNumbers(Value=simplify(probabilities_2), Source=Slider(0.3, range=0..1), Target=y_axis_length_2)  # -> Mapped, Clipped
offset = OffsetCurve(Curve=line_2, Distance=expr("-x", Slider(100, range=0..100)), Plane=xz, Corners=1)
inc = Includes(Value=L, Domain=_95_bounds_2)  # -> simplify(Includes), Deviation
Z_2 = UnitZ(Factor=remap.Mapped)
y_axis = ClusterOutput(offset)
move = Move(Geometry=divide.Points, Motion=Z_2)  # -> simplify(Geometry), Transform
dispatch = Dispatch(List=move.Geometry, DispatchPattern=inc.Includes)  # -> ListA, ListB
intcrv = Interpolate(Vertices=move.Geometry, Degree=Slider(3, range=0..10), Periodic=False, KnotStyle=1)  # -> Curve, Length, Domain
unmoved_points = Data(divide.Points)
pt = Point(dispatch.ListA)
unmoved_points_2 = ClusterOutput(unmoved_points)
item = ListItem(List=pt, Index=[0, -1], Wrap=True)
smocrv = SmoothCurve(
    Curve=intcrv.Curve,
    Steps=Slider(10, range=0..100),
    StartType=0,
    EndType=0,
    DeviationTolerance=Slider(15, range=0..100),
    AngleTolerance=0.05)
crv_cp = CurveClosestPoint(Point=item, Curve=smocrv)  # -> Point, Parameter, Distance
pdecon = Deconstruct(Point=crv_cp.Point)  # -> XComponent, YComponent, ZComponent
pdecon_2 = Deconstruct(Point=base_point_2)  # -> XComponent, YComponent, ZComponent
Z_3 = UnitZ(Factor=expr("-x", 1))
shatter = Shatter(Curve=smocrv, Parameters=crv_cp.Parameter)
subtraction = Subtraction(A=pdecon.ZComponent, B=pdecon_2.ZComponent)
line_3 = LineSDL(Start=crv_cp.Point, Direction=Z_3, Length=subtraction)
# In case of strong early inclusion
lng_2 = ListLength(List=shatter)
end = EndPoints(Curve=line_3)  # -> Start, End
item_2 = ListItem(List=shatter, Index=0, Wrap=True)  # -> simplify(Item)
item_3 = ListItem(List=shatter, Index=1, Wrap=True)  # -> simplify(Item)
smaller = SmallerThan(FirstNumber=lng_2, SecondNumber=2)  # -> SmallerThan, simplify(OrEqualTo)
item_4 = ListItem(List=end.End, Index=0, Wrap=True)  # -> Item, Item1
weave = Weave(Pattern=smaller.OrEqualTo, Stream0=item_3, Stream1=item_2, NullGaps=False)
ln = Line(StartPoint=item_4.Item, EndPoint=item_4.Item1)  # -> simplify(Line)
merge = Merge(Data1=flatten(weave), Data2=flatten(line_3), Data3=flatten(ln))
join = JoinCurves(Curves=merge, Preserve=False)  # -> simplify(Curves)
boundary = BoundarySurfaces(Edges=join)
_95_surface = ClusterOutput(boundary)
line_4 = ClusterOutput(smocrv)

# ==== cluster LogarithmicDeviation
data = ClusterInput()
data_2 = Data(data)
expression = Expression(x=data_2, Expression="ln(x)")
skew_discount = ClusterInput()
lng = ListLength(List=data_2)
skew_discount_2 = Data(skew_discount)
logmean = Average(Input=expression)
subtraction = Subtraction(A=100, B=skew_discount_2)
segmentation = ClusterInput()
expression_2 = Expression(m_log=logmean, y=expression, Expression="(y - m_log)^2")
merge = Merge(Data1=subtraction, Data2=skew_discount_2)
segmentation_2 = Data(segmentation)
remap = RemapNumbers(Value=merge, Source=Domain(0, 100), Target=Domain(0, 1))  # -> Mapped, Clipped
replace = ReplaceItems(List=segmentation_2, Item=0.0001, Indices=0, Wrap=False)
avr = Average(Input=expression_2)
round = Round(Number=remap.Mapped)  # -> Nearest, Floor, Ceiling
sqrt = SquareRoot(Value=avr)
item = ListItem(List=round.Nearest, Index=0, Wrap=True)  # -> Item, Item1
expression_3 = Expression(x=replace, Expression="ln(x)")
subtraction_2 = Subtraction(A=item.Item1, B=item.Item)
multiplication = Multiplication(A=sqrt, B=2)
sort = SortList(Keys=expression)  # -> Keys, ValuesA
series = Series(Start=item.Item, Step=1, Count=subtraction_2)
item_2 = ListItem(List=sort.Keys, Index=series, Wrap=True)
lng_2 = ListLength(List=series)
cull_i = CullIndex(List=expression_3, Indices=-1, Wrap=True)
cull_i_2 = CullIndex(List=expression_3, Indices=0, Wrap=True)
# 95% Bounds
subtraction_3 = Subtraction(A=logmean, B=multiplication)
addition = Addition(A=logmean, B=multiplication)
expression_4 = Expression(x=subtraction_3, Expression="e^x")
expression_5 = Expression(x=addition, Expression="e^x")
expression_6 = Expression(x=item_2, m=logmean, s=sqrt, Expression="((x - m) / s)^3")
division = Division(A=sqrt, B=logmean)
subtraction_4 = Subtraction(A=cull_i, B=logmean)
subtraction_5 = Subtraction(A=cull_i_2, B=logmean)
z_index = ClusterInput()
z_table = ClusterInput()
division_2 = Division(A=subtraction_4, B=sqrt)
division_3 = Division(A=subtraction_5, B=sqrt)
dom = ConstructDomain(DomainStart=expression_4, DomainEnd=expression_5)
cv_ratio = ClusterOutput(division)
z_index_2 = Data(z_index)
z_table_2 = Data(z_table)
py3 = Python3Script(z1=division_2, z2=division_3)  # -> rounded_z1, rounded_z2; inputs z1: list, z2: list; same code as py3
ma = MassAddition(Input=expression_6)  # -> Result, PartialResults
_95_bounds = ClusterOutput(dom)
expression_7 = Expression(x=ma.Result, N=lng_2, Expression="(1/N) * x")
smaller = SmallerThan(FirstNumber=py3.rounded_z1, SecondNumber=-3.99)  # -> graft(SmallerThan), OrEqualTo
larger = LargerThan(FirstNumber=py3.rounded_z1, SecondNumber=3.99)  # -> graft(LargerThan), OrEqualTo
mindex = MemberIndex(Set=z_index_2, Member=py3.rounded_z2)  # -> Index, Count
mindex_2 = MemberIndex(Set=z_index_2, Member=py3.rounded_z1)  # -> Index, Count
skew = ClusterOutput(expression_7)
smaller_2 = SmallerThan(FirstNumber=py3.rounded_z2, SecondNumber=-3.99)  # -> graft(SmallerThan), OrEqualTo
larger_2 = LargerThan(FirstNumber=py3.rounded_z2, SecondNumber=3.99)  # -> graft(LargerThan), OrEqualTo
item_3 = ListItem(List=z_table_2, Index=mindex.Index, Wrap=True)
item_4 = ListItem(List=z_table_2, Index=mindex_2.Index, Wrap=True)
weave = Weave(Pattern=smaller.SmallerThan, Stream0=item_4, Stream1=0, NullGaps=False)
weave_2 = Weave(Pattern=smaller_2.SmallerThan, Stream0=item_3, Stream1=0, NullGaps=False)
weave_3 = Weave(Pattern=larger.LargerThan, Stream0=weave, Stream1=1, NullGaps=False)
weave_4 = Weave(Pattern=larger_2.LargerThan, Stream0=weave_2, Stream1=1, NullGaps=False)
panel = Panel(py3.rounded_z1)
subtraction_6 = Subtraction(A=weave_4, B=weave_3)
probability = Data(simplify(subtraction_6))
probability_2 = ClusterOutput(probability)
panel_2 = Panel(probability)

# ==== cluster LogarithmicGraph
base_point = ClusterInput()
x_axis_length = ClusterInput()
y_axis_length = ClusterInput()
base_point_2 = Point(base_point)
x_axis_length_2 = Data(x_axis_length)
y_axis_length_2 = Data(y_axis_length)
X = UnitX(Factor=1)
Z = UnitZ(Factor=1)
line = LineSDL(Start=base_point_2, Direction=X, Length=x_axis_length_2)
line_2 = LineSDL(Start=base_point_2, Direction=Z, Length=y_axis_length_2)
segments = ClusterInput()
probabilities = ClusterInput()
segments_2 = Data(segments)
probabilities_2 = Data(probabilities)
cull_i = CullIndex(List=segments_2, Indices=-1, Wrap=True)
cull_i_2 = CullIndex(List=segments_2, Indices=0, Wrap=True)
remap = RemapNumbers(Value=simplify(probabilities_2), Source=Slider(0.3, range=0..1), Target=y_axis_length_2)  # -> Mapped, Clipped
cluster = Cluster_2()  # -> unmoved_points_2, _95_surface, line_4, y_axis
subtraction = Subtraction(A=cull_i_2, B=cull_i)
ma = MassAddition(Input=subtraction)  # -> Result, PartialResults
xz = XZPlane(Origin=Point(0, 0, 0))
remap_2 = RemapNumbers(Value=subtraction, Source=ma.Result, Target=x_axis_length_2)  # -> Mapped, Clipped
offset = OffsetCurve(Curve=line_2, Distance=expr("-x", Slider(100, range=0..100)), Plane=xz, Corners=1)
ma_2 = MassAddition(Input=remap_2.Mapped)  # -> Result, PartialResults
eval = EvaluateLength(Curve=line, Length=ma_2.PartialResults, Normalized=False)  # -> Point, Tangent, Parameter
y_axis = ClusterOutput(offset)
Z_2 = UnitZ(Factor=remap.Mapped)
move = Move(Geometry=eval.Point, Motion=Z_2)  # -> simplify(Geometry), Transform
unmoved_points = Data(eval.Point)
item = ListItem(List=move.Geometry, Index=0, Wrap=True)
end = EndPoints(Curve=line)  # -> Start, End
unmoved_points_2 = ClusterOutput(unmoved_points)
ln = Line(StartPoint=end.Start, EndPoint=item)
divide = DivideCurve(Curve=ln, Count=10, Kinks=False)  # -> Points, Tangents, Parameters
pdecon = Deconstruct(Point=divide.Points)  # -> XComponent, YComponent, ZComponent
# For smoothing the trailing end
pdecon_2 = Deconstruct(Point=base_point_2)  # -> XComponent, YComponent, ZComponent
_95_bounds = ClusterInput()
subtraction_2 = Subtraction(A=pdecon.ZComponent, B=pdecon_2.ZComponent)
series = Series(Start=1, Step=-0.1, Count=11)
_95_bounds_2 = Data(_95_bounds)
dedomain = DeconstructDomain(Domain=_95_bounds_2)  # -> Start, End
graph = GraphMapper(series, x0=0, x1=1, y0=0, y1=1, container_name="Bezier", cpx=[0, 0, 0.2498424947, 1], cpy=[0, 0.7787846923, 1, 1])
expression = Expression(x=dedomain.Start, Expression="ln(x)")
expression_2 = Expression(x=dedomain.End, Expression="ln(x)")
dom = ConstructDomain(DomainStart=expression, DomainEnd=expression_2)
remap_3 = RemapNumbers(Value=graft(graph), Source=Domain(0, 1), Target=graft(subtraction_2))  # -> flatten(Mapped), Clipped
inc = Includes(Value=segments_2, Domain=dom)  # -> simplify(Includes), Deviation
Z_3 = UnitZ(Factor=expr("-x", remap_3.Mapped))
move_2 = Move(Geometry=divide.Points, Motion=Z_3)  # -> Geometry, Transform
cull_i_3 = CullIndex(List=move_2.Geometry, Indices=-1, Wrap=True)
ins = InsertItems(List=move.Geometry, Item=cull_i_3, Indices=0, Wrap=True)
dispatch = Dispatch(List=move.Geometry, DispatchPattern=inc.Includes)  # -> ListA, ListB
nurbs = NurbsCurve(Vertices=ins, Degree=Slider(3, range=0..10), Periodic=False)  # -> Curve, Length, Domain
pt = Point(dispatch.ListA)
item_2 = ListItem(List=pt, Index=[0, -1], Wrap=True)
smocrv = SmoothCurve(
    Curve=nurbs.Curve,
    Steps=Slider(10, range=0..100),
    StartType=0,
    EndType=0,
    DeviationTolerance=Slider(15, range=0..100),
    AngleTolerance=0.05)
line_3 = ClusterOutput(smocrv)
crv_cp = CurveClosestPoint(Point=item_2, Curve=smocrv)  # -> Point, Parameter, Distance
pdecon_3 = Deconstruct(Point=crv_cp.Point)  # -> XComponent, YComponent, ZComponent
pdecon_4 = Deconstruct(Point=base_point_2)  # -> XComponent, YComponent, ZComponent
shatter = Shatter(Curve=smocrv, Parameters=crv_cp.Parameter)
Z_4 = UnitZ(Factor=expr("-x", 1))
subtraction_3 = Subtraction(A=pdecon_3.ZComponent, B=pdecon_4.ZComponent)
# In case of strong early inclusion
lng = ListLength(List=shatter)
line_4 = LineSDL(Start=crv_cp.Point, Direction=Z_4, Length=subtraction_3)
item_3 = ListItem(List=shatter, Index=0, Wrap=True)  # -> simplify(Item)
item_4 = ListItem(List=shatter, Index=1, Wrap=True)  # -> simplify(Item)
smaller = SmallerThan(FirstNumber=lng, SecondNumber=2)  # -> SmallerThan, simplify(OrEqualTo)
end_2 = EndPoints(Curve=line_4)  # -> Start, End
item_5 = ListItem(List=end_2.End, Index=0, Wrap=True)  # -> Item, Item1
weave = Weave(Pattern=smaller.OrEqualTo, Stream0=item_4, Stream1=item_3, NullGaps=False)
ln_2 = Line(StartPoint=item_5.Item, EndPoint=item_5.Item1)  # -> simplify(Line)
merge = Merge(Data1=flatten(weave), Data2=flatten(line_4), Data3=flatten(ln_2))
join = JoinCurves(Curves=merge, Preserve=False)  # -> simplify(Curves)
boundary = BoundarySurfaces(Edges=join)
_95_surface = ClusterOutput(boundary)
