# Grasshopper definition Interactive Placement Routine [Jul-07 '26, 1206].gh (Grasshopper 1.0.8)

# ----
# First Set
# Random Reduced
# No duplicates
# Filtered
# Seed: 0
data = Data(Tree({120}: [Point(-130.6378236, 0, 523.9596922), Point(390.024685, 0, 581.9817177), Point(406.3262259, 0, 523.2002601), Point(0, 0, 0), Point(-398.9047505, 0, 70)], {189}: [Point(-95.64816979, 0, 257.1901779), Point(219.9878996, 0, 600.2596855), Point(226.7481597, 0, 574.1196992), Point(0, 0, 0), Point(-420.9972261, 0, 37)], {243}: [Point(-151.6005457, 0, 528.6939328), Point(374.5756026, 0, 576.5018742), Point(390.597572, 0, 524.0963736), Point(0, 0, 0), Point(-398.9047505, 0, 70)], {276}: [Point(-128.4470078, 0, 447.9479503), Point(275.5417934, 0, 595.149817), Point(281.5354134, 0, 575.5455695), Point(0, 0, 0), Point(-398.9047505, 0, 70)], {311}: [Point(-142.3504748, 0, 531.2592045), Point(417.3782367, 0, 571.9443272), Point(440.173446, 0, 492.4479849), Point(0, 0, 0), Point(-390.8657058, 0, 57)], {322}: [Point(-120.922108, 0, 421.705506), Point(358.5353863, 0, 572.8679161), Point(373.6217662, 0, 523.5225907), Point(0, 0, 0), Point(-424.2640687, 0, 70)]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))
data_2 = Data(Tree({120}: [31.8, 28.6, 45, 36.5, 28.35, 18.5, 1.277427, 0.775161, 1.508131, 5.487583, 0.774028, 0.775161], {189}: [28.6, 27, 36, 36.5, 21.25, 12.75, 3.544823, 5.02098, 0.955859, 1.544408, 8.651839, 9.869214], {243}: [31.8, 28.6, 45, 36.5, 23.35, 13, 1.071775, 0.650369, 7.320302, 8.661336, 2.707362, 1.620194], {276}: [31.8, 28.6, 45, 36.5, 33.35, 18, 3.61552, 0.998009, 0.53991, 0.946814, 7.679519, 1.534275], {311}: [31.8, 28.6, 45, 36.5, 23.35, 13, 1.344038, 4.646429, 0.748694, 0.706144, 2.412787, 0.539516], {322}: [31.8, 53.1, 45, 36.5, 23.35, 13, 1.999341, 8.915207, 6.405613, 8.190037, 5.89319, 1.419823]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))

commit = Button()
undo = Button()
reset = Button()

stock_idx = Button()
stock_idx_2 = Button()

target_ori = Button()
target_ori_2 = Button()

candidate_ori = Button()
candidate_ori_2 = Button()

mirror = Button()
merge = Merge(
    Data1=commit,
    Data2=undo,
    Data3=reset,
    Data4=stock_idx,
    Data5=stock_idx_2,
    Data6=target_ori,
    Data7=target_ori_2,
    Data8=candidate_ori,
    Data9=candidate_ori_2,
    Data10=mirror)
geo = Geometry(<curve referenced from the Rhino model>)
panel = Panel("""4
1
3
2
3""")
py3 = Python3Script(buttons=merge)  # -> out, simplify(update_list), view_depth; inputs buttons: list of Boolean
# ---------- py3: Python ----------
# Script for interactive environment #

# Imports
import ghpythonlib.treehelpers as th

# Allowable Button Ranges
max_step = 10
frame_range = 50
target_range = 5
candidate_range = 5
mirror_range = 2

# Global lists creation
if 'commits' not in globals():
    commits = 0
    true_commit = 0
if 'frame_indexes' not in globals():
    frame_indexes = [0]
if 'target_orientation' not in globals():
    target_orientation = [0]
if 'candidate_orientation' not in globals():
    candidate_orientation = [0]
if 'mirror_is' not in globals():
    mirror_is = [0]

# Update Logic

if buttons[0]:
    if true_commit < max_step - 1:
        if commits == true_commit:
            commits += 1
            true_commit += 1
            frame_indexes.append(0)
            target_orientation.append(0)
            candidate_orientation.append(0)
            mirror_is.append(0)
        else:
            commits += 1
    elif true_commit == max_step - 1 and commits < true_commit:
        commits += 1
if buttons[1]:
    if commits > 0:
        commits -= 1
if buttons[2]:
    commits = 0
    true_commit = 0
    frame_indexes = [0]
    target_orientation = [0]
    candidate_orientation = [0]
    mirror_is = [0]
    # Still need logic to wipe the transfer list

if buttons[3]:
    frame_indexes[commits] = (frame_indexes[commits] + 1) % frame_range
if buttons[4]:
    frame_indexes[commits] = (frame_indexes[commits] - 1) % frame_range

if buttons[5]:
    target_orientation[commits] = (target_orientation[commits] + 1) % target_range
if buttons[6]:
    target_orientation[commits] = (target_orientation[commits] - 1) % target_range

if buttons[7]:
    candidate_orientation[commits] = (candidate_orientation[commits] + 1) % candidate_range
if buttons[8]:
    candidate_orientation[commits] = (candidate_orientation[commits] - 1) % candidate_range

if buttons[9]:
    mirror_is[commits] = (mirror_is[commits] + 1) % mirror_range


shape_grammars = [list(group) for group in zip(frame_indexes, target_orientation, candidate_orientation, mirror_is)]

update_list = th.list_to_tree(shape_grammars)

view_depth = commits
# ---------- end py3 ----------
data_3 = Data(Tree({0}: [1, 2, 2, 0], {1}: [0, 2, 2, 1], {2}: [46, 1, 4, 0], {3}: [40, 2, 2, 0], {4}: [8, 2, 3, 1]))
panel_2 = Panel("""3
1
1
1
1""")
replace = ReplaceItems(List=data_3, Item=graft(panel), Indices=1, Wrap=False)  # -> simplify(List)
replace_2 = ReplaceItems(List=replace, Item=graft(panel_2), Indices=2, Wrap=False)  # -> simplify(List)
py3_2 = Python3Script(g_curve=geo, stock_set=data, update_list=py3.update_list)  # -> out, check; inputs g_curve: Curve, stock_set: tree of Point3d, update_list: tree of Int32
# ---------- py3_2: Python ----------
# Script for interactive environment #

# Imports | Linking
import sys
sys.path.append(r'C:\Users\rensh\Documents\Master Thesis\REP_STRUC RL\Main Deployment')

import importlib
import ghpythonlib.treehelpers as th
import main_routine
import gh_assist
from Grasshopper import DataTree

importlib.reload(main_routine)
importlib.reload(gh_assist)

from gh_assist import renum_paths
from main_routine import MAIN

# GH input conversions
if update_list.BranchCount < 2:
    shape_grammars = th.tree_to_list(update_list)
else:
    shape_grammars = th.tree_to_list(update_list, 0)

print(shape_grammars)

numbered_stock = renum_paths(stock_set)
stock_list     = th.tree_to_list(numbered_stock, 0)

# Internal Variables
stock_selections = []

if isinstance(shape_grammars[0], list):
    print('yes')
else:
    print('no')

for i, x in enumerate(shape_grammars):
    stock_selections.append(stock_list[shape_grammars[i][0]])

print(stock_selections)


# Main Deployment
check_pre = MAIN(g_curve, stock_selections, shape_grammars)

check = th.list_to_tree(check_pre)
# ---------- end py3_2 ----------
py3_3 = Python3Script(g_curve=geo, stock_set=data, update_list=replace_2)  # -> out, check; inputs g_curve: Curve, stock_set: tree of Point3d, update_list: tree of Int32
# ---------- py3_3: Python ----------
# Script for interactive environment #

# Imports | Linking
import sys
sys.path.append(r'C:\Users\rensh\Documents\Master Thesis\REP_STRUC RL\Main Deployment')

import importlib
import ghpythonlib.treehelpers as th
import main_routine
import gh_assist

importlib.reload(main_routine)
importlib.reload(gh_assist)

from gh_assist import renum_paths
from main_routine import MAIN

# GH input conversions
numbered_stock = renum_paths(stock_set)
shape_grammars = th.tree_to_list(update_list, 0)
stock_list     = th.tree_to_list(numbered_stock, 0)

# Internal Variables
stock_selections = []

for i, x in enumerate(shape_grammars):
    stock_selections.append(stock_list[shape_grammars[i][0]])


# Main Deployment
check_pre = MAIN(g_curve, stock_selections, shape_grammars)

check = th.list_to_tree(check_pre)
# ---------- end py3_3 ----------
panel_3 = Panel(replace_2)
pline = PolyLine(Vertices=simplify(py3_2.check), Closed=True)  # -> flatten(Polyline)
geo_2 = Geometry([Point(2313.756601, 0, 1236.415986), Point(2611.577351, 0, 1595.060122), Point(2619.655347, 0, 1569.296853), Point(2422.332379, 0, 984.4107077), Point(2000, 0, 1000)])
series = Series(Start=py3.view_depth, Step=-1, Count=expr("x+1", py3.view_depth))
panel_4 = Panel(py3.update_list)
pline_2 = PolyLine(Vertices=geo_2, Closed=True)
pln = Plane([Plane(origin=(2000, 0, 1000), x=(-0.2873478856, 0, 0.9578262852), y=(-0.9578262852, 0, -0.2873478856)), Plane(origin=(2000, 0, 1000), x=(0.8804710999, 0, -0.474099823), y=(0.474099823, 0, 0.8804710999)), Plane(origin=(2000, 0, 1000), x=(-0.474099823, 0, -0.8804710999), y=(0.8804710999, 0, -0.474099823)), Plane(origin=(2211.16619, 0, 992.2053539), x=(-0.9993194336, 0, 0.0368872563), y=(-0.0368872563, 0, -0.9993194336)), Plane(origin=(2156.8783, 0, 1118.207993), x=(0.798655783, 0, 0.6017881191), y=(-0.6017881191, 0, 0.798655783))])
pln_2 = Plane([Plane(origin=(25.37396219, 0, 462.5784624), x=(-0.6770706142, 0, -0.7359180548), y=(0.7359180548, 0, -0.6770706142)), Plane(origin=(271.7754117, 0, 599.7086926), x=(-0.2503800041, 0, 0.9681476404), y=(-0.9681476404, 0, -0.2503800041)), Plane(origin=(159.8784662, 0, 268.6929759), x=(0.3673374747, 0, 0.9300877269), y=(-0.9300877269, 0, 0.3673374747)), Plane(origin=(-214.876068, 0, -31.30801028), x=(0.9961602057, 0, -0.08754909848), y=(0.08754909848, 0, 0.9961602057)), Plane(origin=(-286.3469943, 0, 188.5032864), x=(-0.8281639489, 0, -0.5604859264), y=(0.5604859264, 0, -0.8281639489))])
# Current Issue:
# 
# Mirroring Logic incomplete and initial targets create issues
item = ListItem(List=pline, Index=series, Wrap=True)
pline_3 = PolyLine(Vertices=py3_3.check, Closed=True)
item_2 = ListItem(List=pln, Index=Slider(0, range=0..4), Wrap=True)
