# Grasshopper definition Reward testing for FEA 3.gh (Grasshopper 1.0.8)
# plug-ins: Pufferfish

number_slider = Slider(1000, range=0..1000)

# ----
# Tension Domain
number_slider_2 = Slider(2500, range=0..3000)
dom = ConstructDomain(DomainStart=Slider(20, range=0..2000), DomainEnd=number_slider_2)

# ----
# Reward Domain
number_slider_3 = Slider(0, range=0..2000)
dom_2 = ConstructDomain(DomainStart=number_slider_3, DomainEnd=Slider(10, range=0..2000))

# ----
# Deformation Domain
number_slider_4 = Slider(0.5, range=0..2000)
dom_3 = ConstructDomain(DomainStart=number_slider_4, DomainEnd=Slider(300, range=0..2000))

pt = Point(Point(3700, 0, 3000))
reciprocal_steepness = Slider(0.01, range=0..1)
reciprocal_steepness_2 = Slider(0.15, range=0..1)
steps = Slider(80, range=0..500)
Z = UnitZ(Factor=1)
X = UnitX(Factor=1)  # -> expr("-x", UnitVector)
line = LineSDL(Start=pt, Direction=Z, Length=number_slider)
line_2 = LineSDL(Start=pt, Direction=X, Length=number_slider)
divide = DivideCurve(Curve=line, Count=steps, Kinks=False)  # -> Points, Tangents, Parameters
divide_2 = DivideCurve(Curve=line_2, Count=steps, Kinks=False)  # -> Points, Tangents, Parameters
pdecon = Deconstruct(Point=divide_2.Points)  # -> XComponent, YComponent, ZComponent
item = ListItem(List=pdecon.XComponent, Index=0, Wrap=True)  # -> Item1, Item
number_slider_5 = Slider(70, range=0..3000)
range = Range(Domain=dom_3, Steps=steps)
range_2 = Range(Domain=dom, Steps=steps)
pdecon_2 = Deconstruct(Point=pt)  # -> XComponent, YComponent, ZComponent
subtraction = Subtraction(A=item.Item, B=item.Item1)
X_2 = UnitX(Factor="20")
Z_2 = UnitZ(Factor="-20")
pt_2 = Point(divide.Points)
pt_3 = Point(divide_2.Points)
addition = Addition(A=subtraction, B=pdecon_2.ZComponent)
move = Move(Geometry=pt_2, Motion=X_2)  # -> Geometry, Transform
move_2 = Move(Geometry=pt_3, Motion=Z_2)  # -> Geometry, Transform
expression = Expression(x=range, y=reciprocal_steepness, Expression="1/x^y")
expression_2 = Expression(x=range_2, y=reciprocal_steepness_2, Expression="1/x^y")
dom_4 = ConstructDomain(DomainStart=pdecon_2.ZComponent, DomainEnd=addition)
ln = Line(StartPoint=pt_2, EndPoint=move.Geometry)
xz = XZPlane(Origin=move_2.Geometry)
ln_2 = Line(StartPoint=pt_3, EndPoint=move_2.Geometry)
dom_5 = ConstructDomain(DomainStart=item.Item, DomainEnd=item.Item1)
bnd = Bounds(Numbers=expression)
bnd_2 = Bounds(Numbers=expression_2)
rotate = Rotate(Geometry=xz, Angle=degrees(60), Plane=xz)  # -> Geometry, Transform
remap = RemapNumbers(Value=expression_2, Source=bnd_2, Target=dom_2)  # -> reverse(Mapped), Clipped
xz_2 = XZPlane(Origin=move.Geometry)
round = Round(Number=range_2)  # -> Nearest, Floor, Ceiling
expression_3 = Expression(x=number_slider_5, y=reciprocal_steepness_2, Expression="1/x^y")
expression_4 = Expression(x=Slider(10, range=0..2000), y=reciprocal_steepness, Expression="1/x^y")
remap_2 = RemapNumbers(Value=number_slider_5, Source=dom, Target=dom_5)  # -> Mapped, Clipped
remap_3 = RemapNumbers(Value=expression_3, Source=bnd_2, Target=dom_4)  # -> Mapped, Clipped
rotate_2 = Rotate(Geometry=xz_2, Angle=degrees(0), Plane=xz_2)  # -> Geometry, Transform
roundd = RoundToDecimalPlace(NumberX=remap.Mapped, DecimalPlace=3, RoundType=0)  # -> Rounded, Difference
tag = TextTag3D(Location=rotate.Geometry, Text=round.Nearest, Size=5, Justification=9)
remap_4 = RemapNumbers(Value=expression, Source=bnd, Target=dom_4)  # -> Mapped, Clipped
remap_5 = RemapNumbers(Value=expression_2, Source=bnd_2, Target=dom_4)  # -> Mapped, Clipped
remap_6 = RemapNumbers(Value=expression_4, Source=bnd, Target=dom_2)  # -> Mapped, Clipped
remap_7 = RemapNumbers(Value=expression_3, Source=bnd_2, Target=dom_2)  # -> Mapped, Clipped
tag_2 = TextTag3D(Location=rotate_2.Geometry, Text=roundd.Rounded, Size=5, Justification=7)
pt_4 = ConstructPoint(XCoordinate=pdecon.XComponent, YCoordinate=0, ZCoordinate=remap_4.Mapped)
pt_5 = ConstructPoint(XCoordinate=pdecon.XComponent, YCoordinate=0, ZCoordinate=remap_5.Mapped)
panel = Panel(remap_6.Mapped)
panel_2 = Panel(remap_7.Mapped)
intcrv = Interpolate(Vertices=pt_5, Degree=3, Periodic=False, KnotStyle=1)  # -> Curve, Length, Domain
intcrv_2 = Interpolate(Vertices=pt_4, Degree=3, Periodic=False, KnotStyle=1)  # -> Curve, Length, Domain

# ----
# Intended Curvature
geo = Geometry(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)
preview = CustomPreview(
    Geometry=geo,
    Material={diffuse=RGB(221, 160, 221), emission=RGB(66, 48, 66), shine=0.5, specular=RGB(255, 255, 255), transparency=0})
