# Grasshopper definition Reward testing for FEA.gh (Grasshopper 1.0.8)
# plug-ins: Pufferfish

number_slider = Slider(51, range=0..100)
deform_reward = Slider(10, range=0..100)
deform_reward_2 = Slider(10, range=0..100)
deform_value = Slider(3, range=0..70)
deform_value_2 = Slider(24.28, range=0..70)
steepness = Slider(13, range=0..100)
steepness_2 = Slider(3, range=0..10)
series = Series(Start=0, Step=1, Count=number_slider)
dedomain = DeconstructDomain(Domain="2 to 50")  # -> Start, End
expression = Expression(value=deform_value, low=dedomain.Start, high=dedomain.End, Expression="(value - low) / (high - low)")
smaller = SmallerThan(FirstNumber=deform_value, SecondNumber=dedomain.Start)  # -> SmallerThan, OrEqualTo
larger = LargerThan(FirstNumber=deform_value, SecondNumber=dedomain.End)  # -> LargerThan, OrEqualTo
remap = RemapNumbers(Value=series, Source="2 to 50", Target=Domain(1, 0))  # -> simplify(Mapped), Clipped
smaller_2 = SmallerThan(FirstNumber=remap.Mapped, SecondNumber=0)  # -> SmallerThan, OrEqualTo
larger_2 = LargerThan(FirstNumber=remap.Mapped, SecondNumber=1)  # -> LargerThan, OrEqualTo
repeat = RepeatData(Data=0, Length=number_slider)
repeat_2 = RepeatData(Data=1, Length=number_slider)
expression_2 = Expression(max_reward=deform_reward, t=steepness, steepness=expression, Expression="max_reward *1.5^(-steepness * t)")
p_n_c = PickNChoose(Pattern=smaller_2.SmallerThan, Stream0=remap.Mapped, Stream1=repeat)
p_n_c_2 = PickNChoose(Pattern=larger_2.LargerThan, Stream0=p_n_c, Stream1=repeat_2)
graph = GraphMapper(
    remap.Mapped,
    x0=0,
    x1=1,
    y0=0,
    y1=1,
    container_name="Bezier",
    cpx=[0, 0.5839604735, 0.9951649308, 1],
    cpy=[0, 0, 0.3432077765, 1])
remap_2 = RemapNumbers(Value=graph, Source=Domain(0, 1), Target=deform_reward_2)  # -> Mapped, Clipped
data = Data(remap_2.Mapped)
panel = Panel(data)
filter = StreamFilter(Gate=smaller.SmallerThan, Stream0=expression_2, Stream1=deform_reward)
roundd = RoundToDecimalPlace(NumberX=remap_2.Mapped, DecimalPlace=3, RoundType=0)  # -> Rounded, Difference
concat = Concatenate(FragmentA="Deformation: ", FragmentB=series, FragmentC=".00", FragmentD=" | Reward : ", FragmentE=roundd.Rounded)
filter_2 = StreamFilter(Gate=larger.LargerThan, Stream0=filter, Stream1=0)
data_2 = Data(filter_2)
panel_2 = Panel(data_2)
panel_3 = Panel(concat)
panel_4 = Panel(remap_2.Mapped)
