# Grasshopper definition reward testing for FEA 2.gh (Grasshopper 1.0.8)

number_slider = Slider(2, range=0..100)
number_slider_2 = Slider(50, range=0..100)
number_slider_3 = Slider(10, range=0..10)
dedomain = DeconstructDomain(Domain="2 to 50")  # -> Start, End
range = Range(Domain="70 to 1500", Steps=48)
pt = Point(Point(400, 0, 400))
pt_2 = Point(Point(1000, 0, 400))
range_2 = Range(Domain="1 to 1500", Steps=48)
series = Series(Start=2, Step=1, Count=49)
range_3 = Range(Domain="70 to 1500", Steps=Slider(200, range=0..1000))
pt_3 = Point(Point(400, 0, 400))
pt_4 = Point(Point(1000, 0, 400))
pt_5 = Point(Point(400, 0, 400))
pt_6 = Point(Point(1000, 0, 400))
pt_7 = Point(Point(400, 0, 400))
pt_8 = Point(Point(1000, 0, 400))
series_2 = Series(Start=Slider(50, range=0..100), Step=number_slider_2, Count=expr("x+1", number_slider_3))
smaller = SmallerThan(FirstNumber=number_slider, SecondNumber=dedomain.Start)  # -> SmallerThan, OrEqualTo
larger = LargerThan(FirstNumber=number_slider, SecondNumber=dedomain.End)  # -> LargerThan, OrEqualTo
pdecon = Deconstruct(Point=pt)  # -> XComponent, YComponent, ZComponent
pdecon_2 = Deconstruct(Point=pt_2)  # -> XComponent, YComponent, ZComponent
series_3 = Series(Start=2, Step=1, Count=49)
dedomain_2 = DeconstructDomain(Domain="2 to 50")  # -> Start, End
data = Data([10, 10, 10, 7.660678716, 6.725324059, 6.041026062, 5.487496672, 5.018035932, 4.608651836, 4.245070678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])
pdecon_3 = Deconstruct(Point=pt_3)  # -> XComponent, YComponent, ZComponent
pdecon_4 = Deconstruct(Point=pt_4)  # -> XComponent, YComponent, ZComponent
pdecon_5 = Deconstruct(Point=pt_5)  # -> XComponent, YComponent, ZComponent
pdecon_6 = Deconstruct(Point=pt_6)  # -> XComponent, YComponent, ZComponent
pdecon_7 = Deconstruct(Point=pt_7)  # -> XComponent, YComponent, ZComponent
pdecon_8 = Deconstruct(Point=pt_8)  # -> XComponent, YComponent, ZComponent
number_slider_4 = Slider(1, range=0..10)
dom = ConstructDomain(DomainStart=pdecon.XComponent, DomainEnd=pdecon_2.XComponent)
sqrt = SquareRoot(Value=Slider(27, range=0..100))
dom_2 = ConstructDomain(DomainStart=pdecon_3.XComponent, DomainEnd=pdecon_4.XComponent)
filter = StreamFilter(Gate=smaller.OrEqualTo, Stream0=number_slider, Stream1=dedomain.Start)
dom_3 = ConstructDomain(DomainStart=pdecon_5.XComponent, DomainEnd=pdecon_6.XComponent)
sqrt_2 = SquareRoot(Value=dedomain_2.Start)
sqrt_3 = SquareRoot(Value=dedomain_2.End)
X = UnitX(Factor=series_2)
dom_4 = ConstructDomain(DomainStart=pdecon_7.XComponent, DomainEnd=pdecon_8.XComponent)
panel = Panel(data)
expression = Expression(x=series_2, Expression="1/sqrt(x)")
expression_2 = Expression(x=series_2, Expression="1/x")
expression_3 = Expression(x=series_2, y=Slider(2, range=0..10), Expression="x^y")
division = Division(A=1, B=sqrt_2)
division_2 = Division(A=1, B=sqrt_3)
division_3 = Division(A=1, B=sqrt)
filter_2 = StreamFilter(Gate=larger.OrEqualTo, Stream0=filter, Stream1=dedomain.End)
remap = RemapNumbers(Value=range, Source="70 to 1500", Target=dom)  # -> Mapped, Clipped
pt_9 = ConstructPoint(XCoordinate=X, YCoordinate=0, ZCoordinate=0)
expression_4 = Expression(x=range, y=Slider(1, range=0..10), Expression="y/(x^0.5)")
remap_2 = RemapNumbers(Value=range_2, Source="1 to 1500", Target=dom_2)  # -> Mapped, Clipped
remap_3 = RemapNumbers(Value=range_3, Source="70 to 1500", Target=dom_3)  # -> Mapped, Clipped
remap_4 = RemapNumbers(Value=series_3, Source="2 to 50", Target=dom_4)  # -> Mapped, Clipped
multiplication = Multiplication(A=number_slider_2, B=number_slider_3)
bnd = Bounds(Numbers=expression_2)
multiplication_2 = Multiplication(A=number_slider_2, B=number_slider_3)
multiplication_3 = Multiplication(A=number_slider_2, B=number_slider_3)
expression_5 = Expression(x=range_2, y=Slider(1, range=0..10), z=Slider(0.1, range=0..1), Expression="y/(x^z)")
expression_6 = Expression(x=range_3, y=Slider(1, range=0..10), z=Slider(0.5, range=0..1), Expression="y/(x^z)")
bnd_2 = Bounds(Numbers=expression)
bnd_3 = Bounds(Numbers=expression_3)
dom_5 = ConstructDomain(DomainStart=division_2, DomainEnd=division)
merge = Merge(Data1=dedomain.Start, Data2=dedomain.End, Data3=filter_2)
expression_7 = Expression(x=series_3, y=number_slider_4, Expression="y/(x^0.01)")
expression_8 = Expression(x=series_3, y=number_slider_4, Expression="y/(x^0.5)")
remap_5 = RemapNumbers(Value=expression_2, Source=bnd, Target=multiplication)  # -> reverse(Mapped), Clipped
remap_6 = RemapNumbers(Value=expression, Source=bnd_2, Target=multiplication_2)  # -> reverse(Mapped), Clipped
remap_7 = RemapNumbers(Value=expression_3, Source=bnd_3, Target=multiplication_3)  # -> Mapped, Clipped
expression_9 = Expression(x=merge, Expression="1/sqrt(x)")
remap_8 = RemapNumbers(Value=division_3, Source=dom_5, Target="0 to 10")  # -> Mapped, Clipped
item = ListItem(List=expression_4, Index=0, Wrap=True)  # -> Item1, Item
item_2 = ListItem(List=expression_5, Index=0, Wrap=True)  # -> Item1, Item
item_3 = ListItem(List=expression_6, Index=0, Wrap=True)  # -> Item1, Item
Z = UnitZ(Factor=remap_6.Mapped)
item_4 = ListItem(List=expression_8, Index=0, Wrap=True)  # -> Item1, Item
panel_2 = Panel(remap_6.Mapped)
dom_6 = ConstructDomain(DomainStart=item.Item1, DomainEnd=item.Item)
panel_3 = Panel(remap_8.Mapped)
item_5 = ListItem(List=expression_9, Index=0, Wrap=True)  # -> Item, Item1, Item2
dom_7 = ConstructDomain(DomainStart=item_2.Item1, DomainEnd=item_2.Item)
move = Move(Geometry=pt_9, Motion=Z)  # -> Geometry, Transform
dom_8 = ConstructDomain(DomainStart=item_3.Item1, DomainEnd=item_3.Item)
dom_9 = ConstructDomain(DomainStart=item_4.Item1, DomainEnd=item_4.Item)
dom_10 = ConstructDomain(DomainStart=item_5.Item1, DomainEnd=item_5.Item)
remap_9 = RemapNumbers(Value=expression_4, Source=dom_6, Target="0 to 10")  # -> Mapped, Clipped
remap_10 = RemapNumbers(Value=expression_4, Source=dom_6, Target=dom)  # -> Mapped, Clipped
panel_4 = Panel(remap_10.Mapped)
remap_11 = RemapNumbers(Value=expression_5, Source=dom_7, Target="0 to 10")  # -> Mapped, Clipped
remap_12 = RemapNumbers(Value=expression_5, Source=dom_7, Target=dom_2)  # -> Mapped, Clipped
remap_13 = RemapNumbers(Value=expression_6, Source=dom_8, Target="0 to 10")  # -> Mapped, Clipped
remap_14 = RemapNumbers(Value=expression_6, Source=dom_8, Target=dom_3)  # -> Mapped, Clipped
remap_15 = RemapNumbers(Value=expression_8, Source=dom_9, Target="0 to 10")  # -> Mapped, Clipped
remap_16 = RemapNumbers(Value=expression_8, Source=dom_9, Target=dom_4)  # -> Mapped, Clipped
remap_17 = RemapNumbers(Value=item_5.Item2, Source=dom_10, Target="0 to 10")  # -> Mapped, Clipped
pt_10 = ConstructPoint(XCoordinate=remap.Mapped, YCoordinate=0, ZCoordinate=reverse(remap_10.Mapped))
panel_5 = Panel(remap_2.Mapped)
pt_11 = ConstructPoint(XCoordinate=remap_2.Mapped, YCoordinate=0, ZCoordinate=reverse(remap_12.Mapped))
pt_12 = ConstructPoint(XCoordinate=remap_3.Mapped, YCoordinate=0, ZCoordinate=reverse(remap_14.Mapped))
pt_13 = ConstructPoint(XCoordinate=remap_4.Mapped, YCoordinate=0, ZCoordinate=reverse(remap_16.Mapped))
item_6 = ListItem(List=remap_9.Mapped, Index=[5, 6], Wrap=True)
item_7 = ListItem(List=remap_11.Mapped, Index=[5, 6], Wrap=True)
item_8 = ListItem(List=remap_13.Mapped, Index=[5, 6], Wrap=True)
panel_6 = Panel(remap_17.Mapped)
intcrv = Interpolate(Vertices=pt_10, Degree=2, Periodic=False, KnotStyle=1)  # -> Curve, Length, Domain
item_9 = ListItem(List=item_6, Index=0, Wrap=True)  # -> Item, Item1
intcrv_2 = Interpolate(Vertices=pt_12, Degree=3, Periodic=False, KnotStyle=1)  # -> Curve, Length, Domain
intcrv_3 = Interpolate(Vertices=pt_11, Degree=Slider(3, range=0..10), Periodic=False, KnotStyle=1)  # -> Curve, Length, Domain
intcrv_4 = Interpolate(Vertices=pt_13, Degree=3, Periodic=False, KnotStyle=1)  # -> Curve, Length, Domain
item_10 = ListItem(List=item_7, Index=0, Wrap=True)  # -> Item, Item1
item_11 = ListItem(List=item_8, Index=0, Wrap=True)  # -> Item, Item1
subtraction = Subtraction(A=item_9.Item, B=item_9.Item1)
panel_7 = Panel(series_3)
subtraction_2 = Subtraction(A=item_10.Item, B=item_10.Item1)
subtraction_3 = Subtraction(A=item_11.Item, B=item_11.Item1)
panel_8 = Panel(subtraction)
panel_9 = Panel(remap_15.Mapped)
panel_10 = Panel(subtraction_2)
panel_11 = Panel(subtraction_3)
panel_12 = Panel(remap_9.Mapped)
panel_13 = Panel(remap_11.Mapped)
panel_14 = Panel(remap_13.Mapped)
panel_15 = Panel(range)
panel_16 = Panel(range_2)
panel_17 = Panel(range_3)
