# Grasshopper definition Filtering Test 2.gh (Grasshopper 1.0.8)

data = Data([1, 0.457876, 0])
data_2 = Data([1, 0.180283, 0.825714, 0.525802, 0.363023, 0.677264, 0])
pool_5_fitness = Data(Tree({0;0}: [1, 1, 1, 0, 0.180283], {0;1}: [0.056685, 0.152495, 0.152495, 1, 1], {0;2}: [1, 1, 1, 0, 0.677264], {0;3}: [0.328364, 1, 1, 1, 0.180283], {0;4}: [0.056685, 0.152495, 0.152495, 1, 1], {0;5}: [0.204981, 0.449992, 0.421161, 0.457876, 0.677264]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))
pool_5_data = Data(Tree({0;0}: [479.9904176, 7837.629917, 8066.692261, True, "5,5,5,5,5,5,5,5,5,5,5,5,5,5,5,5,5,5,5,5,5,5,5", -701.8207777, 620.506899, -11.03568259, 80.48465847], {0;1}: ["20", "400", "400", False, "5,5,5,5,5,5,5,5,5,5,5,5,5,5,5,5,5,5,5,5,5,5,5,5"], {0;2}: [175.1256973, 2165.00634, 2133.513735, True, "5,5,5,5,5,5,5,5,5,5,5,5,5,5,5,5,5,5,5,5,5,5,5,5", -307.8452326, 282.2712041, 2.173967752, 34.59826416], {0;3}: [63.18156591, 1675.867408, 1685.881408, True, "5,5,5,5,5,5,5,5,5", -180.880757, 165.099169, 2.611267069, 4.272462848], {0;4}: ["20", "400", "400", False, "5,5,5,5,5,5,5,5,5,5,5,5,5,5,5,5,5,5,5,5,5,5,5,5"], {0;5}: [48.14235816, 743.4691008, 719.5490473, True, "5,5,5,5,5,5,5,5,5,5,5", -124.3315005, 101.3583287, 3.33626088, 13.65055215]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))
arch_fitness_values = Panel(data)
trib_width_fitness_values = Panel(data_2)
item = ListItem(List=pool_5_fitness, Index=4, Wrap=True)  # -> flatten(Item)
item_2 = ListItem(List=pool_5_fitness, Index=3, Wrap=True)  # -> flatten(Item)
tstat = TreeStatistics(Tree=pool_5_fitness)  # -> Paths, Length, Count
mindex = MemberIndex(Set=item, Member=data_2)  # -> simplify(Index), Count
smaller = SmallerThan(FirstNumber=item_2, SecondNumber=0.6)  # -> SmallerThan, OrEqualTo
larger = LargerThan(FirstNumber=item_2, SecondNumber=0.3)  # -> LargerThan, OrEqualTo
and = GateAnd(A=smaller.SmallerThan, B=larger.LargerThan)
item_3 = ListItem(List=tstat.Paths, Index=mindex.Index, Wrap=True)
dispatch = Dispatch(List=tstat.Paths, DispatchPattern=and)  # -> ListA, ListB
item_4 = ListItem(List=pool_5_data, Index=0, Wrap=False)  # -> Item, Item1, Item2, Item3, Item4, Item5, Item6, Item7, Item8
item_5 = TreeItem(Tree=pool_5_fitness, Path=item_3, Index=3, Wrap=True)
mindex_2 = MemberIndex(Set=item_5, Member=data)  # -> Index, Count
lng = ListLength(List=mindex_2.Index)
trim = TrimTree(Tree=mindex_2.Index, Depth=1)
smaller_2 = SmallerThan(FirstNumber=item_4.Item, SecondNumber="1.75")  # -> SmallerThan, OrEqualTo
smaller_3 = SmallerThan(FirstNumber=item_4.Item1, SecondNumber="48.3")  # -> SmallerThan, OrEqualTo
smaller_4 = SmallerThan(FirstNumber=item_4.Item2, SecondNumber="62.1")  # -> SmallerThan, OrEqualTo
larger_2 = LargerThan(FirstNumber=item_4.Item5, SecondNumber="-23.5")  # -> LargerThan, OrEqualTo
smaller_5 = SmallerThan(FirstNumber=item_4.Item6, SecondNumber="23.5")  # -> SmallerThan, OrEqualTo
smaller_6 = SmallerThan(FirstNumber=item_4.Item8, SecondNumber="13.65")  # -> SmallerThan, OrEqualTo
smaller_7 = SmallerThan(FirstNumber=item_4.Item7, SecondNumber="0")  # -> SmallerThan, OrEqualTo
trim_2 = TrimTree(Tree=lng, Depth=1)
item_6 = ListItem(List=item_3, Index=trim, Wrap=True)
partition = PartitionList(List=item_6, Size=trim_2)
and_2 = GateAnd(
    A=smaller_2.SmallerThan,
    B=smaller_3.SmallerThan,
    C=smaller_4.SmallerThan,
    D=larger_2.LargerThan,
    E=smaller_5.SmallerThan,
    F=smaller_6.SmallerThan,
    G=smaller_7.SmallerThan)
tstat_2 = TreeStatistics(Tree=partition)  # -> Paths, Length, Count
repeat = RepeatData(Data=graft(tstat_2.Paths), Length=graft(tstat_2.Length))  # -> simplify(flatten(Data))
flatten = FlattenTree(Tree=partition, Path="{0}")
replace = ReplacePaths(Data=and_2, Search=flatten, Replace=repeat)
dispatch_2 = Dispatch(List=replace, DispatchPattern=replace)  # -> ListA, ListB
lng_2 = ListLength(List=dispatch_2.ListA)
trim_3 = TrimTree(Tree=lng_2, Depth=1)
panel = Panel(trim_3)
