# Grasshopper definition Filtering Test.gh (Grasshopper 1.0.8)

data = Data([1, 0.457876, 0])
data_2 = Data([1, 0.180283, 0.825714, 0.525802, 0.363023, 0.677264, 0])
pool_5_fitness = Data(Tree({0;0}: [1, 1, 1, 0, 0.180283], {0;1}: [0.056685, 0.152495, 0.152495, 1, 1], {0;2}: [1, 1, 1, 0, 0.677264], {0;3}: [0.328364, 1, 1, 1, 0.180283], {0;4}: [0.056685, 0.152495, 0.152495, 1, 1], {0;5}: [0.204981, 0.449992, 0.421161, 0.457876, 0.677264]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))
pool_5_data = Data(Tree({0;0}: [479.9904176, 7837.629917, 8066.692261, True, "5,5,5,5,5,5,5,5,5,5,5,5,5,5,5,5,5,5,5,5,5,5,5", -701.8207777, 620.506899, -11.03568259, 80.48465847], {0;1}: ["20", "400", "400", False, "5,5,5,5,5,5,5,5,5,5,5,5,5,5,5,5,5,5,5,5,5,5,5,5"], {0;2}: [175.1256973, 2165.00634, 2133.513735, True, "5,5,5,5,5,5,5,5,5,5,5,5,5,5,5,5,5,5,5,5,5,5,5,5", -307.8452326, 282.2712041, 2.173967752, 34.59826416], {0;3}: [63.18156591, 1675.867408, 1685.881408, True, "5,5,5,5,5,5,5,5,5", -180.880757, 165.099169, 2.611267069, 4.272462848], {0;4}: ["20", "400", "400", False, "5,5,5,5,5,5,5,5,5,5,5,5,5,5,5,5,5,5,5,5,5,5,5,5"], {0;5}: [48.14235816, 743.4691008, 719.5490473, True, "5,5,5,5,5,5,5,5,5,5,5", -124.3315005, 101.3583287, 3.33626088, 13.65055215]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))
panel = Panel(pool_5_data)
arch_fitness_values = Panel(data)
trib_width_fitness_values = Panel(data_2)
item = ListItem(List=pool_5_fitness, Index=4, Wrap=True)  # -> flatten(Item)
tstat = TreeStatistics(Tree=pool_5_fitness)  # -> Paths, Length, Count
mindex = MemberIndex(Set=item, Member=data_2)  # -> simplify(Index), Count
item_2 = ListItem(List=tstat.Paths, Index=mindex.Index, Wrap=True)
item_3 = ListItem(List=pool_5_data, Index=0, Wrap=False)  # -> Item, Item1, Item2, Item3, Item4, Item5, Item6, Item7, Item8
item_4 = TreeItem(Tree=pool_5_fitness, Path=item_2, Index=3, Wrap=True)
mindex_2 = MemberIndex(Set=item_4, Member=data)  # -> Index, Count
lng = ListLength(List=mindex_2.Index)
trim = TrimTree(Tree=mindex_2.Index, Depth=1)
smaller = SmallerThan(FirstNumber=item_3.Item, SecondNumber="1.75")  # -> SmallerThan, OrEqualTo
smaller_2 = SmallerThan(FirstNumber=item_3.Item1, SecondNumber="48.3")  # -> SmallerThan, OrEqualTo
smaller_3 = SmallerThan(FirstNumber=item_3.Item2, SecondNumber="62.1")  # -> SmallerThan, OrEqualTo
larger = LargerThan(FirstNumber=item_3.Item5, SecondNumber="-23.5")  # -> LargerThan, OrEqualTo
smaller_4 = SmallerThan(FirstNumber=item_3.Item6, SecondNumber="23.5")  # -> SmallerThan, OrEqualTo
smaller_5 = SmallerThan(FirstNumber=item_3.Item8, SecondNumber="13.65")  # -> SmallerThan, OrEqualTo
smaller_6 = SmallerThan(FirstNumber=item_3.Item7, SecondNumber="0")  # -> SmallerThan, OrEqualTo
trim_2 = TrimTree(Tree=lng, Depth=1)
item_5 = ListItem(List=item_2, Index=trim, Wrap=True)
partition = PartitionList(List=item_5, Size=trim_2)
and = GateAnd(
    A=smaller.SmallerThan,
    B=smaller_2.SmallerThan,
    C=smaller_3.SmallerThan,
    D=larger.LargerThan,
    E=smaller_4.SmallerThan,
    F=smaller_5.SmallerThan,
    G=smaller_6.SmallerThan)
tstat_2 = TreeStatistics(Tree=partition)  # -> Paths, Length, Count
tstat_3 = TreeStatistics(Tree=partition)  # -> Paths, Length, Count
item_6 = ListItem(List=tstat_3.Paths, Index=Slider(0, range=0..18), Wrap=True)
repeat = RepeatData(Data=graft(tstat_2.Paths), Length=graft(tstat_2.Length))  # -> simplify(flatten(Data))
flatten = FlattenTree(Tree=partition, Path="{0}")
branch = TreeBranch(Tree=partition, Path=item_6, MaintainPaths=True)
replace = ReplacePaths(Data=and, Search=flatten, Replace=repeat)
branch_2 = TreeBranch(Tree=pool_5_fitness, Path=branch, MaintainPaths=True)
dispatch = Dispatch(List=replace, DispatchPattern=replace)  # -> ListA, ListB
item_7 = ListItem(List=branch_2, Index=[3, 4], Wrap=True)
lng_2 = ListLength(List=dispatch.ListA)
trim_3 = TrimTree(Tree=lng_2, Depth=1)
cset = CreateSet(List=flatten(item_7))  # -> Set, Map
panel_2 = Panel(item_7)
panel_3 = Panel(trim_3)
panel_4 = Panel(cset.Set)
