# Grasshopper definition GA Baseline - Variable Curve.gh (Grasshopper 1.0.8)
# plug-ins: Karamba3D, LunchBox, Wallacei

number_slider = Slider(7, range=7..14)
multiplication = Multiplication(A=number_slider, B=1000)
pt = Point("0,0,0")
X = UnitX(Factor=multiplication)
remap = RemapNumbers(Value=number_slider, Source=Domain(7, 14), Target=Domain(1, 0))  # -> Mapped, Clipped

# ----
# Test 1:
# Max Deform Karamba: 14.541255 centimeter
# Max Deform OpenSeesPy:
# 14.569 centimeter
frames = Data([6, 7, 12, 21, 4, 20, 16, 20, 5, 15, 11, 1, 2, 3, 14, 9, 11, 13, 23, 16, 22, 24, 22, 8, 10])
orientations = Data([0, 2, 2, 3, 6, 6, 6, 6, 0, 1, 4, 4, 3, 4, 7, 6, 7, 3, 2, 0, 1, 7, 5, 3, 6])
shape_grammar = Data(["np.array([6,4,3,1]),", "np.array([7,1,2,1]),", "np.array([12,4,4,0]),", "np.array([21,2,0,0]),", "np.array([4,2,1,0]),", "np.array([20,4,0,0]),", "np.array([16,2,2,1]),", "np.array([5,4,3,0]),", "np.array([15,0,4,1]),", "np.array([11,1,2,0]),", "np.array([1,4,2,1]),", "np.array([2,0,3,0]),", "np.array([3,1,3,0]),"])

# ----
# Test 2:
# Max Deform Karamba: 9.67039 centimeter
# Max Deform OpenSeesPy:
# 8.638 centimeter
frames_2 = Data([4, 15, 15, 5, 1, 13, 19, 12, 4, 24, 4, 12, 11, 24, 19, 23, 11, 24, 22, 19, 16, 20, 12, 9, 13])
orientations_2 = Data([2, 6, 6, 1, 3, 1, 4, 6, 2, 2, 0, 5, 5, 6, 1, 5, 1, 2, 6, 2, 4, 4, 4, 7, 7])
shape_grammar_2 = Data(["np.array([4,4,4,0]),", "np.array([15,1,3,1]),", "np.array([5,0,1,0]),", "np.array([1,4,2,0]),", "np.array([13,3,2,1]),", "np.array([19,3,4,0]),", "np.array([12,2,0,1]),", "np.array([24,3,1,1]),", "np.array([11,3,2,1]),", "np.array([23,1,4,1]),", "np.array([22,0,0,1]),", "np.array([16,3,2,0]),", "np.array([20,3,0,0]),"])

move = Move(Geometry=pt, Motion=X)  # -> Geometry, Transform
avr = Average(Input=[pt, move.Geometry])
Z = UnitZ(Factor=1000)
move_2 = Move(Geometry=avr, Motion=Z)  # -> Geometry, Transform
picked_frame = GenePool(Decimals=0, Maximum=34, Minimum=0, Value=[25, 28, 33, 6, 29, 29, 29, 31, 3, 10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])
merge = Merge(Data1=pt, Data2=move_2.Geometry, Data3=move.Geometry)
intcrv = Interpolate(Vertices=merge, Degree=3, Periodic=False, KnotStyle=1)  # -> Curve, Length, Domain
picked_orientation = GenePool(Decimals=0, Maximum=24, Minimum=0, Value=[22, 3, 23, 21, 7, 9, 7, 11, 19, 18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])
# Next steps before continuing here:
# 
# Push git, check baseline
# 
# Increase termination radius, maybe.
# 
# Add logic for HT connections because I don't want them to make those really big connections with longer elements.
genes = GenePool(Decimals=0, Maximum=1, Minimum=0, Value=[1, 1, 1, 1, 1])
progress_weight = Slider(1, range=1..3)
distance_weight = Slider(1, range=1..3)
rank_window = Slider(25, range=0..50)

# ----
# Tension Cables
panel = Panel("12700")
mm = Slider(18, range=0..100)
num = Number(panel)
matprops = MaterialPropertiesKaramba3D(
    FamilyOfMaterial="Tension_Steel",
    Name="Simple_Cable",
    YoungsModulus_kN_cm²=num,
    InPlaneShearModulus_kN_cm²="4884.4",
    TransverseShearModulus_kN_cm²="4884.4",
    SpecificWeight_kN_m³="81.31",
    CoefficientOfThermalExpansion_1=1.2e-05,
    TensileStrength_kN_cm²="13.65",
    CompressiveStrength_kN_cm²="0",
    StrengthHypothesis="MISES",
    mode="Isotrop")
crosec = CrossSectionKaramba3D(
    FamilyNameOfCrossSection="DefaultCroSec",
    Material=matprops,
    Diameter_cm=expr("x/10", mm),
    WallThickness_cm=expr("x/20", mm),
    mode="Circular Hollow")

panel_2 = Panel("C:\Users\rensh\Documents\Master Thesis\REP_STRUC RL\Datasets\Bike Frames\FRAMED_new_set_35_crs.csv")
file = ReadFile(File=panel_2, PerLineParse=True)
csv = ReadCSV(CSVString=file, Delimiter=",", DataStruct=False)  # -> Headers, Values
cluster = Cluster_2(x=csv.Values)  # -> path_mapper_7, path_mapper_8, path_mapper_11, path_mapper_9, path_mapper_10, path_mapper_12

strict_termination = BooleanToggle(False)
panel_3 = Panel("70")

# ----
# Connection Material
number_slider_2 = Slider(0.5, range=0..10)
matselect = MaterialSelectionKaramba3D(menu=[dropdown(1), dropdown(4)])
crosec_2 = CrossSectionKaramba3D(
    FamilyNameOfCrossSection="DefaultCroSec",
    Material=matselect,
    Diameter_cm=Slider(3, range=0..10),
    WallThickness_cm=number_slider_2,
    mode="Circular Hollow")

addition = Addition(A=multiplication, B=1000)
py3 = Python3Script(
    custom_curve=intcrv.Curve,
    allowed_connections=genes,
    allow_orientation_wrapping=Toggle(False),
    picked_frame=picked_frame,
    picked_orientation=picked_orientation,
    rank_window=rank_window,
    progress_weight=progress_weight,
    distance_weight=distance_weight,
    strict_termination=strict_termination)  # -> out, guide_curve_out, placed_frames_out, bridge_points_out, action_log_out, remaining_options_out, reuse_skips, no_progress_skips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; inputs custom_curve: Curve, allowed_connections: list, allow_orientation_wrapping: Boolean, picked_frame: list of Int32, picked_orientation: list of Int32, rank_window: Int32, progress_weight: Double, distance_weight: Double, strict_termination: Boolean
# ---------- py3: Python ----------
"""
Grasshopper Python 3 component script — the only file here touching Rhino.
Stock/curve load from IV.frames_v0 / IV.arch_v0 (same as RL training),
unless an optional custom curve is supplied.

Inputs:  picked_frame, picked_orientation (required, list[int])
         rank_window, progress_weight, distance_weight, strict_termination (optional)
         allowed_connections (optional, 5-item binary list, TT/HT/DT/CS/SS_MID order)
         custom_curve (optional, planar Rhino curve in the XZ plane, or None)
         If connected, it replaces the RL guide curve (IV.arch_v0). It is still
         shifted so its start sits at IV.origin_position, then resampled to
         IV.curve_samples, exactly like the RL curve.

Outputs: placed_frames_out, action_log_out, remaining_options_out, bridge_points_out,
         connections_out, guide_curve_out, tt_out/ht_out/dt_out/cs_out/ss_out/st_out
         (tube trees), pin_out, roller_out (single points), tension_cable_out,
         load_points_out, reuse_skips, no_progress_skips, no_intersect_skips,
         terminated, true_termination, overshot, steps_completed
         action_log_out: one branch per placed frame, [frame, target, candidate,
         mirror] as ints (target/candidate 0-4 = TT/HT/DT/CS/SS_MID, mirror 0/1).
         remaining_options_out: one int per non-reuse step (0 for skipped steps).
         tension_cable_out: one branch per tension line, 2 points each.
         load_points_out: flat Point3d list (empty if load_valid is False).
         guide_curve_out: the curve actually used (RL or custom), after shift/resample.
         All other *_out Point3d trees are one branch per frame/element; empty
         if no BikeBridge was built (run didn't reach true_termination). pin_out
         and roller_out are None under the same condition.
"""

import sys
sys.path.append(r"C:\Users\rensh\Documents\Master Thesis\REP_STRUC RL\RL Application")
sys.path.append(r"C:\Users\rensh\Documents\Master Thesis\REP_STRUC RL\Main Deployment")

import Rhino.Geometry as rg
import ghpythonlib.treehelpers as th
import importlib
import csv
import numpy as np

import Baseline_GA_Core
import Baseline_GA_Utilities
import environment.envs.BikeBuilder_Classes
import environment.envs.BikeBuilder_Utilities
import internal_variables

importlib.reload(internal_variables)
importlib.reload(environment.envs.BikeBuilder_Classes)
importlib.reload(environment.envs.BikeBuilder_Utilities)
importlib.reload(Baseline_GA_Core)
importlib.reload(Baseline_GA_Utilities)

from internal_variables import IV
from environment.envs.BikeBuilder_Classes import BikeFrame, PointDict
from environment.envs.BikeBuilder_Utilities import resample_curve
from Baseline_GA_Core import run_baseline_ga, RANK_WINDOW_DEFAULT
from Baseline_GA_Utilities import placed_frames_to_point_tuples, bridge_points_to_tuples

# =============================================================================
# CSV HELPERS — stdlib, no pandas (not installed in GH venv)
# =============================================================================

def _read_csv_rows(path):
    with open(path, newline='') as f:
        return list(csv.DictReader(f))

# =============================================================================
# CUSTOM CURVE HELPER
# =============================================================================

def _rhino_curve_to_xz(curve, n_dense=1000, planar_tol=0.1):
    # Even arc-length samples, start -> end, as (x, z). Requires a curve in the XZ plane.
    params = curve.DivideByCount(n_dense, True)
    assert params is not None, (
        "custom_curve could not be divided - check that it is a valid, non-degenerate curve."
    )
    points = [curve.PointAt(t) for t in params]
    y_values = [p.Y for p in points]
    assert max(y_values) - min(y_values) < planar_tol, (
        f"custom_curve must lie in the XZ plane (constant Y); Y varies by "
        f"{max(y_values) - min(y_values):.3f} mm."
    )
    return np.array([[p.X, p.Z] for p in points], dtype=np.float32)

# =============================================================================
# DATA LOADING — same sources as RL training (IV.frames_v0, IV.arch_v0)
# =============================================================================

frame_rows = _read_csv_rows(IV.frames_v0)
frame_stock = []
for row in frame_rows:
    corners = np.array([
        [float(row["ST_TOP_X"]),    float(row["ST_TOP_Z"])],
        [float(row["HT_TOP_X"]),    float(row["HT_TOP_Z"])],
        [float(row["HT_BOTTOM_X"]), float(row["HT_BOTTOM_Z"])],
        [float(row["BB_X"]),        float(row["BB_Z"])],
        [float(row["CS_SS_X"]),     float(row["CS_SS_Z"])],
    ], dtype=np.float32)
    frame_stock.append(BikeFrame(corners))

# +++ Optional custom guide curve (GH input `custom_curve`: Rhino curve or None)
_custom_curve = custom_curve if 'custom_curve' in dir() else None  # noqa: F821

if _custom_curve is not None:
    raw_guide_curve = _rhino_curve_to_xz(_custom_curve)
else:
    curve_rows = _read_csv_rows(IV.arch_v0)
    raw_guide_curve = np.array([
        [float(row["x_cord"]), float(row["z_cord"])]
        for row in curve_rows
    ], dtype=np.float32)
# --- (shift + resample below apply to both sources)

# Shift curve start to IV.origin_position, matching BB_arch_environment.__init__.
shift = np.array(IV.origin_position, dtype=np.float32) - raw_guide_curve[0]
raw_guide_curve = (raw_guide_curve + shift).astype(np.float32)

sampled_guide_curve = resample_curve(raw_guide_curve, IV.curve_samples)

# =============================================================================
# OPTIONAL GH INPUT HANDLING
# =============================================================================

_rank_window = rank_window if 'rank_window' in dir() and rank_window else RANK_WINDOW_DEFAULT  # noqa: F821
_progress_weight = progress_weight if 'progress_weight' in dir() and progress_weight else 1.0  # noqa: F821
_distance_weight = distance_weight if 'distance_weight' in dir() and distance_weight else 1.0  # noqa: F821
_strict_termination = bool(strict_termination) if 'strict_termination' in dir() else False  # noqa: F821

# allowed_connections: optional 5-item binary list (1=allowed, 0=disallowed),
# in TT/HT/DT/CS/SS_MID order, matching PointDict's own value order exactly.
# A 0 excludes that point from BOTH target and candidate roles when the 50
# orientations are generated — not filtered after the fact. Left unconnected
# or all-1s, every point stays allowed (unchanged, full-50 behaviour).
if 'allowed_connections' in dir() and allowed_connections:
    _raw_allowed = list(allowed_connections)
    assert len(_raw_allowed) == 5, (
        f"allowed_connections must have exactly 5 items (TT/HT/DT/CS/SS_MID), "
        f"got {len(_raw_allowed)}."
    )
    _allowed_points = {PointDict(i) for i, flag in enumerate(_raw_allowed) if flag}
else:
    _allowed_points = None  # None -> enumerate_orientations() defaults to all 5

# =============================================================================
# RUN
# =============================================================================
allow_orientation = allow_orientation_wrapping
result = run_baseline_ga(
    frame_stock            = frame_stock,
    guide_curve            = sampled_guide_curve,
    picked_frame           = list(picked_frame),          # noqa: F821 (GH input)
    picked_orientation     = list(picked_orientation),      # noqa: F821 (GH input)
    progress_weight        = _progress_weight,
    distance_weight        = _distance_weight,
    rank_window            = _rank_window,
    strict_termination     = _strict_termination,
    allowed_points         = _allowed_points,
    wrap_orientation       = allow_orientation
)

# =============================================================================
# OUTPUT CONVERSION
# =============================================================================

def _point_tuples_to_tree(nested_tuples):
    # list[list[(x, z)]] -> Point3d tree, one branch per outer entry, XZ-plane.
    nested_points = [
        [rg.Point3d(x, 0.0, z) for (x, z) in branch]
        for branch in nested_tuples
    ]
    return th.list_to_tree(nested_points)

def _bridge_connections_to_tuples(bike_bridge):
    # Flattens bike_bridge.connections (per-frame-pair -> up to 2 connector
    # entries) into one flat list of coordinate tuples, one per polyline. Each
    # entry can resolve to 2 or 3 points depending on BikeBridge's own pruning
    # (dropped perpendicular inserts, connection-length limiting) — the loop
    # below handles either length, no fixed-triple assumption.
    triples_out = []
    for connection_set in bike_bridge.connections:
        for triple in connection_set:
            resolved_points = [
                (float(bike_bridge.points[frame_idx][local_idx][0]),
                 float(bike_bridge.points[frame_idx][local_idx][1]))
                for frame_idx, local_idx in triple
            ]
            triples_out.append(resolved_points)
    return triples_out

def _tube_to_tuples(bike_bridge, per_frame_local_indices):
    # Resolves a BikeBridge per-tube index property (list[list[int]], one
    # inner list per frame) into one coordinate-tuple branch per frame.
    branches_out = []
    for frame_idx, local_indices in enumerate(per_frame_local_indices):
        frame_points = bike_bridge.points[frame_idx]
        branch = [
            (float(frame_points[local_idx][0]), float(frame_points[local_idx][1]))
            for local_idx in local_indices
        ]
        branches_out.append(branch)
    return branches_out

def _support_to_point(bike_bridge, support_id):
    # Resolves a BikeBridge support id (single (frame_idx, local_idx) tuple,
    # as returned by bike_bridge.pin / bike_bridge.roller) to one Point3d.
    frame_idx, local_idx = support_id
    x, z = bike_bridge.points[frame_idx][local_idx]
    return rg.Point3d(float(x), 0.0, float(z))

def _tension_lines_to_tuples(bike_bridge):
    # Resolves bike_bridge.tension_lines (list of (id_a, id_b) pairs, each id
    # a (frame_idx, local_idx)) into one 2-point coordinate branch per line.
    branches_out = []
    for id_a, id_b in bike_bridge.tension_lines:
        points = []
        for frame_idx, local_idx in (id_a, id_b):
            x, z = bike_bridge.points[frame_idx][local_idx]
            points.append((float(x), float(z)))
        branches_out.append(points)
    return branches_out

def _load_points_to_list(bike_bridge):
    # Resolves bike_bridge.load_points (flat list of (frame_idx, local_idx)
    # ids) into a flat list of Point3d — same shape as guide_curve_out, since
    # these are standalone points, not polylines. Empty if load_valid is
    # False; that degrades naturally from load_points already being [] then.
    points_out = []
    for frame_idx, local_idx in bike_bridge.load_points:
        x, z = bike_bridge.points[frame_idx][local_idx]
        points_out.append(rg.Point3d(float(x), 0.0, float(z)))
    return points_out

placed_frames_out = _point_tuples_to_tree(
    placed_frames_to_point_tuples(result.placed_frames)
)

action_log_out = th.list_to_tree(result.action_log)

remaining_options_out = list(result.remaining_options)

guide_curve_out = [rg.Point3d(float(x), 0.0, float(z)) for (x, z) in sampled_guide_curve]

if result.bike_bridge is not None:
    bridge_points_out = _point_tuples_to_tree(
        bridge_points_to_tuples(result.bike_bridge)
    )
    connections_out = _point_tuples_to_tree(
        _bridge_connections_to_tuples(result.bike_bridge)
    )
    tt_out = _point_tuples_to_tree(_tube_to_tuples(result.bike_bridge, result.bike_bridge.top_tubes))
    ht_out = _point_tuples_to_tree(_tube_to_tuples(result.bike_bridge, result.bike_bridge.head_tubes))
    dt_out = _point_tuples_to_tree(_tube_to_tuples(result.bike_bridge, result.bike_bridge.down_tubes))
    cs_out = _point_tuples_to_tree(_tube_to_tuples(result.bike_bridge, result.bike_bridge.chain_stays))
    ss_out = _point_tuples_to_tree(_tube_to_tuples(result.bike_bridge, result.bike_bridge.seat_stays))
    st_out = _point_tuples_to_tree(_tube_to_tuples(result.bike_bridge, result.bike_bridge.seat_tubes))
    pin_out = _support_to_point(result.bike_bridge, result.bike_bridge.pin)
    roller_out = _support_to_point(result.bike_bridge, result.bike_bridge.roller)
    tension_cable_out = _point_tuples_to_tree(_tension_lines_to_tuples(result.bike_bridge))
    load_points_out = _load_points_to_list(result.bike_bridge)
else:
    bridge_points_out = _point_tuples_to_tree([])
    connections_out    = _point_tuples_to_tree([])
    tt_out = _point_tuples_to_tree([])
    ht_out = _point_tuples_to_tree([])
    dt_out = _point_tuples_to_tree([])
    cs_out = _point_tuples_to_tree([])
    ss_out = _point_tuples_to_tree([])
    st_out = _point_tuples_to_tree([])
    pin_out = None
    roller_out = None
    tension_cable_out = _point_tuples_to_tree([])
    load_points_out = []

reuse_skips        = result.tally.reuse_skips
no_progress_skips  = result.tally.no_progress_skips
no_intersect_skips = result.tally.no_intersect_skips
terminated         = result.tally.terminated
true_termination    = result.tally.true_termination
overshot            = result.tally.overshot
steps_completed      = result.tally.steps_completed

# =============================================================================
# IV Outputs
# =============================================================================
deck_range_1      = IV.deck_range[0]
deck_range_2      = IV.deck_range[1]
deck_range        = [deck_range_1, deck_range_2]
tributary_width      = IV.tributary_width
termination_vicinity = IV.termination_vicinity
# ---------- end py3 ----------
# Add supports
# Do an assembly check with only gravity
# See how I can use the SLS self-weight multiplier easily.
# 
# Then:
# Cables
# Force points
# Loading of force points
# 
# Then:
# Conditional FEA firing
dom = ConstructDomain(DomainStart=0, DomainEnd=addition)
and = GateAnd(A=py3.terminated, B=py3.true_termination)
pt_2 = Point(py3.load_points_out)
number_slider_3 = Slider(1, range=0..10)
pline = PolyLine(Vertices=py3.placed_frames_out, Closed=True)
panel_4 = Panel("""1.30
0.866
0.650
0.520
0.433
0.371
0.325""")
tributary_width = Slider(6, range=0..6)

# ----
# Pre-FEA Visualizer
swatch = ColourSwatch(SwatchColor=RGB(255, 0, 238))
intcrv_2 = Interpolate(Vertices=py3.guide_curve_out, Degree=3, Periodic=False, KnotStyle=1)  # -> Curve, Length, Domain
item = ListItem(List=py3.guide_curve_out, Index=-1, Wrap=True)
pline_2 = PolyLine(Vertices=py3.tension_cable_out, Closed=False)  # -> flatten(Polyline)
pline_3 = PolyLine(Vertices=py3.connections_out, Closed=False)  # -> flatten(Polyline)
cluster_2 = Cluster(V_3=py3.st_out, V_4=py3.tt_out, V_5=py3.ht_out, V_6=py3.dt_out, V=py3.cs_out, V_2=py3.ss_out)  # -> R, R_2
pl = ConstructPlane(Origin=item, XAxis=Vector(1, 0, 0), YAxis=Vector(0, 0, 1))
cir = Circle(Plane=pl, Radius=py3.termination_vicinity)
preview = CustomPreview(Geometry=cluster_2.R, Material=simplify(cluster_2.R_2))
preview_2 = CustomPreview(
    Geometry=intcrv_2.Curve,
    Material={diffuse=RGB(221, 160, 221), emission=RGB(66, 48, 66), shine=0.5, specular=RGB(255, 255, 255), transparency=0})
preview_3 = CustomPreview(
    Geometry=cir,
    Material={diffuse=RGB(221, 160, 221), emission=RGB(66, 48, 66), shine=0.5, specular=RGB(255, 255, 255), transparency=0})
preview_4 = CustomPreview(Geometry=pline_2, Material=swatch)
preview_5 = CustomPreview(Geometry=pline_3, Material=ColourSwatch(SwatchColor=RGB(255, 153, 0)))

deck_range = Panel("""0
8000""")
series = Series(Start=0, Step=1, Count=number_slider_3)
tributary_depth = Slider(0.325, range=0..10)
uls_kn_m2 = Slider(7.35, range=0..10)

# ----
# Connections
tstat = TreeStatistics(Tree=py3.connections_out)  # -> Paths, Length, Count
series_2 = Series(Start=0, Step=1, Count=tstat.Count)
pline_4 = PolyLine(Vertices=py3.connections_out, Closed=False)  # -> flatten(Polyline)
concat = Concatenate(FragmentA="CON_", FragmentB=series_2)
lineelem = CreateLinearElementKaramba3D(
    Line=pline_4,
    Colour=ColourSwatch(SwatchColor=RGB(255, 153, 0)),
    Identifier=concat,
    CrossSection=crosec_2,
    LimitDistance_mm=0.005,
    BucklingLengthY_mm=-1,
    BucklingLengthZ_mm=-1,
    BucklingLengthLT_mm=-1,
    Bending=True,
    ToPolylineMaxAngle=0.25,
    ToPolylineTolerance=0.1,
    ToPolylineMaxEdgeLength=0.25,
    New=True,
    Remove=True,
    mode="LineToBeam")  # -> Element, Points, Info

# ----
# Seat Tube
item_2 = ListItem(List=py3.action_log_out, Index=0, Wrap=True)  # -> flatten(Item)
pline_5 = PolyLine(Vertices=py3.st_out, Closed=False)  # -> flatten(Polyline)
concat_2 = Concatenate(FragmentA="ST_", FragmentB=item_2)
item_3 = ListItem(List=cluster.path_mapper_7, Index=item_2, Wrap=True)
lineelem_2 = CreateLinearElementKaramba3D(
    Line=simplify(graft(pline_5)),
    Colour=ColourSwatch(SwatchColor=RGB(170, 0, 255)),
    Identifier=simplify(graft(concat_2)),
    CrossSection=simplify(graft(item_3)),
    LimitDistance_mm=0.005,
    BucklingLengthY_mm=-1,
    BucklingLengthZ_mm=-1,
    BucklingLengthLT_mm=-1,
    Bending=True,
    ToPolylineMaxAngle=0.25,
    ToPolylineTolerance=0.1,
    ToPolylineMaxEdgeLength=0.25,
    New=True,
    Remove=True,
    mode="LineToBeam")  # -> flatten(Element), Points, Info

# ----
# Top Tube
item_4 = ListItem(List=py3.action_log_out, Index=0, Wrap=True)  # -> flatten(Item)
pline_6 = PolyLine(Vertices=py3.tt_out, Closed=False)  # -> flatten(Polyline)
concat_3 = Concatenate(FragmentA="ST_", FragmentB=item_4)
item_5 = ListItem(List=cluster.path_mapper_8, Index=item_4, Wrap=True)
lineelem_3 = CreateLinearElementKaramba3D(
    Line=simplify(graft(pline_6)),
    Colour=ColourSwatch(SwatchColor=RGB(0, 34, 255)),
    Identifier=simplify(graft(concat_3)),
    CrossSection=simplify(graft(item_5)),
    LimitDistance_mm=0.005,
    BucklingLengthY_mm=-1,
    BucklingLengthZ_mm=-1,
    BucklingLengthLT_mm=-1,
    Bending=True,
    ToPolylineMaxAngle=0.25,
    ToPolylineTolerance=0.1,
    ToPolylineMaxEdgeLength=0.25,
    New=True,
    Remove=True,
    mode="LineToBeam")  # -> flatten(Element), Points, Info

# ----
# Head Tube
item_6 = ListItem(List=py3.action_log_out, Index=0, Wrap=True)  # -> flatten(Item)
pline_7 = PolyLine(Vertices=py3.ht_out, Closed=False)  # -> flatten(Polyline)
concat_4 = Concatenate(FragmentA="ST_", FragmentB=item_6)
item_7 = ListItem(List=cluster.path_mapper_11, Index=item_6, Wrap=True)
lineelem_4 = CreateLinearElementKaramba3D(
    Line=simplify(graft(pline_7)),
    Colour=ColourSwatch(SwatchColor=RGB(0, 255, 255)),
    Identifier=simplify(graft(concat_4)),
    CrossSection=simplify(graft(item_7)),
    LimitDistance_mm=0.005,
    BucklingLengthY_mm=-1,
    BucklingLengthZ_mm=-1,
    BucklingLengthLT_mm=-1,
    Bending=True,
    ToPolylineMaxAngle=0.25,
    ToPolylineTolerance=0.1,
    ToPolylineMaxEdgeLength=0.25,
    New=True,
    Remove=True,
    mode="LineToBeam")  # -> flatten(Element), Points, Info

# ----
# Down Tube
item_8 = ListItem(List=py3.action_log_out, Index=0, Wrap=True)  # -> flatten(Item)
pline_8 = PolyLine(Vertices=py3.dt_out, Closed=False)  # -> flatten(Polyline)
concat_5 = Concatenate(FragmentA="ST_", FragmentB=item_8)
item_9 = ListItem(List=cluster.path_mapper_9, Index=item_8, Wrap=True)
lineelem_5 = CreateLinearElementKaramba3D(
    Line=simplify(graft(pline_8)),
    Colour=ColourSwatch(SwatchColor=RGB(51, 255, 0)),
    Identifier=simplify(graft(concat_5)),
    CrossSection=simplify(graft(item_9)),
    LimitDistance_mm=0.005,
    BucklingLengthY_mm=-1,
    BucklingLengthZ_mm=-1,
    BucklingLengthLT_mm=-1,
    Bending=True,
    ToPolylineMaxAngle=0.25,
    ToPolylineTolerance=0.1,
    ToPolylineMaxEdgeLength=0.25,
    New=True,
    Remove=True,
    mode="LineToBeam")  # -> flatten(Element), Points, Info

# ----
# Chain Stay
item_10 = ListItem(List=py3.action_log_out, Index=0, Wrap=True)  # -> flatten(Item)
pline_9 = PolyLine(Vertices=py3.cs_out, Closed=False)  # -> flatten(Polyline)
concat_6 = Concatenate(FragmentA="ST_", FragmentB=item_10)
item_11 = ListItem(List=cluster.path_mapper_10, Index=item_10, Wrap=True)
lineelem_6 = CreateLinearElementKaramba3D(
    Line=simplify(graft(pline_9)),
    Colour=ColourSwatch(SwatchColor=RGB(255, 187, 0)),
    Identifier=simplify(graft(concat_6)),
    CrossSection=simplify(graft(item_11)),
    LimitDistance_mm=0.005,
    BucklingLengthY_mm=-1,
    BucklingLengthZ_mm=-1,
    BucklingLengthLT_mm=-1,
    Bending=True,
    ToPolylineMaxAngle=0.25,
    ToPolylineTolerance=0.1,
    ToPolylineMaxEdgeLength=0.25,
    New=True,
    Remove=True,
    mode="LineToBeam")  # -> flatten(Element), Points, Info

# ----
# Seat Stay
item_12 = ListItem(List=py3.action_log_out, Index=0, Wrap=True)  # -> flatten(Item)
pline_10 = PolyLine(Vertices=py3.ss_out, Closed=False)  # -> flatten(Polyline)
concat_7 = Concatenate(FragmentA="ST_", FragmentB=item_12)
item_13 = ListItem(List=cluster.path_mapper_12, Index=item_12, Wrap=True)
lineelem_7 = CreateLinearElementKaramba3D(
    Line=simplify(graft(pline_10)),
    Colour=ColourSwatch(SwatchColor=RGB(238, 255, 0)),
    Identifier=simplify(graft(concat_7)),
    CrossSection=simplify(graft(item_13)),
    LimitDistance_mm=0.005,
    BucklingLengthY_mm=-1,
    BucklingLengthZ_mm=-1,
    BucklingLengthLT_mm=-1,
    Bending=True,
    ToPolylineMaxAngle=0.25,
    ToPolylineTolerance=0.1,
    ToPolylineMaxEdgeLength=0.25,
    New=True,
    Remove=True,
    mode="LineToBeam")  # -> flatten(Element), Points, Info

item_14 = ListItem(List=panel_4, Index=tributary_width, Wrap=True)
remap_2 = RemapNumbers(Value=tributary_width, Source=Domain(0, 6), Target=Domain(0, 1))  # -> Mapped, Clipped

# ----
# Supports
supp = SupportKaramba3D(PosInd=py3.pin_out, Ct_kN_m=Vector(0, 0, 0), Cr_kNm_rad=Vector(0, 0, 0), menu=[buttons(on, on, on, on, off, on)])
supp_2 = SupportKaramba3D(PosInd=py3.roller_out, Ct_kN_m=Vector(0, 0, 0), Cr_kNm_rad=Vector(0, 0, 0), menu=[buttons(off, on, on, on, off, on)])

cluster_3 = Cluster_3(P=py3.load_points_out, I=dom)
division = Division(A=cluster_3, B=1000)
multiplication_2 = Multiplication(A=item_14, B=division)
multiplication_3 = Multiplication(A=uls_kn_m2, B=multiplication_2)
list = ValueList({"Load_Case_Gravity", "Load_Case_Gravity_ULS", "Load_Case_ULS"}, selected="Load_Case_Gravity")
vec = VectorXYZ(XComponent=0, YComponent=0, ZComponent=expr("-x", multiplication_3))  # -> Vector, Length
loads = LoadsKaramba3D(ForceVector=flatten(vec.Vector), Local=False, PosInd=flatten(py3.load_points_out), LCase="Load_Case_ULS", mode="Point")

simplify = SimplifyTree(Tree=py3.st_out, Front=False)
tstat_2 = TreeStatistics(Tree=simplify(simplify))  # -> Paths, Length, Count
merge_2 = Merge(Data1=supp, Data2=supp_2)
item_15 = ListItem(List=tstat_2.Paths, Index=[0, -1], Wrap=True)
panel_5 = Panel("""Load_Case_Gravity_ULS
Load_Case_ULS""")
split = SplitTree(Data=simplify, Masks=flatten(item_15))  # -> Positive, Negative

# ----
# THIS MIGHT BE VERY WRONG
panel_6 = Panel("Load_Case_Gravity_ULS")
loads_2 = LoadsKaramba3D(Vector="0,0,-1.35", LCase=panel_6, mode="Gravity")

loads_3 = LoadsKaramba3D(Vector=Vector(0, 0, -1), LCase="Load_Case_Gravity", mode="Gravity")

supp_3 = SupportKaramba3D(
    PosInd=flatten(split.Negative),
    Ct_kN_m=Vector(0, 0, 0),
    Cr_kNm_rad=Vector(0, 0, 0),
    menu=[buttons(off, on, off, off, off, off)])
merge_3 = Merge(Data1=merge_2, Data2=supp_3)
panel_7 = Panel(multiplication_3)
merge_4 = Merge(Data1=flatten(loads), Data2=flatten(loads_3))
list_2 = ValueList({"Load_Case_ULS"}, selected="Load_Case_ULS")
merge_5 = Merge(
    Data1=flatten(concat_2),
    Data2=flatten(concat_3),
    Data3=flatten(concat_4),
    Data4=flatten(concat_5),
    Data5=flatten(concat_6),
    Data6=flatten(concat_7))
frame_ids = Data(merge_5)
connection_ids = Data(concat)
merge_6 = Merge(Data1=frame_ids, Data2=connection_ids)  # -> flatten(Result)
non_convergent_objective_scores = Panel("""20
400
400""")
objective_normalization_ranges = Panel("""0 to 100
0 to 1000
0 to 1000""")
item_16 = ListItem(List=objective_normalization_ranges, Index=0, Wrap=True)  # -> Item, Item1, Item2
item_17 = ListItem(List=non_convergent_objective_scores, Index=0, Wrap=True)  # -> Item, Item1, Item2
merge_7 = Merge()
gen_count = Slider(50, range=0..100)
gen_size = Slider(50, range=0..100)

xz = XZPlane(Origin="10000, 0, 10000")
rectangle = Rectangle(Plane=xz, XSize=Domain(0, 10000), YSize=Domain(0, 3000), Radius=0)  # -> Rectangle, Length
area = Area(Geometry=rectangle.Rectangle)  # -> Area, Centroid
arrrec = RectangularArray(Geometry=area.Centroid, Cell=rectangle.Rectangle, XCount=Slider(5, range=0..20), YCount=Slider(10, range=0..20))  # -> Geometry, Transform
pt_3 = Point(Point(4050, 0, 1070))
vec2pt = Vector2Pt(PointA=pt_3, PointB=arrrec.Geometry, Unitize=False)  # -> simplify(graft(Vector)), Length

# ----
# Ran with 8 options and no action wrapping
trib_width_analysis = Data(Tree({0}: [97.61914361, "20", 3.275361537, "20", 4.202921134, "20"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], {1}: [3250.677344, "400", 52.55057185, "400", 337.4580971, "400"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], {2}: [3060.916812, "400", 63.01994328, "400", 383.9169578, "400"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], {3}: ["0.866", "0.371", "0.371", "0.371", "0.866", "0.866"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]))
# Ran with 25 options and no action wrapping
trib_width_analysis_2 = Data(Tree({0}: [41.23540693, "20", 86.14107407, "20", "20", "20"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], {1}: [775.6492175, "400", 911.7258057, "400", "400", "400"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], {2}: [777.0418651, "400", 898.2260666, "400", "400", "400"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], {3}: ["0.866", "0.371", "0.371", "0.371", "0.866", "0.866"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]))
# Ran with 10 options and no action wrapping
trib_width_analysis_3 = Data(Tree({0}: [8.246486269, "20", 8.720374396, 1.743427413, "20", "20"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], {1}: [389.3119882, "400", 240.8052753, 42.1880324, "400", "400"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], {2}: [415.1317952, "400", 235.1750515, 44.49457484, "400", "400"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], {3}: ["0.866", "0.371", "0.371", "0.371", "0.866", "0.866"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]))
curve_length_analysis = Data(Tree({0}: [45.91139109, "20", "20", "20", 30.88201113, 50.05894439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], {1}: [1603.455798, "400", "400", "400", 723.4188777, 826.5417163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], {2}: [1581.042752, "400", "400", "400", 675.7966668, 838.40955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], {3}: [8.7, 13.1, 13.4, 12.7, 8.2, 8.5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]))
trib_width_analysis_4 = Data(Tree({0}: [8.044539191, 0.8801264389, 1.324520036, 4.342973962, 26.14276627, 61.9492962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], {1}: [219.6357844, 85.09830563, 72.03636941, 100.711821, 895.1585595, 1764.964119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], {2}: [120.3966046, 111.0418457, 81.83619596, 101.1868577, 874.0778526, 1755.131157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], {3}: ["0.866", "0.371", "0.371", "0.371", "0.866", "0.866"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]))
trib_width_analysis_pareto_front_solutio = Data(Tree({0}: [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], {1}: [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], {2}: [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], {3}: [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], {4}: [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], {5}: [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]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))  # "Trib width analysis Pareto Front Solutions"
series_3 = Series(Start=0, Step=1, Count=gen_count)
multiplication_4 = Multiplication(A=gen_count, B=gen_size)
bang = ExplodeTree(Data=trib_width_analysis_3)  # -> Branch0, Branch1, Branch2, Branch3
bang_2 = ExplodeTree(Data=trib_width_analysis)  # -> Branch0, Branch1, Branch2, Branch3
bang_3 = ExplodeTree(Data=trib_width_analysis_2)  # -> Branch0, Branch1, Branch2, Branch3
bang_4 = ExplodeTree(Data=curve_length_analysis)  # -> Branch0, Branch1, Branch2, Branch3
bang_5 = ExplodeTree(Data=trib_width_analysis_4)  # -> Branch0, Branch1, Branch2, Branch3
repeat = RepeatData(Data=graft(series_3), Length=gen_size)  # -> flatten(Data)
series_4 = Series(Start=0, Step=1, Count=multiplication_4)
repeat_2 = RepeatData(Data=series_3, Length=multiplication_4)
panel_8 = Panel(series_4)
smaller = SmallerThan(FirstNumber=bang.Branch0, SecondNumber="1.75")  # -> SmallerThan, OrEqualTo
smaller_2 = SmallerThan(FirstNumber=bang.Branch1, SecondNumber="48.3")  # -> SmallerThan, OrEqualTo
smaller_3 = SmallerThan(FirstNumber=bang.Branch2, SecondNumber="62.1")  # -> SmallerThan, OrEqualTo
smaller_4 = SmallerThan(FirstNumber=bang_2.Branch0, SecondNumber="1.75")  # -> SmallerThan, OrEqualTo
smaller_5 = SmallerThan(FirstNumber=bang_2.Branch1, SecondNumber="48.3")  # -> SmallerThan, OrEqualTo
smaller_6 = SmallerThan(FirstNumber=bang_2.Branch2, SecondNumber="62.1")  # -> SmallerThan, OrEqualTo
smaller_7 = SmallerThan(FirstNumber=bang_3.Branch0, SecondNumber="1.75")  # -> SmallerThan, OrEqualTo
smaller_8 = SmallerThan(FirstNumber=bang_3.Branch1, SecondNumber="48.3")  # -> SmallerThan, OrEqualTo
smaller_9 = SmallerThan(FirstNumber=bang_3.Branch2, SecondNumber="62.1")  # -> SmallerThan, OrEqualTo
smaller_10 = SmallerThan(FirstNumber=bang_4.Branch0, SecondNumber="1.75")  # -> SmallerThan, OrEqualTo
smaller_11 = SmallerThan(FirstNumber=bang_4.Branch1, SecondNumber="48.3")  # -> SmallerThan, OrEqualTo
smaller_12 = SmallerThan(FirstNumber=bang_4.Branch2, SecondNumber="62.1")  # -> SmallerThan, OrEqualTo
smaller_13 = SmallerThan(FirstNumber=bang_5.Branch0, SecondNumber="1.75")  # -> SmallerThan, OrEqualTo
smaller_14 = SmallerThan(FirstNumber=bang_5.Branch1, SecondNumber="48.3")  # -> SmallerThan, OrEqualTo
smaller_15 = SmallerThan(FirstNumber=bang_5.Branch2, SecondNumber="62.1")  # -> SmallerThan, OrEqualTo
and_2 = GateAnd(A=smaller.SmallerThan, B=smaller_2.SmallerThan, C=smaller_3.SmallerThan)
and_3 = GateAnd(A=smaller_4.SmallerThan, B=smaller_5.SmallerThan, C=smaller_6.SmallerThan)
and_4 = GateAnd(A=smaller_7.SmallerThan, B=smaller_8.SmallerThan, C=smaller_9.SmallerThan)
and_5 = GateAnd(A=smaller_10.SmallerThan, B=smaller_11.SmallerThan, C=smaller_12.SmallerThan)
and_6 = GateAnd(A=smaller_13.SmallerThan, B=smaller_14.SmallerThan, C=smaller_15.SmallerThan)
dispatch = Dispatch(List=bang.Branch3, DispatchPattern=and_2)  # -> ListA, ListB
dispatch_2 = Dispatch(List=bang_2.Branch3, DispatchPattern=and_3)  # -> ListA, ListB
dispatch_3 = Dispatch(List=bang_3.Branch3, DispatchPattern=and_4)  # -> ListA, ListB
dispatch_4 = Dispatch(List=bang_4.Branch3, DispatchPattern=and_5)  # -> ListA, ListB
dispatch_5 = Dispatch(List=bang_5.Branch3, DispatchPattern=and_6)  # -> ListA, ListB
pt_4 = Point(Point(870, 0, 50))
sort = SortList(Keys=dispatch.ListA)  # -> Keys, ValuesA
sort_2 = SortList(Keys=dispatch_2.ListA)  # -> Keys, ValuesA
sort_3 = SortList(Keys=dispatch_3.ListA)  # -> Keys, ValuesA
sort_4 = SortList(Keys=dispatch_4.ListA)  # -> Keys, ValuesA
sort_5 = SortList(Keys=dispatch_5.ListA)  # -> Keys, ValuesA
move_3 = Move(Geometry=pt_4, Motion=vec2pt.Vector)  # -> Geometry, Transform
xz_2 = XZPlane(Origin=move_3.Geometry)
panel_9 = Panel(sort_4.Keys)
panel_10 = Panel(sort_5.Keys)
panel_11 = Panel(sort.Keys)
panel_12 = Panel(sort_2.Keys)
panel_13 = Panel(sort_3.Keys)
ht_allowed_0_5tbwidth = Data("""HT Allowed:
Mean Compression: -63.538616
Mean Tension: 52.923039
Max Compression: -59.88374
Max Tension: 50.635944
Mean Deformation: 1.624458
Max Deformation: 1.551669""")
tension_both_ways_ht_allowed_0_5_tbwidth = Data("""HT Allowed:
Mean Compression: -48.747901
Mean Tension: 47.643036
Max Compression: -42.75561
Max Tension: 32.830367
Mean Deformation: 1.675795
Max Deformation: 1.488312""")
ht_allowed = Data("""HT Allowed:
Mean Compression: -108.599781
Mean Tension: 86.741628
Max Compression: -108.599781
Max Tension: 86.741628
Mean Deformation: 4.23523
Max Deformation: 4.23523""")
ht_disallowed = Data("""HT Disallowed: 
Mean Compression: -85.313097
Mean Tension: 55.045063
Max Compression: -80.081877
Max Tension: 47.461314
Mean Deformation: 1.843764
Max Deformation: 1.751585""")
ht_allowed_with_cross_prob_0_2 = Data("""HT Allowed:
Mean Compression: -126.290289
Mean Tension: 108.470331
Max Compression: -115.555255
Max Tension: 82.802048
Mean Deformation: 4.533889
Max Deformation: 2.325209""")
panel_14 = Panel(ht_allowed_0_5tbwidth)
ht_allowed_with_1_trib_20_10_crossover = Data("""HT Allowed:
Mean Compression: -186.132803
Mean Tension: 163.624367
Max Compression: -102.986347
Max Tension: 93.857261
Mean Deformation: 3.383445
Max Deformation: 3.32512""")
ht_allowed_1_tribw_0_3_cross_prob = Data("""HT Allowed:
Mean Compression: -138.934035
Mean Tension: 122.641997
Max Compression: -92.904098
Max Tension: 76.151751
Mean Deformation: 4.022554
Max Deformation: 3.469296""")
panel_15 = Panel(ht_allowed_with_cross_prob_0_2)
panel_16 = Panel(ht_allowed_with_1_trib_20_10_crossover)
panel_17 = Panel(ht_allowed_1_tribw_0_3_cross_prob)
panel_18 = Panel(ht_allowed)
panel_19 = Panel(ht_disallowed)
# Ran with 10 options and no action wrapping again
trib_width_analysis_5 = Data(Tree({0}: [8.246486269, "20", 8.720374396, 1.743427413, "20", "20"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], {1}: [389.3119882, "400", 240.8052753, 42.1880324, "400", "400"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], {2}: [415.1317952, "400", 235.1750515, 44.49457484, "400", "400"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], {3}: ["0.866", "0.371", "0.371", "0.371", "0.866", "0.866"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]))
bang_6 = ExplodeTree(Data=trib_width_analysis_5)  # -> Branch0, Branch1, Branch2, Branch3
tstat_3 = TreeStatistics(Tree=Tree({0;0}: [8.246486269, 389.3119882, 415.1317952, "0.866"], {0;1}: ["20", "400", "400", "0.371"], {0;2}: [8.720374396, 240.8052753, 235.1750515, "0.371"], {0;3}: [1.743427413, 42.1880324, 44.49457484, "0.371"], {0;4}: ["20", "400", "400", "0.866"], {0;5}: ["20", "400", "400", "0.866"]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))  # -> Paths, Length, Count
panel_20 = Panel("""1.30
0.866
0.650
0.520
0.433
0.371
0.325""")
smaller_16 = SmallerThan(FirstNumber=bang_6.Branch0, SecondNumber="1.75")  # -> SmallerThan, OrEqualTo
smaller_17 = SmallerThan(FirstNumber=bang_6.Branch1, SecondNumber="48.3")  # -> SmallerThan, OrEqualTo
smaller_18 = SmallerThan(FirstNumber=bang_6.Branch2, SecondNumber="62.1")  # -> SmallerThan, OrEqualTo
equals = Equality(FirstNumber=bang_6.Branch3, SecondNumber=1.3)  # -> Equality, Inequality
equals_2 = Equality(FirstNumber=graft(bang_6.Branch3), SecondNumber=panel_20)  # -> simplify(Equality), Inequality
and_7 = GateAnd(A=smaller_16.SmallerThan, B=smaller_17.SmallerThan, C=smaller_18.SmallerThan)
dispatch_6 = Dispatch(List=[0, 1, 2, 3, 4, 5, 6], DispatchPattern=equals_2.Equality)  # -> flatten(ListA), ListB
dispatch_7 = Dispatch(List=tstat_3.Paths, DispatchPattern=and_7)  # -> ListA, ListB
dispatch_8 = Dispatch(List=bang_6.Branch3, DispatchPattern=and_7)  # -> ListA, ListB
sift = SiftPattern(List=bang_6.Branch0, SiftPattern=dispatch_6.ListA)  # -> Output0, Output1, Output2, Output3, Output4, Output5, Output6
sift_2 = SiftPattern(List=bang_6.Branch1, SiftPattern=dispatch_6.ListA)  # -> Output0, Output1, Output2, Output3, Output4, Output5, Output6
sift_3 = SiftPattern(List=bang_6.Branch2, SiftPattern=dispatch_6.ListA)  # -> Output0, Output1, Output2, Output3, Output4, Output5, Output6
sort_6 = SortList(Keys=dispatch_8.ListA)  # -> Keys, ValuesA
entwine = Entwine(
    Branch0X=sift.Output0,
    Branch1X=sift.Output1,
    Branch2X=sift.Output2,
    Branch3X=sift.Output3,
    Branch4X=sift.Output4,
    Branch5X=sift.Output5,
    Branch6X=sift.Output6,
    FlattenInputs=False)
entwine_2 = Entwine(
    Branch0X=sift_2.Output0,
    Branch1X=sift_2.Output1,
    Branch2X=sift_2.Output2,
    Branch3X=sift_2.Output3,
    Branch4X=sift_2.Output4,
    Branch5X=sift_2.Output5,
    Branch6X=sift_2.Output6,
    FlattenInputs=False)
entwine_3 = Entwine(
    Branch0X=sift_3.Output0,
    Branch1X=sift_3.Output1,
    Branch2X=sift_3.Output2,
    Branch3X=sift_3.Output3,
    Branch4X=sift_3.Output4,
    Branch5X=sift_3.Output5,
    Branch6X=sift_3.Output6,
    FlattenInputs=False)
cset = CreateSet(List=sort_6.Keys)  # -> Set, Map
clean = CleanTree(RemoveNulls=True, RemoveInvalid=True, RemoveEmpty=False, Tree=entwine)
clean_2 = CleanTree(RemoveNulls=True, RemoveInvalid=True, RemoveEmpty=False, Tree=entwine_2)
clean_3 = CleanTree(RemoveNulls=True, RemoveInvalid=True, RemoveEmpty=False, Tree=entwine_3)
mindex = MemberIndex(Set=sort_6.Keys, Member=cset.Set)  # -> Index, Count
sort_7 = SortList(Keys=clean)  # -> Keys, ValuesA
sort_8 = SortList(Keys=clean_2)  # -> Keys, ValuesA
sort_9 = SortList(Keys=clean_3)  # -> Keys, ValuesA
avr_2 = Average(Input=sort_7.Keys)  # -> flatten(ArithmeticMean)
avr_3 = Average(Input=sort_8.Keys)  # -> flatten(ArithmeticMean)
avr_4 = Average(Input=sort_9.Keys)  # -> flatten(ArithmeticMean)
item_18 = ListItem(List=sort_7.Keys, Index=0, Wrap=True)  # -> flatten(Item)
item_19 = ListItem(List=sort_7.Keys, Index=-1, Wrap=True)  # -> flatten(Item)
item_20 = ListItem(List=sort_8.Keys, Index=0, Wrap=True)  # -> flatten(Item)
item_21 = ListItem(List=sort_8.Keys, Index=-1, Wrap=True)  # -> flatten(Item)
item_22 = ListItem(List=sort_9.Keys, Index=0, Wrap=True)  # -> flatten(Item)
item_23 = ListItem(List=sort_9.Keys, Index=-1, Wrap=True)  # -> flatten(Item)
panel_21 = Panel(mindex.Count)
sort_10 = SortList(Keys=bang_6.Branch0)  # -> Keys, ValuesA
item_24 = ListItem(List=sort_10.Keys, Index=0, Wrap=True)  # -> Item1, Item
panel_22 = Panel(item_18)
panel_23 = Panel(item_19)
panel_24 = Panel(item_20)
panel_25 = Panel(item_21)
panel_26 = Panel(item_22)
panel_27 = Panel(item_23)
pt_5 = Point("20000,0,0")
xz_3 = XZPlane(Origin=pt_5)
panel_28 = Panel(avr_2)
panel_29 = Panel(avr_3)
panel_30 = Panel(avr_4)
rectangle_2 = Rectangle(Plane=xz_3, XSize="1000", YSize="1000", Radius=0)  # -> Rectangle, Length

# ----
# Tension Cables
tstat_4 = TreeStatistics(Tree=py3.tension_cable_out)  # -> Paths, Length, Count
series_5 = Series(Start=0, Step=1, Count=tstat_4.Count)
pline_11 = PolyLine(Vertices=py3.tension_cable_out, Closed=False)  # -> flatten(Polyline)
concat_8 = Concatenate(FragmentA="TENSION_", FragmentB=series_5)

divide = DivideCurve(Curve=pline_11, Count=number_slider_3, Kinks=False)  # -> Points, Tangents, Parameters
pline_12 = PolyLine(Vertices=divide.Points, Closed=False)
concat_9 = Concatenate(FragmentA=graft(concat_8), FragmentB="_", FragmentC=series)  # -> flatten(Result)
explode = Explode(Curve=pline_12, Recursive=True)  # -> flatten(Segments), Vertices

lineelem_8 = CreateLinearElementKaramba3D(
    Line=pline_11,
    Colour=ColourSwatch(SwatchColor=RGB(255, 0, 238)),
    Identifier=concat_9,
    CrossSection=crosec,
    LimitDistance_mm=0.005,
    BucklingLengthY_mm=-1,
    BucklingLengthZ_mm=-1,
    BucklingLengthLT_mm=-1,
    Bending=False,
    ToPolylineMaxAngle=0.25,
    ToPolylineTolerance=0.1,
    ToPolylineMaxEdgeLength=0.25,
    New=True,
    Remove=True,
    mode="LineToTruss")  # -> Element, Points, Info

loads_4 = LoadsKaramba3D(Eps0=Slider(1, range=0..1), ElementIdentifiers=concat_8, LCase=panel_5, mode="InitialStrain")
merge_8 = Merge(
    Data1=flatten(lineelem_8.Element),
    Data2=flatten(lineelem.Element),
    Data3=flatten(lineelem_2.Element),
    Data4=flatten(lineelem_3.Element),
    Data5=flatten(lineelem_4.Element),
    Data6=flatten(lineelem_5.Element),
    Data7=flatten(lineelem_6.Element),
    Data8=flatten(lineelem_7.Element))
assemble = AssembleModelKaramba3D(Elem=merge_8, Support=merge_2, Load=merge_4, LimitDistance_mm=0.005)  # -> Model, Info, Mass_kg, CentreOfGravity, LoadCaseNames
tension_ids = Data(concat_9)
analyse = AnalyseKaramba3D(Model=assemble.Model, LoadCases=list_2)  # -> AnalysedModel, MaximumDisplacement_cm, ResultingForce_kN, ChangeOfElasticEnergy_kNm
analysethii = AnalyseThIIKaramba3D(
    Model=assemble.Model,
    LoadCases=list_2,
    UseInitialNII=True,
    NIIFromCombination=True,
    NoTensionalNII=False,
    RTolerance=1e-07,
    MaxIterations=50)  # -> AnalysedModel, MaximumDisplacement_cm, ResultingForce_kN, ChangeOfElasticEnergy_kNm; disabled
modelview = ModelViewKaramba3D(Model=analyse.AnalysedModel)  # -> Model, DeformedMesh, DeformedAxes, DeformedModel, MaximumDeformation
# Frames
utilization = UtilizationOfElementsKaramba3D(
    AnalysedModel=analyse.AnalysedModel,
    ElementsIdentifiers=frame_ids,
    NumberOfSamplePoints=3,
    ElasticDesign=True,
    GammaM0=1,
    GammaM1=1.1,
    SwayFrame=True,
    WithDetails=True,
    mode="Beams")  # -> Model, Utilization, SigMax_kN_cm², SigMin_kN_cm², TauMax_kN_cm², UtilN, UtilVy, UtilVz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
# Connections
utilization_2 = UtilizationOfElementsKaramba3D(
    AnalysedModel=analyse.AnalysedModel,
    ElementsIdentifiers=connection_ids,
    NumberOfSamplePoints=3,
    ElasticDesign=True,
    GammaM0=1,
    GammaM1=1.1,
    SwayFrame=True,
    WithDetails=False,
    mode="Beams")  # -> Model, Utilization, SigMax_kN_cm², SigMin_kN_cm², TauMax_kN_cm², UtilN, UtilVy, UtilVz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
# Tension Cables
utilization_3 = UtilizationOfElementsKaramba3D(
    AnalysedModel=analyse.AnalysedModel,
    ElementsIdentifiers=tension_ids,
    NumberOfSamplePoints=3,
    ElasticDesign=True,
    GammaM0=1,
    GammaM1=1.1,
    SwayFrame=True,
    WithDetails=False,
    mode="Beams")  # -> Model, Utilization, SigMax_kN_cm², SigMin_kN_cm², TauMax_kN_cm², UtilN, UtilVy, UtilVz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
# Frames + Connectors
utilization_4 = UtilizationOfElementsKaramba3D(
    AnalysedModel=analyse.AnalysedModel,
    ElementsIdentifiers=merge_6,
    NumberOfSamplePoints=3,
    ElasticDesign=True,
    GammaM0=1,
    GammaM1=1.1,
    SwayFrame=True,
    WithDetails=False,
    mode="Beams")  # -> Model, Utilization, SigMax_kN_cm², SigMin_kN_cm², TauMax_kN_cm², UtilN, UtilVy, UtilVz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
merge_9 = Merge(Data1=flatten(utilization.SigMax_kN_cm²), Data2=flatten(utilization.SigMin_kN_cm²))
merge_10 = Merge(Data1=flatten(utilization_2.SigMax_kN_cm²), Data2=flatten(utilization_2.SigMin_kN_cm²))
merge_11 = Merge(Data1=flatten(utilization_3.SigMax_kN_cm²), Data2=flatten(utilization_3.SigMin_kN_cm²))
beamview = BeamViewKaramba3D(Model=modelview.Model)  # -> Model, MeshesOfRenderedBeams, DeformedBeamAxes, LegendColours, LegendTags
sort_11 = SortList(Keys=merge_9)  # -> Keys, ValuesA
sort_12 = SortList(Keys=merge_10)  # -> Keys, ValuesA
sort_13 = SortList(Keys=merge_11)  # -> Keys, ValuesA
max_compression = ListItem(List=sort_11.Keys, Index=0, Wrap=True)
max_tension = ListItem(List=sort_11.Keys, Index=-1, Wrap=True)
max_compression_2 = ListItem(List=sort_12.Keys, Index=0, Wrap=True)
max_tension_2 = ListItem(List=sort_12.Keys, Index=-1, Wrap=True)
max_compression_3 = ListItem(List=sort_13.Keys, Index=0, Wrap=True)
max_tension_3 = ListItem(List=sort_13.Keys, Index=-1, Wrap=True)
mesh = Mesh(beamview.MeshesOfRenderedBeams)
panel_31 = Panel(max_compression)
panel_32 = Panel(max_tension)
panel_33 = Panel(max_compression_2)
panel_34 = Panel(max_tension_2)
panel_35 = Panel(max_compression_3)
panel_36 = Panel(max_tension_3)
preview_6 = CustomPreview(Geometry=mesh, Material=ColourSwatch(SwatchColor=RGB(255, 255, 255)))
legend = Legend(Colour=beamview.LegendColours, Tags=beamview.LegendTags, LegendType=1)

# ----
# Wallacei Optimizer
merge_12 = Merge(Data1=flatten(utilization_4.SigMax_kN_cm²), Data2=flatten(utilization_4.SigMin_kN_cm²))
item_25 = ListItem(List=py3.action_log_out, Index=0, Wrap=True)  # -> Item, Item1, Item2, Item3
sort_14 = SortList(Keys=merge_12)  # -> Keys, ValuesA
concat_10 = Concatenate(
    FragmentH="[",
    FragmentA=item_25.Item,
    FragmentE=",",
    FragmentB=item_25.Item1,
    FragmentF=",",
    FragmentC=item_25.Item2,
    FragmentG=",",
    FragmentD=item_25.Item3,
    FragmentI="]")  # -> flatten(Result)
max_compression_4 = ListItem(List=sort_14.Keys, Index=0, Wrap=True)
max_tension_4 = ListItem(List=sort_14.Keys, Index=-1, Wrap=True)
max_compression_5 = Absolute(Value=max_compression_4)
filter = StreamFilter(Gate=and, Stream0=item_17.Item, Stream1=modelview.MaximumDeformation)
filter_2 = StreamFilter(Gate=and, Stream0=item_17.Item1, Stream1=max_compression_5)
filter_3 = StreamFilter(Gate=and, Stream0=item_17.Item2, Stream1=max_tension_4)
karamba_mesh = Mesh(beamview.MeshesOfRenderedBeams)
shape_grammar_3 = Data(concat_10)
remap_3 = RemapNumbers(Value=filter, Source=item_16.Item, Target=Domain(0, 1))  # -> Mapped, Clipped
remap_4 = RemapNumbers(Value=filter_2, Source=item_16.Item1, Target=Domain(0, 1))  # -> Mapped, Clipped
remap_5 = RemapNumbers(Value=filter_3, Source=item_16.Item2, Target=Domain(0, 1))  # -> Mapped, Clipped
merge_13 = Merge(
    Data1=max_compression_2,
    Data2=max_tension_2,
    Data3=max_compression_3,
    Data4=max_tension_3,
    Data5=max_compression_4,
    Data6=max_tension_4,
    Data7=filter)
merge_14 = Merge(Data1=filter, Data2=filter_2, Data3=filter_3, Data4=item_14)

filter_4 = StreamFilter(Gate=and, Stream1=karamba_mesh)
txt = Text(shape_grammar_3)
merge_15 = Merge(Data1=remap_3.Mapped, Data2=remap_4.Mapped, Data3=remap_5.Mapped, Data4=remap.Mapped, Data5=remap_2.Mapped)
num_2 = Number(merge_13)
merge_16 = Merge(Data1=flatten(txt), Data2=flatten(num_2), Data3=flatten(filter_4))
graph = GraphMapper(
    merge_15,
    x0=0,
    x1=1,
    y0=0,
    y1=1,
    container_name="Bezier",
    cpx=[0, 0.5000813603, 0.8996440768, 1],
    cpy=[0, 0.09800034761, 0.4913656116, 1])
item_26 = ListItem(List=graph, Index=0, Wrap=True)  # -> Item, Item1, Item2, Item3, Item4

# ----
# Shape Grammar Export
concat_11 = Concatenate(FragmentA="np.array(", FragmentB=txt, FragmentC="),")
panel_37 = Panel(concat_11)

max_deform = Number(item_26.Item)
max_compression_6 = Number(item_26.Item1)
max_tributary = Number(item_26.Item4)
max_tension_5 = Number(item_26.Item2)
max_span = Number(item_26.Item3)
# First Run. Aligned to baseline, assuming a loading force of 7.35 kN/m2 and a tributary width of 0.325 metres.
wallacei_x = WallaceiX(
    Genes=[picked_frame, picked_orientation, tributary_width],
    Objectives=[max_deform, max_compression_6, max_tension_5, max_tributary],
    Data=merge_14,
    Phenotype=merge_16,
    allFitness="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",
    allFrontIdx="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",
    allGenomes="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",
    curFrontIdx="199|0;199|1;199|2;199|3;199|4;199|5;199|6;199|7;199|8;199|9;199|10;199|11;199|12;199|13;199|14;199|15;199|16;199|17;199|18;199|19;199|20;199|21;199|22;199|23;199|24;199|25;199|26;199|27;199|28;199|29;199|30;199|31;199|32;199|33;199|34;199|35;199|36;199|37;199|38;199|39;199|40;199|41;199|42;199|43;199|44;199|45;199|46;199|47;199|48;199|49",
    curFrontIdxSave="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",
    popGen="50,200",
    total="2051735",
    wlcDone=True)  # -> WallaceiGenomes, FitnessValues, simplify(Data), WPhenotypes

path_mapper = PathMapper(wallacei_x.Data, source="{A;B}", target="{path_index}")
dam = DataDam(DataA=wallacei_x.WPhenotypes, BufferDelay=10000000, BufferMode=0)
flip = FlipMatrix(Data=simplify(path_mapper))
pdecoder = DecodePhenotype(WallaceiPhenotype=dam)  # -> GeometriesList, simplify(MeshesList), simplify(NumbersList), TextList
bang_7 = ExplodeTree(Data=flip)  # -> Branch0, Branch1, Branch2, Branch3
flatten = FlattenTree(Tree=bang_7.Branch3, Path="{0}")
panel_38 = Panel(flatten)
flatten_2 = FlattenTree(Tree=pdecoder.MeshesList, Path="{0}")  # -> simplify(graft(Tree))
cluster_4 = Cluster_4(x=pdecoder.NumbersList)
item_27 = ListItem(List=pdecoder.NumbersList, Index=0, Wrap=True)  # -> Item, Item1, Item2, Item3, flatten(Item4), flatten(Item5), flatten(Item6)
sort_15 = SortList(Keys=item_27.Item4)  # -> Keys, ValuesA
sort_16 = SortList(Keys=item_27.Item5)  # -> Keys, ValuesA
sort_17 = SortList(Keys=item_27.Item6)  # -> Keys, ValuesA
item_28 = ListItem(List=sort_15.Keys, Index=-1, Wrap=True)
item_29 = ListItem(List=sort_16.Keys, Index=0, Wrap=True)
item_30 = ListItem(List=sort_17.Keys, Index=0, Wrap=True)
avr_5 = Average(Input=sort_17.Keys)
move_4 = Move(Geometry=simplify(flatten_2), Motion=vec2pt.Vector)  # -> Geometry, Transform
avr_6 = Average(Input=sort_15.Keys)
avr_7 = Average(Input=sort_16.Keys)
panel_39 = Panel(item_28)
panel_40 = Panel(item_29)
panel_41 = Panel(item_30)
panel_42 = Panel(avr_5)
panel_43 = Panel(avr_6)
panel_44 = Panel(avr_7)
tag = TextTag3D(Location=xz_2, Text=cluster_4, Size=100, Justification=7)
cluster_5 = Cluster_5(M="HT Allowed:", B=avr_6, D=avr_7, F=item_28, H=item_29, J=avr_5, L=item_30)
panel_45 = Panel(cluster_5)

# ==== cluster Cluster
V = ClusterInput()
V_2 = ClusterInput()
V_3 = ClusterInput()
V_4 = ClusterInput()
V_5 = ClusterInput()
V_6 = ClusterInput()
pline = PolyLine(Vertices=V, Closed=False)  # -> flatten(Polyline)
pline_2 = PolyLine(Vertices=V_2, Closed=False)  # -> flatten(Polyline)
pline_3 = PolyLine(Vertices=V_3, Closed=False)  # -> flatten(Polyline)
pline_4 = PolyLine(Vertices=V_4, Closed=False)  # -> flatten(Polyline)
pline_5 = PolyLine(Vertices=V_5, Closed=False)  # -> flatten(Polyline)
pline_6 = PolyLine(Vertices=V_6, Closed=False)  # -> flatten(Polyline)
entwine = Entwine(
    Branch0X=pline_3,
    Branch1X=pline_4,
    Branch2X=pline_5,
    Branch3X=pline_6,
    Branch4X=pline,
    Branch5X=pline_2,
    FlattenInputs=False)  # -> simplify(Result)
merge = Merge(
    Data1=ColourSwatch(SwatchColor=RGB(170, 0, 255)),
    Data2=ColourSwatch(SwatchColor=RGB(0, 34, 255)),
    Data3=ColourSwatch(SwatchColor=RGB(0, 255, 255)),
    Data4=ColourSwatch(SwatchColor=RGB(51, 255, 0)),
    Data5=ColourSwatch(SwatchColor=RGB(255, 187, 0)),
    Data6=ColourSwatch(SwatchColor=RGB(238, 255, 0)))  # -> graft(Result)
R = ClusterOutput(entwine)
R_2 = ClusterOutput(merge)

# ==== cluster Cluster_2
x = ClusterInput()

num = Number("21000")
matprops = MaterialPropertiesKaramba3D(
    FamilyOfMaterial="HT-steel",
    Name="Assumed_Steel",
    YoungsModulus_kN_cm²=num,
    InPlaneShearModulus_kN_cm²="8076",
    TransverseShearModulus_kN_cm²="8076",
    SpecificWeight_kN_m³="78.5",
    CoefficientOfThermalExpansion_1=1.2e-05,
    TensileStrength_kN_cm²="70",
    CompressiveStrength_kN_cm²="60",
    StrengthHypothesis="MISES",
    mode="Isotrop")

expression = Expression(x=x, Expression="x * 100")
bang = ExplodeTree(Data=expression)  # -> Branch0, Branch1, Branch2, Branch3, Branch4, Branch5, Branch6, Branch7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
expression_2 = Expression(D=bang.Branch8, t=bang.Branch9, Expression="(sqrt(2*D²-(D-2*t)²)-D + 2*t)/2")
expression_3 = Expression(D=bang.Branch10, t=bang.Branch11, Expression="(sqrt(2*D²-(D-2*t)²)-D + 2*t)/2")
expression_4 = Expression(D=bang.Branch8, t=bang.Branch9, Expression="sqrt(2*D²-(D-2*t)²)")
crosec_calculation = Expression(D=expression_4, t=expression_2, Expression="(pi*(D/2)²)-(pi*((D-2*t)/2)²)")
expression_5 = Expression(D=bang.Branch10, t=bang.Branch11, Expression="sqrt(2*D²-(D-2*t)²)")
panel = Panel(bang.Branch2)
crosec = CrossSectionKaramba3D(
    FamilyNameOfCrossSection="DefaultCroSec",
    Material=matprops,
    Diameter_cm=bang.Branch0,
    WallThickness_cm=bang.Branch1,
    mode="Circular Hollow")
crosec_2 = CrossSectionKaramba3D(
    FamilyNameOfCrossSection="DefaultCroSec",
    Material=matprops,
    Diameter_cm=bang.Branch2,
    WallThickness_cm=bang.Branch3,
    mode="Circular Hollow")
crosec_3 = CrossSectionKaramba3D(
    FamilyNameOfCrossSection="DefaultCroSec",
    Material=matprops,
    Diameter_cm=bang.Branch4,
    WallThickness_cm=bang.Branch5,
    mode="Circular Hollow")
crosec_4 = CrossSectionKaramba3D(
    FamilyNameOfCrossSection="DefaultCroSec",
    Material=matprops,
    Diameter_cm=bang.Branch6,
    WallThickness_cm=bang.Branch7,
    mode="Circular Hollow")
crosec_5 = CrossSectionKaramba3D(
    FamilyNameOfCrossSection="DefaultCroSec",
    Material=matprops,
    Diameter_cm=expression_4,
    WallThickness_cm=expression_2,
    mode="Circular Hollow")
crosec_6 = CrossSectionKaramba3D(
    FamilyNameOfCrossSection="DefaultCroSec",
    Material=matprops,
    Diameter_cm=expression_5,
    WallThickness_cm=expression_3,
    mode="Circular Hollow")
path_mapper = PathMapper(crosec, source="{A}", target="{0}")
path_mapper_2 = PathMapper(crosec_2, source="{A}", target="{0}")
path_mapper_3 = PathMapper(crosec_3, source="{A}", target="{0}")
path_mapper_4 = PathMapper(crosec_4, source="{A}", target="{0}")
path_mapper_5 = PathMapper(crosec_5, source="{A}", target="{0}")
path_mapper_6 = PathMapper(crosec_6, source="{A}", target="{0}")
path_mapper_7 = ClusterOutput(path_mapper)
path_mapper_8 = ClusterOutput(path_mapper_2)
path_mapper_9 = ClusterOutput(path_mapper_4)
path_mapper_10 = ClusterOutput(path_mapper_5)
path_mapper_11 = ClusterOutput(path_mapper_3)
path_mapper_12 = ClusterOutput(path_mapper_6)
multiplication = Multiplication(A=bang.Branch6, B=2)
# Testing if changing the tube size but not the area affects output
expression_6 = Expression(D=bang.Branch6, t=bang.Branch7, Expression="(D*t - t²)/(D + sqrt(D²-D*t+t²))")
expression_7 = Expression(D=bang.Branch6, t=bang.Branch7, Expression="(pi * (D/2)²)-(pi*((D-2*t)/2)²)")
expression_8 = Expression(D=multiplication, t=expression_6, Expression="(pi * (D/2)²)-(pi*((D-2*t)/2)²)")
crosec_7 = CrossSectionKaramba3D(
    FamilyNameOfCrossSection="DefaultCroSec",
    Material=matprops,
    Diameter_cm=multiplication,
    WallThickness_cm=expression_6,
    mode="Circular Hollow")
panel_2 = Panel(expression_8)

# ==== cluster Cluster_3
P = ClusterInput()
pdecon = Deconstruct(Point=P)  # -> XComponent, YComponent, ZComponent
I = ClusterInput()
ins = InsertItems(List=pdecon.XComponent, Item=I, Indices=[0, -1], Wrap=True)
consec = ConsecutiveDomains(Numbers=ins, Additive=False)
cull_i = CullIndex(List=consec, Indices=[0, -1], Wrap=True)
div = DivideDomain(Domain=cull_i, Count=2)  # -> simplify(flatten(Segments))
item = ListItem(List=consec, Index=[0, -1], Wrap=True)
ins_2 = InsertItems(List=div, Item=item, Indices=[0, -1], Wrap=True)
partition = PartitionList(List=ins_2, Size=2)  # -> simplify(Chunks)
dedomain = DeconstructDomain(Domain=partition)  # -> Start, End
item_2 = ListItem(List=dedomain.End, Index=1, Wrap=True)
item_3 = ListItem(List=dedomain.Start, Index=0, Wrap=True)
subtraction = Subtraction(A=item_2, B=item_3)  # -> flatten(EffectiveLength)
panel = Panel(subtraction)
effective_length = ClusterOutput(subtraction)

# ==== cluster Cluster_4
x = ClusterInput()
roundd = RoundToDecimalPlace(NumberX=x, DecimalPlace=4, RoundType=0)  # -> Rounded, Difference
fragment = TextFragment(Text=roundd.Rounded, Start=0, Count=6)
item = ListItem(List=fragment, Index=0, Wrap=True)  # -> Item, Item1, Item2, Item3, Item4, Item5, Item6
concat = Concatenate(
    FragmentA="Total Tension: ",
    FragmentB=item.Item5,
    FragmentC=" | Total Compression: ",
    FragmentD=item.Item4,
    FragmentE="Cable Tension: ",
    FragmentF=item.Item3,
    FragmentG=" | Cable Compression: ",
    FragmentH=item.Item2,
    FragmentI="Conn. Tension: ",
    FragmentJ=item.Item1,
    FragmentK=" | Conn. Compression: ",
    FragmentL=item.Item,
    FragmentM="Maximum Deformation: ",
    FragmentN=item.Item6)
R = ClusterOutput(concat)

# ==== cluster Cluster_5
M = ClusterInput()
B = ClusterInput()
D = ClusterInput()
F = ClusterInput()
H = ClusterInput()
J = ClusterInput()
L = ClusterInput()
concat = Concatenate(
    FragmentM=M,
    FragmentA="Mean Compression: ",
    FragmentB=B,
    FragmentC="Mean Tension: ",
    FragmentD=D,
    FragmentE="Max Compression: ",
    FragmentF=F,
    FragmentG="Max Tension: ",
    FragmentH=H,
    FragmentI="Mean Deformation: ",
    FragmentJ=J,
    FragmentK="Max Deformation: ",
    FragmentL=L)
R = ClusterOutput(concat)
