# Grasshopper definition GA Baseline Final Tributary and Span Analyses.gh (Grasshopper 1.0.8)
# plug-ins: Karamba3D, LunchBox, Wallacei

# ----
# Arch Length
number_slider = Slider(0, range=0..2)
panel = Panel("""15
7
4.33""")
item = ListItem(List=panel, Index=number_slider, Wrap=True)
multiplication = Multiplication(A=item, B=1000)
pt = Point("0,0,0")
X = UnitX(Factor=multiplication)
remap = RemapNumbers(Value=item, Source=Domain(4.33, 15), Target=Domain(1, 0))  # -> Mapped, Clipped
move = Move(Geometry=pt, Motion=X)  # -> Geometry, Transform
avr = Average(Input=[pt, move.Geometry])
Z = UnitZ(Factor=1000)
move_2 = Move(Geometry=avr, Motion=Z)  # -> Geometry, Transform
merge = Merge(Data1=pt, Data2=move_2.Geometry, Data3=move.Geometry)
intcrv = Interpolate(Vertices=merge, Degree=3, Periodic=False, KnotStyle=1)  # -> Curve, Length, Domain

picked_frame = GenePool(Decimals=0, Maximum=34, Minimum=0, Value=[9, 4, 14, 27, 24, 15, 12, 32, 3, 31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])
genes = GenePool(Decimals=0, Maximum=1, Minimum=0, Value=[1, 1, 1, 1, 1])
progress_weight = Slider(1, range=1..3)
distance_weight = Slider(1, range=1..3)
rank_window = Slider(5, range=0..100)
picked_orientation = GenePool(Decimals=0, Maximum=4, Minimum=0, Value=[3, 3, 3, 2, 2, 1, 4, 3, 1, 2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])

# ----
# Tension Cables
panel_2 = Panel("12700")
mm = Slider(18, range=0..100)
num = Number(panel_2)
matprops = MaterialPropertiesKaramba3D(
    FamilyOfMaterial="Tension_Steel",
    Name="Simple_Cable",
    YoungsModulus_kN_cm²=num,
    InPlaneShearModulus_kN_cm²="4884.4",
    TransverseShearModulus_kN_cm²="4884.4",
    SpecificWeight_kN_m³="81.31",
    CoefficientOfThermalExpansion_1=1.2e-05,
    TensileStrength_kN_cm²="13.65",
    CompressiveStrength_kN_cm²="0",
    StrengthHypothesis="MISES",
    mode="Isotrop")
crosec = CrossSectionKaramba3D(
    FamilyNameOfCrossSection="DefaultCroSec",
    Material=matprops,
    Diameter_cm=expr("x/10", mm),
    WallThickness_cm=expr("x/20", mm),
    mode="Circular Hollow")

panel_3 = Panel("C:\Users\rensh\Documents\Master Thesis\REP_STRUC RL\Datasets\Bike Frames\FRAMED_new_set_35_crs.csv")
file = ReadFile(File=panel_3, PerLineParse=True)
csv = ReadCSV(CSVString=file, Delimiter=",", DataStruct=False)  # -> Headers, Values
cluster = Cluster_2(x=csv.Values)  # -> path_mapper_7, path_mapper_8, path_mapper_11, path_mapper_9, path_mapper_10, path_mapper_12

strict_termination = BooleanToggle(False)
panel_4 = Panel("70")

# ----
# Connection Material
number_slider_2 = Slider(0.5, range=0..10)
matselect = MaterialSelectionKaramba3D(menu=[dropdown(1), dropdown(4)])
crosec_2 = CrossSectionKaramba3D(
    FamilyNameOfCrossSection="DefaultCroSec",
    Material=matselect,
    Diameter_cm=Slider(3, range=0..10),
    WallThickness_cm=number_slider_2,
    mode="Circular Hollow")

py3 = Python3Script(
    allowed_connections=genes,
    custom_curve=intcrv.Curve,
    allow_orientation_wrapping=Toggle(False),
    picked_frame=picked_frame,
    picked_orientation=picked_orientation,
    rank_window=rank_window,
    progress_weight=progress_weight,
    distance_weight=distance_weight,
    strict_termination=strict_termination)  # -> out, guide_curve_out, placed_frames_out, bridge_points_out, action_log_out, remaining_options_out, reuse_skips, no_progress_skips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; inputs allowed_connections: list, custom_curve: Curve, allow_orientation_wrapping: Boolean, picked_frame: list of Int32, picked_orientation: list of Int32, rank_window: Int32, progress_weight: Double, distance_weight: Double, strict_termination: Boolean
# ---------- py3: Python ----------
"""
Grasshopper Python 3 component script — the only file here touching Rhino.
Stock/curve load from IV.frames_v0 / IV.arch_v0 (same as RL training),
unless an optional custom curve is supplied.

Inputs:  picked_frame, picked_orientation (required, list[int])
         allow_orientation_wrapping (bool)
         rank_window, progress_weight, distance_weight, strict_termination (optional)
         allowed_connections (optional, 5-item binary list, TT/HT/DT/CS/SS_MID order)
         custom_curve (optional, planar Rhino curve in the XZ plane, or None)
         If connected, it replaces the RL guide curve (IV.arch_v0). It is still
         shifted so its start sits at IV.origin_position, then resampled to
         IV.curve_samples, exactly like the RL curve.

Outputs: placed_frames_out, action_log_out, remaining_options_out, bridge_points_out,
         connections_out, guide_curve_out, tt_out/ht_out/dt_out/cs_out/ss_out/st_out
         (tube trees), pin_out, roller_out (single points), tension_cable_out,
         load_points_out, reuse_skips, no_progress_skips, no_intersect_skips,
         terminated, true_termination, overshot, steps_completed
         action_log_out: one branch per placed frame, [frame, target, candidate,
         mirror] as ints (target/candidate 0-4 = TT/HT/DT/CS/SS_MID, mirror 0/1).
         remaining_options_out: comma-separated string, one value per non-reuse step.
         tension_cable_out: one branch per tension line, 2 points each.
         load_points_out: flat Point3d list (empty if load_valid is False).
         guide_curve_out: the curve actually used (RL or custom), after shift/resample.
         All other *_out Point3d trees are one branch per frame/element; empty
         if no BikeBridge was built (run didn't reach true_termination). pin_out
         and roller_out are None under the same condition.
"""

import sys
sys.path.append(r"C:\Users\rensh\Documents\Master Thesis\REP_STRUC RL\RL Application")
sys.path.append(r"C:\Users\rensh\Documents\Master Thesis\REP_STRUC RL\Main Deployment")

import Rhino.Geometry as rg
import ghpythonlib.treehelpers as th
import importlib
import csv
import numpy as np

import Baseline_GA_Core
import Baseline_GA_Utilities
import environment.envs.BikeBuilder_Classes
import environment.envs.BikeBuilder_Utilities
import internal_variables

importlib.reload(internal_variables)
importlib.reload(environment.envs.BikeBuilder_Classes)
importlib.reload(environment.envs.BikeBuilder_Utilities)
importlib.reload(Baseline_GA_Core)
importlib.reload(Baseline_GA_Utilities)

from internal_variables import IV
from environment.envs.BikeBuilder_Classes import BikeFrame, PointDict
from environment.envs.BikeBuilder_Utilities import resample_curve
from Baseline_GA_Core import run_baseline_ga, RANK_WINDOW_DEFAULT
from Baseline_GA_Utilities import placed_frames_to_point_tuples, bridge_points_to_tuples

# =============================================================================
# CSV HELPERS — stdlib, no pandas (not installed in GH venv)
# =============================================================================

def _read_csv_rows(path):
    with open(path, newline='') as f:
        return list(csv.DictReader(f))

# =============================================================================
# CUSTOM CURVE HELPER
# =============================================================================

def _rhino_curve_to_xz(curve, n_dense=1000, planar_tol=0.1):
    # Even arc-length samples, start -> end, as (x, z). Requires a curve in the XZ plane.
    params = curve.DivideByCount(n_dense, True)
    assert params is not None, (
        "custom_curve could not be divided - check that it is a valid, non-degenerate curve."
    )
    points = [curve.PointAt(t) for t in params]
    y_values = [p.Y for p in points]
    assert max(y_values) - min(y_values) < planar_tol, (
        f"custom_curve must lie in the XZ plane (constant Y); Y varies by "
        f"{max(y_values) - min(y_values):.3f} mm."
    )
    return np.array([[p.X, p.Z] for p in points], dtype=np.float32)

# =============================================================================
# DATA LOADING — same sources as RL training (IV.frames_v0, IV.arch_v0)
# =============================================================================

frame_rows = _read_csv_rows(IV.frames_v0)
frame_stock = []
for row in frame_rows:
    corners = np.array([
        [float(row["ST_TOP_X"]),    float(row["ST_TOP_Z"])],
        [float(row["HT_TOP_X"]),    float(row["HT_TOP_Z"])],
        [float(row["HT_BOTTOM_X"]), float(row["HT_BOTTOM_Z"])],
        [float(row["BB_X"]),        float(row["BB_Z"])],
        [float(row["CS_SS_X"]),     float(row["CS_SS_Z"])],
    ], dtype=np.float32)
    frame_stock.append(BikeFrame(corners))

# +++ Optional custom guide curve (GH input `custom_curve`: Rhino curve or None)
_custom_curve = custom_curve if 'custom_curve' in dir() else None  # noqa: F821

if _custom_curve is not None:
    raw_guide_curve = _rhino_curve_to_xz(_custom_curve)
else:
    curve_rows = _read_csv_rows(IV.arch_v0)
    raw_guide_curve = np.array([
        [float(row["x_cord"]), float(row["z_cord"])]
        for row in curve_rows
    ], dtype=np.float32)
# --- (shift + resample below apply to both sources)

# Shift curve start to IV.origin_position, matching BB_arch_environment.__init__.
shift = np.array(IV.origin_position, dtype=np.float32) - raw_guide_curve[0]
raw_guide_curve = (raw_guide_curve + shift).astype(np.float32)

sampled_guide_curve = resample_curve(raw_guide_curve, IV.curve_samples)

# =============================================================================
# OPTIONAL GH INPUT HANDLING
# =============================================================================

_rank_window = rank_window if 'rank_window' in dir() and rank_window else RANK_WINDOW_DEFAULT  # noqa: F821
_progress_weight = progress_weight if 'progress_weight' in dir() and progress_weight else 1.0  # noqa: F821
_distance_weight = distance_weight if 'distance_weight' in dir() and distance_weight else 1.0  # noqa: F821
_strict_termination = bool(strict_termination) if 'strict_termination' in dir() else False  # noqa: F821

# allowed_connections: optional 5-item binary list (1=allowed, 0=disallowed),
# in TT/HT/DT/CS/SS_MID order, matching PointDict's own value order exactly.
# A 0 excludes that point from BOTH target and candidate roles when the 50
# orientations are generated — not filtered after the fact. Left unconnected
# or all-1s, every point stays allowed (unchanged, full-50 behaviour).
if 'allowed_connections' in dir() and allowed_connections:
    _raw_allowed = list(allowed_connections)
    assert len(_raw_allowed) == 5, (
        f"allowed_connections must have exactly 5 items (TT/HT/DT/CS/SS_MID), "
        f"got {len(_raw_allowed)}."
    )
    _allowed_points = {PointDict(i) for i, flag in enumerate(_raw_allowed) if flag}
else:
    _allowed_points = None  # None -> enumerate_orientations() defaults to all 5

# =============================================================================
# RUN
# =============================================================================
allow_wrapping = allow_orientation_wrapping
result = run_baseline_ga(
    frame_stock            = frame_stock,
    guide_curve            = sampled_guide_curve,
    picked_frame           = list(picked_frame),          # noqa: F821 (GH input)
    picked_orientation     = list(picked_orientation),      # noqa: F821 (GH input)
    progress_weight        = _progress_weight,
    distance_weight        = _distance_weight,
    rank_window            = _rank_window,
    strict_termination     = _strict_termination,
    allowed_points         = _allowed_points,
    wrap_orientation       = allow_wrapping,
)

# =============================================================================
# OUTPUT CONVERSION
# =============================================================================

def _point_tuples_to_tree(nested_tuples):
    # list[list[(x, z)]] -> Point3d tree, one branch per outer entry, XZ-plane.
    nested_points = [
        [rg.Point3d(x, 0.0, z) for (x, z) in branch]
        for branch in nested_tuples
    ]
    return th.list_to_tree(nested_points)

def _bridge_connections_to_tuples(bike_bridge):
    # Flattens bike_bridge.connections (per-frame-pair -> up to 2 connector
    # entries) into one flat list of coordinate tuples, one per polyline. Each
    # entry can resolve to 2 or 3 points depending on BikeBridge's own pruning
    # (dropped perpendicular inserts, connection-length limiting) — the loop
    # below handles either length, no fixed-triple assumption.
    triples_out = []
    for connection_set in bike_bridge.connections:
        for triple in connection_set:
            resolved_points = [
                (float(bike_bridge.points[frame_idx][local_idx][0]),
                 float(bike_bridge.points[frame_idx][local_idx][1]))
                for frame_idx, local_idx in triple
            ]
            triples_out.append(resolved_points)
    return triples_out

def _tube_to_tuples(bike_bridge, per_frame_local_indices):
    # Resolves a BikeBridge per-tube index property (list[list[int]], one
    # inner list per frame) into one coordinate-tuple branch per frame.
    branches_out = []
    for frame_idx, local_indices in enumerate(per_frame_local_indices):
        frame_points = bike_bridge.points[frame_idx]
        branch = [
            (float(frame_points[local_idx][0]), float(frame_points[local_idx][1]))
            for local_idx in local_indices
        ]
        branches_out.append(branch)
    return branches_out

def _support_to_point(bike_bridge, support_id):
    # Resolves a BikeBridge support id (single (frame_idx, local_idx) tuple,
    # as returned by bike_bridge.pin / bike_bridge.roller) to one Point3d.
    frame_idx, local_idx = support_id
    x, z = bike_bridge.points[frame_idx][local_idx]
    return rg.Point3d(float(x), 0.0, float(z))

def _tension_lines_to_tuples(bike_bridge):
    # Resolves bike_bridge.tension_lines (list of (id_a, id_b) pairs, each id
    # a (frame_idx, local_idx)) into one 2-point coordinate branch per line.
    branches_out = []
    for id_a, id_b in bike_bridge.tension_lines:
        points = []
        for frame_idx, local_idx in (id_a, id_b):
            x, z = bike_bridge.points[frame_idx][local_idx]
            points.append((float(x), float(z)))
        branches_out.append(points)
    return branches_out

def _load_points_to_list(bike_bridge):
    # Resolves bike_bridge.load_points (flat list of (frame_idx, local_idx)
    # ids) into a flat list of Point3d — same shape as guide_curve_out, since
    # these are standalone points, not polylines. Empty if load_valid is
    # False; that degrades naturally from load_points already being [] then.
    points_out = []
    for frame_idx, local_idx in bike_bridge.load_points:
        x, z = bike_bridge.points[frame_idx][local_idx]
        points_out.append(rg.Point3d(float(x), 0.0, float(z)))
    return points_out

placed_frames_out = _point_tuples_to_tree(
    placed_frames_to_point_tuples(result.placed_frames)
)

action_log_out = th.list_to_tree(result.action_log)

remaining_options_out = ",".join(str(count) for count in result.remaining_options)

guide_curve_out = [rg.Point3d(float(x), 0.0, float(z)) for (x, z) in sampled_guide_curve]

if result.bike_bridge is not None:
    bridge_points_out = _point_tuples_to_tree(
        bridge_points_to_tuples(result.bike_bridge)
    )
    connections_out = _point_tuples_to_tree(
        _bridge_connections_to_tuples(result.bike_bridge)
    )
    tt_out = _point_tuples_to_tree(_tube_to_tuples(result.bike_bridge, result.bike_bridge.top_tubes))
    ht_out = _point_tuples_to_tree(_tube_to_tuples(result.bike_bridge, result.bike_bridge.head_tubes))
    dt_out = _point_tuples_to_tree(_tube_to_tuples(result.bike_bridge, result.bike_bridge.down_tubes))
    cs_out = _point_tuples_to_tree(_tube_to_tuples(result.bike_bridge, result.bike_bridge.chain_stays))
    ss_out = _point_tuples_to_tree(_tube_to_tuples(result.bike_bridge, result.bike_bridge.seat_stays))
    st_out = _point_tuples_to_tree(_tube_to_tuples(result.bike_bridge, result.bike_bridge.seat_tubes))
    pin_out = _support_to_point(result.bike_bridge, result.bike_bridge.pin)
    roller_out = _support_to_point(result.bike_bridge, result.bike_bridge.roller)
    tension_cable_out = _point_tuples_to_tree(_tension_lines_to_tuples(result.bike_bridge))
    load_points_out = _load_points_to_list(result.bike_bridge)
else:
    bridge_points_out = _point_tuples_to_tree([])
    connections_out    = _point_tuples_to_tree([])
    tt_out = _point_tuples_to_tree([])
    ht_out = _point_tuples_to_tree([])
    dt_out = _point_tuples_to_tree([])
    cs_out = _point_tuples_to_tree([])
    ss_out = _point_tuples_to_tree([])
    st_out = _point_tuples_to_tree([])
    pin_out = None
    roller_out = None
    tension_cable_out = _point_tuples_to_tree([])
    load_points_out = []

reuse_skips        = result.tally.reuse_skips
no_progress_skips  = result.tally.no_progress_skips
no_intersect_skips = result.tally.no_intersect_skips
terminated         = result.tally.terminated
true_termination    = result.tally.true_termination
overshot            = result.tally.overshot
steps_completed      = result.tally.steps_completed

# =============================================================================
# IV Outputs
# =============================================================================
deck_range_1      = IV.deck_range[0]
deck_range_2      = IV.deck_range[1]
deck_range        = [deck_range_1, deck_range_2]
tributary_width      = IV.tributary_width
termination_vicinity = IV.termination_vicinity
# ---------- end py3 ----------
and = GateAnd(A=py3.terminated, B=py3.true_termination)
number_slider_3 = Slider(1, range=0..10)
pline = PolyLine(Vertices=py3.placed_frames_out, Closed=True)
pt_2 = Point(py3.load_points_out)
panel_5 = Panel("""1.25
0.833
0.625
0.5
0.416
0.357
0.3125""")
concat = Concatenate()

# ----
# Pre-FEA Visualizer
swatch = ColourSwatch(SwatchColor=RGB(255, 0, 238))
intcrv_2 = Interpolate(Vertices=py3.guide_curve_out, Degree=3, Periodic=False, KnotStyle=1)  # -> Curve, Length, Domain
item_2 = ListItem(List=py3.guide_curve_out, Index=-1, Wrap=True)
pline_2 = PolyLine(Vertices=py3.tension_cable_out, Closed=False)  # -> flatten(Polyline)
pline_3 = PolyLine(Vertices=py3.connections_out, Closed=False)  # -> flatten(Polyline)
cluster_2 = Cluster(V_3=py3.st_out, V_4=py3.tt_out, V_5=py3.ht_out, V_6=py3.dt_out, V=py3.cs_out, V_2=py3.ss_out)  # -> R, R_2
pl = ConstructPlane(Origin=item_2, XAxis=Vector(1, 0, 0), YAxis=Vector(0, 0, 1))
cir = Circle(Plane=pl, Radius=py3.termination_vicinity)
preview = CustomPreview(Geometry=cluster_2.R, Material=simplify(cluster_2.R_2))
preview_2 = CustomPreview(
    Geometry=intcrv_2.Curve,
    Material={diffuse=RGB(221, 160, 221), emission=RGB(66, 48, 66), shine=0.5, specular=RGB(255, 255, 255), transparency=0})
preview_3 = CustomPreview(
    Geometry=cir,
    Material={diffuse=RGB(221, 160, 221), emission=RGB(66, 48, 66), shine=0.5, specular=RGB(255, 255, 255), transparency=0})
preview_4 = CustomPreview(Geometry=pline_2, Material=swatch)
preview_5 = CustomPreview(Geometry=pline_3, Material=ColourSwatch(SwatchColor=RGB(255, 153, 0)))

series = Series(Start=0, Step=1, Count=number_slider_3)
tributary_depth = Slider(1.25, range=0..10)
uls_kn_m2 = Slider(7.35, range=0..10)
item_3 = ListItem(List=panel_5, Index=Slider(6, range=0..6), Wrap=True)
deck_range = Panel("""0
8000""")

# ----
# Connections
tstat = TreeStatistics(Tree=py3.connections_out)  # -> Paths, Length, Count
series_2 = Series(Start=0, Step=1, Count=tstat.Count)
pline_4 = PolyLine(Vertices=py3.connections_out, Closed=False)  # -> flatten(Polyline)
concat_2 = Concatenate(FragmentA="CON_", FragmentB=series_2)
lineelem = CreateLinearElementKaramba3D(
    Line=pline_4,
    Colour=ColourSwatch(SwatchColor=RGB(255, 153, 0)),
    Identifier=concat_2,
    CrossSection=crosec_2,
    LimitDistance_mm=0.005,
    BucklingLengthY_mm=-1,
    BucklingLengthZ_mm=-1,
    BucklingLengthLT_mm=-1,
    Bending=True,
    ToPolylineMaxAngle=0.25,
    ToPolylineTolerance=0.1,
    ToPolylineMaxEdgeLength=0.25,
    New=True,
    Remove=True,
    mode="LineToBeam")  # -> Element, Points, Info

# ----
# Seat Tube
item_4 = ListItem(List=py3.action_log_out, Index=0, Wrap=True)  # -> flatten(Item)
pline_5 = PolyLine(Vertices=py3.st_out, Closed=False)  # -> flatten(Polyline)
concat_3 = Concatenate(FragmentA="ST_", FragmentB=item_4)
item_5 = ListItem(List=cluster.path_mapper_7, Index=item_4, Wrap=True)
lineelem_2 = CreateLinearElementKaramba3D(
    Line=simplify(graft(pline_5)),
    Colour=ColourSwatch(SwatchColor=RGB(170, 0, 255)),
    Identifier=simplify(graft(concat_3)),
    CrossSection=simplify(graft(item_5)),
    LimitDistance_mm=0.005,
    BucklingLengthY_mm=-1,
    BucklingLengthZ_mm=-1,
    BucklingLengthLT_mm=-1,
    Bending=True,
    ToPolylineMaxAngle=0.25,
    ToPolylineTolerance=0.1,
    ToPolylineMaxEdgeLength=0.25,
    New=True,
    Remove=True,
    mode="LineToBeam")  # -> flatten(Element), Points, Info

# ----
# Top Tube
item_6 = ListItem(List=py3.action_log_out, Index=0, Wrap=True)  # -> flatten(Item)
pline_6 = PolyLine(Vertices=py3.tt_out, Closed=False)  # -> flatten(Polyline)
concat_4 = Concatenate(FragmentA="ST_", FragmentB=item_6)
item_7 = ListItem(List=cluster.path_mapper_8, Index=item_6, Wrap=True)
lineelem_3 = CreateLinearElementKaramba3D(
    Line=simplify(graft(pline_6)),
    Colour=ColourSwatch(SwatchColor=RGB(0, 34, 255)),
    Identifier=simplify(graft(concat_4)),
    CrossSection=simplify(graft(item_7)),
    LimitDistance_mm=0.005,
    BucklingLengthY_mm=-1,
    BucklingLengthZ_mm=-1,
    BucklingLengthLT_mm=-1,
    Bending=True,
    ToPolylineMaxAngle=0.25,
    ToPolylineTolerance=0.1,
    ToPolylineMaxEdgeLength=0.25,
    New=True,
    Remove=True,
    mode="LineToBeam")  # -> flatten(Element), Points, Info

# ----
# Head Tube
item_8 = ListItem(List=py3.action_log_out, Index=0, Wrap=True)  # -> flatten(Item)
pline_7 = PolyLine(Vertices=py3.ht_out, Closed=False)  # -> flatten(Polyline)
concat_5 = Concatenate(FragmentA="ST_", FragmentB=item_8)
item_9 = ListItem(List=cluster.path_mapper_11, Index=item_8, Wrap=True)
lineelem_4 = CreateLinearElementKaramba3D(
    Line=simplify(graft(pline_7)),
    Colour=ColourSwatch(SwatchColor=RGB(0, 255, 255)),
    Identifier=simplify(graft(concat_5)),
    CrossSection=simplify(graft(item_9)),
    LimitDistance_mm=0.005,
    BucklingLengthY_mm=-1,
    BucklingLengthZ_mm=-1,
    BucklingLengthLT_mm=-1,
    Bending=True,
    ToPolylineMaxAngle=0.25,
    ToPolylineTolerance=0.1,
    ToPolylineMaxEdgeLength=0.25,
    New=True,
    Remove=True,
    mode="LineToBeam")  # -> flatten(Element), Points, Info

# ----
# Down Tube
item_10 = ListItem(List=py3.action_log_out, Index=0, Wrap=True)  # -> flatten(Item)
pline_8 = PolyLine(Vertices=py3.dt_out, Closed=False)  # -> flatten(Polyline)
concat_6 = Concatenate(FragmentA="ST_", FragmentB=item_10)
item_11 = ListItem(List=cluster.path_mapper_9, Index=item_10, Wrap=True)
lineelem_5 = CreateLinearElementKaramba3D(
    Line=simplify(graft(pline_8)),
    Colour=ColourSwatch(SwatchColor=RGB(51, 255, 0)),
    Identifier=simplify(graft(concat_6)),
    CrossSection=simplify(graft(item_11)),
    LimitDistance_mm=0.005,
    BucklingLengthY_mm=-1,
    BucklingLengthZ_mm=-1,
    BucklingLengthLT_mm=-1,
    Bending=True,
    ToPolylineMaxAngle=0.25,
    ToPolylineTolerance=0.1,
    ToPolylineMaxEdgeLength=0.25,
    New=True,
    Remove=True,
    mode="LineToBeam")  # -> flatten(Element), Points, Info

# ----
# Chain Stay
item_12 = ListItem(List=py3.action_log_out, Index=0, Wrap=True)  # -> flatten(Item)
pline_9 = PolyLine(Vertices=py3.cs_out, Closed=False)  # -> flatten(Polyline)
concat_7 = Concatenate(FragmentA="ST_", FragmentB=item_12)
item_13 = ListItem(List=cluster.path_mapper_10, Index=item_12, Wrap=True)
lineelem_6 = CreateLinearElementKaramba3D(
    Line=simplify(graft(pline_9)),
    Colour=ColourSwatch(SwatchColor=RGB(255, 187, 0)),
    Identifier=simplify(graft(concat_7)),
    CrossSection=simplify(graft(item_13)),
    LimitDistance_mm=0.005,
    BucklingLengthY_mm=-1,
    BucklingLengthZ_mm=-1,
    BucklingLengthLT_mm=-1,
    Bending=True,
    ToPolylineMaxAngle=0.25,
    ToPolylineTolerance=0.1,
    ToPolylineMaxEdgeLength=0.25,
    New=True,
    Remove=True,
    mode="LineToBeam")  # -> flatten(Element), Points, Info

# ----
# Seat Stay
item_14 = ListItem(List=py3.action_log_out, Index=0, Wrap=True)  # -> flatten(Item)
pline_10 = PolyLine(Vertices=py3.ss_out, Closed=False)  # -> flatten(Polyline)
concat_8 = Concatenate(FragmentA="ST_", FragmentB=item_14)
item_15 = ListItem(List=cluster.path_mapper_12, Index=item_14, Wrap=True)
lineelem_7 = CreateLinearElementKaramba3D(
    Line=simplify(graft(pline_10)),
    Colour=ColourSwatch(SwatchColor=RGB(238, 255, 0)),
    Identifier=simplify(graft(concat_8)),
    CrossSection=simplify(graft(item_15)),
    LimitDistance_mm=0.005,
    BucklingLengthY_mm=-1,
    BucklingLengthZ_mm=-1,
    BucklingLengthLT_mm=-1,
    Bending=True,
    ToPolylineMaxAngle=0.25,
    ToPolylineTolerance=0.1,
    ToPolylineMaxEdgeLength=0.25,
    New=True,
    Remove=True,
    mode="LineToBeam")  # -> flatten(Element), Points, Info

remap_2 = RemapNumbers(Value=item_3, Source=Domain(0.3125, 1.25), Target=Domain(1, 0))  # -> Mapped, Clipped

# ----
# Supports
supp = SupportKaramba3D(PosInd=py3.pin_out, Ct_kN_m=Vector(0, 0, 0), Cr_kNm_rad=Vector(0, 0, 0), menu=[buttons(on, on, on, on, off, on)])
supp_2 = SupportKaramba3D(PosInd=py3.roller_out, Ct_kN_m=Vector(0, 0, 0), Cr_kNm_rad=Vector(0, 0, 0), menu=[buttons(off, on, on, on, off, on)])

cluster_3 = Cluster_3(P=py3.load_points_out, I=deck_range)
division = Division(A=cluster_3, B=1000)
multiplication_2 = Multiplication(A=item_3, B=division)
multiplication_3 = Multiplication(A=uls_kn_m2, B=multiplication_2)
list = ValueList({"Load_Case_Gravity", "Load_Case_Gravity_ULS", "Load_Case_ULS"}, selected="Load_Case_Gravity")
vec = VectorXYZ(XComponent=0, YComponent=0, ZComponent=expr("-x", multiplication_3))  # -> Vector, Length
loads = LoadsKaramba3D(ForceVector=flatten(vec.Vector), Local=False, PosInd=flatten(py3.load_points_out), LCase="Load_Case_ULS", mode="Point")

simplify = SimplifyTree(Tree=py3.st_out, Front=False)
tstat_2 = TreeStatistics(Tree=simplify(simplify))  # -> Paths, Length, Count
merge_2 = Merge(Data1=supp, Data2=supp_2)
item_16 = ListItem(List=tstat_2.Paths, Index=[0, -1], Wrap=True)
panel_6 = Panel("""Load_Case_Gravity_ULS
Load_Case_ULS""")
split = SplitTree(Data=simplify, Masks=flatten(item_16))  # -> Positive, Negative

# ----
# THIS MIGHT BE VERY WRONG
panel_7 = Panel("Load_Case_Gravity_ULS")
loads_2 = LoadsKaramba3D(Vector="0,0,-1.35", LCase=panel_7, mode="Gravity")

loads_3 = LoadsKaramba3D(Vector=Vector(0, 0, -1), LCase="Load_Case_Gravity", mode="Gravity")

supp_3 = SupportKaramba3D(
    PosInd=flatten(split.Negative),
    Ct_kN_m=Vector(0, 0, 0),
    Cr_kNm_rad=Vector(0, 0, 0),
    menu=[buttons(off, on, off, off, off, off)])
merge_3 = Merge(Data1=merge_2, Data2=supp_3)
panel_8 = Panel(multiplication_3)
merge_4 = Merge(Data1=flatten(loads), Data2=flatten(loads_3))
list_2 = ValueList({"Load_Case_ULS"}, selected="Load_Case_ULS")
merge_5 = Merge(
    Data1=flatten(concat_3),
    Data2=flatten(concat_4),
    Data3=flatten(concat_5),
    Data4=flatten(concat_6),
    Data5=flatten(concat_7),
    Data6=flatten(concat_8))
frame_ids = Data(merge_5)
connection_ids = Data(concat_2)
merge_6 = Merge(Data1=frame_ids, Data2=connection_ids)  # -> flatten(Result)
non_convergent_objective_scores = Panel("""20
400
400""")
objective_normalization_ranges = Panel("""0 to 100
0 to 1000
0 to 1000""")
item_17 = ListItem(List=objective_normalization_ranges, Index=0, Wrap=True)  # -> Item, Item1, Item2
item_18 = ListItem(List=non_convergent_objective_scores, Index=0, Wrap=True)  # -> Item, Item1, Item2
filter = StreamFilter(Gate=and, Stream0=1, Stream1=remap.Mapped)
filter_2 = StreamFilter(Gate=and, Stream0=1, Stream1=remap_2.Mapped)
merge_7 = Merge()
span_15_pool_5_data = Data(Tree({0;0}: [True, "5,5,5,5,5,5,5,5,5,5,5,5,5,5,5,5,5,5,5,5,5,5,5,5"], {0;1}: ["20", "400", "400", False, "5,5,5,5,5,5,5,5,5,5,5,5,5,5,5,5,5,5,5,5,5,5,5,5"], {0;2}: [True, "5,5,5,5,5,5,5,5,5,5,5,5,5,5,5,5,5,5,5,5,5,5,5,5"], {0;3}: [True, "5,5,5,5,5,5,5,5,5,5,5,5,5,5,5,5,5,5,5,5,5,5,5"], {0;4}: [True, "5,5,5,5,5,5,5,5,5,5,5,5,5,5,5,5,5,5,5,5,5,5,5,5"], {0;5}: ["20", "400", "400", False, "5,5,5,5,5,5,5,5,5,5,5,5,5,5,5,5,5,5,5,5,5,5"]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))
data = Data([1, 0.457876, 0])
data_2 = Data([1, 0.180283, 0.825714, 0.525802, 0.363023, 0.677264, 0])
arch_fitness_values = Panel(data)
trib_width_fitness_values = Panel(data_2)

fitness_span_10_trib = Data(Tree({0;0}: [0.19005, 1, 1, 0.180283], {0;1}: [0.018048, 0.144444, 0.130953, 0.180283], {0;2}: [0.056685, 0.152495, 0.152495, 1], {0;3}: [0.056685, 0.152495, 0.152495, 1], {0;4}: [0.010418, 0.03487, 0.036164, 0.677264], {0;5}: [0.056685, 0.152495, 0.152495, 1]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))
data_span_10_trib = Data(Tree({0;0}: [45.96119854, 1439.939242, 1435.721216, True, "10,10,10,10,10,10,10,10,10,10,10,10,10,10", -298.0670844, 243.9318722, -0.9887054912, 22.2304581], {0;1}: [7.865154887, 386.2003469, 362.1378866, True, "10,10,10,10,10,10,10,10,10,10,10,10,10,10,10,10", -82.14835174, 80.47129361, -5.027330638, 14.16670202], {0;2}: ["20", "400", "400", False, "10,10,10,10,10,10,10,10,10,10,10,10,10,10,10"], {0;3}: ["20", "400", "400", False, "10,10,10,10,10,10,10,10,10,10,10,10,10"], {0;4}: [4.815033275, 136.7842431, 140.8585451, True, "10,10,10,10,10,10,10,10,10,10,10,10,10", -67.89672953, 65.47628185, 2.040929353, 4.939867795], {0;5}: ["20", "400", "400", False, "10,10,10,10,10,10,10,10,10,10,10,10,10,10"]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))
item_19 = ListItem(List=fitness_span_10_trib, Index=3, Wrap=True)  # -> flatten(Item)
item_20 = ListItem(List=data_span_10_trib, Index=0, Wrap=False)  # -> Item, Item1, Item2, Item3, Item4, Item5, Item6, Item7, Item8
tstat_3 = TreeStatistics(Tree=fitness_span_10_trib)  # -> Paths, Length, Count
mindex = MemberIndex(Set=item_19, Member=data_2)  # -> simplify(Index), Count
item_21 = ListItem(List=tstat_3.Paths, Index=mindex.Index, Wrap=True)
smaller = SmallerThan(FirstNumber=item_20.Item, SecondNumber="1.75")  # -> SmallerThan, OrEqualTo
smaller_2 = SmallerThan(FirstNumber=item_20.Item1, SecondNumber="48.3")  # -> SmallerThan, OrEqualTo
smaller_3 = SmallerThan(FirstNumber=item_20.Item2, SecondNumber="62.1")  # -> SmallerThan, OrEqualTo
larger = LargerThan(FirstNumber=item_20.Item5, SecondNumber="-23.5")  # -> LargerThan, OrEqualTo
smaller_4 = SmallerThan(FirstNumber=item_20.Item6, SecondNumber="23.5")  # -> SmallerThan, OrEqualTo
smaller_5 = SmallerThan(FirstNumber=item_20.Item8, SecondNumber="13.65")  # -> SmallerThan, OrEqualTo
smaller_6 = SmallerThan(FirstNumber=item_20.Item7, SecondNumber="0")  # -> SmallerThan, OrEqualTo
bang = ExplodeTree(Data=item_21)  # -> flatten(Branch0), flatten(Branch1), flatten(Branch2), flatten(Branch3), flatten(Branch4), flatten(Branch5), flatten(Branch6)
and_2 = GateAnd(
    A=smaller.SmallerThan,
    B=smaller_2.SmallerThan,
    C=smaller_3.SmallerThan,
    D=larger.LargerThan,
    E=smaller_4.SmallerThan,
    F=smaller_5.SmallerThan,
    G=smaller_6.SmallerThan)
branch = TreeBranch(Tree=and_2, Path=bang.Branch0, MaintainPaths=True)  # -> flatten(Branch)
branch_2 = TreeBranch(Tree=and_2, Path=bang.Branch1, MaintainPaths=True)  # -> flatten(Branch)
branch_3 = TreeBranch(Tree=and_2, Path=bang.Branch2, MaintainPaths=True)  # -> flatten(Branch)
branch_4 = TreeBranch(Tree=and_2, Path=bang.Branch3, MaintainPaths=True)  # -> flatten(Branch)
branch_5 = TreeBranch(Tree=and_2, Path=bang.Branch4, MaintainPaths=True)  # -> flatten(Branch)
branch_6 = TreeBranch(Tree=and_2, Path=bang.Branch5, MaintainPaths=True)  # -> flatten(Branch)
branch_7 = TreeBranch(Tree=and_2, Path=bang.Branch6, MaintainPaths=True)  # -> flatten(Branch)
dispatch = Dispatch(List=branch, DispatchPattern=branch)  # -> ListA, ListB
dispatch_2 = Dispatch(List=branch_2, DispatchPattern=branch_2)  # -> ListA, ListB
dispatch_3 = Dispatch(List=branch_3, DispatchPattern=branch_3)  # -> ListA, ListB
dispatch_4 = Dispatch(List=branch_4, DispatchPattern=branch_4)  # -> ListA, ListB
dispatch_5 = Dispatch(List=branch_5, DispatchPattern=branch_5)  # -> ListA, ListB
dispatch_6 = Dispatch(List=branch_6, DispatchPattern=branch_6)  # -> ListA, ListB
dispatch_7 = Dispatch(List=branch_7, DispatchPattern=branch_7)  # -> ListA, ListB
dispatch_8 = Dispatch(List=flatten(and_2), DispatchPattern=flatten(and_2))  # -> ListA, ListB
lng = ListLength(List=dispatch.ListA)
lng_2 = ListLength(List=dispatch_2.ListA)
lng_3 = ListLength(List=dispatch_3.ListA)
lng_4 = ListLength(List=dispatch_4.ListA)
lng_5 = ListLength(List=dispatch_5.ListA)
lng_6 = ListLength(List=dispatch_6.ListA)
lng_7 = ListLength(List=dispatch_7.ListA)
lng_8 = ListLength(List=dispatch_8.ListA)
merge_8 = Merge(Data1=lng, Data2=lng_2, Data3=lng_3, Data4=lng_4, Data5=lng_5, Data6=lng_6, Data7=lng_7)
ma = MassAddition(Input=merge_8)  # -> Result, PartialResults
panel_9 = Panel(merge_8)

xz = XZPlane(Origin="10000, 0, 10000")
rectangle = Rectangle(Plane=xz, XSize=Domain(0, 10000), YSize=Domain(0, 3000), Radius=0)  # -> Rectangle, Length
area = Area(Geometry=rectangle.Rectangle)  # -> Area, Centroid
arrrec = RectangularArray(Geometry=area.Centroid, Cell=rectangle.Rectangle, XCount=Slider(5, range=0..20), YCount=Slider(10, range=0..20))  # -> Geometry, Transform
pt_3 = Point(Point(4050, 0, 1070))
vec2pt = Vector2Pt(PointA=pt_3, PointB=arrrec.Geometry, Unitize=False)  # -> simplify(graft(Vector)), Length

fitness_span_50_trib = Data(Tree({0;0}: [0.260388, 0.36561, 0.415176, 0.180283], {0;1}: [0.056685, 0.152495, 0.152495, 1], {0;2}: [0.056685, 0.152495, 0.152495, 1], {0;3}: [0.056685, 0.152495, 0.152495, 1], {0;4}: [0.056685, 0.152495, 0.152495, 1], {0;5}: [0.056685, 0.152495, 0.152495, 1]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))
data_span_50_trib = Data(Tree({0;0}: [55.47981028, 669.162814, 714.4002019, True, "50,27,20,20,21,30,28,30,27,21,22,21,21,25,17,25,21,21,22,21,25,24,25,24,24,24", -577.1646894, 584.613111, -21.72499479, 19.35879062], {0;1}: ["20", "400", "400", False, "50,24,16,16,16,22,20,20,20,22,21,23,21,21,21,22,22,19,23,23,24,20,25,18,18,18,22,22,22,26"], {0;2}: ["20", "400", "400", False, "50,22,19,19,18,26,25,26,26,26,15,14,14,15,14,15,14,14,20,20,21,18,23,25,25,22,21,23,22,23"], {0;3}: ["20", "400", "400", False, "50,22,26,20,21,21,25,25,26,26,27,26,20,28,30,20,22,20,28,20,20,28,20,21,21,21,20,20,20"], {0;4}: ["20", "400", "400", False, "50,22,24,29,20,20,24,25,23,13,13,14,15,27,23,23,24,24,23,13,12,22,17,20,20,20,20,26,20,23"], {0;5}: ["20", "400", "400", False, "50,29,18,16,16,16,16,16,24,24,17,24,24,20,20,20,26,25,24,23,26,24,24,24,24,24,24,22"]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))
item_22 = ListItem(List=fitness_span_50_trib, Index=3, Wrap=True)  # -> flatten(Item)
item_23 = ListItem(List=data_span_50_trib, Index=0, Wrap=False)  # -> Item, Item1, Item2, Item3, Item4, Item5, Item6, Item7, Item8
tstat_4 = TreeStatistics(Tree=fitness_span_50_trib)  # -> Paths, Length, Count
mindex_2 = MemberIndex(Set=item_22, Member=data_2)  # -> simplify(Index), Count
item_24 = ListItem(List=tstat_4.Paths, Index=mindex_2.Index, Wrap=True)
smaller_7 = SmallerThan(FirstNumber=item_23.Item, SecondNumber="1.75")  # -> SmallerThan, OrEqualTo
smaller_8 = SmallerThan(FirstNumber=item_23.Item1, SecondNumber="48.3")  # -> SmallerThan, OrEqualTo
smaller_9 = SmallerThan(FirstNumber=item_23.Item2, SecondNumber="62.1")  # -> SmallerThan, OrEqualTo
larger_2 = LargerThan(FirstNumber=item_23.Item5, SecondNumber="-23.5")  # -> LargerThan, OrEqualTo
smaller_10 = SmallerThan(FirstNumber=item_23.Item6, SecondNumber="23.5")  # -> SmallerThan, OrEqualTo
smaller_11 = SmallerThan(FirstNumber=item_23.Item8, SecondNumber="13.65")  # -> SmallerThan, OrEqualTo
smaller_12 = SmallerThan(FirstNumber=item_23.Item7, SecondNumber="0")  # -> SmallerThan, OrEqualTo
bang_2 = ExplodeTree(Data=item_24)  # -> flatten(Branch0), flatten(Branch1), flatten(Branch2), flatten(Branch3), flatten(Branch4), flatten(Branch5), flatten(Branch6)
and_3 = GateAnd(
    A=smaller_7.SmallerThan,
    B=smaller_8.SmallerThan,
    C=smaller_9.SmallerThan,
    D=larger_2.LargerThan,
    E=smaller_10.SmallerThan,
    F=smaller_11.SmallerThan,
    G=smaller_12.SmallerThan)
branch_8 = TreeBranch(Tree=and_3, Path=bang_2.Branch0, MaintainPaths=True)  # -> flatten(Branch)
branch_9 = TreeBranch(Tree=and_3, Path=bang_2.Branch1, MaintainPaths=True)  # -> flatten(Branch)
branch_10 = TreeBranch(Tree=and_3, Path=bang_2.Branch2, MaintainPaths=True)  # -> flatten(Branch)
branch_11 = TreeBranch(Tree=and_3, Path=bang_2.Branch3, MaintainPaths=True)  # -> flatten(Branch)
branch_12 = TreeBranch(Tree=and_3, Path=bang_2.Branch4, MaintainPaths=True)  # -> flatten(Branch)
branch_13 = TreeBranch(Tree=and_3, Path=bang_2.Branch5, MaintainPaths=True)  # -> flatten(Branch)
branch_14 = TreeBranch(Tree=and_3, Path=bang_2.Branch6, MaintainPaths=True)  # -> flatten(Branch)
dispatch_9 = Dispatch(List=branch_8, DispatchPattern=branch_8)  # -> ListA, ListB
dispatch_10 = Dispatch(List=branch_9, DispatchPattern=branch_9)  # -> ListA, ListB
dispatch_11 = Dispatch(List=branch_10, DispatchPattern=branch_10)  # -> ListA, ListB
dispatch_12 = Dispatch(List=branch_11, DispatchPattern=branch_11)  # -> ListA, ListB
dispatch_13 = Dispatch(List=branch_12, DispatchPattern=branch_12)  # -> ListA, ListB
dispatch_14 = Dispatch(List=branch_13, DispatchPattern=branch_13)  # -> ListA, ListB
dispatch_15 = Dispatch(List=branch_14, DispatchPattern=branch_14)  # -> ListA, ListB
dispatch_16 = Dispatch(List=flatten(and_3), DispatchPattern=flatten(and_3))  # -> ListA, ListB
lng_9 = ListLength(List=dispatch_9.ListA)
lng_10 = ListLength(List=dispatch_10.ListA)
lng_11 = ListLength(List=dispatch_11.ListA)
lng_12 = ListLength(List=dispatch_12.ListA)
lng_13 = ListLength(List=dispatch_13.ListA)
lng_14 = ListLength(List=dispatch_14.ListA)
lng_15 = ListLength(List=dispatch_15.ListA)
lng_16 = ListLength(List=dispatch_16.ListA)
merge_9 = Merge(Data1=lng_9, Data2=lng_10, Data3=lng_11, Data4=lng_12, Data5=lng_13, Data6=lng_14, Data7=lng_15)
ma_2 = MassAddition(Input=merge_9)  # -> Result, PartialResults
panel_10 = Panel(merge_9)

fitness_span_5_trib = Data(Tree({0;0}: [0.039917, 1, 0.885364, 0.180283], {0;1}: [0.354955, 1, 1, 0.180283], {0;2}: [0.056685, 0.152495, 0.152495, 1], {0;3}: [1, 1, 1, 0], {0;4}: [0.022671, 0.081849, 0.061591, 0.677264], {0;5}: [0.064033, 0.213176, 0.209804, 0.677264]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))
data_span_5_trib = Data(Tree({0;0}: [15.24161698, 1048.416916, 971.8015966, True, "5,5,5,5,5,5,5,5,5,5,5,5,5", -112.4470855, 101.2555164, -0.4711354376, 17.7504404], {0;1}: [65.87913283, 1972.603068, 2034.305622, True, "5,5,5,5,5,5,5,5,5,5,5,5", -281.7715414, 179.6217525, 0.2365006549, 25.54000099], {0;2}: ["20", "400", "400", False, "5,5,5,5,5,5,5,5,5,5,5,5"], {0;3}: [113.5102551, 3107.534411, 3002.688378, True, "5,5,5,5,5,5,5,5,5,5,5,5", -479.443705, 396.9880515, -7.728836396, 52.15831337], {0;4}: [9.570826484, 262.031696, 212.8656245, True, "5,5,5,5,5,5,5,5,5,5,5", -45.74022701, 48.19902625, 0.7818383873, 7.034737521], {0;5}: [21.91169375, 492.9946188, 488.2657175, True, "5,5,5,5,5,5,5,5,5,5,5,5", -145.5263844, 126.0722272, 2.353519972, 13.71177907]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))
item_25 = ListItem(List=fitness_span_5_trib, Index=3, Wrap=True)  # -> flatten(Item)
item_26 = ListItem(List=data_span_5_trib, Index=0, Wrap=False)  # -> Item, Item1, Item2, Item3, Item4, Item5, Item6, Item7, Item8
tstat_5 = TreeStatistics(Tree=fitness_span_5_trib)  # -> Paths, Length, Count
mindex_3 = MemberIndex(Set=item_25, Member=data_2)  # -> simplify(Index), Count
item_27 = ListItem(List=tstat_5.Paths, Index=mindex_3.Index, Wrap=True)
smaller_13 = SmallerThan(FirstNumber=item_26.Item, SecondNumber="1.75")  # -> SmallerThan, OrEqualTo
smaller_14 = SmallerThan(FirstNumber=item_26.Item1, SecondNumber="48.3")  # -> SmallerThan, OrEqualTo
smaller_15 = SmallerThan(FirstNumber=item_26.Item2, SecondNumber="62.1")  # -> SmallerThan, OrEqualTo
larger_3 = LargerThan(FirstNumber=item_26.Item5, SecondNumber="-23.5")  # -> LargerThan, OrEqualTo
smaller_16 = SmallerThan(FirstNumber=item_26.Item6, SecondNumber="23.5")  # -> SmallerThan, OrEqualTo
smaller_17 = SmallerThan(FirstNumber=item_26.Item8, SecondNumber="13.65")  # -> SmallerThan, OrEqualTo
smaller_18 = SmallerThan(FirstNumber=item_26.Item7, SecondNumber="0")  # -> SmallerThan, OrEqualTo
bang_3 = ExplodeTree(Data=item_27)  # -> flatten(Branch0), flatten(Branch1), flatten(Branch2), flatten(Branch3), flatten(Branch4), flatten(Branch5), flatten(Branch6)
and_4 = GateAnd(
    A=smaller_13.SmallerThan,
    B=smaller_14.SmallerThan,
    C=smaller_15.SmallerThan,
    D=larger_3.LargerThan,
    E=smaller_16.SmallerThan,
    F=smaller_17.SmallerThan,
    G=smaller_18.SmallerThan)
branch_15 = TreeBranch(Tree=and_4, Path=bang_3.Branch0, MaintainPaths=True)  # -> flatten(Branch)
branch_16 = TreeBranch(Tree=and_4, Path=bang_3.Branch1, MaintainPaths=True)  # -> flatten(Branch)
branch_17 = TreeBranch(Tree=and_4, Path=bang_3.Branch2, MaintainPaths=True)  # -> flatten(Branch)
branch_18 = TreeBranch(Tree=and_4, Path=bang_3.Branch3, MaintainPaths=True)  # -> flatten(Branch)
branch_19 = TreeBranch(Tree=and_4, Path=bang_3.Branch4, MaintainPaths=True)  # -> flatten(Branch)
branch_20 = TreeBranch(Tree=and_4, Path=bang_3.Branch5, MaintainPaths=True)  # -> flatten(Branch)
branch_21 = TreeBranch(Tree=and_4, Path=bang_3.Branch6, MaintainPaths=True)  # -> flatten(Branch)
dispatch_17 = Dispatch(List=branch_15, DispatchPattern=branch_15)  # -> ListA, ListB
dispatch_18 = Dispatch(List=branch_16, DispatchPattern=branch_16)  # -> ListA, ListB
dispatch_19 = Dispatch(List=branch_17, DispatchPattern=branch_17)  # -> ListA, ListB
dispatch_20 = Dispatch(List=branch_18, DispatchPattern=branch_18)  # -> ListA, ListB
dispatch_21 = Dispatch(List=branch_19, DispatchPattern=branch_19)  # -> ListA, ListB
dispatch_22 = Dispatch(List=branch_20, DispatchPattern=branch_20)  # -> ListA, ListB
dispatch_23 = Dispatch(List=branch_21, DispatchPattern=branch_21)  # -> ListA, ListB
dispatch_24 = Dispatch(List=flatten(and_4), DispatchPattern=flatten(and_4))  # -> ListA, ListB
lng_17 = ListLength(List=dispatch_17.ListA)
lng_18 = ListLength(List=dispatch_18.ListA)
lng_19 = ListLength(List=dispatch_19.ListA)
lng_20 = ListLength(List=dispatch_20.ListA)
lng_21 = ListLength(List=dispatch_21.ListA)
lng_22 = ListLength(List=dispatch_22.ListA)
lng_23 = ListLength(List=dispatch_23.ListA)
lng_24 = ListLength(List=dispatch_24.ListA)
merge_10 = Merge(Data1=lng_17, Data2=lng_18, Data3=lng_19, Data4=lng_20, Data5=lng_21, Data6=lng_22, Data7=lng_23)
ma_3 = MassAddition(Input=merge_10)  # -> Result, PartialResults
panel_11 = Panel(merge_10)

fitness_span_2_trib = Data(Tree({0;0}: [0.189667, 1, 1, 0.180283], {0;1}: [0.133187, 1, 1, 0.180283], {0;2}: [0.176672, 1, 0.732094, 0.677264], {0;3}: [0.324904, 1, 1, 0], {0;4}: [0.038438, 0.23736, 0.223352, 0.677264], {0;5}: [0.048776, 0.774585, 0.639159, 0.677264]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))
data_span_2_trib = Data(Tree({0;0}: [45.9039474, 1351.53206, 1257.403269, True, "2,2,2,2,2,2,2,2,2,2,2,2", -234.8730771, 220.7795816, -32.2914046, 43.30996274], {0;1}: [36.62086346, 1050.455905, 1074.633114, True, "2,2,2,2,2,2,2,2,2,2,2", -151.421515, 137.5464913, -0.9949640622, 16.40296056], {0;2}: [43.92071075, 1061.333471, 915.4648479, True, "2,2,2,2,2,2,2,2,2,2", -137.9437104, 148.7371819, 3.009343102, 14.37583796], {0;3}: [62.81861877, 1885.842166, 1971.733639, True, "2,2,2,2,2,2,2,2,2,2", -409.324664, 365.4696632, -4.118420173, 21.52166528], {0;4}: [14.79070999, 525.6282055, 506.99147, True, "2,2,2,2,2,2,2,2,2,2", -107.9453875, 92.78460931, 0.4159586665, 9.182884538], {0;5}: [17.83123444, 933.3596158, 869.6793874, True, "2,2,2,2,2,2,2,2,2,2", -106.9211692, 94.226646, -14.14449536, 17.47816821]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))
item_28 = ListItem(List=fitness_span_2_trib, Index=3, Wrap=True)  # -> flatten(Item)
item_29 = ListItem(List=data_span_2_trib, Index=0, Wrap=False)  # -> Item, Item1, Item2, Item3, Item4, Item5, Item6, Item7, Item8
tstat_6 = TreeStatistics(Tree=fitness_span_2_trib)  # -> Paths, Length, Count
mindex_4 = MemberIndex(Set=item_28, Member=data_2)  # -> simplify(Index), Count
item_30 = ListItem(List=tstat_6.Paths, Index=mindex_4.Index, Wrap=True)
smaller_19 = SmallerThan(FirstNumber=item_29.Item, SecondNumber="1.75")  # -> SmallerThan, OrEqualTo
smaller_20 = SmallerThan(FirstNumber=item_29.Item1, SecondNumber="48.3")  # -> SmallerThan, OrEqualTo
smaller_21 = SmallerThan(FirstNumber=item_29.Item2, SecondNumber="62.1")  # -> SmallerThan, OrEqualTo
larger_4 = LargerThan(FirstNumber=item_29.Item5, SecondNumber="-23.5")  # -> LargerThan, OrEqualTo
smaller_22 = SmallerThan(FirstNumber=item_29.Item6, SecondNumber="23.5")  # -> SmallerThan, OrEqualTo
smaller_23 = SmallerThan(FirstNumber=item_29.Item8, SecondNumber="13.65")  # -> SmallerThan, OrEqualTo
smaller_24 = SmallerThan(FirstNumber=item_29.Item7, SecondNumber="0")  # -> SmallerThan, OrEqualTo
bang_4 = ExplodeTree(Data=item_30)  # -> flatten(Branch0), flatten(Branch1), flatten(Branch2), flatten(Branch3), flatten(Branch4), flatten(Branch5), flatten(Branch6)
and_5 = GateAnd(
    A=smaller_19.SmallerThan,
    B=smaller_20.SmallerThan,
    C=smaller_21.SmallerThan,
    D=larger_4.LargerThan,
    E=smaller_22.SmallerThan,
    F=smaller_23.SmallerThan,
    G=smaller_24.SmallerThan)
branch_22 = TreeBranch(Tree=and_5, Path=bang_4.Branch0, MaintainPaths=True)  # -> flatten(Branch)
branch_23 = TreeBranch(Tree=and_5, Path=bang_4.Branch1, MaintainPaths=True)  # -> flatten(Branch)
branch_24 = TreeBranch(Tree=and_5, Path=bang_4.Branch2, MaintainPaths=True)  # -> flatten(Branch)
branch_25 = TreeBranch(Tree=and_5, Path=bang_4.Branch3, MaintainPaths=True)  # -> flatten(Branch)
branch_26 = TreeBranch(Tree=and_5, Path=bang_4.Branch4, MaintainPaths=True)  # -> flatten(Branch)
branch_27 = TreeBranch(Tree=and_5, Path=bang_4.Branch5, MaintainPaths=True)  # -> flatten(Branch)
branch_28 = TreeBranch(Tree=and_5, Path=bang_4.Branch6, MaintainPaths=True)  # -> flatten(Branch)
dispatch_25 = Dispatch(List=branch_22, DispatchPattern=branch_22)  # -> ListA, ListB
dispatch_26 = Dispatch(List=branch_23, DispatchPattern=branch_23)  # -> ListA, ListB
dispatch_27 = Dispatch(List=branch_24, DispatchPattern=branch_24)  # -> ListA, ListB
dispatch_28 = Dispatch(List=branch_25, DispatchPattern=branch_25)  # -> ListA, ListB
dispatch_29 = Dispatch(List=branch_26, DispatchPattern=branch_26)  # -> ListA, ListB
dispatch_30 = Dispatch(List=branch_27, DispatchPattern=branch_27)  # -> ListA, ListB
dispatch_31 = Dispatch(List=branch_28, DispatchPattern=branch_28)  # -> ListA, ListB
dispatch_32 = Dispatch(List=flatten(and_5), DispatchPattern=flatten(and_5))  # -> ListA, ListB
lng_25 = ListLength(List=dispatch_25.ListA)
lng_26 = ListLength(List=dispatch_26.ListA)
lng_27 = ListLength(List=dispatch_27.ListA)
lng_28 = ListLength(List=dispatch_28.ListA)
lng_29 = ListLength(List=dispatch_29.ListA)
lng_30 = ListLength(List=dispatch_30.ListA)
lng_31 = ListLength(List=dispatch_31.ListA)
lng_32 = ListLength(List=dispatch_32.ListA)
merge_11 = Merge(Data1=lng_25, Data2=lng_26, Data3=lng_27, Data4=lng_28, Data5=lng_29, Data6=lng_30, Data7=lng_31)
ma_4 = MassAddition(Input=merge_11)  # -> Result, PartialResults
panel_12 = Panel(merge_11)

fitness_span_2_trib_2 = Data(Tree({0;0}: [0.264166, 0.592169, 0.583363, 0.180283], {0;1}: [0.040549, 0.082244, 0.083445, 0.825714], {0;2}: [0.275052, 0.221914, 0.255918, 0.180283], {0;3}: [0.00867, 0.025111, 0.018948, 0.363023], {0;4}: [0.068304, 0.180095, 0.196153, 0.180283], {0;5}: [1, 1, 1, 0.363023]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))
data_span_2_trib_2 = Data(Tree({0;0}: [55.94206001, 842.772684, 837.4282494, True, "1,1,1,1,1,1,1,1,1,1,1", -383.7225274, 316.6729375, 4.261208657, 19.45713075], {0;1}: [15.43284475, 262.9331588, 265.6671915, True, "1,1,1,1,1,1,1,1,1,1", -76.52587666, 63.70834424, -8.694058304, 16.26628991], {0;2}: [57.24983866, 505.0375896, 549.2716387, True, "1,1,1,1,1,1,1,1,1,1", -395.398692, 297.6512529, 5.401646449, 30.98592564], {0;3}: [4.067301232, 104.3479208, 82.04663035, True, "1,1,1,1,1,1,1,1,1,1", -46.66172422, 35.92600679, -6.653791244, 10.16855033], {0;4}: [22.98218873, 444.5100708, 468.6447259, True, "1,1,1,1,1,1,1,1,1,1", -118.763641, 117.3340007, -22.69091445, 47.8566857], {0;5}: [144.1251338, 2573.08174, 2503.193403, True, "1,1,1,1,1,1,1,1,1,1", -348.3962334, 289.3449531, 0.5156818559, 15.70433888]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))
item_31 = ListItem(List=fitness_span_2_trib_2, Index=3, Wrap=True)  # -> flatten(Item)
item_32 = ListItem(List=data_span_2_trib_2, Index=0, Wrap=False)  # -> Item, Item1, Item2, Item3, Item4, Item5, Item6, Item7, Item8
tstat_7 = TreeStatistics(Tree=fitness_span_2_trib_2)  # -> Paths, Length, Count
mindex_5 = MemberIndex(Set=item_31, Member=data_2)  # -> simplify(Index), Count
item_33 = ListItem(List=tstat_7.Paths, Index=mindex_5.Index, Wrap=True)
smaller_25 = SmallerThan(FirstNumber=item_32.Item, SecondNumber="1.75")  # -> SmallerThan, OrEqualTo
smaller_26 = SmallerThan(FirstNumber=item_32.Item1, SecondNumber="48.3")  # -> SmallerThan, OrEqualTo
smaller_27 = SmallerThan(FirstNumber=item_32.Item2, SecondNumber="62.1")  # -> SmallerThan, OrEqualTo
larger_5 = LargerThan(FirstNumber=item_32.Item5, SecondNumber="-23.5")  # -> LargerThan, OrEqualTo
smaller_28 = SmallerThan(FirstNumber=item_32.Item6, SecondNumber="23.5")  # -> SmallerThan, OrEqualTo
smaller_29 = SmallerThan(FirstNumber=item_32.Item8, SecondNumber="13.65")  # -> SmallerThan, OrEqualTo
smaller_30 = SmallerThan(FirstNumber=item_32.Item7, SecondNumber="0")  # -> SmallerThan, OrEqualTo
bang_5 = ExplodeTree(Data=item_33)  # -> flatten(Branch0), flatten(Branch1), flatten(Branch2), flatten(Branch3), flatten(Branch4), flatten(Branch5), flatten(Branch6)
and_6 = GateAnd(
    A=smaller_25.SmallerThan,
    B=smaller_26.SmallerThan,
    C=smaller_27.SmallerThan,
    D=larger_5.LargerThan,
    E=smaller_28.SmallerThan,
    F=smaller_29.SmallerThan,
    G=smaller_30.SmallerThan)
branch_29 = TreeBranch(Tree=and_6, Path=bang_5.Branch0, MaintainPaths=True)  # -> flatten(Branch)
branch_30 = TreeBranch(Tree=and_6, Path=bang_5.Branch1, MaintainPaths=True)  # -> flatten(Branch)
branch_31 = TreeBranch(Tree=and_6, Path=bang_5.Branch2, MaintainPaths=True)  # -> flatten(Branch)
branch_32 = TreeBranch(Tree=and_6, Path=bang_5.Branch3, MaintainPaths=True)  # -> flatten(Branch)
branch_33 = TreeBranch(Tree=and_6, Path=bang_5.Branch4, MaintainPaths=True)  # -> flatten(Branch)
branch_34 = TreeBranch(Tree=and_6, Path=bang_5.Branch5, MaintainPaths=True)  # -> flatten(Branch)
branch_35 = TreeBranch(Tree=and_6, Path=bang_5.Branch6, MaintainPaths=True)  # -> flatten(Branch)
dispatch_33 = Dispatch(List=branch_29, DispatchPattern=branch_29)  # -> ListA, ListB
dispatch_34 = Dispatch(List=branch_30, DispatchPattern=branch_30)  # -> ListA, ListB
dispatch_35 = Dispatch(List=branch_31, DispatchPattern=branch_31)  # -> ListA, ListB
dispatch_36 = Dispatch(List=branch_32, DispatchPattern=branch_32)  # -> ListA, ListB
dispatch_37 = Dispatch(List=branch_33, DispatchPattern=branch_33)  # -> ListA, ListB
dispatch_38 = Dispatch(List=branch_34, DispatchPattern=branch_34)  # -> ListA, ListB
dispatch_39 = Dispatch(List=branch_35, DispatchPattern=branch_35)  # -> ListA, ListB
dispatch_40 = Dispatch(List=flatten(and_6), DispatchPattern=flatten(and_6))  # -> ListA, ListB
lng_33 = ListLength(List=dispatch_33.ListA)
lng_34 = ListLength(List=dispatch_34.ListA)
lng_35 = ListLength(List=dispatch_35.ListA)
lng_36 = ListLength(List=dispatch_36.ListA)
lng_37 = ListLength(List=dispatch_37.ListA)
lng_38 = ListLength(List=dispatch_38.ListA)
lng_39 = ListLength(List=dispatch_39.ListA)
lng_40 = ListLength(List=dispatch_40.ListA)
merge_12 = Merge(Data1=lng_33, Data2=lng_34, Data3=lng_35, Data4=lng_36, Data5=lng_37, Data6=lng_38, Data7=lng_39)
ma_5 = MassAddition(Input=merge_12)  # -> Result, PartialResults
panel_13 = Panel(merge_12)

# ----
# 10 step action space
# 1.25 trib width
data_3 = Data(Tree({0}: ["20", "20", 21.2863956, "20", 8.965122866, 29.5065569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], {1}: ["400", "400", 548.3073001, "400", 223.6857979, 546.3442947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], {2}: ["400", "400", 507.1847623, "400", 212.1630925, 511.8863214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], {3}: [False, False, True, False, True, True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], {4}: ["10,10,10,10,10,10,10,10,10,10,10,10,10", "10,10,10,10,10,10,10,10,10,10,10,10,10", "10,10,10,10,10,10,10,10,10,10,10,10,10,10", "10,10,10,10,10,10,10,10,10,10,10,10,10,10", "10,10,10,10,10,10,10,10,10,10,10,10,10", "10,10,10,10,10,10,10,10,10,10,10,10,10,10"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]))

bang_6 = ExplodeTree(Data=data_3)  # -> Branch0, Branch1, Branch2, Branch3, Branch4

fitness_span_25_trib = Data(Tree({0;0}: [0.056685, 0.152495, 0.152495, 1], {0;1}: [0.056685, 0.152495, 0.152495, 1], {0;2}: [0.056685, 0.152495, 0.152495, 1], {0;3}: [0.056685, 0.152495, 0.152495, 1], {0;4}: [0.056685, 0.152495, 0.152495, 1], {0;5}: [0.056685, 0.152495, 0.152495, 1]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))
data_span_25_trib = Data(Tree({0;0}: ["20", "400", "400", False, "25,24,23,21,19,25,22,25,24,20,21,25,24,20,23,20,18,21,21,21"], {0;1}: ["20", "400", "400", False, "25,25,23,23,20,25,24,22,22,21,22,24,16,16,16,17,16,21,25,20"], {0;2}: ["20", "400", "400", False, "25,25,25,24,25,16,16,16,16,22,19,21,21,25,18,17,17,25,23,20,21,19,20,18"], {0;3}: ["20", "400", "400", False, "25,23,23,24,22,23,23,25,23,20,21,24,25,23,20,25,17,24"], {0;4}: ["20", "400", "400", False, "25,25,25,23,21,22,24,25,25,25,23,25,21,24,15,15,14,17"], {0;5}: ["20", "400", "400", False, "25,22,20,20,20,20,22,14,20,23,21,19,20,20,21,21,25,24,22,23,13,15,15,15,24,20"]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))
item_34 = ListItem(List=fitness_span_25_trib, Index=3, Wrap=True)  # -> flatten(Item)
item_35 = ListItem(List=data_span_25_trib, Index=0, Wrap=False)  # -> Item, Item1, Item2, Item3, Item4, Item5, Item6, Item7, Item8
tstat_8 = TreeStatistics(Tree=fitness_span_25_trib)  # -> Paths, Length, Count
mindex_6 = MemberIndex(Set=item_34, Member=data_2)  # -> simplify(Index), Count
item_36 = ListItem(List=tstat_8.Paths, Index=mindex_6.Index, Wrap=True)
smaller_31 = SmallerThan(FirstNumber=item_35.Item, SecondNumber="1.75")  # -> SmallerThan, OrEqualTo
smaller_32 = SmallerThan(FirstNumber=item_35.Item1, SecondNumber="48.3")  # -> SmallerThan, OrEqualTo
smaller_33 = SmallerThan(FirstNumber=item_35.Item2, SecondNumber="62.1")  # -> SmallerThan, OrEqualTo
larger_6 = LargerThan(FirstNumber=item_35.Item5, SecondNumber="-23.5")  # -> LargerThan, OrEqualTo
smaller_34 = SmallerThan(FirstNumber=item_35.Item6, SecondNumber="23.5")  # -> SmallerThan, OrEqualTo
smaller_35 = SmallerThan(FirstNumber=item_35.Item8, SecondNumber="13.65")  # -> SmallerThan, OrEqualTo
smaller_36 = SmallerThan(FirstNumber=item_35.Item7, SecondNumber="0")  # -> SmallerThan, OrEqualTo
bang_7 = ExplodeTree(Data=item_36)  # -> flatten(Branch0), flatten(Branch1), flatten(Branch2), flatten(Branch3), flatten(Branch4), flatten(Branch5), flatten(Branch6)
and_7 = GateAnd(
    A=smaller_31.SmallerThan,
    B=smaller_32.SmallerThan,
    C=smaller_33.SmallerThan,
    D=larger_6.LargerThan,
    E=smaller_34.SmallerThan,
    F=smaller_35.SmallerThan,
    G=smaller_36.SmallerThan)
branch_36 = TreeBranch(Tree=and_7, Path=bang_7.Branch0, MaintainPaths=True)  # -> flatten(Branch)
branch_37 = TreeBranch(Tree=and_7, Path=bang_7.Branch1, MaintainPaths=True)  # -> flatten(Branch)
branch_38 = TreeBranch(Tree=and_7, Path=bang_7.Branch2, MaintainPaths=True)  # -> flatten(Branch)
branch_39 = TreeBranch(Tree=and_7, Path=bang_7.Branch3, MaintainPaths=True)  # -> flatten(Branch)
branch_40 = TreeBranch(Tree=and_7, Path=bang_7.Branch4, MaintainPaths=True)  # -> flatten(Branch)
branch_41 = TreeBranch(Tree=and_7, Path=bang_7.Branch5, MaintainPaths=True)  # -> flatten(Branch)
branch_42 = TreeBranch(Tree=and_7, Path=bang_7.Branch6, MaintainPaths=True)  # -> flatten(Branch)
dispatch_41 = Dispatch(List=branch_36, DispatchPattern=branch_36)  # -> ListA, ListB
dispatch_42 = Dispatch(List=branch_37, DispatchPattern=branch_37)  # -> ListA, ListB
dispatch_43 = Dispatch(List=branch_38, DispatchPattern=branch_38)  # -> ListA, ListB
dispatch_44 = Dispatch(List=branch_39, DispatchPattern=branch_39)  # -> ListA, ListB
dispatch_45 = Dispatch(List=branch_40, DispatchPattern=branch_40)  # -> ListA, ListB
dispatch_46 = Dispatch(List=branch_41, DispatchPattern=branch_41)  # -> ListA, ListB
dispatch_47 = Dispatch(List=branch_42, DispatchPattern=branch_42)  # -> ListA, ListB
dispatch_48 = Dispatch(List=flatten(and_7), DispatchPattern=flatten(and_7))  # -> ListA, ListB
lng_41 = ListLength(List=dispatch_41.ListA)
lng_42 = ListLength(List=dispatch_42.ListA)
lng_43 = ListLength(List=dispatch_43.ListA)
lng_44 = ListLength(List=dispatch_44.ListA)
lng_45 = ListLength(List=dispatch_45.ListA)
lng_46 = ListLength(List=dispatch_46.ListA)
lng_47 = ListLength(List=dispatch_47.ListA)
lng_48 = ListLength(List=dispatch_48.ListA)
merge_13 = Merge(Data1=lng_41, Data2=lng_42, Data3=lng_43, Data4=lng_44, Data5=lng_45, Data6=lng_46, Data7=lng_47)
ma_6 = MassAddition(Input=merge_13)  # -> Result, PartialResults
panel_14 = Panel(merge_13)

smaller_37 = SmallerThan(FirstNumber=bang_6.Branch0, SecondNumber="1.75")  # -> SmallerThan, OrEqualTo
smaller_38 = SmallerThan(FirstNumber=bang_6.Branch1, SecondNumber="48.3")  # -> SmallerThan, OrEqualTo
smaller_39 = SmallerThan(FirstNumber=bang_6.Branch2, SecondNumber="62.1")  # -> SmallerThan, OrEqualTo
and_8 = GateAnd(A=smaller_37.SmallerThan, B=smaller_38.SmallerThan, C=smaller_39.SmallerThan)
dispatch_49 = Dispatch(List=and_8, DispatchPattern=and_8)  # -> ListA, ListB
pt_4 = Point(Point(870, 0, 50))
move_3 = Move(Geometry=pt_4, Motion=vec2pt.Vector)  # -> Geometry, Transform
xz_2 = XZPlane(Origin=move_3.Geometry)

# ----
# Tension Cables
tstat_9 = TreeStatistics(Tree=py3.tension_cable_out)  # -> Paths, Length, Count
series_3 = Series(Start=0, Step=1, Count=tstat_9.Count)
pline_11 = PolyLine(Vertices=py3.tension_cable_out, Closed=False)  # -> flatten(Polyline)
concat_9 = Concatenate(FragmentA="TENSION_", FragmentB=series_3)

divide = DivideCurve(Curve=pline_11, Count=number_slider_3, Kinks=False)  # -> Points, Tangents, Parameters
pline_12 = PolyLine(Vertices=divide.Points, Closed=False)
concat_10 = Concatenate(FragmentA=graft(concat_9), FragmentB="_", FragmentC=series)  # -> flatten(Result)
explode = Explode(Curve=pline_12, Recursive=True)  # -> flatten(Segments), Vertices

lineelem_8 = CreateLinearElementKaramba3D(
    Line=pline_11,
    Colour=ColourSwatch(SwatchColor=RGB(255, 0, 238)),
    Identifier=concat_10,
    CrossSection=crosec,
    LimitDistance_mm=0.005,
    BucklingLengthY_mm=-1,
    BucklingLengthZ_mm=-1,
    BucklingLengthLT_mm=-1,
    Bending=False,
    ToPolylineMaxAngle=0.25,
    ToPolylineTolerance=0.1,
    ToPolylineMaxEdgeLength=0.25,
    New=True,
    Remove=True,
    mode="LineToTruss")  # -> Element, Points, Info

loads_4 = LoadsKaramba3D(Eps0=Slider(1, range=0..1), ElementIdentifiers=concat_9, LCase=panel_6, mode="InitialStrain")
merge_14 = Merge(
    Data1=flatten(lineelem_8.Element),
    Data2=flatten(lineelem.Element),
    Data3=flatten(lineelem_2.Element),
    Data4=flatten(lineelem_3.Element),
    Data5=flatten(lineelem_4.Element),
    Data6=flatten(lineelem_5.Element),
    Data7=flatten(lineelem_6.Element),
    Data8=flatten(lineelem_7.Element))
assemble = AssembleModelKaramba3D(Elem=merge_14, Support=merge_2, Load=merge_4, LimitDistance_mm=0.005)  # -> Model, Info, Mass_kg, CentreOfGravity, LoadCaseNames
tension_ids = Data(concat_10)
analyse = AnalyseKaramba3D(Model=assemble.Model, LoadCases=list_2)  # -> AnalysedModel, MaximumDisplacement_cm, ResultingForce_kN, ChangeOfElasticEnergy_kNm
analysethii = AnalyseThIIKaramba3D(
    Model=assemble.Model,
    LoadCases=list_2,
    UseInitialNII=True,
    NIIFromCombination=True,
    NoTensionalNII=False,
    RTolerance=1e-07,
    MaxIterations=50)  # -> AnalysedModel, MaximumDisplacement_cm, ResultingForce_kN, ChangeOfElasticEnergy_kNm; disabled
modelview = ModelViewKaramba3D(Model=analyse.AnalysedModel)  # -> Model, DeformedMesh, DeformedAxes, DeformedModel, MaximumDeformation
# Frames
utilization = UtilizationOfElementsKaramba3D(
    AnalysedModel=analyse.AnalysedModel,
    ElementsIdentifiers=frame_ids,
    NumberOfSamplePoints=3,
    ElasticDesign=True,
    GammaM0=1,
    GammaM1=1.1,
    SwayFrame=True,
    WithDetails=True,
    mode="Beams")  # -> Model, Utilization, SigMax_kN_cm², SigMin_kN_cm², TauMax_kN_cm², UtilN, UtilVy, UtilVz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
# Connections
utilization_2 = UtilizationOfElementsKaramba3D(
    AnalysedModel=analyse.AnalysedModel,
    ElementsIdentifiers=connection_ids,
    NumberOfSamplePoints=3,
    ElasticDesign=True,
    GammaM0=1,
    GammaM1=1.1,
    SwayFrame=True,
    WithDetails=False,
    mode="Beams")  # -> Model, Utilization, SigMax_kN_cm², SigMin_kN_cm², TauMax_kN_cm², UtilN, UtilVy, UtilVz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
# Tension Cables
utilization_3 = UtilizationOfElementsKaramba3D(
    AnalysedModel=analyse.AnalysedModel,
    ElementsIdentifiers=tension_ids,
    NumberOfSamplePoints=3,
    ElasticDesign=True,
    GammaM0=1,
    GammaM1=1.1,
    SwayFrame=True,
    WithDetails=False,
    mode="Beams")  # -> Model, Utilization, SigMax_kN_cm², SigMin_kN_cm², TauMax_kN_cm², UtilN, UtilVy, UtilVz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
# Frames + Connectors
utilization_4 = UtilizationOfElementsKaramba3D(
    AnalysedModel=analyse.AnalysedModel,
    ElementsIdentifiers=merge_6,
    NumberOfSamplePoints=3,
    ElasticDesign=True,
    GammaM0=1,
    GammaM1=1.1,
    SwayFrame=True,
    WithDetails=False,
    mode="Beams")  # -> Model, Utilization, SigMax_kN_cm², SigMin_kN_cm², TauMax_kN_cm², UtilN, UtilVy, UtilVz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
merge_15 = Merge(Data1=flatten(utilization.SigMax_kN_cm²), Data2=flatten(utilization.SigMin_kN_cm²))
merge_16 = Merge(Data1=flatten(utilization_2.SigMax_kN_cm²), Data2=flatten(utilization_2.SigMin_kN_cm²))
merge_17 = Merge(Data1=flatten(utilization_3.SigMax_kN_cm²), Data2=flatten(utilization_3.SigMin_kN_cm²))
beamview = BeamViewKaramba3D(Model=modelview.Model)  # -> Model, MeshesOfRenderedBeams, DeformedBeamAxes, LegendColours, LegendTags
sort = SortList(Keys=merge_15)  # -> Keys, ValuesA
sort_2 = SortList(Keys=merge_16)  # -> Keys, ValuesA
sort_3 = SortList(Keys=merge_17)  # -> Keys, ValuesA
max_compression = ListItem(List=sort.Keys, Index=0, Wrap=True)
max_tension = ListItem(List=sort.Keys, Index=-1, Wrap=True)
max_compression_2 = ListItem(List=sort_2.Keys, Index=0, Wrap=True)
max_tension_2 = ListItem(List=sort_2.Keys, Index=-1, Wrap=True)
max_compression_3 = ListItem(List=sort_3.Keys, Index=0, Wrap=True)
max_tension_3 = ListItem(List=sort_3.Keys, Index=-1, Wrap=True)
mesh = Mesh(beamview.MeshesOfRenderedBeams)
panel_15 = Panel(max_compression)
panel_16 = Panel(max_tension)
panel_17 = Panel(max_compression_2)
panel_18 = Panel(max_tension_2)
panel_19 = Panel(max_compression_3)
panel_20 = Panel(max_tension_3)
preview_6 = CustomPreview(Geometry=mesh, Material=ColourSwatch(SwatchColor=RGB(255, 255, 255)))
legend = Legend(Colour=beamview.LegendColours, Tags=beamview.LegendTags, LegendType=1)

# ----
# Wallacei Optimizer
merge_18 = Merge(Data1=flatten(utilization_4.SigMax_kN_cm²), Data2=flatten(utilization_4.SigMin_kN_cm²))
item_37 = ListItem(List=py3.action_log_out, Index=0, Wrap=True)  # -> Item, Item1, Item2, Item3
sort_4 = SortList(Keys=merge_18)  # -> Keys, ValuesA
concat_11 = Concatenate(
    FragmentH="[",
    FragmentA=item_37.Item,
    FragmentE=",",
    FragmentB=item_37.Item1,
    FragmentF=",",
    FragmentC=item_37.Item2,
    FragmentG=",",
    FragmentD=item_37.Item3,
    FragmentI="]")  # -> flatten(Result)
max_compression_4 = ListItem(List=sort_4.Keys, Index=0, Wrap=True)
max_tension_4 = ListItem(List=sort_4.Keys, Index=-1, Wrap=True)
max_compression_5 = Absolute(Value=max_compression_4)
filter_3 = StreamFilter(Gate=and, Stream0=item_18.Item, Stream1=modelview.MaximumDeformation)
filter_4 = StreamFilter(Gate=and, Stream0=item_18.Item1, Stream1=max_compression_5)
filter_5 = StreamFilter(Gate=and, Stream0=item_18.Item2, Stream1=max_tension_4)
karamba_mesh = Mesh(beamview.MeshesOfRenderedBeams)
shape_grammar = Data(concat_11)
remap_3 = RemapNumbers(Value=filter_3, Source=item_17.Item, Target=Domain(0, 1))  # -> Mapped, Clipped
remap_4 = RemapNumbers(Value=filter_4, Source=item_17.Item1, Target=Domain(0, 1))  # -> Mapped, Clipped
remap_5 = RemapNumbers(Value=filter_5, Source=item_17.Item2, Target=Domain(0, 1))  # -> Mapped, Clipped
merge_19 = Merge(
    Data1=max_compression_2,
    Data2=max_tension_2,
    Data3=max_compression_3,
    Data4=max_tension_3,
    Data5=max_compression_4,
    Data6=max_tension_4,
    Data7=filter_3)
merge_20 = Merge(Data1=max_compression_2, Data2=max_tension_2, Data3=max_compression_3, Data4=max_tension_3)
merge_21 = Merge(Data1=filter_3, Data2=filter_4, Data3=filter_5, Data4=and, Data5=py3.remaining_options_out, Data6=merge_20)

filter_6 = StreamFilter(Gate=and, Stream1=karamba_mesh)
txt = Text(shape_grammar)
merge_22 = Merge(Data1=remap_3.Mapped, Data2=remap_4.Mapped, Data3=remap_5.Mapped, Data4=filter, Data5=filter_2)
num_2 = Number(merge_19)
merge_23 = Merge(Data1=flatten(txt), Data2=flatten(num_2), Data3=flatten(filter_6))
graph = GraphMapper(
    merge_22,
    x0=0,
    x1=1,
    y0=0,
    y1=1,
    container_name="Bezier",
    cpx=[0, 0.5000813603, 0.8996440768, 1],
    cpy=[0, 0.09800034761, 0.4913656116, 1])
item_38 = ListItem(List=graph, Index=0, Wrap=True)  # -> Item, Item1, Item2, Item3, Item4

max_compression_6 = Number(item_38.Item1)
max_deform = Number(item_38.Item)
max_tension_5 = Number(item_38.Item2)
# First Run. Aligned to baseline, assuming a loading force of 7.35 kN/m2 and a tributary width of 0.325 metres.
wallacei_x = WallaceiX(
    Genes=[picked_frame, picked_orientation],
    Objectives=[max_deform, max_compression_6, max_tension_5],
    Data=merge_21,
    Phenotype=merge_23,
    allFitness="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",
    allFrontIdx="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",
    allGenomes="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",
    curFrontIdx="299|0;299|1;299|2;299|3;299|4;299|5;299|6;299|7;299|8;299|9;299|10;299|11;299|12;299|13;299|14;299|15;299|16;299|17;299|18;299|19;299|20;299|21;299|22;299|23;299|24;299|25;299|26;299|27;299|28;299|29;299|30;299|31;299|32;299|33;299|34;299|35;299|36;299|37;299|38;299|39;299|40;299|41;299|42;299|43;299|44;299|45;299|46;299|47;299|48;299|49",
    curFrontIdxSave="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",
    popGen="50,300",
    total="2486906",
    wlcDone=True)  # -> WallaceiGenomes, FitnessValues, simplify(Data), WPhenotypes

arch_span = Number(item_38.Item3)
tributary_width = Number(item_38.Item4)

# ----
# Shape Grammar Export
concat_12 = Concatenate(FragmentA="np.array(", FragmentB=txt, FragmentC="),")
panel_21 = Panel(concat_12)

tstat_10 = TreeStatistics(Tree=wallacei_x.Data)  # -> Paths, Length, Count
larger_7 = LargerThan(FirstNumber=tstat_10.Length, SecondNumber=2)  # -> LargerThan, OrEqualTo
dispatch_50 = Dispatch(List=tstat_10.Paths, DispatchPattern=larger_7.LargerThan)  # -> ListA, ListB
split_2 = SplitTree(Data=wallacei_x.Data, Masks=flatten(dispatch_50.ListA))  # -> Positive, Negative
item_39 = ListItem(List=split_2.Positive, Index=3, Wrap=True)  # -> flatten(Item)
item_40 = ListItem(List=split_2.Positive, Index=3, Wrap=True)
item_41 = ListItem(List=split_2.Negative, Index=0, Wrap=True)
merge_24 = Merge(Data1=item_40, Data2=item_41)  # -> flatten(Result)
partition = PartitionList(List=merge_24, Size=50)
panel_22 = Panel(item_39)
dispatch_51 = Dispatch(List=partition, DispatchPattern=partition)  # -> ListA, ListB
lng_49 = ListLength(List=dispatch_51.ListA)  # -> flatten(Length)
division_2 = Division(A=lng_49, B=50)
panel_23 = Panel(division_2)
dam = DataDam(DataA=wallacei_x.WPhenotypes, BufferDelay=10000000, BufferMode=0)
pdecoder = DecodePhenotype(WallaceiPhenotype=dam)  # -> GeometriesList, simplify(MeshesList), simplify(NumbersList), TextList
flatten = FlattenTree(Tree=pdecoder.MeshesList, Path="{0}")  # -> simplify(graft(Tree))
cluster_4 = Cluster_4(x=pdecoder.NumbersList)
item_42 = ListItem(List=pdecoder.NumbersList, Index=0, Wrap=True)  # -> Item, Item1, Item2, Item3, flatten(Item4), flatten(Item5), flatten(Item6)
sort_5 = SortList(Keys=item_42.Item4)  # -> Keys, ValuesA
sort_6 = SortList(Keys=item_42.Item5)  # -> Keys, ValuesA
sort_7 = SortList(Keys=item_42.Item6)  # -> Keys, ValuesA
item_43 = ListItem(List=sort_5.Keys, Index=-1, Wrap=True)
item_44 = ListItem(List=sort_6.Keys, Index=0, Wrap=True)
item_45 = ListItem(List=sort_7.Keys, Index=0, Wrap=True)
avr_2 = Average(Input=sort_7.Keys)
move_4 = Move(Geometry=simplify(flatten), Motion=vec2pt.Vector)  # -> Geometry, Transform
avr_3 = Average(Input=sort_5.Keys)
avr_4 = Average(Input=sort_6.Keys)
panel_24 = Panel(item_43)
panel_25 = Panel(item_44)
panel_26 = Panel(item_45)
panel_27 = Panel(avr_2)
panel_28 = Panel(avr_3)
panel_29 = Panel(avr_4)
tag = TextTag3D(Location=xz_2, Text=cluster_4, Size=100, Justification=7)
cluster_5 = Cluster_5(M="HT Allowed:", B=avr_3, D=avr_4, F=item_43, H=item_44, J=avr_2, L=item_45)
panel_30 = Panel(cluster_5)

# ==== cluster Cluster
V = ClusterInput()
V_2 = ClusterInput()
V_3 = ClusterInput()
V_4 = ClusterInput()
V_5 = ClusterInput()
V_6 = ClusterInput()
pline = PolyLine(Vertices=V, Closed=False)  # -> flatten(Polyline)
pline_2 = PolyLine(Vertices=V_2, Closed=False)  # -> flatten(Polyline)
pline_3 = PolyLine(Vertices=V_3, Closed=False)  # -> flatten(Polyline)
pline_4 = PolyLine(Vertices=V_4, Closed=False)  # -> flatten(Polyline)
pline_5 = PolyLine(Vertices=V_5, Closed=False)  # -> flatten(Polyline)
pline_6 = PolyLine(Vertices=V_6, Closed=False)  # -> flatten(Polyline)
entwine = Entwine(
    Branch0X=pline_3,
    Branch1X=pline_4,
    Branch2X=pline_5,
    Branch3X=pline_6,
    Branch4X=pline,
    Branch5X=pline_2,
    FlattenInputs=False)  # -> simplify(Result)
merge = Merge(
    Data1=ColourSwatch(SwatchColor=RGB(170, 0, 255)),
    Data2=ColourSwatch(SwatchColor=RGB(0, 34, 255)),
    Data3=ColourSwatch(SwatchColor=RGB(0, 255, 255)),
    Data4=ColourSwatch(SwatchColor=RGB(51, 255, 0)),
    Data5=ColourSwatch(SwatchColor=RGB(255, 187, 0)),
    Data6=ColourSwatch(SwatchColor=RGB(238, 255, 0)))  # -> graft(Result)
R = ClusterOutput(entwine)
R_2 = ClusterOutput(merge)

# ==== cluster Cluster_2
x = ClusterInput()

num = Number("21000")
matprops = MaterialPropertiesKaramba3D(
    FamilyOfMaterial="HT-steel",
    Name="Assumed_Steel",
    YoungsModulus_kN_cm²=num,
    InPlaneShearModulus_kN_cm²="8076",
    TransverseShearModulus_kN_cm²="8076",
    SpecificWeight_kN_m³="78.5",
    CoefficientOfThermalExpansion_1=1.2e-05,
    TensileStrength_kN_cm²="70",
    CompressiveStrength_kN_cm²="60",
    StrengthHypothesis="MISES",
    mode="Isotrop")

expression = Expression(x=x, Expression="x * 100")
bang = ExplodeTree(Data=expression)  # -> Branch0, Branch1, Branch2, Branch3, Branch4, Branch5, Branch6, Branch7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
expression_2 = Expression(D=bang.Branch8, t=bang.Branch9, Expression="(sqrt(2*D²-(D-2*t)²)-D + 2*t)/2")
expression_3 = Expression(D=bang.Branch10, t=bang.Branch11, Expression="(sqrt(2*D²-(D-2*t)²)-D + 2*t)/2")
expression_4 = Expression(D=bang.Branch8, t=bang.Branch9, Expression="sqrt(2*D²-(D-2*t)²)")
crosec_calculation = Expression(D=expression_4, t=expression_2, Expression="(pi*(D/2)²)-(pi*((D-2*t)/2)²)")
expression_5 = Expression(D=bang.Branch10, t=bang.Branch11, Expression="sqrt(2*D²-(D-2*t)²)")
panel = Panel(bang.Branch2)
crosec = CrossSectionKaramba3D(
    FamilyNameOfCrossSection="DefaultCroSec",
    Material=matprops,
    Diameter_cm=bang.Branch0,
    WallThickness_cm=bang.Branch1,
    mode="Circular Hollow")
crosec_2 = CrossSectionKaramba3D(
    FamilyNameOfCrossSection="DefaultCroSec",
    Material=matprops,
    Diameter_cm=bang.Branch2,
    WallThickness_cm=bang.Branch3,
    mode="Circular Hollow")
crosec_3 = CrossSectionKaramba3D(
    FamilyNameOfCrossSection="DefaultCroSec",
    Material=matprops,
    Diameter_cm=bang.Branch4,
    WallThickness_cm=bang.Branch5,
    mode="Circular Hollow")
crosec_4 = CrossSectionKaramba3D(
    FamilyNameOfCrossSection="DefaultCroSec",
    Material=matprops,
    Diameter_cm=bang.Branch6,
    WallThickness_cm=bang.Branch7,
    mode="Circular Hollow")
crosec_5 = CrossSectionKaramba3D(
    FamilyNameOfCrossSection="DefaultCroSec",
    Material=matprops,
    Diameter_cm=expression_4,
    WallThickness_cm=expression_2,
    mode="Circular Hollow")
crosec_6 = CrossSectionKaramba3D(
    FamilyNameOfCrossSection="DefaultCroSec",
    Material=matprops,
    Diameter_cm=expression_5,
    WallThickness_cm=expression_3,
    mode="Circular Hollow")
path_mapper = PathMapper(crosec, source="{A}", target="{0}")
path_mapper_2 = PathMapper(crosec_2, source="{A}", target="{0}")
path_mapper_3 = PathMapper(crosec_3, source="{A}", target="{0}")
path_mapper_4 = PathMapper(crosec_4, source="{A}", target="{0}")
path_mapper_5 = PathMapper(crosec_5, source="{A}", target="{0}")
path_mapper_6 = PathMapper(crosec_6, source="{A}", target="{0}")
path_mapper_7 = ClusterOutput(path_mapper)
path_mapper_8 = ClusterOutput(path_mapper_2)
path_mapper_9 = ClusterOutput(path_mapper_4)
path_mapper_10 = ClusterOutput(path_mapper_5)
path_mapper_11 = ClusterOutput(path_mapper_3)
path_mapper_12 = ClusterOutput(path_mapper_6)
multiplication = Multiplication(A=bang.Branch6, B=2)
# Testing if changing the tube size but not the area affects output
expression_6 = Expression(D=bang.Branch6, t=bang.Branch7, Expression="(D*t - t²)/(D + sqrt(D²-D*t+t²))")
expression_7 = Expression(D=bang.Branch6, t=bang.Branch7, Expression="(pi * (D/2)²)-(pi*((D-2*t)/2)²)")
expression_8 = Expression(D=multiplication, t=expression_6, Expression="(pi * (D/2)²)-(pi*((D-2*t)/2)²)")
crosec_7 = CrossSectionKaramba3D(
    FamilyNameOfCrossSection="DefaultCroSec",
    Material=matprops,
    Diameter_cm=multiplication,
    WallThickness_cm=expression_6,
    mode="Circular Hollow")
panel_2 = Panel(expression_8)

# ==== cluster Cluster_3
P = ClusterInput()
pdecon = Deconstruct(Point=P)  # -> XComponent, YComponent, ZComponent
I = ClusterInput()
ins = InsertItems(List=pdecon.XComponent, Item=I, Indices=[0, -1], Wrap=True)
consec = ConsecutiveDomains(Numbers=ins, Additive=False)
cull_i = CullIndex(List=consec, Indices=[0, -1], Wrap=True)
div = DivideDomain(Domain=cull_i, Count=2)  # -> simplify(flatten(Segments))
item = ListItem(List=consec, Index=[0, -1], Wrap=True)
ins_2 = InsertItems(List=div, Item=item, Indices=[0, -1], Wrap=True)
partition = PartitionList(List=ins_2, Size=2)  # -> simplify(Chunks)
dedomain = DeconstructDomain(Domain=partition)  # -> Start, End
item_2 = ListItem(List=dedomain.End, Index=1, Wrap=True)
item_3 = ListItem(List=dedomain.Start, Index=0, Wrap=True)
subtraction = Subtraction(A=item_2, B=item_3)  # -> flatten(EffectiveLength)
panel = Panel(subtraction)
effective_length = ClusterOutput(subtraction)

# ==== cluster Cluster_4
x = ClusterInput()
roundd = RoundToDecimalPlace(NumberX=x, DecimalPlace=4, RoundType=0)  # -> Rounded, Difference
fragment = TextFragment(Text=roundd.Rounded, Start=0, Count=6)
item = ListItem(List=fragment, Index=0, Wrap=True)  # -> Item, Item1, Item2, Item3, Item4, Item5, Item6
concat = Concatenate(
    FragmentA="Total Tension: ",
    FragmentB=item.Item5,
    FragmentC=" | Total Compression: ",
    FragmentD=item.Item4,
    FragmentE="Cable Tension: ",
    FragmentF=item.Item3,
    FragmentG=" | Cable Compression: ",
    FragmentH=item.Item2,
    FragmentI="Conn. Tension: ",
    FragmentJ=item.Item1,
    FragmentK=" | Conn. Compression: ",
    FragmentL=item.Item,
    FragmentM="Maximum Deformation: ",
    FragmentN=item.Item6)
R = ClusterOutput(concat)

# ==== cluster Cluster_5
M = ClusterInput()
B = ClusterInput()
D = ClusterInput()
F = ClusterInput()
H = ClusterInput()
J = ClusterInput()
L = ClusterInput()
concat = Concatenate(
    FragmentM=M,
    FragmentA="Mean Compression: ",
    FragmentB=B,
    FragmentC="Mean Tension: ",
    FragmentD=D,
    FragmentE="Max Compression: ",
    FragmentF=F,
    FragmentG="Max Tension: ",
    FragmentH=H,
    FragmentI="Mean Deformation: ",
    FragmentJ=J,
    FragmentK="Max Deformation: ",
    FragmentL=L)
R = ClusterOutput(concat)
