# Grasshopper definition GA Baseline Full Action Space.gh (Grasshopper 1.0.8)
# plug-ins: Wallacei

# ----
# Test 1:
# Max Deform Karamba: 14.541255 centimeter
# Max Deform OpenSeesPy:
# 14.569 centimeter
frames = Data([6, 7, 12, 21, 4, 20, 16, 20, 5, 15, 11, 1, 2, 3, 14, 9, 11, 13, 23, 16, 22, 24, 22, 8, 10])
orientations = Data([0, 2, 2, 3, 6, 6, 6, 6, 0, 1, 4, 4, 3, 4, 7, 6, 7, 3, 2, 0, 1, 7, 5, 3, 6])
shape_grammar = Data(["np.array([6,4,3,1]),", "np.array([7,1,2,1]),", "np.array([12,4,4,0]),", "np.array([21,2,0,0]),", "np.array([4,2,1,0]),", "np.array([20,4,0,0]),", "np.array([16,2,2,1]),", "np.array([5,4,3,0]),", "np.array([15,0,4,1]),", "np.array([11,1,2,0]),", "np.array([1,4,2,1]),", "np.array([2,0,3,0]),", "np.array([3,1,3,0]),"])

# ----
# Test 2:
# Max Deform Karamba: 9.67039 centimeter
# Max Deform OpenSeesPy:
# 8.638 centimeter
frames_2 = Data([4, 15, 15, 5, 1, 13, 19, 12, 4, 24, 4, 12, 11, 24, 19, 23, 11, 24, 22, 19, 16, 20, 12, 9, 13])
orientations_2 = Data([2, 6, 6, 1, 3, 1, 4, 6, 2, 2, 0, 5, 5, 6, 1, 5, 1, 2, 6, 2, 4, 4, 4, 7, 7])
shape_grammar_2 = Data(["np.array([4,4,4,0]),", "np.array([15,1,3,1]),", "np.array([5,0,1,0]),", "np.array([1,4,2,0]),", "np.array([13,3,2,1]),", "np.array([19,3,4,0]),", "np.array([12,2,0,1]),", "np.array([24,3,1,1]),", "np.array([11,3,2,1]),", "np.array([23,1,4,1]),", "np.array([22,0,0,1]),", "np.array([16,3,2,0]),", "np.array([20,3,0,0]),"])

picked_frame = GenePool(Decimals=0, Maximum=4, Minimum=0, Value=[2, 3, 3, 3, 1, 4, 1, 1, 1, 0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])
picked_frame_2 = GenePool(Decimals=0, Maximum=34, Minimum=0, Value=[23, 27, 1, 1, 2, 33, 31, 6, 26, 14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])
picked_frame_3 = GenePool(Decimals=0, Maximum=4, Minimum=0, Value=[1, 1, 2, 3, 2, 3, 2, 0, 3, 4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])
picked_frame_4 = GenePool(Decimals=0, Maximum=1, Minimum=0, Value=[0, 1, 0, 1, 1, 0, 0, 0, 1, 1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])
# Next steps before continuing here:
# 
# Push git, check baseline
# 
# Increase termination radius, maybe.
# 
# Add logic for HT connections because I don't want them to make those really big connections with longer elements.
genes = GenePool(Decimals=0, Maximum=1, Minimum=0, Value=[1, 1, 1, 1, 1])
progress_weight = Slider(1, range=1..3)
distance_weight = Slider(1, range=1..3)
strict_termination = BooleanToggle(False)
py3 = Python3Script(
    allowed_connections=genes,
    picked_frame=picked_frame_2,
    picked_target=picked_frame,
    picked_candidate=picked_frame_3,
    picked_mirror=picked_frame_4,
    progress_weight=progress_weight,
    distance_weight=distance_weight,
    strict_termination=strict_termination)  # -> out, guide_curve_out, placed_frames_out, bridge_points_out, action_log_out, remaining_options_out, reuse_skips, no_progress_skips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; inputs allowed_connections: list, picked_frame: list of Int32, picked_target: list, picked_candidate: list, picked_mirror: list, progress_weight: Double, distance_weight: Double, strict_termination: Boolean
# ---------- py3: Python ----------
"""
Grasshopper Python 3 component script — direct-action variant of the baseline GA.
Stock/curve load from IV.frames_v0 / IV.arch_v0 (same as RL training).

Inputs:  picked_frame, picked_target, picked_candidate, picked_mirror (required, list[int])
         strict_termination (optional)
         picked_target / picked_candidate: 0-4 = TT/HT/DT/CS/SS_MID
         picked_mirror: 0/1

Outputs: identical to GH_Baseline_GA_Calling_Script.py.
         no_progress_skips is always 0 and remaining_options_out always empty,
         since this variant has no ranking or progress filter.
"""

import sys
sys.path.append(r"C:\Users\rensh\Documents\Master Thesis\REP_STRUC RL\RL Application")
sys.path.append(r"C:\Users\rensh\Documents\Master Thesis\REP_STRUC RL\Main Deployment")

import Rhino.Geometry as rg
import ghpythonlib.treehelpers as th
import importlib
import csv
import numpy as np

import Baseline_GA_Core
import Baseline_GA_Core_Direct                                              # +++
import Baseline_GA_Utilities
import environment.envs.BikeBuilder_Classes
import environment.envs.BikeBuilder_Utilities
import internal_variables

# +++ Dependency order: each module is reloaded after the modules it imports from
importlib.reload(internal_variables)
importlib.reload(environment.envs.BikeBuilder_Classes)
importlib.reload(environment.envs.BikeBuilder_Utilities)
importlib.reload(Baseline_GA_Utilities)
importlib.reload(Baseline_GA_Core)
importlib.reload(Baseline_GA_Core_Direct)

from internal_variables import IV
from environment.envs.BikeBuilder_Classes import BikeFrame
from environment.envs.BikeBuilder_Utilities import resample_curve
from Baseline_GA_Core_Direct import run_baseline_ga_direct                 # +++
from Baseline_GA_Utilities import placed_frames_to_point_tuples, bridge_points_to_tuples

# =============================================================================
# CSV HELPERS — stdlib, no pandas (not installed in GH venv)
# =============================================================================

def _read_csv_rows(path):
    with open(path, newline='') as f:
        return list(csv.DictReader(f))

# =============================================================================
# DATA LOADING — same sources as RL training (IV.frames_v0, IV.arch_v0)
# =============================================================================

frame_rows = _read_csv_rows(IV.frames_v0)
frame_stock = []
for row in frame_rows:
    corners = np.array([
        [float(row["ST_TOP_X"]),    float(row["ST_TOP_Z"])],
        [float(row["HT_TOP_X"]),    float(row["HT_TOP_Z"])],
        [float(row["HT_BOTTOM_X"]), float(row["HT_BOTTOM_Z"])],
        [float(row["BB_X"]),        float(row["BB_Z"])],
        [float(row["CS_SS_X"]),     float(row["CS_SS_Z"])],
    ], dtype=np.float32)
    frame_stock.append(BikeFrame(corners))

curve_rows = _read_csv_rows(IV.arch_v0)
raw_guide_curve = np.array([
    [float(row["x_cord"]), float(row["z_cord"])]
    for row in curve_rows
], dtype=np.float32)

# Shift curve start to IV.origin_position, matching BB_arch_environment.__init__.
shift = np.array(IV.origin_position, dtype=np.float32) - raw_guide_curve[0]
raw_guide_curve = (raw_guide_curve + shift).astype(np.float32)

sampled_guide_curve = resample_curve(raw_guide_curve, IV.curve_samples)

# =============================================================================
# OPTIONAL GH INPUT HANDLING
# =============================================================================

# --- rank_window, progress_weight, distance_weight, allowed_connections removed:
# --- no ranking, and the RL env enforces no allowed-point restriction.
_strict_termination = bool(strict_termination) if 'strict_termination' in dir() else False  # noqa: F821

# =============================================================================
# RUN
# =============================================================================

result = run_baseline_ga_direct(                                            # +++
    frame_stock        = frame_stock,
    guide_curve        = sampled_guide_curve,
    picked_frame       = [int(v) for v in picked_frame],      # noqa: F821 (GH input)
    picked_target      = [int(v) for v in picked_target],     # noqa: F821 (GH input)
    picked_candidate   = [int(v) for v in picked_candidate],  # noqa: F821 (GH input)
    picked_mirror      = [int(v) for v in picked_mirror],     # noqa: F821 (GH input)
    strict_termination = _strict_termination,
)

# =============================================================================
# OUTPUT CONVERSION — unchanged from GH_Baseline_GA_Calling_Script.py
# =============================================================================

def _point_tuples_to_tree(nested_tuples):
    # list[list[(x, z)]] -> Point3d tree, one branch per outer entry, XZ-plane.
    nested_points = [
        [rg.Point3d(x, 0.0, z) for (x, z) in branch]
        for branch in nested_tuples
    ]
    return th.list_to_tree(nested_points)

def _bridge_connections_to_tuples(bike_bridge):
    # Flattens bike_bridge.connections into one coordinate list per polyline.
    # Each entry resolves to 2 or 3 points depending on BikeBridge's pruning.
    triples_out = []
    for connection_set in bike_bridge.connections:
        for triple in connection_set:
            resolved_points = [
                (float(bike_bridge.points[frame_idx][local_idx][0]),
                 float(bike_bridge.points[frame_idx][local_idx][1]))
                for frame_idx, local_idx in triple
            ]
            triples_out.append(resolved_points)
    return triples_out

def _tube_to_tuples(bike_bridge, per_frame_local_indices):
    # Resolves a BikeBridge per-tube index property into one branch per frame.
    branches_out = []
    for frame_idx, local_indices in enumerate(per_frame_local_indices):
        frame_points = bike_bridge.points[frame_idx]
        branch = [
            (float(frame_points[local_idx][0]), float(frame_points[local_idx][1]))
            for local_idx in local_indices
        ]
        branches_out.append(branch)
    return branches_out

def _support_to_point(bike_bridge, support_id):
    # Resolves a BikeBridge support id (frame_idx, local_idx) to one Point3d.
    frame_idx, local_idx = support_id
    x, z = bike_bridge.points[frame_idx][local_idx]
    return rg.Point3d(float(x), 0.0, float(z))

def _tension_lines_to_tuples(bike_bridge):
    # Resolves bike_bridge.tension_lines into one 2-point branch per line.
    branches_out = []
    for id_a, id_b in bike_bridge.tension_lines:
        points = []
        for frame_idx, local_idx in (id_a, id_b):
            x, z = bike_bridge.points[frame_idx][local_idx]
            points.append((float(x), float(z)))
        branches_out.append(points)
    return branches_out

def _load_points_to_list(bike_bridge):
    # Resolves bike_bridge.load_points into a flat Point3d list (empty if load_valid is False).
    points_out = []
    for frame_idx, local_idx in bike_bridge.load_points:
        x, z = bike_bridge.points[frame_idx][local_idx]
        points_out.append(rg.Point3d(float(x), 0.0, float(z)))
    return points_out

placed_frames_out = _point_tuples_to_tree(
    placed_frames_to_point_tuples(result.placed_frames)
)

action_log_out = th.list_to_tree(result.action_log)

remaining_options_out = list(result.remaining_options)   # always empty in this variant

guide_curve_out = [rg.Point3d(float(x), 0.0, float(z)) for (x, z) in sampled_guide_curve]

if result.bike_bridge is not None:
    bridge_points_out = _point_tuples_to_tree(
        bridge_points_to_tuples(result.bike_bridge)
    )
    connections_out = _point_tuples_to_tree(
        _bridge_connections_to_tuples(result.bike_bridge)
    )
    tt_out = _point_tuples_to_tree(_tube_to_tuples(result.bike_bridge, result.bike_bridge.top_tubes))
    ht_out = _point_tuples_to_tree(_tube_to_tuples(result.bike_bridge, result.bike_bridge.head_tubes))
    dt_out = _point_tuples_to_tree(_tube_to_tuples(result.bike_bridge, result.bike_bridge.down_tubes))
    cs_out = _point_tuples_to_tree(_tube_to_tuples(result.bike_bridge, result.bike_bridge.chain_stays))
    ss_out = _point_tuples_to_tree(_tube_to_tuples(result.bike_bridge, result.bike_bridge.seat_stays))
    st_out = _point_tuples_to_tree(_tube_to_tuples(result.bike_bridge, result.bike_bridge.seat_tubes))
    pin_out = _support_to_point(result.bike_bridge, result.bike_bridge.pin)
    roller_out = _support_to_point(result.bike_bridge, result.bike_bridge.roller)
    tension_cable_out = _point_tuples_to_tree(_tension_lines_to_tuples(result.bike_bridge))
    load_points_out = _load_points_to_list(result.bike_bridge)
else:
    bridge_points_out = _point_tuples_to_tree([])
    connections_out    = _point_tuples_to_tree([])
    tt_out = _point_tuples_to_tree([])
    ht_out = _point_tuples_to_tree([])
    dt_out = _point_tuples_to_tree([])
    cs_out = _point_tuples_to_tree([])
    ss_out = _point_tuples_to_tree([])
    st_out = _point_tuples_to_tree([])
    pin_out = None
    roller_out = None
    tension_cable_out = _point_tuples_to_tree([])
    load_points_out = []

reuse_skips        = result.tally.reuse_skips
no_progress_skips  = result.tally.no_progress_skips    # always 0 in this variant
no_intersect_skips = result.tally.no_intersect_skips
terminated         = result.tally.terminated
true_termination   = result.tally.true_termination
overshot           = result.tally.overshot
steps_completed    = result.tally.steps_completed

# =============================================================================
# IV Outputs
# =============================================================================
deck_range_1         = IV.deck_range[0]
deck_range_2         = IV.deck_range[1]
deck_range           = [deck_range_1, deck_range_2]
tributary_width      = IV.tributary_width
termination_vicinity = IV.termination_vicinity
# ---------- end py3 ----------
and = GateAnd(A=py3.terminated, B=py3.true_termination)
pline = PolyLine(Vertices=py3.placed_frames_out, Closed=True)
item = ListItem(List=py3.placed_frames_out, Index=[0, 3], Wrap=True)
area = Area(Geometry=flatten(pline))  # -> Area, Centroid
pline_2 = PolyLine(Vertices=item, Closed=False)
merge = Merge(Data1=pline, Data2=pline_2)  # -> flatten(Result)

# ----
# Pre-FEA Visualizer
intcrv = Interpolate(Vertices=py3.guide_curve_out, Degree=3, Periodic=False, KnotStyle=1)  # -> Curve, Length, Domain
item_2 = ListItem(List=py3.guide_curve_out, Index=-1, Wrap=True)
pl = ConstructPlane(Origin=item_2, XAxis=Vector(1, 0, 0), YAxis=Vector(0, 0, 1))
cir = Circle(Plane=pl, Radius=py3.termination_vicinity)
preview = CustomPreview(
    Geometry=intcrv.Curve,
    Material={diffuse=RGB(221, 160, 221), emission=RGB(66, 48, 66), shine=0.5, specular=RGB(255, 255, 255), transparency=0})
preview_2 = CustomPreview(
    Geometry=cir,
    Material={diffuse=RGB(221, 160, 221), emission=RGB(66, 48, 66), shine=0.5, specular=RGB(255, 255, 255), transparency=0})

crv_cp = CurveClosestPoint(Point=area.Centroid, Curve=intcrv.Curve)  # -> Point, Parameter, Distance
cull_i = CullIndex(List=crv_cp.Point, Indices=-1, Wrap=True)
cull_i_2 = CullIndex(List=crv_cp.Point, Indices=0, Wrap=True)
pdecon = Deconstruct(Point=cull_i)  # -> XComponent, YComponent, ZComponent
pdecon_2 = Deconstruct(Point=cull_i_2)  # -> XComponent, YComponent, ZComponent
remap = RemapNumbers(Value=crv_cp.Distance, Source=" 0 to 500", Target=Domain(0, 1))  # -> Mapped, Clipped
subtraction = Subtraction(A=pdecon_2.XComponent, B=pdecon.XComponent)
dist = Distance(PointA=cull_i, PointB=cull_i_2)
lng = ListLength(List=pdecon.XComponent)
graph = GraphMapper(
    remap.Clipped,
    x0=0,
    x1=1,
    y0=0,
    y1=1,
    container_name="Bezier",
    cpx=[0, 0.7987184525, 0.9055777192, 1],
    cpy=[0, 0.09933084249, 0.201543808, 1])
larger = LargerThan(FirstNumber=subtraction, SecondNumber=0)  # -> LargerThan, OrEqualTo
repeat = RepeatData(Data=1, Length=lng)
remap_2 = RemapNumbers(Value=dist, Source="0 to 1500", Target=Domain(1, 0))  # -> Mapped, Clipped
item_3 = ListItem(List=area.Centroid, Index=-1, Wrap=True)
end = EndPoints(Curve=intcrv.Curve)  # -> Start, End
weave = Weave(Pattern=larger.LargerThan, Stream0=repeat, Stream1=remap_2.Mapped, NullGaps=False)
dist_2 = Distance(PointA=item_3, PointB=end.End)
graph_2 = GraphMapper(
    weave,
    x0=0,
    x1=1,
    y0=0,
    y1=1,
    container_name="Bezier",
    cpx=[0, 0.7987184525, 0.9055777192, 1],
    cpy=[0, 0.09933084249, 0.201543808, 1])
termination_score = Slider(30, range=0..100)
termination_score_2 = Slider(0, range=0..1)
remap_3 = RemapNumbers(Value=Slider(300, range=0..1000), Source="0 to 7000", Target=Domain(0, 1))  # -> Mapped, Clipped
remap_4 = RemapNumbers(Value=py3.steps_completed, Source="0 to 35", Target="35 to 0")  # -> Mapped, Clipped
ma = MassAddition(Input=graph_2)  # -> Result, PartialResults
graph_3 = GraphMapper(
    remap_3.Clipped,
    x0=0,
    x1=1,
    y0=0,
    y1=1,
    container_name="Bezier",
    cpx=[0, 0.7916631103, 0.8982481956, 1],
    cpy=[0, 0.1073648334, 0.2002855539, 1])
ma_2 = MassAddition(Input=graph)  # -> Result, PartialResults
dom = ConstructDomain(DomainStart=termination_score_2, DomainEnd=termination_score)
filter = StreamFilter(Gate=and, Stream0=termination_score, Stream1=termination_score_2)
filter_2 = StreamFilter(Gate=and, Stream0=ma_2.Result, Stream1=0)
filter_3 = StreamFilter(Gate=and, Stream0=ma.Result, Stream1=0)
filter_4 = StreamFilter(Gate=and, Stream0=remap_4.Clipped, Stream1=0)
remap_5 = RemapNumbers(Value=graph_3, Source=Domain(0, 1), Target=dom)  # -> Mapped, Clipped
distance_to_gesture = Number(ma_2.Result)
non_termination_penalty = Number(remap_5.Clipped)
progress = Number(ma.Result)
placed_frames = Number(remap_4.Clipped)
entwine = Entwine(
    Branch0X=flatten(crv_cp.Distance),
    Branch1X=flatten(subtraction),
    Branch2X=flatten(py3.reuse_skips),
    Branch3X=flatten(and),
    Branch4X=flatten(py3.steps_completed),
    FlattenInputs=False)  # -> simplify(Result)
wallacei_x = WallaceiX(
    Genes=[picked_frame_4, picked_frame_2, picked_frame, picked_frame_3],
    Objectives=[distance_to_gesture, progress, placed_frames, non_termination_penalty],
    Data=entwine,
    Phenotype=merge,
    allFitness="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",
    allFrontIdx="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",
    allGenomes="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",
    curFrontIdx="99|0;99|1;99|2;99|3;99|4;99|5;99|6;99|7;99|8;99|9;99|10;99|11;99|12;99|13;99|14;99|15;99|16;99|17;99|18;99|19;99|20;99|21;99|22;99|23;99|24;99|25;99|26;99|27;99|28;99|29;99|30;99|31;99|32;99|33;99|34;99|35;99|36;99|37;99|38;99|39;99|40;99|41;99|42;99|43;99|44;99|45;99|46;99|47;99|48;99|49",
    curFrontIdxSave="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",
    popGen="50,100",
    total="231515",
    wlcDone=True)  # -> WallaceiGenomes, FitnessValues, Data, WPhenotypes
panel = Panel(entwine)
pdecoder = DecodePhenotype(WallaceiPhenotype=wallacei_x.WPhenotypes)  # -> simplify(GeometriesList), MeshesList, NumbersList, TextList
branch = TreeBranch(Tree=pdecoder.GeometriesList, Path=Slider(0, range=0..49), MaintainPaths=True)

# ----
# Initial test:
# GA figured out that placing fewer frames yields the best reward.
# 
# Setup:
# In line with RL reward structure, but made the mistake of setting the score to 0 on termination, which would therefore allow disregard of curve on termination.
geo = Geometry(Tree({0}: [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], {1}: [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], {2}: [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], {3}: [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], {4}: [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], {5}: [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]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))

# ----
# Second test:
# 
# Added a fitness value for frames placed. However,not normalized as the other values are only normalized per-step, not over all, so these can exceed 1. The score is inverted, though:
# 
# 0,35 -> 35,0
geo_2 = Geometry(Tree({0}: [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], {1}: [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], {2}: [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], {3}: [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], {4}: [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], {5}: [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]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))
data = Data(Tree({0;0;0}: [336.5874342, 185.3699845, 866.7015281, 1178.11095, 1993.924759, 2853.299368, 3288.936267, 3621.372501, 3963.932926, 3620.781539, 3962.352521, 4190.614291, 4565.904836, 4707.275067, 4936.728597, 5168.314788, 5547.799609, 4918.117494, 5082.790401, 4292.204898, 4658.970678], {0;0;1}: [-263.8175497, 466.2337333, 615.7555494, -284.6081266, -22.46292076, 537.6929684, 857.4558719, -794.407799, -1328.614991, -47.04428584, 0, 0, 520.5490096, -520.5490096, 0, 0, 0, 0, 0, 0], {0;0;2}: [7], {0;0;3}: [False], {0;0;4}: [21], {0;1;0}: [372.1774866, 650.5922472, 619.1057934, 873.4813684, 925.2063747, 1442.320932, 1739.030868, 1771.512079, 1210.662769, 1316.261003, 856.1157728, 1269.418887, 1740.516496]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))

# ----
# Third test:
# 
# Replacing the switch for termination reward to a seperate value, set to 30 if not terminated, 0 if terminated.
data_2 = Data(Tree({0;0;0}: [336.5874342, 185.3699845, 866.7015281, 1178.11095, 1993.924759, 2853.299368, 3288.936267, 3621.372501, 3963.932926, 3620.781539, 3962.352521, 4190.614291, 4565.904836, 4707.275067, 4936.728597, 5168.314788, 5547.799609, 4918.117494, 5082.790401, 4292.204898, 4658.970678], {0;0;1}: [-263.8175497, 466.2337333, 615.7555494, -284.6081266, -22.46292076, 537.6929684, 857.4558719, -794.407799, -1328.614991, -47.04428584, 0, 0, 520.5490096, -520.5490096, 0, 0, 0, 0, 0, 0], {0;0;2}: [7], {0;0;3}: [False], {0;0;4}: [21], {0;1;0}: [372.1774866, 650.5922472, 619.1057934, 873.4813684, 925.2063747, 1442.320932, 1739.030868, 1771.512079, 1210.662769, 1316.261003, 856.1157728, 1269.418887, 1740.516496]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))
geo_3 = Geometry(Tree({0}: [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], {1}: [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], {2}: [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], {3}: [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], {4}: [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], {5}: [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]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))

panel_2 = Panel(geo_3)

# ----
# Fourth test:
# 
# Replacing the termination fitness value switch with a granular fitness value taken from the end point distance.
geo_4 = Geometry(Tree({0}: [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], {1}: [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], {2}: [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], {3}: [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], {4}: [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], {5}: [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]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))
data_3 = Data(Tree({0;0;0}: [336.5874342, 185.3699845, 866.7015281, 1178.11095, 1993.924759, 2853.299368, 3288.936267, 3621.372501, 3963.932926, 3620.781539, 3962.352521, 4190.614291, 4565.904836, 4707.275067, 4936.728597, 5168.314788, 5547.799609, 4918.117494, 5082.790401, 4292.204898, 4658.970678], {0;0;1}: [-263.8175497, 466.2337333, 615.7555494, -284.6081266, -22.46292076, 537.6929684, 857.4558719, -794.407799, -1328.614991, -47.04428584, 0, 0, 520.5490096, -520.5490096, 0, 0, 0, 0, 0, 0], {0;0;2}: [7], {0;0;3}: [False], {0;0;4}: [21], {0;1;0}: [372.1774866, 650.5922472, 619.1057934, 873.4813684, 925.2063747, 1442.320932, 1739.030868, 1771.512079, 1210.662769, 1316.261003, 856.1157728, 1269.418887, 1740.516496]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))

data_4 = Data(wallacei_x.Data)

# ----
# Fifth test:
# 
# Not rewarding termination, as the GA is already likely to prefer fewer frames. Though this might encourage overshooting.
geo_5 = Geometry(Tree({0}: [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], {1}: [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], {2}: [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], {3}: [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], {4}: [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], {5}: [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]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))
data_5 = Data(Tree({0;0;0}: [336.5874342, 185.3699845, 866.7015281, 1178.11095, 1993.924759, 2853.299368, 3288.936267, 3621.372501, 3963.932926, 3620.781539, 3962.352521, 4190.614291, 4565.904836, 4707.275067, 4936.728597, 5168.314788, 5547.799609, 4918.117494, 5082.790401, 4292.204898, 4658.970678], {0;0;1}: [-263.8175497, 466.2337333, 615.7555494, -284.6081266, -22.46292076, 537.6929684, 857.4558719, -794.407799, -1328.614991, -47.04428584, 0, 0, 520.5490096, -520.5490096, 0, 0, 0, 0, 0, 0], {0;0;2}: [7], {0;0;3}: [False], {0;0;4}: [21], {0;1;0}: [372.1774866, 650.5922472, 619.1057934, 873.4813684, 925.2063747, 1442.320932, 1739.030868, 1771.512079, 1210.662769, 1316.261003, 856.1157728, 1269.418887, 1740.516496]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))

# ----
# Sixth test:
# 
# Using the flat termination but increasing from 30 to 90
geo_6 = Geometry(Tree({0}: [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], {1}: [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], {2}: [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], {3}: [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], {4}: [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], {5}: [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]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))
data_6 = Data(Tree({0;0;0}: [336.5874342, 185.3699845, 866.7015281, 1178.11095, 1993.924759, 2853.299368, 3288.936267, 3621.372501, 3963.932926, 3620.781539, 3962.352521, 4190.614291, 4565.904836, 4707.275067, 4936.728597, 5168.314788, 5547.799609, 4918.117494, 5082.790401, 4292.204898, 4658.970678], {0;0;1}: [-263.8175497, 466.2337333, 615.7555494, -284.6081266, -22.46292076, 537.6929684, 857.4558719, -794.407799, -1328.614991, -47.04428584, 0, 0, 520.5490096, -520.5490096, 0, 0, 0, 0, 0, 0], {0;0;2}: [7], {0;0;3}: [False], {0;0;4}: [21], {0;1;0}: [372.1774866, 650.5922472, 619.1057934, 873.4813684, 925.2063747, 1442.320932, 1739.030868, 1771.512079, 1210.662769, 1316.261003, 856.1157728, 1269.418887, 1740.516496]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))

# ----
# Seventh test:
# 
# Using granular termination but with a max of 90 instead of 30
geo_7 = Geometry(Tree({0}: [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], {1}: [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], {2}: [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], {3}: [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], {4}: [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], {5}: [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]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))
data_7 = Data(Tree({0;0;0}: [336.5874342, 185.3699845, 866.7015281, 1178.11095, 1993.924759, 2853.299368, 3288.936267, 3621.372501, 3963.932926, 3620.781539, 3962.352521, 4190.614291, 4565.904836, 4707.275067, 4936.728597, 5168.314788, 5547.799609, 4918.117494, 5082.790401, 4292.204898, 4658.970678], {0;0;1}: [-263.8175497, 466.2337333, 615.7555494, -284.6081266, -22.46292076, 537.6929684, 857.4558719, -794.407799, -1328.614991, -47.04428584, 0, 0, 520.5490096, -520.5490096, 0, 0, 0, 0, 0, 0], {0;0;2}: [7], {0;0;3}: [False], {0;0;4}: [21], {0;1;0}: [372.1774866, 650.5922472, 619.1057934, 873.4813684, 925.2063747, 1442.320932, 1739.030868, 1771.512079, 1210.662769, 1316.261003, 856.1157728, 1269.418887, 1740.516496]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))

# ----
# Eigth test:
# 
# Extending test three to 300 generations
geo_8 = Geometry(Tree({0}: [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], {1}: [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], {2}: [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], {3}: [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], {4}: [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], {5}: [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]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))
# Second Test: 75,46%
# Third Test: 4,3 %
# Fourth Test: 0%
# Fifth Test: 0,24%
# Sixth: 0,24 %
# Seventh: 3,96 %
# NOTE: In the excell file the tests are offset by 1, so test 3 in gh is test 2 in excell!
data_8 = Data(Tree({0;0;0}: [336.5874342, 185.3699845, 866.7015281, 1178.11095, 1993.924759, 2853.299368, 3288.936267, 3621.372501, 3963.932926, 3620.781539, 3962.352521, 4190.614291, 4565.904836, 4707.275067, 4936.728597, 5168.314788, 5547.799609, 4918.117494, 5082.790401, 4292.204898, 4658.970678], {0;0;1}: [-263.8175497, 466.2337333, 615.7555494, -284.6081266, -22.46292076, 537.6929684, 857.4558719, -794.407799, -1328.614991, -47.04428584, 0, 0, 520.5490096, -520.5490096, 0, 0, 0, 0, 0, 0], {0;0;2}: [7], {0;0;3}: [False], {0;0;4}: [21], {0;1;0}: [372.1774866, 650.5922472, 619.1057934, 873.4813684, 925.2063747, 1442.320932, 1739.030868, 1771.512079, 1210.662769, 1316.261003, 856.1157728, 1269.418887, 1740.516496]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))

split = SplitTree(Data=data_8, Masks=flatten("{*;*;3}"))  # -> flatten(Positive), Negative
partition = PartitionList(List=split.Positive, Size=50)
dispatch = Dispatch(List=split.Positive, DispatchPattern=split.Positive)  # -> ListA, ListB
lng_2 = ListLength(List=split.Positive)
dispatch_2 = Dispatch(List=partition, DispatchPattern=partition)  # -> ListA, ListB
lng_3 = ListLength(List=dispatch.ListA)
lng_4 = ListLength(List=dispatch_2.ListA)  # -> flatten(Length)
multiplication = Multiplication(A=lng_3, B=100)
division = Division(A=multiplication, B=lng_2)
expression = Expression(x=lng_4, Expression="(x*100) / 50")

# ----
# Nineth test:
# 
# Using a recip function for the granular reward
geo_9 = Geometry(Tree({0}: [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], {1}: [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], {2}: [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], {3}: [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], {4}: [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], {5}: [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]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))
data_9 = Data(Tree({0;0;0}: [336.5874342, 185.3699845, 866.7015281, 1178.11095, 1993.924759, 2853.299368, 3288.936267, 3621.372501, 3963.932926, 3620.781539, 3962.352521, 4190.614291, 4565.904836, 4707.275067, 4936.728597, 5168.314788, 5547.799609, 4918.117494, 5082.790401, 4292.204898, 4658.970678], {0;0;1}: [-263.8175497, 466.2337333, 615.7555494, -284.6081266, -22.46292076, 537.6929684, 857.4558719, -794.407799, -1328.614991, -47.04428584, 0, 0, 520.5490096, -520.5490096, 0, 0, 0, 0, 0, 0], {0;0;2}: [7], {0;0;3}: [False], {0;0;4}: [21], {0;1;0}: [372.1774866, 650.5922472, 619.1057934, 873.4813684, 925.2063747, 1442.320932, 1739.030868, 1771.512079, 1210.662769, 1316.261003, 856.1157728, 1269.418887, 1740.516496]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))

panel_3 = Panel(expression)
number_slider = Slider(3, range=0..10)
panel_4 = Panel(data_8)
