# Grasshopper definition GA Baseline Shape Grammar Converter.gh (Grasshopper 1.0.8)
# plug-ins: Karamba3D, LunchBox

picked_frame = GenePool(Decimals=0, Maximum=4, Minimum=0, Value=[2, 3, 3, 3, 1, 4, 1, 1, 1, 0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])
picked_frame_2 = GenePool(Decimals=0, Maximum=34, Minimum=0, Value=[23, 27, 1, 1, 2, 33, 31, 6, 26, 14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])
picked_frame_3 = GenePool(Decimals=0, Maximum=1, Minimum=0, Value=[0, 1, 0, 1, 1, 0, 0, 0, 1, 1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])
picked_frame_4 = GenePool(Decimals=0, Maximum=4, Minimum=0, Value=[1, 1, 2, 3, 2, 3, 2, 0, 3, 4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])
genes = GenePool(Decimals=0, Maximum=1, Minimum=0, Value=[1, 1, 1, 1, 1])
progress_weight = Slider(1, range=1..3)
distance_weight = Slider(1, range=1..3)

# ----
# Tension Cables
panel = Panel("12700")
mm = Slider(18, range=0..100)
num = Number(panel)
matprops = MaterialPropertiesKaramba3D(
    FamilyOfMaterial="Tension_Steel",
    Name="Simple_Cable",
    YoungsModulus_kN_cm²=num,
    InPlaneShearModulus_kN_cm²="4884.4",
    TransverseShearModulus_kN_cm²="4884.4",
    SpecificWeight_kN_m³="81.31",
    CoefficientOfThermalExpansion_1=1.2e-05,
    TensileStrength_kN_cm²="13.65",
    CompressiveStrength_kN_cm²="0",
    StrengthHypothesis="MISES",
    mode="Isotrop")
crosec = CrossSectionKaramba3D(
    FamilyNameOfCrossSection="DefaultCroSec",
    Material=matprops,
    Diameter_cm=expr("x/10", mm),
    WallThickness_cm=expr("x/20", mm),
    mode="Circular Hollow")

panel_2 = Panel("C:\Users\rensh\Documents\Master Thesis\REP_STRUC RL\Datasets\Bike Frames\FRAMED_new_set_35_crs.csv")
file = ReadFile(File=panel_2, PerLineParse=True)
csv = ReadCSV(CSVString=file, Delimiter=",", DataStruct=False)  # -> Headers, Values
cluster = Cluster_2(x=csv.Values)  # -> path_mapper_7, path_mapper_8, path_mapper_11, path_mapper_9, path_mapper_10, path_mapper_12

strict_termination = BooleanToggle(False)
panel_3 = Panel("70")

# ----
# Connection Material
number_slider = Slider(0.5, range=0..10)
matselect = MaterialSelectionKaramba3D(menu=[dropdown(1), dropdown(4)])
crosec_2 = CrossSectionKaramba3D(
    FamilyNameOfCrossSection="DefaultCroSec",
    Material=matselect,
    Diameter_cm=Slider(3, range=0..10),
    WallThickness_cm=number_slider,
    mode="Circular Hollow")

py3 = Python3Script(
    allowed_connections=genes,
    picked_frame=picked_frame_2,
    picked_target=picked_frame,
    picked_candidate=picked_frame_4,
    picked_mirror=picked_frame_3,
    progress_weight=progress_weight,
    distance_weight=distance_weight,
    strict_termination=strict_termination)  # -> out, guide_curve_out, placed_frames_out, bridge_points_out, action_log_out, remaining_options_out, reuse_skips, no_progress_skips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; inputs allowed_connections: list, picked_frame: list of Int32, picked_target: list, picked_candidate: list, picked_mirror: list, progress_weight: Double, distance_weight: Double, strict_termination: Boolean
# ---------- py3: Python ----------
"""
Grasshopper Python 3 component script — direct-action variant of the baseline GA.
Stock/curve load from IV.frames_v0 / IV.arch_v0 (same as RL training).

Inputs:  picked_frame, picked_target, picked_candidate, picked_mirror (required, list[int])
         strict_termination (optional)
         picked_target / picked_candidate: 0-4 = TT/HT/DT/CS/SS_MID
         picked_mirror: 0/1

Outputs: identical to GH_Baseline_GA_Calling_Script.py.
         no_progress_skips is always 0 and remaining_options_out always empty,
         since this variant has no ranking or progress filter.
"""

import sys
sys.path.append(r"C:\Users\rensh\Documents\Master Thesis\REP_STRUC RL\RL Application")
sys.path.append(r"C:\Users\rensh\Documents\Master Thesis\REP_STRUC RL\Main Deployment")

import Rhino.Geometry as rg
import ghpythonlib.treehelpers as th
import importlib
import csv
import numpy as np

import Baseline_GA_Core
import Baseline_GA_Core_Direct                                              # +++
import Baseline_GA_Utilities
import environment.envs.BikeBuilder_Classes
import environment.envs.BikeBuilder_Utilities
import internal_variables

# +++ Dependency order: each module is reloaded after the modules it imports from
importlib.reload(internal_variables)
importlib.reload(environment.envs.BikeBuilder_Classes)
importlib.reload(environment.envs.BikeBuilder_Utilities)
importlib.reload(Baseline_GA_Utilities)
importlib.reload(Baseline_GA_Core)
importlib.reload(Baseline_GA_Core_Direct)

from internal_variables import IV
from environment.envs.BikeBuilder_Classes import BikeFrame
from environment.envs.BikeBuilder_Utilities import resample_curve
from Baseline_GA_Core_Direct import run_baseline_ga_direct                 # +++
from Baseline_GA_Utilities import placed_frames_to_point_tuples, bridge_points_to_tuples

# =============================================================================
# CSV HELPERS — stdlib, no pandas (not installed in GH venv)
# =============================================================================

def _read_csv_rows(path):
    with open(path, newline='') as f:
        return list(csv.DictReader(f))

# =============================================================================
# DATA LOADING — same sources as RL training (IV.frames_v0, IV.arch_v0)
# =============================================================================

frame_rows = _read_csv_rows(IV.frames_v0)
frame_stock = []
for row in frame_rows:
    corners = np.array([
        [float(row["ST_TOP_X"]),    float(row["ST_TOP_Z"])],
        [float(row["HT_TOP_X"]),    float(row["HT_TOP_Z"])],
        [float(row["HT_BOTTOM_X"]), float(row["HT_BOTTOM_Z"])],
        [float(row["BB_X"]),        float(row["BB_Z"])],
        [float(row["CS_SS_X"]),     float(row["CS_SS_Z"])],
    ], dtype=np.float32)
    frame_stock.append(BikeFrame(corners))

curve_rows = _read_csv_rows(IV.arch_v0)
raw_guide_curve = np.array([
    [float(row["x_cord"]), float(row["z_cord"])]
    for row in curve_rows
], dtype=np.float32)

# Shift curve start to IV.origin_position, matching BB_arch_environment.__init__.
shift = np.array(IV.origin_position, dtype=np.float32) - raw_guide_curve[0]
raw_guide_curve = (raw_guide_curve + shift).astype(np.float32)

sampled_guide_curve = resample_curve(raw_guide_curve, IV.curve_samples)

# =============================================================================
# OPTIONAL GH INPUT HANDLING
# =============================================================================

# --- rank_window, progress_weight, distance_weight, allowed_connections removed:
# --- no ranking, and the RL env enforces no allowed-point restriction.
_strict_termination = bool(strict_termination) if 'strict_termination' in dir() else False  # noqa: F821

# =============================================================================
# RUN
# =============================================================================

result = run_baseline_ga_direct(                                            # +++
    frame_stock        = frame_stock,
    guide_curve        = sampled_guide_curve,
    picked_frame       = [int(v) for v in picked_frame],      # noqa: F821 (GH input)
    picked_target      = [int(v) for v in picked_target],     # noqa: F821 (GH input)
    picked_candidate   = [int(v) for v in picked_candidate],  # noqa: F821 (GH input)
    picked_mirror      = [int(v) for v in picked_mirror],     # noqa: F821 (GH input)
    strict_termination = _strict_termination,
)

# =============================================================================
# OUTPUT CONVERSION — unchanged from GH_Baseline_GA_Calling_Script.py
# =============================================================================

def _point_tuples_to_tree(nested_tuples):
    # list[list[(x, z)]] -> Point3d tree, one branch per outer entry, XZ-plane.
    nested_points = [
        [rg.Point3d(x, 0.0, z) for (x, z) in branch]
        for branch in nested_tuples
    ]
    return th.list_to_tree(nested_points)

def _bridge_connections_to_tuples(bike_bridge):
    # Flattens bike_bridge.connections into one coordinate list per polyline.
    # Each entry resolves to 2 or 3 points depending on BikeBridge's pruning.
    triples_out = []
    for connection_set in bike_bridge.connections:
        for triple in connection_set:
            resolved_points = [
                (float(bike_bridge.points[frame_idx][local_idx][0]),
                 float(bike_bridge.points[frame_idx][local_idx][1]))
                for frame_idx, local_idx in triple
            ]
            triples_out.append(resolved_points)
    return triples_out

def _tube_to_tuples(bike_bridge, per_frame_local_indices):
    # Resolves a BikeBridge per-tube index property into one branch per frame.
    branches_out = []
    for frame_idx, local_indices in enumerate(per_frame_local_indices):
        frame_points = bike_bridge.points[frame_idx]
        branch = [
            (float(frame_points[local_idx][0]), float(frame_points[local_idx][1]))
            for local_idx in local_indices
        ]
        branches_out.append(branch)
    return branches_out

def _support_to_point(bike_bridge, support_id):
    # Resolves a BikeBridge support id (frame_idx, local_idx) to one Point3d.
    frame_idx, local_idx = support_id
    x, z = bike_bridge.points[frame_idx][local_idx]
    return rg.Point3d(float(x), 0.0, float(z))

def _tension_lines_to_tuples(bike_bridge):
    # Resolves bike_bridge.tension_lines into one 2-point branch per line.
    branches_out = []
    for id_a, id_b in bike_bridge.tension_lines:
        points = []
        for frame_idx, local_idx in (id_a, id_b):
            x, z = bike_bridge.points[frame_idx][local_idx]
            points.append((float(x), float(z)))
        branches_out.append(points)
    return branches_out

def _load_points_to_list(bike_bridge):
    # Resolves bike_bridge.load_points into a flat Point3d list (empty if load_valid is False).
    points_out = []
    for frame_idx, local_idx in bike_bridge.load_points:
        x, z = bike_bridge.points[frame_idx][local_idx]
        points_out.append(rg.Point3d(float(x), 0.0, float(z)))
    return points_out

placed_frames_out = _point_tuples_to_tree(
    placed_frames_to_point_tuples(result.placed_frames)
)

action_log_out = th.list_to_tree(result.action_log)

remaining_options_out = list(result.remaining_options)   # always empty in this variant

guide_curve_out = [rg.Point3d(float(x), 0.0, float(z)) for (x, z) in sampled_guide_curve]

if result.bike_bridge is not None:
    bridge_points_out = _point_tuples_to_tree(
        bridge_points_to_tuples(result.bike_bridge)
    )
    connections_out = _point_tuples_to_tree(
        _bridge_connections_to_tuples(result.bike_bridge)
    )
    tt_out = _point_tuples_to_tree(_tube_to_tuples(result.bike_bridge, result.bike_bridge.top_tubes))
    ht_out = _point_tuples_to_tree(_tube_to_tuples(result.bike_bridge, result.bike_bridge.head_tubes))
    dt_out = _point_tuples_to_tree(_tube_to_tuples(result.bike_bridge, result.bike_bridge.down_tubes))
    cs_out = _point_tuples_to_tree(_tube_to_tuples(result.bike_bridge, result.bike_bridge.chain_stays))
    ss_out = _point_tuples_to_tree(_tube_to_tuples(result.bike_bridge, result.bike_bridge.seat_stays))
    st_out = _point_tuples_to_tree(_tube_to_tuples(result.bike_bridge, result.bike_bridge.seat_tubes))
    pin_out = _support_to_point(result.bike_bridge, result.bike_bridge.pin)
    roller_out = _support_to_point(result.bike_bridge, result.bike_bridge.roller)
    tension_cable_out = _point_tuples_to_tree(_tension_lines_to_tuples(result.bike_bridge))
    load_points_out = _load_points_to_list(result.bike_bridge)
else:
    bridge_points_out = _point_tuples_to_tree([])
    connections_out    = _point_tuples_to_tree([])
    tt_out = _point_tuples_to_tree([])
    ht_out = _point_tuples_to_tree([])
    dt_out = _point_tuples_to_tree([])
    cs_out = _point_tuples_to_tree([])
    ss_out = _point_tuples_to_tree([])
    st_out = _point_tuples_to_tree([])
    pin_out = None
    roller_out = None
    tension_cable_out = _point_tuples_to_tree([])
    load_points_out = []

reuse_skips        = result.tally.reuse_skips
no_progress_skips  = result.tally.no_progress_skips    # always 0 in this variant
no_intersect_skips = result.tally.no_intersect_skips
terminated         = result.tally.terminated
true_termination   = result.tally.true_termination
overshot           = result.tally.overshot
steps_completed    = result.tally.steps_completed

# =============================================================================
# IV Outputs
# =============================================================================
deck_range_1         = IV.deck_range[0]
deck_range_2         = IV.deck_range[1]
deck_range           = [deck_range_1, deck_range_2]
tributary_width      = IV.tributary_width
termination_vicinity = IV.termination_vicinity
# ---------- end py3 ----------
and = GateAnd(A=py3.terminated, B=py3.true_termination)
number_slider_2 = Slider(1, range=0..10)
pline = PolyLine(Vertices=py3.placed_frames_out, Closed=True)
pt = Point(py3.load_points_out)
panel_4 = Panel("""1.25
0.833
0.625
0.5
0.416
0.357
0.3125""")
concat = Concatenate()

# ----
# Pre-FEA Visualizer
swatch = ColourSwatch(SwatchColor=RGB(255, 0, 238))
intcrv = Interpolate(Vertices=py3.guide_curve_out, Degree=3, Periodic=False, KnotStyle=1)  # -> Curve, Length, Domain
item = ListItem(List=py3.guide_curve_out, Index=-1, Wrap=True)
pline_2 = PolyLine(Vertices=py3.tension_cable_out, Closed=False)  # -> flatten(Polyline)
pline_3 = PolyLine(Vertices=py3.connections_out, Closed=False)  # -> flatten(Polyline)
cluster_2 = Cluster(V_3=py3.st_out, V_4=py3.tt_out, V_5=py3.ht_out, V_6=py3.dt_out, V=py3.cs_out, V_2=py3.ss_out)  # -> R, R_2
pl = ConstructPlane(Origin=item, XAxis=Vector(1, 0, 0), YAxis=Vector(0, 0, 1))
cir = Circle(Plane=pl, Radius=py3.termination_vicinity)
preview = CustomPreview(Geometry=cluster_2.R, Material=simplify(cluster_2.R_2))
preview_2 = CustomPreview(
    Geometry=intcrv.Curve,
    Material={diffuse=RGB(221, 160, 221), emission=RGB(66, 48, 66), shine=0.5, specular=RGB(255, 255, 255), transparency=0})
preview_3 = CustomPreview(
    Geometry=cir,
    Material={diffuse=RGB(221, 160, 221), emission=RGB(66, 48, 66), shine=0.5, specular=RGB(255, 255, 255), transparency=0})
preview_4 = CustomPreview(Geometry=pline_2, Material=swatch)
preview_5 = CustomPreview(Geometry=pline_3, Material=ColourSwatch(SwatchColor=RGB(255, 153, 0)))

series = Series(Start=0, Step=1, Count=number_slider_2)
tributary_depth = Slider(1.25, range=0..10)
uls_kn_m2 = Slider(7.35, range=0..10)
item_2 = ListItem(List=panel_4, Index=Slider(6, range=0..6), Wrap=True)
deck_range = Panel("""0
8000""")

# ----
# Connections
tstat = TreeStatistics(Tree=py3.connections_out)  # -> Paths, Length, Count
series_2 = Series(Start=0, Step=1, Count=tstat.Count)
pline_4 = PolyLine(Vertices=py3.connections_out, Closed=False)  # -> flatten(Polyline)
concat_2 = Concatenate(FragmentA="CON_", FragmentB=series_2)
lineelem = CreateLinearElementKaramba3D(
    Line=pline_4,
    Colour=ColourSwatch(SwatchColor=RGB(255, 153, 0)),
    Identifier=concat_2,
    CrossSection=crosec_2,
    LimitDistance_mm=0.005,
    BucklingLengthY_mm=-1,
    BucklingLengthZ_mm=-1,
    BucklingLengthLT_mm=-1,
    Bending=True,
    ToPolylineMaxAngle=0.25,
    ToPolylineTolerance=0.1,
    ToPolylineMaxEdgeLength=0.25,
    New=True,
    Remove=True,
    mode="LineToBeam")  # -> Element, Points, Info

# ----
# Seat Tube
item_3 = ListItem(List=py3.action_log_out, Index=0, Wrap=True)  # -> flatten(Item)
pline_5 = PolyLine(Vertices=py3.st_out, Closed=False)  # -> flatten(Polyline)
concat_3 = Concatenate(FragmentA="ST_", FragmentB=item_3)
item_4 = ListItem(List=cluster.path_mapper_7, Index=item_3, Wrap=True)
lineelem_2 = CreateLinearElementKaramba3D(
    Line=simplify(graft(pline_5)),
    Colour=ColourSwatch(SwatchColor=RGB(170, 0, 255)),
    Identifier=simplify(graft(concat_3)),
    CrossSection=simplify(graft(item_4)),
    LimitDistance_mm=0.005,
    BucklingLengthY_mm=-1,
    BucklingLengthZ_mm=-1,
    BucklingLengthLT_mm=-1,
    Bending=True,
    ToPolylineMaxAngle=0.25,
    ToPolylineTolerance=0.1,
    ToPolylineMaxEdgeLength=0.25,
    New=True,
    Remove=True,
    mode="LineToBeam")  # -> flatten(Element), Points, Info

# ----
# Top Tube
item_5 = ListItem(List=py3.action_log_out, Index=0, Wrap=True)  # -> flatten(Item)
pline_6 = PolyLine(Vertices=py3.tt_out, Closed=False)  # -> flatten(Polyline)
concat_4 = Concatenate(FragmentA="ST_", FragmentB=item_5)
item_6 = ListItem(List=cluster.path_mapper_8, Index=item_5, Wrap=True)
lineelem_3 = CreateLinearElementKaramba3D(
    Line=simplify(graft(pline_6)),
    Colour=ColourSwatch(SwatchColor=RGB(0, 34, 255)),
    Identifier=simplify(graft(concat_4)),
    CrossSection=simplify(graft(item_6)),
    LimitDistance_mm=0.005,
    BucklingLengthY_mm=-1,
    BucklingLengthZ_mm=-1,
    BucklingLengthLT_mm=-1,
    Bending=True,
    ToPolylineMaxAngle=0.25,
    ToPolylineTolerance=0.1,
    ToPolylineMaxEdgeLength=0.25,
    New=True,
    Remove=True,
    mode="LineToBeam")  # -> flatten(Element), Points, Info

# ----
# Head Tube
item_7 = ListItem(List=py3.action_log_out, Index=0, Wrap=True)  # -> flatten(Item)
pline_7 = PolyLine(Vertices=py3.ht_out, Closed=False)  # -> flatten(Polyline)
concat_5 = Concatenate(FragmentA="ST_", FragmentB=item_7)
item_8 = ListItem(List=cluster.path_mapper_11, Index=item_7, Wrap=True)
lineelem_4 = CreateLinearElementKaramba3D(
    Line=simplify(graft(pline_7)),
    Colour=ColourSwatch(SwatchColor=RGB(0, 255, 255)),
    Identifier=simplify(graft(concat_5)),
    CrossSection=simplify(graft(item_8)),
    LimitDistance_mm=0.005,
    BucklingLengthY_mm=-1,
    BucklingLengthZ_mm=-1,
    BucklingLengthLT_mm=-1,
    Bending=True,
    ToPolylineMaxAngle=0.25,
    ToPolylineTolerance=0.1,
    ToPolylineMaxEdgeLength=0.25,
    New=True,
    Remove=True,
    mode="LineToBeam")  # -> flatten(Element), Points, Info

# ----
# Down Tube
item_9 = ListItem(List=py3.action_log_out, Index=0, Wrap=True)  # -> flatten(Item)
pline_8 = PolyLine(Vertices=py3.dt_out, Closed=False)  # -> flatten(Polyline)
concat_6 = Concatenate(FragmentA="ST_", FragmentB=item_9)
item_10 = ListItem(List=cluster.path_mapper_9, Index=item_9, Wrap=True)
lineelem_5 = CreateLinearElementKaramba3D(
    Line=simplify(graft(pline_8)),
    Colour=ColourSwatch(SwatchColor=RGB(51, 255, 0)),
    Identifier=simplify(graft(concat_6)),
    CrossSection=simplify(graft(item_10)),
    LimitDistance_mm=0.005,
    BucklingLengthY_mm=-1,
    BucklingLengthZ_mm=-1,
    BucklingLengthLT_mm=-1,
    Bending=True,
    ToPolylineMaxAngle=0.25,
    ToPolylineTolerance=0.1,
    ToPolylineMaxEdgeLength=0.25,
    New=True,
    Remove=True,
    mode="LineToBeam")  # -> flatten(Element), Points, Info

# ----
# Chain Stay
item_11 = ListItem(List=py3.action_log_out, Index=0, Wrap=True)  # -> flatten(Item)
pline_9 = PolyLine(Vertices=py3.cs_out, Closed=False)  # -> flatten(Polyline)
concat_7 = Concatenate(FragmentA="ST_", FragmentB=item_11)
item_12 = ListItem(List=cluster.path_mapper_10, Index=item_11, Wrap=True)
lineelem_6 = CreateLinearElementKaramba3D(
    Line=simplify(graft(pline_9)),
    Colour=ColourSwatch(SwatchColor=RGB(255, 187, 0)),
    Identifier=simplify(graft(concat_7)),
    CrossSection=simplify(graft(item_12)),
    LimitDistance_mm=0.005,
    BucklingLengthY_mm=-1,
    BucklingLengthZ_mm=-1,
    BucklingLengthLT_mm=-1,
    Bending=True,
    ToPolylineMaxAngle=0.25,
    ToPolylineTolerance=0.1,
    ToPolylineMaxEdgeLength=0.25,
    New=True,
    Remove=True,
    mode="LineToBeam")  # -> flatten(Element), Points, Info

# ----
# Seat Stay
item_13 = ListItem(List=py3.action_log_out, Index=0, Wrap=True)  # -> flatten(Item)
pline_10 = PolyLine(Vertices=py3.ss_out, Closed=False)  # -> flatten(Polyline)
concat_8 = Concatenate(FragmentA="ST_", FragmentB=item_13)
item_14 = ListItem(List=cluster.path_mapper_12, Index=item_13, Wrap=True)
lineelem_7 = CreateLinearElementKaramba3D(
    Line=simplify(graft(pline_10)),
    Colour=ColourSwatch(SwatchColor=RGB(238, 255, 0)),
    Identifier=simplify(graft(concat_8)),
    CrossSection=simplify(graft(item_14)),
    LimitDistance_mm=0.005,
    BucklingLengthY_mm=-1,
    BucklingLengthZ_mm=-1,
    BucklingLengthLT_mm=-1,
    Bending=True,
    ToPolylineMaxAngle=0.25,
    ToPolylineTolerance=0.1,
    ToPolylineMaxEdgeLength=0.25,
    New=True,
    Remove=True,
    mode="LineToBeam")  # -> flatten(Element), Points, Info

remap = RemapNumbers(Value=item_2, Source=Domain(0.3125, 1.25), Target=Domain(1, 0))  # -> Mapped, Clipped

# ----
# Supports
supp = SupportKaramba3D(PosInd=py3.pin_out, Ct_kN_m=Vector(0, 0, 0), Cr_kNm_rad=Vector(0, 0, 0), menu=[buttons(on, on, on, on, off, on)])
supp_2 = SupportKaramba3D(PosInd=py3.roller_out, Ct_kN_m=Vector(0, 0, 0), Cr_kNm_rad=Vector(0, 0, 0), menu=[buttons(off, on, on, on, off, on)])

cluster_3 = Cluster_3(P=py3.load_points_out, I=deck_range)
division = Division(A=cluster_3, B=1000)
multiplication = Multiplication(A=item_2, B=division)
multiplication_2 = Multiplication(A=uls_kn_m2, B=multiplication)
list = ValueList({"Load_Case_Gravity", "Load_Case_Gravity_ULS", "Load_Case_ULS"}, selected="Load_Case_Gravity")
vec = VectorXYZ(XComponent=0, YComponent=0, ZComponent=expr("-x", multiplication_2))  # -> Vector, Length
loads = LoadsKaramba3D(ForceVector=flatten(vec.Vector), Local=False, PosInd=flatten(py3.load_points_out), LCase="Load_Case_ULS", mode="Point")

simplify = SimplifyTree(Tree=py3.st_out, Front=False)
tstat_2 = TreeStatistics(Tree=simplify(simplify))  # -> Paths, Length, Count
merge = Merge(Data1=supp, Data2=supp_2)
item_15 = ListItem(List=tstat_2.Paths, Index=[0, -1], Wrap=True)
panel_5 = Panel("""Load_Case_Gravity_ULS
Load_Case_ULS""")
split = SplitTree(Data=simplify, Masks=flatten(item_15))  # -> Positive, Negative

# ----
# THIS MIGHT BE VERY WRONG
panel_6 = Panel("Load_Case_Gravity_ULS")
loads_2 = LoadsKaramba3D(Vector="0,0,-1.35", LCase=panel_6, mode="Gravity")

loads_3 = LoadsKaramba3D(Vector=Vector(0, 0, -1), LCase="Load_Case_Gravity", mode="Gravity")

supp_3 = SupportKaramba3D(
    PosInd=flatten(split.Negative),
    Ct_kN_m=Vector(0, 0, 0),
    Cr_kNm_rad=Vector(0, 0, 0),
    menu=[buttons(off, on, off, off, off, off)])
merge_2 = Merge(Data1=merge, Data2=supp_3)
panel_7 = Panel(multiplication_2)
merge_3 = Merge(Data1=flatten(loads), Data2=flatten(loads_3))
list_2 = ValueList({"Load_Case_ULS"}, selected="Load_Case_ULS")
merge_4 = Merge(
    Data1=flatten(concat_3),
    Data2=flatten(concat_4),
    Data3=flatten(concat_5),
    Data4=flatten(concat_6),
    Data5=flatten(concat_7),
    Data6=flatten(concat_8))
frame_ids = Data(merge_4)
connection_ids = Data(concat_2)
merge_5 = Merge(Data1=frame_ids, Data2=connection_ids)  # -> flatten(Result)

# ----
# Shape Grammar Export
concat_9 = Concatenate(FragmentA="np.array(", FragmentC="),")
panel_8 = Panel(concat_9)

# ----
# Tension Cables
tstat_3 = TreeStatistics(Tree=py3.tension_cable_out)  # -> Paths, Length, Count
series_3 = Series(Start=0, Step=1, Count=tstat_3.Count)
pline_11 = PolyLine(Vertices=py3.tension_cable_out, Closed=False)  # -> flatten(Polyline)
concat_10 = Concatenate(FragmentA="TENSION_", FragmentB=series_3)

divide = DivideCurve(Curve=pline_11, Count=number_slider_2, Kinks=False)  # -> Points, Tangents, Parameters
pline_12 = PolyLine(Vertices=divide.Points, Closed=False)
concat_11 = Concatenate(FragmentA=graft(concat_10), FragmentB="_", FragmentC=series)  # -> flatten(Result)
explode = Explode(Curve=pline_12, Recursive=True)  # -> flatten(Segments), Vertices

lineelem_8 = CreateLinearElementKaramba3D(
    Line=pline_11,
    Colour=ColourSwatch(SwatchColor=RGB(255, 0, 238)),
    Identifier=concat_11,
    CrossSection=crosec,
    LimitDistance_mm=0.005,
    BucklingLengthY_mm=-1,
    BucklingLengthZ_mm=-1,
    BucklingLengthLT_mm=-1,
    Bending=False,
    ToPolylineMaxAngle=0.25,
    ToPolylineTolerance=0.1,
    ToPolylineMaxEdgeLength=0.25,
    New=True,
    Remove=True,
    mode="LineToTruss")  # -> Element, Points, Info

loads_4 = LoadsKaramba3D(Eps0=Slider(1, range=0..1), ElementIdentifiers=concat_10, LCase=panel_5, mode="InitialStrain")
merge_6 = Merge(
    Data1=flatten(lineelem_8.Element),
    Data2=flatten(lineelem.Element),
    Data3=flatten(lineelem_2.Element),
    Data4=flatten(lineelem_3.Element),
    Data5=flatten(lineelem_4.Element),
    Data6=flatten(lineelem_5.Element),
    Data7=flatten(lineelem_6.Element),
    Data8=flatten(lineelem_7.Element))
assemble = AssembleModelKaramba3D(Elem=merge_6, Support=merge, Load=merge_3, LimitDistance_mm=0.005)  # -> Model, Info, Mass_kg, CentreOfGravity, LoadCaseNames
tension_ids = Data(concat_11)
analyse = AnalyseKaramba3D(Model=assemble.Model, LoadCases=list_2)  # -> AnalysedModel, MaximumDisplacement_cm, ResultingForce_kN, ChangeOfElasticEnergy_kNm
analysethii = AnalyseThIIKaramba3D(
    Model=assemble.Model,
    LoadCases=list_2,
    UseInitialNII=True,
    NIIFromCombination=True,
    NoTensionalNII=False,
    RTolerance=1e-07,
    MaxIterations=50)  # -> AnalysedModel, MaximumDisplacement_cm, ResultingForce_kN, ChangeOfElasticEnergy_kNm; disabled
modelview = ModelViewKaramba3D(Model=analyse.AnalysedModel)  # -> Model, DeformedMesh, DeformedAxes, DeformedModel, MaximumDeformation
# Frames
utilization = UtilizationOfElementsKaramba3D(
    AnalysedModel=analyse.AnalysedModel,
    ElementsIdentifiers=frame_ids,
    NumberOfSamplePoints=3,
    ElasticDesign=True,
    GammaM0=1,
    GammaM1=1.1,
    SwayFrame=True,
    WithDetails=True,
    mode="Beams")  # -> Model, Utilization, SigMax_kN_cm², SigMin_kN_cm², TauMax_kN_cm², UtilN, UtilVy, UtilVz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
# Connections
utilization_2 = UtilizationOfElementsKaramba3D(
    AnalysedModel=analyse.AnalysedModel,
    ElementsIdentifiers=connection_ids,
    NumberOfSamplePoints=3,
    ElasticDesign=True,
    GammaM0=1,
    GammaM1=1.1,
    SwayFrame=True,
    WithDetails=False,
    mode="Beams")  # -> Model, Utilization, SigMax_kN_cm², SigMin_kN_cm², TauMax_kN_cm², UtilN, UtilVy, UtilVz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
# Tension Cables
utilization_3 = UtilizationOfElementsKaramba3D(
    AnalysedModel=analyse.AnalysedModel,
    ElementsIdentifiers=tension_ids,
    NumberOfSamplePoints=3,
    ElasticDesign=True,
    GammaM0=1,
    GammaM1=1.1,
    SwayFrame=True,
    WithDetails=False,
    mode="Beams")  # -> Model, Utilization, SigMax_kN_cm², SigMin_kN_cm², TauMax_kN_cm², UtilN, UtilVy, UtilVz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
# Frames + Connectors
utilization_4 = UtilizationOfElementsKaramba3D(
    AnalysedModel=analyse.AnalysedModel,
    ElementsIdentifiers=merge_5,
    NumberOfSamplePoints=3,
    ElasticDesign=True,
    GammaM0=1,
    GammaM1=1.1,
    SwayFrame=True,
    WithDetails=False,
    mode="Beams")  # -> Model, Utilization, SigMax_kN_cm², SigMin_kN_cm², TauMax_kN_cm², UtilN, UtilVy, UtilVz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
merge_7 = Merge(Data1=flatten(utilization.SigMax_kN_cm²), Data2=flatten(utilization.SigMin_kN_cm²))
merge_8 = Merge(Data1=flatten(utilization_2.SigMax_kN_cm²), Data2=flatten(utilization_2.SigMin_kN_cm²))
merge_9 = Merge(Data1=flatten(utilization_3.SigMax_kN_cm²), Data2=flatten(utilization_3.SigMin_kN_cm²))
beamview = BeamViewKaramba3D(Model=modelview.Model)  # -> Model, MeshesOfRenderedBeams, DeformedBeamAxes, LegendColours, LegendTags
sort = SortList(Keys=merge_7)  # -> Keys, ValuesA
sort_2 = SortList(Keys=merge_8)  # -> Keys, ValuesA
sort_3 = SortList(Keys=merge_9)  # -> Keys, ValuesA
max_compression = ListItem(List=sort.Keys, Index=0, Wrap=True)
max_tension = ListItem(List=sort.Keys, Index=-1, Wrap=True)
max_compression_2 = ListItem(List=sort_2.Keys, Index=0, Wrap=True)
max_tension_2 = ListItem(List=sort_2.Keys, Index=-1, Wrap=True)
max_compression_3 = ListItem(List=sort_3.Keys, Index=0, Wrap=True)
max_tension_3 = ListItem(List=sort_3.Keys, Index=-1, Wrap=True)
mesh = Mesh(beamview.MeshesOfRenderedBeams)
panel_9 = Panel(max_compression)
panel_10 = Panel(max_tension)
panel_11 = Panel(max_compression_2)
panel_12 = Panel(max_tension_2)
panel_13 = Panel(max_compression_3)
panel_14 = Panel(max_tension_3)
preview_6 = CustomPreview(Geometry=mesh, Material=ColourSwatch(SwatchColor=RGB(255, 255, 255)))
legend = Legend(Colour=beamview.LegendColours, Tags=beamview.LegendTags, LegendType=1)

# ==== cluster Cluster
V = ClusterInput()
V_2 = ClusterInput()
V_3 = ClusterInput()
V_4 = ClusterInput()
V_5 = ClusterInput()
V_6 = ClusterInput()
pline = PolyLine(Vertices=V, Closed=False)  # -> flatten(Polyline)
pline_2 = PolyLine(Vertices=V_2, Closed=False)  # -> flatten(Polyline)
pline_3 = PolyLine(Vertices=V_3, Closed=False)  # -> flatten(Polyline)
pline_4 = PolyLine(Vertices=V_4, Closed=False)  # -> flatten(Polyline)
pline_5 = PolyLine(Vertices=V_5, Closed=False)  # -> flatten(Polyline)
pline_6 = PolyLine(Vertices=V_6, Closed=False)  # -> flatten(Polyline)
entwine = Entwine(
    Branch0X=pline_3,
    Branch1X=pline_4,
    Branch2X=pline_5,
    Branch3X=pline_6,
    Branch4X=pline,
    Branch5X=pline_2,
    FlattenInputs=False)  # -> simplify(Result)
merge = Merge(
    Data1=ColourSwatch(SwatchColor=RGB(170, 0, 255)),
    Data2=ColourSwatch(SwatchColor=RGB(0, 34, 255)),
    Data3=ColourSwatch(SwatchColor=RGB(0, 255, 255)),
    Data4=ColourSwatch(SwatchColor=RGB(51, 255, 0)),
    Data5=ColourSwatch(SwatchColor=RGB(255, 187, 0)),
    Data6=ColourSwatch(SwatchColor=RGB(238, 255, 0)))  # -> graft(Result)
R = ClusterOutput(entwine)
R_2 = ClusterOutput(merge)

# ==== cluster Cluster_2
x = ClusterInput()

num = Number("21000")
matprops = MaterialPropertiesKaramba3D(
    FamilyOfMaterial="HT-steel",
    Name="Assumed_Steel",
    YoungsModulus_kN_cm²=num,
    InPlaneShearModulus_kN_cm²="8076",
    TransverseShearModulus_kN_cm²="8076",
    SpecificWeight_kN_m³="78.5",
    CoefficientOfThermalExpansion_1=1.2e-05,
    TensileStrength_kN_cm²="70",
    CompressiveStrength_kN_cm²="60",
    StrengthHypothesis="MISES",
    mode="Isotrop")

expression = Expression(x=x, Expression="x * 100")
bang = ExplodeTree(Data=expression)  # -> Branch0, Branch1, Branch2, Branch3, Branch4, Branch5, Branch6, Branch7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
expression_2 = Expression(D=bang.Branch8, t=bang.Branch9, Expression="(sqrt(2*D²-(D-2*t)²)-D + 2*t)/2")
expression_3 = Expression(D=bang.Branch10, t=bang.Branch11, Expression="(sqrt(2*D²-(D-2*t)²)-D + 2*t)/2")
expression_4 = Expression(D=bang.Branch8, t=bang.Branch9, Expression="sqrt(2*D²-(D-2*t)²)")
crosec_calculation = Expression(D=expression_4, t=expression_2, Expression="(pi*(D/2)²)-(pi*((D-2*t)/2)²)")
expression_5 = Expression(D=bang.Branch10, t=bang.Branch11, Expression="sqrt(2*D²-(D-2*t)²)")
panel = Panel(bang.Branch2)
crosec = CrossSectionKaramba3D(
    FamilyNameOfCrossSection="DefaultCroSec",
    Material=matprops,
    Diameter_cm=bang.Branch0,
    WallThickness_cm=bang.Branch1,
    mode="Circular Hollow")
crosec_2 = CrossSectionKaramba3D(
    FamilyNameOfCrossSection="DefaultCroSec",
    Material=matprops,
    Diameter_cm=bang.Branch2,
    WallThickness_cm=bang.Branch3,
    mode="Circular Hollow")
crosec_3 = CrossSectionKaramba3D(
    FamilyNameOfCrossSection="DefaultCroSec",
    Material=matprops,
    Diameter_cm=bang.Branch4,
    WallThickness_cm=bang.Branch5,
    mode="Circular Hollow")
crosec_4 = CrossSectionKaramba3D(
    FamilyNameOfCrossSection="DefaultCroSec",
    Material=matprops,
    Diameter_cm=bang.Branch6,
    WallThickness_cm=bang.Branch7,
    mode="Circular Hollow")
crosec_5 = CrossSectionKaramba3D(
    FamilyNameOfCrossSection="DefaultCroSec",
    Material=matprops,
    Diameter_cm=expression_4,
    WallThickness_cm=expression_2,
    mode="Circular Hollow")
crosec_6 = CrossSectionKaramba3D(
    FamilyNameOfCrossSection="DefaultCroSec",
    Material=matprops,
    Diameter_cm=expression_5,
    WallThickness_cm=expression_3,
    mode="Circular Hollow")
path_mapper = PathMapper(crosec, source="{A}", target="{0}")
path_mapper_2 = PathMapper(crosec_2, source="{A}", target="{0}")
path_mapper_3 = PathMapper(crosec_3, source="{A}", target="{0}")
path_mapper_4 = PathMapper(crosec_4, source="{A}", target="{0}")
path_mapper_5 = PathMapper(crosec_5, source="{A}", target="{0}")
path_mapper_6 = PathMapper(crosec_6, source="{A}", target="{0}")
path_mapper_7 = ClusterOutput(path_mapper)
path_mapper_8 = ClusterOutput(path_mapper_2)
path_mapper_9 = ClusterOutput(path_mapper_4)
path_mapper_10 = ClusterOutput(path_mapper_5)
path_mapper_11 = ClusterOutput(path_mapper_3)
path_mapper_12 = ClusterOutput(path_mapper_6)
multiplication = Multiplication(A=bang.Branch6, B=2)
# Testing if changing the tube size but not the area affects output
expression_6 = Expression(D=bang.Branch6, t=bang.Branch7, Expression="(D*t - t²)/(D + sqrt(D²-D*t+t²))")
expression_7 = Expression(D=bang.Branch6, t=bang.Branch7, Expression="(pi * (D/2)²)-(pi*((D-2*t)/2)²)")
expression_8 = Expression(D=multiplication, t=expression_6, Expression="(pi * (D/2)²)-(pi*((D-2*t)/2)²)")
crosec_7 = CrossSectionKaramba3D(
    FamilyNameOfCrossSection="DefaultCroSec",
    Material=matprops,
    Diameter_cm=multiplication,
    WallThickness_cm=expression_6,
    mode="Circular Hollow")
panel_2 = Panel(expression_8)

# ==== cluster Cluster_3
P = ClusterInput()
pdecon = Deconstruct(Point=P)  # -> XComponent, YComponent, ZComponent
I = ClusterInput()
ins = InsertItems(List=pdecon.XComponent, Item=I, Indices=[0, -1], Wrap=True)
consec = ConsecutiveDomains(Numbers=ins, Additive=False)
cull_i = CullIndex(List=consec, Indices=[0, -1], Wrap=True)
div = DivideDomain(Domain=cull_i, Count=2)  # -> simplify(flatten(Segments))
item = ListItem(List=consec, Index=[0, -1], Wrap=True)
ins_2 = InsertItems(List=div, Item=item, Indices=[0, -1], Wrap=True)
partition = PartitionList(List=ins_2, Size=2)  # -> simplify(Chunks)
dedomain = DeconstructDomain(Domain=partition)  # -> Start, End
item_2 = ListItem(List=dedomain.End, Index=1, Wrap=True)
item_3 = ListItem(List=dedomain.Start, Index=0, Wrap=True)
subtraction = Subtraction(A=item_2, B=item_3)  # -> flatten(EffectiveLength)
panel = Panel(subtraction)
effective_length = ClusterOutput(subtraction)
