# Grasshopper definition GA Baseline Tributary Width Analysis.gh (Grasshopper 1.0.8)
# plug-ins: Karamba3D, LunchBox, Wallacei

# ----
# Arch Length
number_slider = Slider(1, range=0..2)
panel = Panel("""15
7
4.33""")
item = ListItem(List=panel, Index=number_slider, Wrap=True)
multiplication = Multiplication(A=item, B=1000)
pt = Point("0,0,0")
X = UnitX(Factor=multiplication)
remap = RemapNumbers(Value=item, Source=Domain(4.33, 15), Target=Domain(1, 0))  # -> Mapped, Clipped
move = Move(Geometry=pt, Motion=X)  # -> Geometry, Transform
avr = Average(Input=[pt, move.Geometry])
Z = UnitZ(Factor=1000)
move_2 = Move(Geometry=avr, Motion=Z)  # -> Geometry, Transform
merge = Merge(Data1=pt, Data2=move_2.Geometry, Data3=move.Geometry)
intcrv = Interpolate(Vertices=merge, Degree=3, Periodic=False, KnotStyle=1)  # -> Curve, Length, Domain

picked_frame = GenePool(Decimals=0, Maximum=34, Minimum=0, Value=[22, 29, 2, 29, 14, 16, 8, 0, 5, 19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])
genes = GenePool(Decimals=0, Maximum=1, Minimum=0, Value=[1, 1, 1, 1, 1])
progress_weight = Slider(1, range=1..3)
distance_weight = Slider(1, range=1..3)
rank_window = Slider(5, range=0..100)
picked_orientation = GenePool(Decimals=0, Maximum=4, Minimum=0, Value=[0, 0, 3, 2, 3, 3, 4, 2, 3, 2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])

# ----
# Tension Cables
panel_2 = Panel("12700")
mm = Slider(18, range=0..100)
num = Number(panel_2)
matprops = MaterialPropertiesKaramba3D(
    FamilyOfMaterial="Tension_Steel",
    Name="Simple_Cable",
    YoungsModulus_kN_cm²=num,
    InPlaneShearModulus_kN_cm²="4884.4",
    TransverseShearModulus_kN_cm²="4884.4",
    SpecificWeight_kN_m³="81.31",
    CoefficientOfThermalExpansion_1=1.2e-05,
    TensileStrength_kN_cm²="13.65",
    CompressiveStrength_kN_cm²="0",
    StrengthHypothesis="MISES",
    mode="Isotrop")
crosec = CrossSectionKaramba3D(
    FamilyNameOfCrossSection="DefaultCroSec",
    Material=matprops,
    Diameter_cm=expr("x/10", mm),
    WallThickness_cm=expr("x/20", mm),
    mode="Circular Hollow")

panel_3 = Panel("C:\Users\rensh\Documents\Master Thesis\REP_STRUC RL\Datasets\Bike Frames\FRAMED_new_set_35_crs.csv")
file = ReadFile(File=panel_3, PerLineParse=True)
csv = ReadCSV(CSVString=file, Delimiter=",", DataStruct=False)  # -> Headers, Values
cluster = Cluster_2(x=csv.Values)  # -> path_mapper_7, path_mapper_8, path_mapper_11, path_mapper_9, path_mapper_10, path_mapper_12

strict_termination = BooleanToggle(False)
panel_4 = Panel("70")

# ----
# Connection Material
number_slider_2 = Slider(0.5, range=0..10)
matselect = MaterialSelectionKaramba3D(menu=[dropdown(1), dropdown(4)])
crosec_2 = CrossSectionKaramba3D(
    FamilyNameOfCrossSection="DefaultCroSec",
    Material=matselect,
    Diameter_cm=Slider(3, range=0..10),
    WallThickness_cm=number_slider_2,
    mode="Circular Hollow")

py3 = Python3Script(
    allowed_connections=genes,
    custom_curve=intcrv.Curve,
    allow_orientation_wrapping=Toggle(False),
    picked_frame=picked_frame,
    picked_orientation=picked_orientation,
    rank_window=rank_window,
    progress_weight=progress_weight,
    distance_weight=distance_weight,
    strict_termination=strict_termination)  # -> out, guide_curve_out, placed_frames_out, bridge_points_out, action_log_out, remaining_options_out, reuse_skips, no_progress_skips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; inputs allowed_connections: list, custom_curve: Curve, allow_orientation_wrapping: Boolean, picked_frame: list of Int32, picked_orientation: list of Int32, rank_window: Int32, progress_weight: Double, distance_weight: Double, strict_termination: Boolean
# ---------- py3: Python ----------
"""
Grasshopper Python 3 component script — the only file here touching Rhino.
Stock/curve load from IV.frames_v0 / IV.arch_v0 (same as RL training),
unless an optional custom curve is supplied.

Inputs:  picked_frame, picked_orientation (required, list[int])
         allow_orientation_wrapping (bool)
         rank_window, progress_weight, distance_weight, strict_termination (optional)
         allowed_connections (optional, 5-item binary list, TT/HT/DT/CS/SS_MID order)
         custom_curve (optional, planar Rhino curve in the XZ plane, or None)
         If connected, it replaces the RL guide curve (IV.arch_v0). It is still
         shifted so its start sits at IV.origin_position, then resampled to
         IV.curve_samples, exactly like the RL curve.

Outputs: placed_frames_out, action_log_out, remaining_options_out, bridge_points_out,
         connections_out, guide_curve_out, tt_out/ht_out/dt_out/cs_out/ss_out/st_out
         (tube trees), pin_out, roller_out (single points), tension_cable_out,
         load_points_out, reuse_skips, no_progress_skips, no_intersect_skips,
         terminated, true_termination, overshot, steps_completed
         action_log_out: one branch per placed frame, [frame, target, candidate,
         mirror] as ints (target/candidate 0-4 = TT/HT/DT/CS/SS_MID, mirror 0/1).
         remaining_options_out: comma-separated string, one value per non-reuse step.
         tension_cable_out: one branch per tension line, 2 points each.
         load_points_out: flat Point3d list (empty if load_valid is False).
         guide_curve_out: the curve actually used (RL or custom), after shift/resample.
         All other *_out Point3d trees are one branch per frame/element; empty
         if no BikeBridge was built (run didn't reach true_termination). pin_out
         and roller_out are None under the same condition.
"""

import sys
sys.path.append(r"C:\Users\rensh\Documents\Master Thesis\REP_STRUC RL\RL Application")
sys.path.append(r"C:\Users\rensh\Documents\Master Thesis\REP_STRUC RL\Main Deployment")

import Rhino.Geometry as rg
import ghpythonlib.treehelpers as th
import importlib
import csv
import numpy as np

import Baseline_GA_Core
import Baseline_GA_Utilities
import environment.envs.BikeBuilder_Classes
import environment.envs.BikeBuilder_Utilities
import internal_variables

importlib.reload(internal_variables)
importlib.reload(environment.envs.BikeBuilder_Classes)
importlib.reload(environment.envs.BikeBuilder_Utilities)
importlib.reload(Baseline_GA_Core)
importlib.reload(Baseline_GA_Utilities)

from internal_variables import IV
from environment.envs.BikeBuilder_Classes import BikeFrame, PointDict
from environment.envs.BikeBuilder_Utilities import resample_curve
from Baseline_GA_Core import run_baseline_ga, RANK_WINDOW_DEFAULT
from Baseline_GA_Utilities import placed_frames_to_point_tuples, bridge_points_to_tuples

# =============================================================================
# CSV HELPERS — stdlib, no pandas (not installed in GH venv)
# =============================================================================

def _read_csv_rows(path):
    with open(path, newline='') as f:
        return list(csv.DictReader(f))

# =============================================================================
# CUSTOM CURVE HELPER
# =============================================================================

def _rhino_curve_to_xz(curve, n_dense=1000, planar_tol=0.1):
    # Even arc-length samples, start -> end, as (x, z). Requires a curve in the XZ plane.
    params = curve.DivideByCount(n_dense, True)
    assert params is not None, (
        "custom_curve could not be divided - check that it is a valid, non-degenerate curve."
    )
    points = [curve.PointAt(t) for t in params]
    y_values = [p.Y for p in points]
    assert max(y_values) - min(y_values) < planar_tol, (
        f"custom_curve must lie in the XZ plane (constant Y); Y varies by "
        f"{max(y_values) - min(y_values):.3f} mm."
    )
    return np.array([[p.X, p.Z] for p in points], dtype=np.float32)

# =============================================================================
# DATA LOADING — same sources as RL training (IV.frames_v0, IV.arch_v0)
# =============================================================================

frame_rows = _read_csv_rows(IV.frames_v0)
frame_stock = []
for row in frame_rows:
    corners = np.array([
        [float(row["ST_TOP_X"]),    float(row["ST_TOP_Z"])],
        [float(row["HT_TOP_X"]),    float(row["HT_TOP_Z"])],
        [float(row["HT_BOTTOM_X"]), float(row["HT_BOTTOM_Z"])],
        [float(row["BB_X"]),        float(row["BB_Z"])],
        [float(row["CS_SS_X"]),     float(row["CS_SS_Z"])],
    ], dtype=np.float32)
    frame_stock.append(BikeFrame(corners))

# +++ Optional custom guide curve (GH input `custom_curve`: Rhino curve or None)
_custom_curve = custom_curve if 'custom_curve' in dir() else None  # noqa: F821

if _custom_curve is not None:
    raw_guide_curve = _rhino_curve_to_xz(_custom_curve)
else:
    curve_rows = _read_csv_rows(IV.arch_v0)
    raw_guide_curve = np.array([
        [float(row["x_cord"]), float(row["z_cord"])]
        for row in curve_rows
    ], dtype=np.float32)
# --- (shift + resample below apply to both sources)

# Shift curve start to IV.origin_position, matching BB_arch_environment.__init__.
shift = np.array(IV.origin_position, dtype=np.float32) - raw_guide_curve[0]
raw_guide_curve = (raw_guide_curve + shift).astype(np.float32)

sampled_guide_curve = resample_curve(raw_guide_curve, IV.curve_samples)

# =============================================================================
# OPTIONAL GH INPUT HANDLING
# =============================================================================

_rank_window = rank_window if 'rank_window' in dir() and rank_window else RANK_WINDOW_DEFAULT  # noqa: F821
_progress_weight = progress_weight if 'progress_weight' in dir() and progress_weight else 1.0  # noqa: F821
_distance_weight = distance_weight if 'distance_weight' in dir() and distance_weight else 1.0  # noqa: F821
_strict_termination = bool(strict_termination) if 'strict_termination' in dir() else False  # noqa: F821

# allowed_connections: optional 5-item binary list (1=allowed, 0=disallowed),
# in TT/HT/DT/CS/SS_MID order, matching PointDict's own value order exactly.
# A 0 excludes that point from BOTH target and candidate roles when the 50
# orientations are generated — not filtered after the fact. Left unconnected
# or all-1s, every point stays allowed (unchanged, full-50 behaviour).
if 'allowed_connections' in dir() and allowed_connections:
    _raw_allowed = list(allowed_connections)
    assert len(_raw_allowed) == 5, (
        f"allowed_connections must have exactly 5 items (TT/HT/DT/CS/SS_MID), "
        f"got {len(_raw_allowed)}."
    )
    _allowed_points = {PointDict(i) for i, flag in enumerate(_raw_allowed) if flag}
else:
    _allowed_points = None  # None -> enumerate_orientations() defaults to all 5

# =============================================================================
# RUN
# =============================================================================
allow_wrapping = allow_orientation_wrapping
result = run_baseline_ga(
    frame_stock            = frame_stock,
    guide_curve            = sampled_guide_curve,
    picked_frame           = list(picked_frame),          # noqa: F821 (GH input)
    picked_orientation     = list(picked_orientation),      # noqa: F821 (GH input)
    progress_weight        = _progress_weight,
    distance_weight        = _distance_weight,
    rank_window            = _rank_window,
    strict_termination     = _strict_termination,
    allowed_points         = _allowed_points,
    wrap_orientation       = allow_wrapping,
)

# =============================================================================
# OUTPUT CONVERSION
# =============================================================================

def _point_tuples_to_tree(nested_tuples):
    # list[list[(x, z)]] -> Point3d tree, one branch per outer entry, XZ-plane.
    nested_points = [
        [rg.Point3d(x, 0.0, z) for (x, z) in branch]
        for branch in nested_tuples
    ]
    return th.list_to_tree(nested_points)

def _bridge_connections_to_tuples(bike_bridge):
    # Flattens bike_bridge.connections (per-frame-pair -> up to 2 connector
    # entries) into one flat list of coordinate tuples, one per polyline. Each
    # entry can resolve to 2 or 3 points depending on BikeBridge's own pruning
    # (dropped perpendicular inserts, connection-length limiting) — the loop
    # below handles either length, no fixed-triple assumption.
    triples_out = []
    for connection_set in bike_bridge.connections:
        for triple in connection_set:
            resolved_points = [
                (float(bike_bridge.points[frame_idx][local_idx][0]),
                 float(bike_bridge.points[frame_idx][local_idx][1]))
                for frame_idx, local_idx in triple
            ]
            triples_out.append(resolved_points)
    return triples_out

def _tube_to_tuples(bike_bridge, per_frame_local_indices):
    # Resolves a BikeBridge per-tube index property (list[list[int]], one
    # inner list per frame) into one coordinate-tuple branch per frame.
    branches_out = []
    for frame_idx, local_indices in enumerate(per_frame_local_indices):
        frame_points = bike_bridge.points[frame_idx]
        branch = [
            (float(frame_points[local_idx][0]), float(frame_points[local_idx][1]))
            for local_idx in local_indices
        ]
        branches_out.append(branch)
    return branches_out

def _support_to_point(bike_bridge, support_id):
    # Resolves a BikeBridge support id (single (frame_idx, local_idx) tuple,
    # as returned by bike_bridge.pin / bike_bridge.roller) to one Point3d.
    frame_idx, local_idx = support_id
    x, z = bike_bridge.points[frame_idx][local_idx]
    return rg.Point3d(float(x), 0.0, float(z))

def _tension_lines_to_tuples(bike_bridge):
    # Resolves bike_bridge.tension_lines (list of (id_a, id_b) pairs, each id
    # a (frame_idx, local_idx)) into one 2-point coordinate branch per line.
    branches_out = []
    for id_a, id_b in bike_bridge.tension_lines:
        points = []
        for frame_idx, local_idx in (id_a, id_b):
            x, z = bike_bridge.points[frame_idx][local_idx]
            points.append((float(x), float(z)))
        branches_out.append(points)
    return branches_out

def _load_points_to_list(bike_bridge):
    # Resolves bike_bridge.load_points (flat list of (frame_idx, local_idx)
    # ids) into a flat list of Point3d — same shape as guide_curve_out, since
    # these are standalone points, not polylines. Empty if load_valid is
    # False; that degrades naturally from load_points already being [] then.
    points_out = []
    for frame_idx, local_idx in bike_bridge.load_points:
        x, z = bike_bridge.points[frame_idx][local_idx]
        points_out.append(rg.Point3d(float(x), 0.0, float(z)))
    return points_out

placed_frames_out = _point_tuples_to_tree(
    placed_frames_to_point_tuples(result.placed_frames)
)

action_log_out = th.list_to_tree(result.action_log)

remaining_options_out = ",".join(str(count) for count in result.remaining_options)

guide_curve_out = [rg.Point3d(float(x), 0.0, float(z)) for (x, z) in sampled_guide_curve]

if result.bike_bridge is not None:
    bridge_points_out = _point_tuples_to_tree(
        bridge_points_to_tuples(result.bike_bridge)
    )
    connections_out = _point_tuples_to_tree(
        _bridge_connections_to_tuples(result.bike_bridge)
    )
    tt_out = _point_tuples_to_tree(_tube_to_tuples(result.bike_bridge, result.bike_bridge.top_tubes))
    ht_out = _point_tuples_to_tree(_tube_to_tuples(result.bike_bridge, result.bike_bridge.head_tubes))
    dt_out = _point_tuples_to_tree(_tube_to_tuples(result.bike_bridge, result.bike_bridge.down_tubes))
    cs_out = _point_tuples_to_tree(_tube_to_tuples(result.bike_bridge, result.bike_bridge.chain_stays))
    ss_out = _point_tuples_to_tree(_tube_to_tuples(result.bike_bridge, result.bike_bridge.seat_stays))
    st_out = _point_tuples_to_tree(_tube_to_tuples(result.bike_bridge, result.bike_bridge.seat_tubes))
    pin_out = _support_to_point(result.bike_bridge, result.bike_bridge.pin)
    roller_out = _support_to_point(result.bike_bridge, result.bike_bridge.roller)
    tension_cable_out = _point_tuples_to_tree(_tension_lines_to_tuples(result.bike_bridge))
    load_points_out = _load_points_to_list(result.bike_bridge)
else:
    bridge_points_out = _point_tuples_to_tree([])
    connections_out    = _point_tuples_to_tree([])
    tt_out = _point_tuples_to_tree([])
    ht_out = _point_tuples_to_tree([])
    dt_out = _point_tuples_to_tree([])
    cs_out = _point_tuples_to_tree([])
    ss_out = _point_tuples_to_tree([])
    st_out = _point_tuples_to_tree([])
    pin_out = None
    roller_out = None
    tension_cable_out = _point_tuples_to_tree([])
    load_points_out = []

reuse_skips        = result.tally.reuse_skips
no_progress_skips  = result.tally.no_progress_skips
no_intersect_skips = result.tally.no_intersect_skips
terminated         = result.tally.terminated
true_termination    = result.tally.true_termination
overshot            = result.tally.overshot
steps_completed      = result.tally.steps_completed

# =============================================================================
# IV Outputs
# =============================================================================
deck_range_1      = IV.deck_range[0]
deck_range_2      = IV.deck_range[1]
deck_range        = [deck_range_1, deck_range_2]
tributary_width      = IV.tributary_width
termination_vicinity = IV.termination_vicinity
# ---------- end py3 ----------
and = GateAnd(A=py3.terminated, B=py3.true_termination)
number_slider_3 = Slider(1, range=0..10)
pline = PolyLine(Vertices=py3.placed_frames_out, Closed=True)
pt_2 = Point(py3.load_points_out)
number_slider_4 = Slider(3, range=0..6)
panel_5 = Panel("""1.25
0.833
0.625
0.5
0.416
0.357
0.3125""")
concat = Concatenate()

# ----
# Pre-FEA Visualizer
swatch = ColourSwatch(SwatchColor=RGB(255, 0, 238))
intcrv_2 = Interpolate(Vertices=py3.guide_curve_out, Degree=3, Periodic=False, KnotStyle=1)  # -> Curve, Length, Domain
item_2 = ListItem(List=py3.guide_curve_out, Index=-1, Wrap=True)
pline_2 = PolyLine(Vertices=py3.tension_cable_out, Closed=False)  # -> flatten(Polyline)
pline_3 = PolyLine(Vertices=py3.connections_out, Closed=False)  # -> flatten(Polyline)
cluster_2 = Cluster(V_3=py3.st_out, V_4=py3.tt_out, V_5=py3.ht_out, V_6=py3.dt_out, V=py3.cs_out, V_2=py3.ss_out)  # -> R, R_2
pl = ConstructPlane(Origin=item_2, XAxis=Vector(1, 0, 0), YAxis=Vector(0, 0, 1))
cir = Circle(Plane=pl, Radius=py3.termination_vicinity)
preview = CustomPreview(Geometry=cluster_2.R, Material=simplify(cluster_2.R_2))
preview_2 = CustomPreview(
    Geometry=intcrv_2.Curve,
    Material={diffuse=RGB(221, 160, 221), emission=RGB(66, 48, 66), shine=0.5, specular=RGB(255, 255, 255), transparency=0})
preview_3 = CustomPreview(
    Geometry=cir,
    Material={diffuse=RGB(221, 160, 221), emission=RGB(66, 48, 66), shine=0.5, specular=RGB(255, 255, 255), transparency=0})
preview_4 = CustomPreview(Geometry=pline_2, Material=swatch)
preview_5 = CustomPreview(Geometry=pline_3, Material=ColourSwatch(SwatchColor=RGB(255, 153, 0)))

series = Series(Start=0, Step=1, Count=number_slider_3)
tributary_depth = Slider(1.25, range=0..10)
uls_kn_m2 = Slider(7.35, range=0..10)
item_3 = ListItem(List=panel_5, Index=number_slider_4, Wrap=True)
deck_range = Panel("""0
8000""")

# ----
# Connections
tstat = TreeStatistics(Tree=py3.connections_out)  # -> Paths, Length, Count
series_2 = Series(Start=0, Step=1, Count=tstat.Count)
pline_4 = PolyLine(Vertices=py3.connections_out, Closed=False)  # -> flatten(Polyline)
concat_2 = Concatenate(FragmentA="CON_", FragmentB=series_2)
lineelem = CreateLinearElementKaramba3D(
    Line=pline_4,
    Colour=ColourSwatch(SwatchColor=RGB(255, 153, 0)),
    Identifier=concat_2,
    CrossSection=crosec_2,
    LimitDistance_mm=0.005,
    BucklingLengthY_mm=-1,
    BucklingLengthZ_mm=-1,
    BucklingLengthLT_mm=-1,
    Bending=True,
    ToPolylineMaxAngle=0.25,
    ToPolylineTolerance=0.1,
    ToPolylineMaxEdgeLength=0.25,
    New=True,
    Remove=True,
    mode="LineToBeam")  # -> Element, Points, Info

# ----
# Seat Tube
item_4 = ListItem(List=py3.action_log_out, Index=0, Wrap=True)  # -> flatten(Item)
pline_5 = PolyLine(Vertices=py3.st_out, Closed=False)  # -> flatten(Polyline)
concat_3 = Concatenate(FragmentA="ST_", FragmentB=item_4)
item_5 = ListItem(List=cluster.path_mapper_7, Index=item_4, Wrap=True)
lineelem_2 = CreateLinearElementKaramba3D(
    Line=simplify(graft(pline_5)),
    Colour=ColourSwatch(SwatchColor=RGB(170, 0, 255)),
    Identifier=simplify(graft(concat_3)),
    CrossSection=simplify(graft(item_5)),
    LimitDistance_mm=0.005,
    BucklingLengthY_mm=-1,
    BucklingLengthZ_mm=-1,
    BucklingLengthLT_mm=-1,
    Bending=True,
    ToPolylineMaxAngle=0.25,
    ToPolylineTolerance=0.1,
    ToPolylineMaxEdgeLength=0.25,
    New=True,
    Remove=True,
    mode="LineToBeam")  # -> flatten(Element), Points, Info

# ----
# Top Tube
item_6 = ListItem(List=py3.action_log_out, Index=0, Wrap=True)  # -> flatten(Item)
pline_6 = PolyLine(Vertices=py3.tt_out, Closed=False)  # -> flatten(Polyline)
concat_4 = Concatenate(FragmentA="ST_", FragmentB=item_6)
item_7 = ListItem(List=cluster.path_mapper_8, Index=item_6, Wrap=True)
lineelem_3 = CreateLinearElementKaramba3D(
    Line=simplify(graft(pline_6)),
    Colour=ColourSwatch(SwatchColor=RGB(0, 34, 255)),
    Identifier=simplify(graft(concat_4)),
    CrossSection=simplify(graft(item_7)),
    LimitDistance_mm=0.005,
    BucklingLengthY_mm=-1,
    BucklingLengthZ_mm=-1,
    BucklingLengthLT_mm=-1,
    Bending=True,
    ToPolylineMaxAngle=0.25,
    ToPolylineTolerance=0.1,
    ToPolylineMaxEdgeLength=0.25,
    New=True,
    Remove=True,
    mode="LineToBeam")  # -> flatten(Element), Points, Info

# ----
# Head Tube
item_8 = ListItem(List=py3.action_log_out, Index=0, Wrap=True)  # -> flatten(Item)
pline_7 = PolyLine(Vertices=py3.ht_out, Closed=False)  # -> flatten(Polyline)
concat_5 = Concatenate(FragmentA="ST_", FragmentB=item_8)
item_9 = ListItem(List=cluster.path_mapper_11, Index=item_8, Wrap=True)
lineelem_4 = CreateLinearElementKaramba3D(
    Line=simplify(graft(pline_7)),
    Colour=ColourSwatch(SwatchColor=RGB(0, 255, 255)),
    Identifier=simplify(graft(concat_5)),
    CrossSection=simplify(graft(item_9)),
    LimitDistance_mm=0.005,
    BucklingLengthY_mm=-1,
    BucklingLengthZ_mm=-1,
    BucklingLengthLT_mm=-1,
    Bending=True,
    ToPolylineMaxAngle=0.25,
    ToPolylineTolerance=0.1,
    ToPolylineMaxEdgeLength=0.25,
    New=True,
    Remove=True,
    mode="LineToBeam")  # -> flatten(Element), Points, Info

# ----
# Down Tube
item_10 = ListItem(List=py3.action_log_out, Index=0, Wrap=True)  # -> flatten(Item)
pline_8 = PolyLine(Vertices=py3.dt_out, Closed=False)  # -> flatten(Polyline)
concat_6 = Concatenate(FragmentA="ST_", FragmentB=item_10)
item_11 = ListItem(List=cluster.path_mapper_9, Index=item_10, Wrap=True)
lineelem_5 = CreateLinearElementKaramba3D(
    Line=simplify(graft(pline_8)),
    Colour=ColourSwatch(SwatchColor=RGB(51, 255, 0)),
    Identifier=simplify(graft(concat_6)),
    CrossSection=simplify(graft(item_11)),
    LimitDistance_mm=0.005,
    BucklingLengthY_mm=-1,
    BucklingLengthZ_mm=-1,
    BucklingLengthLT_mm=-1,
    Bending=True,
    ToPolylineMaxAngle=0.25,
    ToPolylineTolerance=0.1,
    ToPolylineMaxEdgeLength=0.25,
    New=True,
    Remove=True,
    mode="LineToBeam")  # -> flatten(Element), Points, Info

# ----
# Chain Stay
item_12 = ListItem(List=py3.action_log_out, Index=0, Wrap=True)  # -> flatten(Item)
pline_9 = PolyLine(Vertices=py3.cs_out, Closed=False)  # -> flatten(Polyline)
concat_7 = Concatenate(FragmentA="ST_", FragmentB=item_12)
item_13 = ListItem(List=cluster.path_mapper_10, Index=item_12, Wrap=True)
lineelem_6 = CreateLinearElementKaramba3D(
    Line=simplify(graft(pline_9)),
    Colour=ColourSwatch(SwatchColor=RGB(255, 187, 0)),
    Identifier=simplify(graft(concat_7)),
    CrossSection=simplify(graft(item_13)),
    LimitDistance_mm=0.005,
    BucklingLengthY_mm=-1,
    BucklingLengthZ_mm=-1,
    BucklingLengthLT_mm=-1,
    Bending=True,
    ToPolylineMaxAngle=0.25,
    ToPolylineTolerance=0.1,
    ToPolylineMaxEdgeLength=0.25,
    New=True,
    Remove=True,
    mode="LineToBeam")  # -> flatten(Element), Points, Info

# ----
# Seat Stay
item_14 = ListItem(List=py3.action_log_out, Index=0, Wrap=True)  # -> flatten(Item)
pline_10 = PolyLine(Vertices=py3.ss_out, Closed=False)  # -> flatten(Polyline)
concat_8 = Concatenate(FragmentA="ST_", FragmentB=item_14)
item_15 = ListItem(List=cluster.path_mapper_12, Index=item_14, Wrap=True)
lineelem_7 = CreateLinearElementKaramba3D(
    Line=simplify(graft(pline_10)),
    Colour=ColourSwatch(SwatchColor=RGB(238, 255, 0)),
    Identifier=simplify(graft(concat_8)),
    CrossSection=simplify(graft(item_15)),
    LimitDistance_mm=0.005,
    BucklingLengthY_mm=-1,
    BucklingLengthZ_mm=-1,
    BucklingLengthLT_mm=-1,
    Bending=True,
    ToPolylineMaxAngle=0.25,
    ToPolylineTolerance=0.1,
    ToPolylineMaxEdgeLength=0.25,
    New=True,
    Remove=True,
    mode="LineToBeam")  # -> flatten(Element), Points, Info

remap_2 = RemapNumbers(Value=item_3, Source=Domain(0.3125, 1.25), Target=Domain(1, 0))  # -> Mapped, Clipped

# ----
# Supports
supp = SupportKaramba3D(PosInd=py3.pin_out, Ct_kN_m=Vector(0, 0, 0), Cr_kNm_rad=Vector(0, 0, 0), menu=[buttons(on, on, on, on, off, on)])
supp_2 = SupportKaramba3D(PosInd=py3.roller_out, Ct_kN_m=Vector(0, 0, 0), Cr_kNm_rad=Vector(0, 0, 0), menu=[buttons(off, on, on, on, off, on)])

cluster_3 = Cluster_3(P=py3.load_points_out, I=deck_range)
division = Division(A=cluster_3, B=1000)
multiplication_2 = Multiplication(A=item_3, B=division)
multiplication_3 = Multiplication(A=uls_kn_m2, B=multiplication_2)
list = ValueList({"Load_Case_Gravity", "Load_Case_Gravity_ULS", "Load_Case_ULS"}, selected="Load_Case_Gravity")
vec = VectorXYZ(XComponent=0, YComponent=0, ZComponent=expr("-x", multiplication_3))  # -> Vector, Length
loads = LoadsKaramba3D(ForceVector=flatten(vec.Vector), Local=False, PosInd=flatten(py3.load_points_out), LCase="Load_Case_ULS", mode="Point")

simplify = SimplifyTree(Tree=py3.st_out, Front=False)
tstat_2 = TreeStatistics(Tree=simplify(simplify))  # -> Paths, Length, Count
merge_2 = Merge(Data1=supp, Data2=supp_2)
item_16 = ListItem(List=tstat_2.Paths, Index=[0, -1], Wrap=True)
panel_6 = Panel("""Load_Case_Gravity_ULS
Load_Case_ULS""")
split = SplitTree(Data=simplify, Masks=flatten(item_16))  # -> Positive, Negative

# ----
# THIS MIGHT BE VERY WRONG
panel_7 = Panel("Load_Case_Gravity_ULS")
loads_2 = LoadsKaramba3D(Vector="0,0,-1.35", LCase=panel_7, mode="Gravity")

loads_3 = LoadsKaramba3D(Vector=Vector(0, 0, -1), LCase="Load_Case_Gravity", mode="Gravity")

supp_3 = SupportKaramba3D(
    PosInd=flatten(split.Negative),
    Ct_kN_m=Vector(0, 0, 0),
    Cr_kNm_rad=Vector(0, 0, 0),
    menu=[buttons(off, on, off, off, off, off)])
merge_3 = Merge(Data1=merge_2, Data2=supp_3)
panel_8 = Panel(multiplication_3)
merge_4 = Merge(Data1=flatten(loads), Data2=flatten(loads_3))
list_2 = ValueList({"Load_Case_ULS"}, selected="Load_Case_ULS")
merge_5 = Merge(
    Data1=flatten(concat_3),
    Data2=flatten(concat_4),
    Data3=flatten(concat_5),
    Data4=flatten(concat_6),
    Data5=flatten(concat_7),
    Data6=flatten(concat_8))
frame_ids = Data(merge_5)
connection_ids = Data(concat_2)
merge_6 = Merge(Data1=frame_ids, Data2=connection_ids)  # -> flatten(Result)
non_convergent_objective_scores = Panel("""20
400
400""")
objective_normalization_ranges = Panel("""0 to 100
0 to 1000
0 to 1000""")
item_17 = ListItem(List=objective_normalization_ranges, Index=0, Wrap=True)  # -> Item, Item1, Item2
item_18 = ListItem(List=non_convergent_objective_scores, Index=0, Wrap=True)  # -> Item, Item1, Item2
filter = StreamFilter(Gate=and, Stream0=1, Stream1=remap.Mapped)
filter_2 = StreamFilter(Gate=and, Stream0=1, Stream1=remap_2.Mapped)
merge_7 = Merge()
path_mapper = PathMapper(source="{A;B}", target="{path_index}")
flip = FlipMatrix(Data=path_mapper)
bang = ExplodeTree(Data=flip)  # -> Branch0, Branch1, Branch2, Branch3, Branch4
division_2 = Division(A=bang.Branch0, B="1.75")  # -> flatten(Result)
division_3 = Division(A=bang.Branch1, B="48.3")  # -> flatten(Result)
division_4 = Division(A=bang.Branch2, B="62.1")  # -> flatten(Result)
data = Data([1, 0.457876, 0])
data_2 = Data([1, 0.180283, 0.825714, 0.525802, 0.363023, 0.677264, 0])
smaller = SmallerThan(FirstNumber=division_2, SecondNumber=1)  # -> SmallerThan, OrEqualTo
smaller_2 = SmallerThan(FirstNumber=division_3, SecondNumber=1)  # -> SmallerThan, OrEqualTo
smaller_3 = SmallerThan(FirstNumber=division_4, SecondNumber=1)  # -> SmallerThan, OrEqualTo
arch_fitness_values = Panel(data)
trib_width_fitness_values = Panel(data_2)
and_2 = GateAnd(A=smaller.OrEqualTo, B=smaller_2.OrEqualTo, C=smaller_3.OrEqualTo)
subtraction = Subtraction(A=division_2, B=1)
subtraction_2 = Subtraction(A=division_3, B=1)
subtraction_3 = Subtraction(A=division_4, B=1)
merge_8 = Merge(Data1=simplify(graft(division_2)), Data2=simplify(graft(division_3)), Data3=simplify(graft(division_4)))
smaller_4 = SmallerThan(FirstNumber=subtraction, SecondNumber=0)  # -> SmallerThan, OrEqualTo
smaller_5 = SmallerThan(FirstNumber=subtraction_2, SecondNumber=0)  # -> SmallerThan, OrEqualTo
repeat = RepeatData(Data=0, Length=2500)
repeat_2 = RepeatData(Data=0, Length=2500)
smaller_6 = SmallerThan(FirstNumber=subtraction_3, SecondNumber=0)  # -> SmallerThan, OrEqualTo
repeat_3 = RepeatData(Data=0, Length=2500)
sort = SortList(Keys=merge_8)  # -> reverse(Keys), ValuesA
p_n_c = PickNChoose(Pattern=smaller_4.SmallerThan, Stream0=subtraction, Stream1=repeat)
p_n_c_2 = PickNChoose(Pattern=smaller_5.SmallerThan, Stream0=subtraction_2, Stream1=repeat_2)
p_n_c_3 = PickNChoose(Pattern=smaller_6.SmallerThan, Stream0=subtraction_3, Stream1=repeat_3)
item_19 = ListItem(List=sort.Keys, Index=0, Wrap=True)  # -> flatten(Item)
addition = Addition(A=p_n_c, B=p_n_c_2, C=p_n_c_3, D="1")
sort_2 = SortList(Keys=item_19)  # -> Keys, ValuesA

xz = XZPlane(Origin="10000, 0, 10000")
rectangle = Rectangle(Plane=xz, XSize=Domain(0, 10000), YSize=Domain(0, 3000), Radius=0)  # -> Rectangle, Length
area = Area(Geometry=rectangle.Rectangle)  # -> Area, Centroid
arrrec = RectangularArray(Geometry=area.Centroid, Cell=rectangle.Rectangle, XCount=Slider(5, range=0..20), YCount=Slider(10, range=0..20))  # -> Geometry, Transform
pt_3 = Point(Point(4050, 0, 1070))
vec2pt = Vector2Pt(PointA=pt_3, PointB=arrrec.Geometry, Unitize=False)  # -> simplify(graft(Vector)), Length

p_n_c_4 = PickNChoose(Pattern=and_2, Stream0=addition, Stream1=item_19)

# ----
# 10 step action space
# 1.25 trib width
data_3 = Data(Tree({0}: ["20", "20", 21.2863956, "20", 8.965122866, 29.5065569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], {1}: ["400", "400", 548.3073001, "400", 223.6857979, 546.3442947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], {2}: ["400", "400", 507.1847623, "400", 212.1630925, 511.8863214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], {3}: [False, False, True, False, True, True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], {4}: ["10,10,10,10,10,10,10,10,10,10,10,10,10", "10,10,10,10,10,10,10,10,10,10,10,10,10", "10,10,10,10,10,10,10,10,10,10,10,10,10,10", "10,10,10,10,10,10,10,10,10,10,10,10,10,10", "10,10,10,10,10,10,10,10,10,10,10,10,10", "10,10,10,10,10,10,10,10,10,10,10,10,10,10"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]))

series_3 = Series(Start=0, Step=1, Count=50)  # -> graft(Series)
partition = PartitionList(List=p_n_c_4, Size=50)
avr_2 = Average(Input=partition)  # -> flatten(ArithmeticMean)
bang_2 = ExplodeTree(Data=data_3)  # -> Branch0, Branch1, Branch2, Branch3, Branch4
repeat_4 = RepeatData(Data=series_3, Length=50)  # -> flatten(Data)
pool_5_fitness = Data(Tree({0;0}: [1, 1, 1, 0, 0.180283], {0;1}: [0.056685, 0.152495, 0.152495, 1, 1], {0;2}: [1, 1, 1, 0, 0.677264], {0;3}: [0.328364, 1, 1, 1, 0.180283], {0;4}: [0.056685, 0.152495, 0.152495, 1, 1], {0;5}: [0.204981, 0.449992, 0.421161, 0.457876, 0.677264]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))
pool_5_data = Data(Tree({0;0}: [479.9904176, 7837.629917, 8066.692261, True, "5,5,5,5,5,5,5,5,5,5,5,5,5,5,5,5,5,5,5,5,5,5,5", -701.8207777, 620.506899, -11.03568259, 80.48465847], {0;1}: ["20", "400", "400", False, "5,5,5,5,5,5,5,5,5,5,5,5,5,5,5,5,5,5,5,5,5,5,5,5"], {0;2}: [175.1256973, 2165.00634, 2133.513735, True, "5,5,5,5,5,5,5,5,5,5,5,5,5,5,5,5,5,5,5,5,5,5,5,5", -307.8452326, 282.2712041, 2.173967752, 34.59826416], {0;3}: [63.18156591, 1675.867408, 1685.881408, True, "5,5,5,5,5,5,5,5,5", -180.880757, 165.099169, 2.611267069, 4.272462848], {0;4}: ["20", "400", "400", False, "5,5,5,5,5,5,5,5,5,5,5,5,5,5,5,5,5,5,5,5,5,5,5,5"], {0;5}: [48.14235816, 743.4691008, 719.5490473, True, "5,5,5,5,5,5,5,5,5,5,5", -124.3315005, 101.3583287, 3.33626088, 13.65055215]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))
panel_9 = Panel(repeat_4)
panel_10 = Panel(avr_2)
pool_10_fitness = Data(Tree({0;0}: [0.056685, 0.152495, 0.152495, 1, 1], {0;1}: [0.056685, 0.152495, 0.152495, 1, 1], {0;2}: [0.056685, 0.152495, 0.152495, 1, 1], {0;3}: [0.007822, 0.170969, 0.159372, 1, 0.180283], {0;4}: [0.056685, 0.152495, 0.152495, 1, 1], {0;5}: [0.056685, 0.152495, 0.152495, 1, 1]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))
pool_10_data = Data(Tree({0;0}: ["20", "400", "400", False, "10,10,10,10,10,10,10,10,10,10,10,10,10,10,10,10,10,10,10,10,10,10,10,10"], {0;1}: ["20", "400", "400", False, "10,10,10,10,10,10,10,10,10,10,10,10,10,10,10,10,10,10,10,10,10,10,10,10"], {0;2}: ["20", "400", "400", False, "10,10,10,10,10,10,10,10,10,10,10,10,10,10,10,10,10,10,10,10,10,10,10,10"], {0;3}: [3.696807109, 430.2404625, 411.479804, True, "10,10,10,10,10,10,10,10,10,10", -76.20087074, 64.38339522, 4.38150825, 10.69740424], {0;4}: ["20", "400", "400", False, "10,10,10,10,10,10,10,10,10,10,10,10,10,10,10,10,10,10,10,10,10,10,10,10"], {0;5}: ["20", "400", "400", False, "10,10,10,10,10,10,10,10,10,10,10,10"]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))
smaller_7 = SmallerThan(FirstNumber=bang_2.Branch0, SecondNumber="1.75")  # -> SmallerThan, OrEqualTo
smaller_8 = SmallerThan(FirstNumber=bang_2.Branch1, SecondNumber="48.3")  # -> SmallerThan, OrEqualTo
smaller_9 = SmallerThan(FirstNumber=bang_2.Branch2, SecondNumber="62.1")  # -> SmallerThan, OrEqualTo
and_3 = GateAnd(A=smaller_7.SmallerThan, B=smaller_8.SmallerThan, C=smaller_9.SmallerThan)
dispatch = Dispatch(List=and_3, DispatchPattern=and_3)  # -> ListA, ListB
pt_4 = Point(Point(870, 0, 50))
path_mapper_2 = PathMapper(pool_5_data, source="{A;B}", target="{path_index}")
path_mapper_3 = PathMapper(pool_10_data, source="{A;B}", target="{path_index}")
move_3 = Move(Geometry=pt_4, Motion=vec2pt.Vector)  # -> Geometry, Transform
flip_2 = FlipMatrix(Data=simplify(path_mapper_2))
xz_2 = XZPlane(Origin=move_3.Geometry)
flip_3 = FlipMatrix(Data=simplify(path_mapper_3))
bang_3 = ExplodeTree(Data=flip_2)  # -> Branch0, Branch1, Branch2, Branch3, Branch4, Branch5, Branch6, Branch7, Branch8
arch_length = ListItem(List=pool_5_fitness, Index=3, Wrap=True)  # -> flatten(Item)
trib_width = ListItem(List=pool_5_fitness, Index=4, Wrap=True)  # -> flatten(Item)
bang_4 = ExplodeTree(Data=flip_3)  # -> Branch0, Branch1, Branch2, Branch3, Branch4, Branch5, Branch6, Branch7, Branch8
arch_length_2 = ListItem(List=pool_10_fitness, Index=3, Wrap=True)  # -> flatten(Item)
trib_width_2 = ListItem(List=pool_10_fitness, Index=4, Wrap=True)  # -> flatten(Item)
data_4 = Data([1, 0.457876, 0])
data_5 = Data([1, 0.180283, 0.825714, 0.525802, 0.363023, 0.677264, 0])
pool_5_fitness_2 = Data(pool_10_fitness)
pool_5_data_2 = Data(pool_10_data)
mindex = MemberIndex(Set=trib_width, Member=data_2)  # -> Index, Count
mindex_2 = MemberIndex(Set=trib_width_2, Member=data_2)  # -> Index, Count
arch_fitness_values_2 = Panel(data_4)
trib_width_fitness_values_2 = Panel(data_5)
item_20 = ListItem(List=arch_length, Index=mindex.Index, Wrap=True)
smaller_10 = SmallerThan(FirstNumber=bang_3.Branch0, SecondNumber="1.75")  # -> SmallerThan, OrEqualTo
smaller_11 = SmallerThan(FirstNumber=bang_3.Branch1, SecondNumber="48.3")  # -> SmallerThan, OrEqualTo
smaller_12 = SmallerThan(FirstNumber=bang_3.Branch2, SecondNumber="62.1")  # -> SmallerThan, OrEqualTo
larger = LargerThan(FirstNumber=bang_3.Branch5, SecondNumber="-23.5")  # -> LargerThan, OrEqualTo
smaller_13 = SmallerThan(FirstNumber=bang_3.Branch6, SecondNumber="23.5")  # -> SmallerThan, OrEqualTo
smaller_14 = SmallerThan(FirstNumber=bang_3.Branch8, SecondNumber="13.65")  # -> SmallerThan, OrEqualTo
smaller_15 = SmallerThan(FirstNumber=bang_3.Branch7, SecondNumber="0")  # -> SmallerThan, OrEqualTo
item_21 = ListItem(List=pool_5_fitness_2, Index=4, Wrap=True)  # -> flatten(Item)
item_22 = ListItem(List=pool_5_fitness_2, Index=3, Wrap=True)  # -> flatten(Item)
item_23 = ListItem(List=arch_length_2, Index=mindex_2.Index, Wrap=True)
tstat_3 = TreeStatistics(Tree=pool_5_fitness_2)  # -> Paths, Length, Count
smaller_16 = SmallerThan(FirstNumber=bang_4.Branch0, SecondNumber="1.75")  # -> SmallerThan, OrEqualTo
smaller_17 = SmallerThan(FirstNumber=bang_4.Branch1, SecondNumber="48.3")  # -> SmallerThan, OrEqualTo
smaller_18 = SmallerThan(FirstNumber=bang_4.Branch2, SecondNumber="62.1")  # -> SmallerThan, OrEqualTo
larger_2 = LargerThan(FirstNumber=bang_4.Branch5, SecondNumber="-23.5")  # -> LargerThan, OrEqualTo
smaller_19 = SmallerThan(FirstNumber=bang_4.Branch6, SecondNumber="23.5")  # -> SmallerThan, OrEqualTo
smaller_20 = SmallerThan(FirstNumber=bang_4.Branch8, SecondNumber="13.65")  # -> SmallerThan, OrEqualTo
smaller_21 = SmallerThan(FirstNumber=bang_4.Branch7, SecondNumber="0")  # -> SmallerThan, OrEqualTo
# This is a list of iterations sorted per tributary width and per arch length
mindex_3 = MemberIndex(Set=item_20, Member=data)  # -> simplify(Index), Count
# This is a list of iterations sorted per tributary width and per arch length
mindex_4 = MemberIndex(Set=item_23, Member=data)  # -> simplify(Index), Count
branch = TreeBranch(Tree=pool_5_fitness, Path="{1;6}", MaintainPaths=True)
mindex_5 = MemberIndex(Set=item_21, Member=data_5)  # -> simplify(Index), Count
smaller_22 = SmallerThan(FirstNumber=item_22, SecondNumber=0.6)  # -> SmallerThan, OrEqualTo
larger_3 = LargerThan(FirstNumber=item_22, SecondNumber=0.3)  # -> LargerThan, OrEqualTo
and_4 = GateAnd(
    A=smaller_10.SmallerThan,
    B=smaller_11.SmallerThan,
    C=smaller_12.SmallerThan,
    D=larger.LargerThan,
    E=smaller_13.SmallerThan,
    F=smaller_14.SmallerThan,
    G=smaller_15.SmallerThan)
and_5 = GateAnd(
    A=smaller_16.SmallerThan,
    B=smaller_17.SmallerThan,
    C=smaller_18.SmallerThan,
    D=larger_2.LargerThan,
    E=smaller_19.SmallerThan,
    F=smaller_20.SmallerThan,
    G=smaller_21.SmallerThan)
and_6 = GateAnd(A=smaller_22.SmallerThan, B=larger_3.LargerThan)
panel_11 = Panel(branch)
tstat_4 = TreeStatistics(Tree=pool_5_data)  # -> Paths, Length, Count
item_24 = ListItem(List=tstat_3.Paths, Index=mindex_5.Index, Wrap=True)
dispatch_2 = Dispatch(List=tstat_3.Paths, DispatchPattern=and_6)  # -> ListA, ListB
item_25 = ListItem(List=pool_5_data_2, Index=0, Wrap=False)  # -> Item, Item1, Item2, Item3, Item4, Item5, Item6, Item7, Item8
item_26 = ListItem(List=and_4, Index=mindex_3.Index, Wrap=True)
item_27 = ListItem(List=tstat_4.Paths, Index=mindex_3.Index, Wrap=True)
item_28 = ListItem(List=and_5, Index=mindex_4.Index, Wrap=True)
item_29 = TreeItem(Tree=pool_5_fitness_2, Path=item_24, Index=3, Wrap=True)
dispatch_3 = Dispatch(List=item_26, DispatchPattern=item_26)  # -> ListA, ListB
dispatch_4 = Dispatch(List=item_27, DispatchPattern=item_26)  # -> ListA, ListB
dispatch_5 = Dispatch(List=item_28, DispatchPattern=item_28)  # -> ListA, ListB
mindex_6 = MemberIndex(Set=item_29, Member=data_4)  # -> Index, Count
lng = ListLength(List=dispatch_3.ListA)  # -> flatten(Length)
lng_2 = ListLength(List=dispatch_5.ListA)  # -> flatten(Length)
lng_3 = ListLength(List=mindex_6.Index)
trim = TrimTree(Tree=mindex_6.Index, Depth=1)
branch_2 = TreeBranch(Tree=dispatch_4.ListA, Path="{1;1}", MaintainPaths=True)
smaller_23 = SmallerThan(FirstNumber=item_25.Item, SecondNumber="1.75")  # -> SmallerThan, OrEqualTo
smaller_24 = SmallerThan(FirstNumber=item_25.Item1, SecondNumber="48.3")  # -> SmallerThan, OrEqualTo
smaller_25 = SmallerThan(FirstNumber=item_25.Item2, SecondNumber="62.1")  # -> SmallerThan, OrEqualTo
larger_4 = LargerThan(FirstNumber=item_25.Item5, SecondNumber="-23.5")  # -> LargerThan, OrEqualTo
smaller_26 = SmallerThan(FirstNumber=item_25.Item6, SecondNumber="23.5")  # -> SmallerThan, OrEqualTo
smaller_27 = SmallerThan(FirstNumber=item_25.Item8, SecondNumber="13.65")  # -> SmallerThan, OrEqualTo
smaller_28 = SmallerThan(FirstNumber=item_25.Item7, SecondNumber="0")  # -> SmallerThan, OrEqualTo
partition_2 = PartitionList(List=lng, Size=3)
partition_3 = PartitionList(List=lng_2, Size=3)
trim_2 = TrimTree(Tree=lng_3, Depth=1)
item_30 = ListItem(List=item_24, Index=trim, Wrap=True)
branch_3 = TreeBranch(Tree=pool_5_fitness, Path=branch_2, MaintainPaths=True)
partition_4 = PartitionList(List=item_30, Size=trim_2)
and_7 = GateAnd(
    A=smaller_23.SmallerThan,
    B=smaller_24.SmallerThan,
    C=smaller_25.SmallerThan,
    D=larger_4.LargerThan,
    E=smaller_26.SmallerThan,
    F=smaller_27.SmallerThan,
    G=smaller_28.SmallerThan)
panel_12 = Panel(partition_3)
panel_13 = Panel(partition_2)
tstat_5 = TreeStatistics(Tree=partition_4)  # -> Paths, Length, Count
repeat_5 = RepeatData(Data=graft(tstat_5.Paths), Length=graft(tstat_5.Length))  # -> simplify(flatten(Data))
panel_14 = Panel(branch_3)
flatten = FlattenTree(Tree=partition_4, Path="{0}")
replace = ReplacePaths(Data=and_7, Search=flatten, Replace=repeat_5)
dispatch_6 = Dispatch(List=replace, DispatchPattern=replace)  # -> ListA, ListB
lng_4 = ListLength(List=dispatch_6.ListA)
trim_3 = TrimTree(Tree=lng_4, Depth=1)
panel_15 = Panel(lng_4)

# ----
# Tension Cables
tstat_6 = TreeStatistics(Tree=py3.tension_cable_out)  # -> Paths, Length, Count
series_4 = Series(Start=0, Step=1, Count=tstat_6.Count)
pline_11 = PolyLine(Vertices=py3.tension_cable_out, Closed=False)  # -> flatten(Polyline)
concat_9 = Concatenate(FragmentA="TENSION_", FragmentB=series_4)

divide = DivideCurve(Curve=pline_11, Count=number_slider_3, Kinks=False)  # -> Points, Tangents, Parameters
pline_12 = PolyLine(Vertices=divide.Points, Closed=False)
concat_10 = Concatenate(FragmentA=graft(concat_9), FragmentB="_", FragmentC=series)  # -> flatten(Result)
explode = Explode(Curve=pline_12, Recursive=True)  # -> flatten(Segments), Vertices

lineelem_8 = CreateLinearElementKaramba3D(
    Line=pline_11,
    Colour=ColourSwatch(SwatchColor=RGB(255, 0, 238)),
    Identifier=concat_10,
    CrossSection=crosec,
    LimitDistance_mm=0.005,
    BucklingLengthY_mm=-1,
    BucklingLengthZ_mm=-1,
    BucklingLengthLT_mm=-1,
    Bending=False,
    ToPolylineMaxAngle=0.25,
    ToPolylineTolerance=0.1,
    ToPolylineMaxEdgeLength=0.25,
    New=True,
    Remove=True,
    mode="LineToTruss")  # -> Element, Points, Info

loads_4 = LoadsKaramba3D(Eps0=Slider(1, range=0..1), ElementIdentifiers=concat_9, LCase=panel_6, mode="InitialStrain")
merge_9 = Merge(
    Data1=flatten(lineelem_8.Element),
    Data2=flatten(lineelem.Element),
    Data3=flatten(lineelem_2.Element),
    Data4=flatten(lineelem_3.Element),
    Data5=flatten(lineelem_4.Element),
    Data6=flatten(lineelem_5.Element),
    Data7=flatten(lineelem_6.Element),
    Data8=flatten(lineelem_7.Element))
assemble = AssembleModelKaramba3D(Elem=merge_9, Support=merge_2, Load=merge_4, LimitDistance_mm=0.005)  # -> Model, Info, Mass_kg, CentreOfGravity, LoadCaseNames
tension_ids = Data(concat_10)
analyse = AnalyseKaramba3D(Model=assemble.Model, LoadCases=list_2)  # -> AnalysedModel, MaximumDisplacement_cm, ResultingForce_kN, ChangeOfElasticEnergy_kNm
analysethii = AnalyseThIIKaramba3D(
    Model=assemble.Model,
    LoadCases=list_2,
    UseInitialNII=True,
    NIIFromCombination=True,
    NoTensionalNII=False,
    RTolerance=1e-07,
    MaxIterations=50)  # -> AnalysedModel, MaximumDisplacement_cm, ResultingForce_kN, ChangeOfElasticEnergy_kNm; disabled
modelview = ModelViewKaramba3D(Model=analyse.AnalysedModel)  # -> Model, DeformedMesh, DeformedAxes, DeformedModel, MaximumDeformation
# Frames
utilization = UtilizationOfElementsKaramba3D(
    AnalysedModel=analyse.AnalysedModel,
    ElementsIdentifiers=frame_ids,
    NumberOfSamplePoints=3,
    ElasticDesign=True,
    GammaM0=1,
    GammaM1=1.1,
    SwayFrame=True,
    WithDetails=True,
    mode="Beams")  # -> Model, Utilization, SigMax_kN_cm², SigMin_kN_cm², TauMax_kN_cm², UtilN, UtilVy, UtilVz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
# Connections
utilization_2 = UtilizationOfElementsKaramba3D(
    AnalysedModel=analyse.AnalysedModel,
    ElementsIdentifiers=connection_ids,
    NumberOfSamplePoints=3,
    ElasticDesign=True,
    GammaM0=1,
    GammaM1=1.1,
    SwayFrame=True,
    WithDetails=False,
    mode="Beams")  # -> Model, Utilization, SigMax_kN_cm², SigMin_kN_cm², TauMax_kN_cm², UtilN, UtilVy, UtilVz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
# Tension Cables
utilization_3 = UtilizationOfElementsKaramba3D(
    AnalysedModel=analyse.AnalysedModel,
    ElementsIdentifiers=tension_ids,
    NumberOfSamplePoints=3,
    ElasticDesign=True,
    GammaM0=1,
    GammaM1=1.1,
    SwayFrame=True,
    WithDetails=False,
    mode="Beams")  # -> Model, Utilization, SigMax_kN_cm², SigMin_kN_cm², TauMax_kN_cm², UtilN, UtilVy, UtilVz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
# Frames + Connectors
utilization_4 = UtilizationOfElementsKaramba3D(
    AnalysedModel=analyse.AnalysedModel,
    ElementsIdentifiers=merge_6,
    NumberOfSamplePoints=3,
    ElasticDesign=True,
    GammaM0=1,
    GammaM1=1.1,
    SwayFrame=True,
    WithDetails=False,
    mode="Beams")  # -> Model, Utilization, SigMax_kN_cm², SigMin_kN_cm², TauMax_kN_cm², UtilN, UtilVy, UtilVz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
merge_10 = Merge(Data1=flatten(utilization.SigMax_kN_cm²), Data2=flatten(utilization.SigMin_kN_cm²))
merge_11 = Merge(Data1=flatten(utilization_2.SigMax_kN_cm²), Data2=flatten(utilization_2.SigMin_kN_cm²))
merge_12 = Merge(Data1=flatten(utilization_3.SigMax_kN_cm²), Data2=flatten(utilization_3.SigMin_kN_cm²))
beamview = BeamViewKaramba3D(Model=modelview.Model)  # -> Model, MeshesOfRenderedBeams, DeformedBeamAxes, LegendColours, LegendTags
sort_3 = SortList(Keys=merge_10)  # -> Keys, ValuesA
sort_4 = SortList(Keys=merge_11)  # -> Keys, ValuesA
sort_5 = SortList(Keys=merge_12)  # -> Keys, ValuesA
max_compression = ListItem(List=sort_3.Keys, Index=0, Wrap=True)
max_tension = ListItem(List=sort_3.Keys, Index=-1, Wrap=True)
max_compression_2 = ListItem(List=sort_4.Keys, Index=0, Wrap=True)
max_tension_2 = ListItem(List=sort_4.Keys, Index=-1, Wrap=True)
max_compression_3 = ListItem(List=sort_5.Keys, Index=0, Wrap=True)
max_tension_3 = ListItem(List=sort_5.Keys, Index=-1, Wrap=True)
mesh = Mesh(beamview.MeshesOfRenderedBeams)
panel_16 = Panel(max_compression)
panel_17 = Panel(max_tension)
panel_18 = Panel(max_compression_2)
panel_19 = Panel(max_tension_2)
panel_20 = Panel(max_compression_3)
panel_21 = Panel(max_tension_3)
preview_6 = CustomPreview(Geometry=mesh, Material=ColourSwatch(SwatchColor=RGB(255, 255, 255)))
legend = Legend(Colour=beamview.LegendColours, Tags=beamview.LegendTags, LegendType=1)

# ----
# Wallacei Optimizer
merge_13 = Merge(Data1=flatten(utilization_4.SigMax_kN_cm²), Data2=flatten(utilization_4.SigMin_kN_cm²))
item_31 = ListItem(List=py3.action_log_out, Index=0, Wrap=True)  # -> Item, Item1, Item2, Item3
sort_6 = SortList(Keys=merge_13)  # -> Keys, ValuesA
concat_11 = Concatenate(
    FragmentH="[",
    FragmentA=item_31.Item,
    FragmentE=",",
    FragmentB=item_31.Item1,
    FragmentF=",",
    FragmentC=item_31.Item2,
    FragmentG=",",
    FragmentD=item_31.Item3,
    FragmentI="]")  # -> flatten(Result)
max_compression_4 = ListItem(List=sort_6.Keys, Index=0, Wrap=True)
max_tension_4 = ListItem(List=sort_6.Keys, Index=-1, Wrap=True)
max_compression_5 = Absolute(Value=max_compression_4)
filter_3 = StreamFilter(Gate=and, Stream0=item_18.Item, Stream1=modelview.MaximumDeformation)
filter_4 = StreamFilter(Gate=and, Stream0=item_18.Item1, Stream1=max_compression_5)
filter_5 = StreamFilter(Gate=and, Stream0=item_18.Item2, Stream1=max_tension_4)
karamba_mesh = Mesh(beamview.MeshesOfRenderedBeams)
shape_grammar = Data(concat_11)
remap_3 = RemapNumbers(Value=filter_3, Source=item_17.Item, Target=Domain(0, 1))  # -> Mapped, Clipped
remap_4 = RemapNumbers(Value=filter_4, Source=item_17.Item1, Target=Domain(0, 1))  # -> Mapped, Clipped
remap_5 = RemapNumbers(Value=filter_5, Source=item_17.Item2, Target=Domain(0, 1))  # -> Mapped, Clipped
merge_14 = Merge(
    Data1=max_compression_2,
    Data2=max_tension_2,
    Data3=max_compression_3,
    Data4=max_tension_3,
    Data5=max_compression_4,
    Data6=max_tension_4,
    Data7=filter_3)
merge_15 = Merge(Data1=max_compression_2, Data2=max_tension_2, Data3=max_compression_3, Data4=max_tension_3)
merge_16 = Merge(Data1=filter_3, Data2=filter_4, Data3=filter_5, Data4=and, Data5=py3.remaining_options_out, Data6=merge_15)

filter_6 = StreamFilter(Gate=and, Stream1=karamba_mesh)
txt = Text(shape_grammar)
merge_17 = Merge(Data1=remap_3.Mapped, Data2=remap_4.Mapped, Data3=remap_5.Mapped, Data4=filter, Data5=filter_2)
num_2 = Number(merge_14)
merge_18 = Merge(Data1=flatten(txt), Data2=flatten(num_2), Data3=flatten(filter_6))
graph = GraphMapper(
    merge_17,
    x0=0,
    x1=1,
    y0=0,
    y1=1,
    container_name="Bezier",
    cpx=[0, 0.5000813603, 0.8996440768, 1],
    cpy=[0, 0.09800034761, 0.4913656116, 1])
item_32 = ListItem(List=graph, Index=0, Wrap=True)  # -> Item, Item1, Item2, Item3, Item4
arch_span = Number(item_32.Item3)
tributary_width = Number(item_32.Item4)

max_compression_6 = Number(item_32.Item1)
max_deform = Number(item_32.Item)
max_tension_5 = Number(item_32.Item2)
# First Run. Aligned to baseline, assuming a loading force of 7.35 kN/m2 and a tributary width of 0.325 metres.
wallacei_x = WallaceiX(
    Genes=[picked_frame, picked_orientation, number_slider, number_slider_4],
    Objectives=[max_deform, max_compression_6, max_tension_5, arch_span, tributary_width],
    Data=merge_16,
    Phenotype=merge_18,
    allFitness="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",
    allFrontIdx="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",
    allGenomes="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",
    curFrontIdx="199|0;199|1;199|2;199|3;199|4;199|5;199|6;199|7;199|8;199|9;199|10;199|11;199|12;199|13;199|14;199|15;199|16;199|17;199|18;199|19;199|20;199|21;199|22;199|23;199|24;199|25;199|26;199|27;199|28;199|29;199|30;199|31;199|32;199|33;199|34;199|35;199|36;199|37;199|38;199|39;199|40;199|41;199|42;199|43;199|44;199|45;199|46;199|47;199|48;199|49",
    curFrontIdxSave="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",
    popGen="50,200",
    total="1195984",
    wlcDone=True)  # -> WallaceiGenomes, FitnessValues, simplify(Data), WPhenotypes

# ----
# Shape Grammar Export
concat_12 = Concatenate(FragmentA="np.array(", FragmentB=txt, FragmentC="),")
panel_22 = Panel(concat_12)

dam = DataDam(DataA=wallacei_x.WPhenotypes, BufferDelay=10000000, BufferMode=0)
pdecoder = DecodePhenotype(WallaceiPhenotype=dam)  # -> GeometriesList, simplify(MeshesList), simplify(NumbersList), TextList
flatten_2 = FlattenTree(Tree=pdecoder.MeshesList, Path="{0}")  # -> simplify(graft(Tree))
cluster_4 = Cluster_4(x=pdecoder.NumbersList)
item_33 = ListItem(List=pdecoder.NumbersList, Index=0, Wrap=True)  # -> Item, Item1, Item2, Item3, flatten(Item4), flatten(Item5), flatten(Item6)
sort_7 = SortList(Keys=item_33.Item4)  # -> Keys, ValuesA
sort_8 = SortList(Keys=item_33.Item5)  # -> Keys, ValuesA
sort_9 = SortList(Keys=item_33.Item6)  # -> Keys, ValuesA
item_34 = ListItem(List=sort_7.Keys, Index=-1, Wrap=True)
item_35 = ListItem(List=sort_8.Keys, Index=0, Wrap=True)
item_36 = ListItem(List=sort_9.Keys, Index=0, Wrap=True)
avr_3 = Average(Input=sort_9.Keys)
move_4 = Move(Geometry=simplify(flatten_2), Motion=vec2pt.Vector)  # -> Geometry, Transform
avr_4 = Average(Input=sort_7.Keys)
avr_5 = Average(Input=sort_8.Keys)
panel_23 = Panel(item_34)
panel_24 = Panel(item_35)
panel_25 = Panel(item_36)
panel_26 = Panel(avr_3)
panel_27 = Panel(avr_4)
panel_28 = Panel(avr_5)
tag = TextTag3D(Location=xz_2, Text=cluster_4, Size=100, Justification=7)
cluster_5 = Cluster_5(M="HT Allowed:", B=avr_4, D=avr_5, F=item_34, H=item_35, J=avr_3, L=item_36)
panel_29 = Panel(cluster_5)

# ==== cluster Cluster
V = ClusterInput()
V_2 = ClusterInput()
V_3 = ClusterInput()
V_4 = ClusterInput()
V_5 = ClusterInput()
V_6 = ClusterInput()
pline = PolyLine(Vertices=V, Closed=False)  # -> flatten(Polyline)
pline_2 = PolyLine(Vertices=V_2, Closed=False)  # -> flatten(Polyline)
pline_3 = PolyLine(Vertices=V_3, Closed=False)  # -> flatten(Polyline)
pline_4 = PolyLine(Vertices=V_4, Closed=False)  # -> flatten(Polyline)
pline_5 = PolyLine(Vertices=V_5, Closed=False)  # -> flatten(Polyline)
pline_6 = PolyLine(Vertices=V_6, Closed=False)  # -> flatten(Polyline)
entwine = Entwine(
    Branch0X=pline_3,
    Branch1X=pline_4,
    Branch2X=pline_5,
    Branch3X=pline_6,
    Branch4X=pline,
    Branch5X=pline_2,
    FlattenInputs=False)  # -> simplify(Result)
merge = Merge(
    Data1=ColourSwatch(SwatchColor=RGB(170, 0, 255)),
    Data2=ColourSwatch(SwatchColor=RGB(0, 34, 255)),
    Data3=ColourSwatch(SwatchColor=RGB(0, 255, 255)),
    Data4=ColourSwatch(SwatchColor=RGB(51, 255, 0)),
    Data5=ColourSwatch(SwatchColor=RGB(255, 187, 0)),
    Data6=ColourSwatch(SwatchColor=RGB(238, 255, 0)))  # -> graft(Result)
R = ClusterOutput(entwine)
R_2 = ClusterOutput(merge)

# ==== cluster Cluster_2
x = ClusterInput()

num = Number("21000")
matprops = MaterialPropertiesKaramba3D(
    FamilyOfMaterial="HT-steel",
    Name="Assumed_Steel",
    YoungsModulus_kN_cm²=num,
    InPlaneShearModulus_kN_cm²="8076",
    TransverseShearModulus_kN_cm²="8076",
    SpecificWeight_kN_m³="78.5",
    CoefficientOfThermalExpansion_1=1.2e-05,
    TensileStrength_kN_cm²="70",
    CompressiveStrength_kN_cm²="60",
    StrengthHypothesis="MISES",
    mode="Isotrop")

expression = Expression(x=x, Expression="x * 100")
bang = ExplodeTree(Data=expression)  # -> Branch0, Branch1, Branch2, Branch3, Branch4, Branch5, Branch6, Branch7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
expression_2 = Expression(D=bang.Branch8, t=bang.Branch9, Expression="(sqrt(2*D²-(D-2*t)²)-D + 2*t)/2")
expression_3 = Expression(D=bang.Branch10, t=bang.Branch11, Expression="(sqrt(2*D²-(D-2*t)²)-D + 2*t)/2")
expression_4 = Expression(D=bang.Branch8, t=bang.Branch9, Expression="sqrt(2*D²-(D-2*t)²)")
crosec_calculation = Expression(D=expression_4, t=expression_2, Expression="(pi*(D/2)²)-(pi*((D-2*t)/2)²)")
expression_5 = Expression(D=bang.Branch10, t=bang.Branch11, Expression="sqrt(2*D²-(D-2*t)²)")
panel = Panel(bang.Branch2)
crosec = CrossSectionKaramba3D(
    FamilyNameOfCrossSection="DefaultCroSec",
    Material=matprops,
    Diameter_cm=bang.Branch0,
    WallThickness_cm=bang.Branch1,
    mode="Circular Hollow")
crosec_2 = CrossSectionKaramba3D(
    FamilyNameOfCrossSection="DefaultCroSec",
    Material=matprops,
    Diameter_cm=bang.Branch2,
    WallThickness_cm=bang.Branch3,
    mode="Circular Hollow")
crosec_3 = CrossSectionKaramba3D(
    FamilyNameOfCrossSection="DefaultCroSec",
    Material=matprops,
    Diameter_cm=bang.Branch4,
    WallThickness_cm=bang.Branch5,
    mode="Circular Hollow")
crosec_4 = CrossSectionKaramba3D(
    FamilyNameOfCrossSection="DefaultCroSec",
    Material=matprops,
    Diameter_cm=bang.Branch6,
    WallThickness_cm=bang.Branch7,
    mode="Circular Hollow")
crosec_5 = CrossSectionKaramba3D(
    FamilyNameOfCrossSection="DefaultCroSec",
    Material=matprops,
    Diameter_cm=expression_4,
    WallThickness_cm=expression_2,
    mode="Circular Hollow")
crosec_6 = CrossSectionKaramba3D(
    FamilyNameOfCrossSection="DefaultCroSec",
    Material=matprops,
    Diameter_cm=expression_5,
    WallThickness_cm=expression_3,
    mode="Circular Hollow")
path_mapper = PathMapper(crosec, source="{A}", target="{0}")
path_mapper_2 = PathMapper(crosec_2, source="{A}", target="{0}")
path_mapper_3 = PathMapper(crosec_3, source="{A}", target="{0}")
path_mapper_4 = PathMapper(crosec_4, source="{A}", target="{0}")
path_mapper_5 = PathMapper(crosec_5, source="{A}", target="{0}")
path_mapper_6 = PathMapper(crosec_6, source="{A}", target="{0}")
path_mapper_7 = ClusterOutput(path_mapper)
path_mapper_8 = ClusterOutput(path_mapper_2)
path_mapper_9 = ClusterOutput(path_mapper_4)
path_mapper_10 = ClusterOutput(path_mapper_5)
path_mapper_11 = ClusterOutput(path_mapper_3)
path_mapper_12 = ClusterOutput(path_mapper_6)
multiplication = Multiplication(A=bang.Branch6, B=2)
# Testing if changing the tube size but not the area affects output
expression_6 = Expression(D=bang.Branch6, t=bang.Branch7, Expression="(D*t - t²)/(D + sqrt(D²-D*t+t²))")
expression_7 = Expression(D=bang.Branch6, t=bang.Branch7, Expression="(pi * (D/2)²)-(pi*((D-2*t)/2)²)")
expression_8 = Expression(D=multiplication, t=expression_6, Expression="(pi * (D/2)²)-(pi*((D-2*t)/2)²)")
crosec_7 = CrossSectionKaramba3D(
    FamilyNameOfCrossSection="DefaultCroSec",
    Material=matprops,
    Diameter_cm=multiplication,
    WallThickness_cm=expression_6,
    mode="Circular Hollow")
panel_2 = Panel(expression_8)

# ==== cluster Cluster_3
P = ClusterInput()
pdecon = Deconstruct(Point=P)  # -> XComponent, YComponent, ZComponent
I = ClusterInput()
ins = InsertItems(List=pdecon.XComponent, Item=I, Indices=[0, -1], Wrap=True)
consec = ConsecutiveDomains(Numbers=ins, Additive=False)
cull_i = CullIndex(List=consec, Indices=[0, -1], Wrap=True)
div = DivideDomain(Domain=cull_i, Count=2)  # -> simplify(flatten(Segments))
item = ListItem(List=consec, Index=[0, -1], Wrap=True)
ins_2 = InsertItems(List=div, Item=item, Indices=[0, -1], Wrap=True)
partition = PartitionList(List=ins_2, Size=2)  # -> simplify(Chunks)
dedomain = DeconstructDomain(Domain=partition)  # -> Start, End
item_2 = ListItem(List=dedomain.End, Index=1, Wrap=True)
item_3 = ListItem(List=dedomain.Start, Index=0, Wrap=True)
subtraction = Subtraction(A=item_2, B=item_3)  # -> flatten(EffectiveLength)
panel = Panel(subtraction)
effective_length = ClusterOutput(subtraction)

# ==== cluster Cluster_4
x = ClusterInput()
roundd = RoundToDecimalPlace(NumberX=x, DecimalPlace=4, RoundType=0)  # -> Rounded, Difference
fragment = TextFragment(Text=roundd.Rounded, Start=0, Count=6)
item = ListItem(List=fragment, Index=0, Wrap=True)  # -> Item, Item1, Item2, Item3, Item4, Item5, Item6
concat = Concatenate(
    FragmentA="Total Tension: ",
    FragmentB=item.Item5,
    FragmentC=" | Total Compression: ",
    FragmentD=item.Item4,
    FragmentE="Cable Tension: ",
    FragmentF=item.Item3,
    FragmentG=" | Cable Compression: ",
    FragmentH=item.Item2,
    FragmentI="Conn. Tension: ",
    FragmentJ=item.Item1,
    FragmentK=" | Conn. Compression: ",
    FragmentL=item.Item,
    FragmentM="Maximum Deformation: ",
    FragmentN=item.Item6)
R = ClusterOutput(concat)

# ==== cluster Cluster_5
M = ClusterInput()
B = ClusterInput()
D = ClusterInput()
F = ClusterInput()
H = ClusterInput()
J = ClusterInput()
L = ClusterInput()
concat = Concatenate(
    FragmentM=M,
    FragmentA="Mean Compression: ",
    FragmentB=B,
    FragmentC="Mean Tension: ",
    FragmentD=D,
    FragmentE="Max Compression: ",
    FragmentF=F,
    FragmentG="Max Tension: ",
    FragmentH=H,
    FragmentI="Mean Deformation: ",
    FragmentJ=J,
    FragmentK="Max Deformation: ",
    FragmentL=L)
R = ClusterOutput(concat)
