# Grasshopper definition Grammar to Maquette.gh (Grasshopper 1.0.8)

sg_130 = Panel("""27
5
17
34
10
3
12
26
30
29
16
33
23
21
13
19
28
6""")
sg_130_2 = Panel("""TT_MID
TT_MID
SS_MID
TT_MID
TT_MID
SS_MID
TT_MID
SS_MID
TT_MID
TT_MID
TT_MID
SS_MID
TT_MID
TT_MID
SS_MID
SS_MID
TT_MID
TT_MID""")
sg_130_3 = Panel("""DT_MID
DT_MID
DT_MID
DT_MID
DT_MID
DT_MID
DT_MID
DT_MID
DT_MID
DT_MID
DT_MID
DT_MID
DT_MID
DT_MID
DT_MID
DT_MID
DT_MID
DT_MID""")
sg_130_4 = Panel("""0
0
1
0
0
1
0
1
0
0
0
1
0
0
1
1
0
0""")
sg_460 = Panel("""27
12
19
33
5
26
3
13
23
1
6
30
7
34
28
10
16
29""")
sg_460_2 = Panel("""TT_MID
TT_MID
SS_MID
SS_MID
TT_MID
SS_MID
SS_MID
SS_MID
TT_MID
SS_MID
TT_MID
TT_MID
TT_MID
SS_MID
TT_MID
TT_MID
SS_MID
TT_MID""")
sg_460_3 = Panel("""DT_MID
DT_MID
DT_MID
DT_MID
DT_MID
DT_MID
DT_MID
DT_MID
DT_MID
DT_MID
DT_MID
DT_MID
DT_MID
DT_MID
DT_MID
DT_MID
DT_MID
DT_MID""")
sg_460_4 = Panel("""0
0
0
0
0
0
0
0
0
1
0
0
0
1
0
0
1
0""")
sg_810 = Panel("""27
5
19
3
13
6
23
33
10
16
30
26
8
1
18
21""")
sg_810_2 = Panel("""TT_MID
TT_MID
SS_MID
SS_MID
SS_MID
SS_MID
TT_MID
SS_MID
SS_MID
SS_MID
TT_MID
SS_MID
SS_MID
SS_MID
TT_MID
SS_MID""")
sg_810_3 = Panel("""DT_MID
DT_MID
DT_MID
DT_MID
DT_MID
DT_MID
DT_MID
DT_MID
DT_MID
DT_MID
DT_MID
DT_MID
DT_MID
DT_MID
DT_MID
DT_MID""")
sg_810_4 = Panel("""0
0
0
0
0
0
0
0
0
0
0
0
0
0
0
0""")
sg_821 = Panel("""3
23
33
19
16
30
21
34
8
2
27
12
26
5
13
10""")
sg_821_2 = Panel("""TT_MID
TT_MID
SS_MID
SS_MID
SS_MID
TT_MID
SS_MID
SS_MID
SS_MID
SS_MID
SS_MID
TT_MID
SS_MID
SS_MID
SS_MID
SS_MID""")
sg_821_3 = Panel("""DT_MID
DT_MID
DT_MID
DT_MID
DT_MID
DT_MID
DT_MID
DT_MID
DT_MID
DT_MID
DT_MID
DT_MID
DT_MID
DT_MID
DT_MID
DT_MID""")
sg_821_4 = Panel("""0
0
0
0
0
0
0
0
0
0
0
0
0
0
0
0""")
sg_995 = Panel("""27
3
26
10
21
33
2
16
8
5
23
30
4
34
19
13""")
sg_995_2 = Panel("""TT_MID
TT_MID
SS_MID
SS_MID
TT_MID
SS_MID
SS_MID
SS_MID
SS_MID
SS_MID
SS_MID
TT_MID
TT_MID
TT_MID
SS_MID
SS_MID""")
sg_995_3 = Panel("""DT_MID
DT_MID
DT_MID
DT_MID
DT_MID
DT_MID
DT_MID
DT_MID
DT_MID
DT_MID
DT_MID
DT_MID
DT_MID
DT_MID
DT_MID
DT_MID""")
sg_995_4 = Panel("""0
0
0
0
0
0
0
0
1
0
0
1
0
0
0
0""")
sg_1517 = Panel("""27
5
13
10
19
12
21
26
33
3
18
6
16
23
30
34""")
sg_1517_2 = Panel("""TT_MID
TT_MID
SS_MID
SS_MID
SS_MID
SS_MID
TT_MID
SS_MID
SS_MID
SS_MID
SS_MID
TT_MID
SS_MID
SS_MID
TT_MID
SS_MID""")
sg_1517_3 = Panel("""DT_MID
DT_MID
DT_MID
DT_MID
DT_MID
DT_MID
DT_MID
DT_MID
DT_MID
DT_MID
DT_MID
DT_MID
DT_MID
DT_MID
DT_MID
DT_MID""")
sg_1517_4 = Panel("""0
0
0
0
0
0
0
0
0
0
0
0
0
0
0
0""")
entwine = Entwine(
    Branch0X=sg_130,
    Branch1X=sg_460,
    Branch2X=sg_810,
    Branch3X=sg_821,
    Branch4X=sg_995,
    Branch5X=sg_1517,
    FlattenInputs=False)  # -> simplify(Result)
entwine_2 = Entwine(
    Branch0X=sg_130_2,
    Branch1X=sg_460_2,
    Branch2X=sg_810_2,
    Branch3X=sg_821_2,
    Branch4X=sg_995_2,
    Branch5X=sg_1517_2,
    FlattenInputs=False)  # -> simplify(Result)
entwine_3 = Entwine(
    Branch0X=sg_130_3,
    Branch1X=sg_460_3,
    Branch2X=sg_810_3,
    Branch3X=sg_821_3,
    Branch4X=sg_995_3,
    Branch5X=sg_1517_3,
    FlattenInputs=False)  # -> simplify(Result)
entwine_4 = Entwine(
    Branch0X=sg_130_4,
    Branch1X=sg_460_4,
    Branch2X=sg_810_4,
    Branch3X=sg_821_4,
    Branch4X=sg_995_4,
    Branch5X=sg_1517_4,
    FlattenInputs=False)  # -> simplify(Result)
number_slider = Slider(0, range=0..5)
branch = TreeBranch(Tree=entwine, Path=number_slider, MaintainPaths=True)
branch_2 = TreeBranch(Tree=entwine_2, Path=number_slider, MaintainPaths=True)
branch_3 = TreeBranch(Tree=entwine_3, Path=number_slider, MaintainPaths=True)
branch_4 = TreeBranch(Tree=entwine_4, Path=number_slider, MaintainPaths=True)
panel = Panel("""TT_MID
HT_MID
DT_MID
CS_MID
SS_MID""")
mindex = MemberIndex(Set=panel, Member=branch_2)  # -> flatten(Index), Count
mindex_2 = MemberIndex(Set=panel, Member=branch_3)  # -> flatten(Index), Count
genes = GenePool(Decimals=0, Maximum=1, Minimum=0, Value=[1, 1, 1, 1, 1])
progress_weight = Slider(1, range=1..3)
distance_weight = Slider(1, range=1..3)
strict_termination = BooleanToggle(False)
py3 = Python3Script(
    allowed_connections=genes,
    picked_frame=branch,
    picked_target=mindex.Index,
    picked_candidate=mindex_2.Index,
    picked_mirror=branch_4,
    progress_weight=progress_weight,
    distance_weight=distance_weight,
    strict_termination=strict_termination)  # -> out, guide_curve_out, placed_frames_out, bridge_points_out, action_log_out, remaining_options_out, reuse_skips, no_progress_skips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; inputs allowed_connections: list, picked_frame: list of Int32, picked_target: list, picked_candidate: list, picked_mirror: list, progress_weight: Double, distance_weight: Double, strict_termination: Boolean
# ---------- py3: Python ----------
"""
Grasshopper Python 3 component script — direct-action variant of the baseline GA.
Stock/curve load from IV.frames_v0 / IV.arch_v0 (same as RL training).

Inputs:  picked_frame, picked_target, picked_candidate, picked_mirror (required, list[int])
         strict_termination (optional)
         picked_target / picked_candidate: 0-4 = TT/HT/DT/CS/SS_MID
         picked_mirror: 0/1

Outputs: identical to GH_Baseline_GA_Calling_Script.py.
         no_progress_skips is always 0 and remaining_options_out always empty,
         since this variant has no ranking or progress filter.
"""

import sys
sys.path.append(r"C:\Users\rensh\Documents\Master Thesis\REP_STRUC RL\RL Application")
sys.path.append(r"C:\Users\rensh\Documents\Master Thesis\REP_STRUC RL\Main Deployment")

import Rhino.Geometry as rg
import ghpythonlib.treehelpers as th
import importlib
import csv
import numpy as np

import Baseline_GA_Core
import Baseline_GA_Core_Direct                                              # +++
import Baseline_GA_Utilities
import environment.envs.BikeBuilder_Classes
import environment.envs.BikeBuilder_Utilities
import internal_variables

# +++ Dependency order: each module is reloaded after the modules it imports from
importlib.reload(internal_variables)
importlib.reload(environment.envs.BikeBuilder_Classes)
importlib.reload(environment.envs.BikeBuilder_Utilities)
importlib.reload(Baseline_GA_Utilities)
importlib.reload(Baseline_GA_Core)
importlib.reload(Baseline_GA_Core_Direct)

from internal_variables import IV
from environment.envs.BikeBuilder_Classes import BikeFrame
from environment.envs.BikeBuilder_Utilities import resample_curve
from Baseline_GA_Core_Direct import run_baseline_ga_direct                 # +++
from Baseline_GA_Utilities import placed_frames_to_point_tuples, bridge_points_to_tuples

# =============================================================================
# CSV HELPERS — stdlib, no pandas (not installed in GH venv)
# =============================================================================

def _read_csv_rows(path):
    with open(path, newline='') as f:
        return list(csv.DictReader(f))

# =============================================================================
# DATA LOADING — same sources as RL training (IV.frames_v0, IV.arch_v0)
# =============================================================================

frame_rows = _read_csv_rows(IV.frames_v0)
frame_stock = []
for row in frame_rows:
    corners = np.array([
        [float(row["ST_TOP_X"]),    float(row["ST_TOP_Z"])],
        [float(row["HT_TOP_X"]),    float(row["HT_TOP_Z"])],
        [float(row["HT_BOTTOM_X"]), float(row["HT_BOTTOM_Z"])],
        [float(row["BB_X"]),        float(row["BB_Z"])],
        [float(row["CS_SS_X"]),     float(row["CS_SS_Z"])],
    ], dtype=np.float32)
    frame_stock.append(BikeFrame(corners))

curve_rows = _read_csv_rows(IV.arch_v0)
raw_guide_curve = np.array([
    [float(row["x_cord"]), float(row["z_cord"])]
    for row in curve_rows
], dtype=np.float32)

# Shift curve start to IV.origin_position, matching BB_arch_environment.__init__.
shift = np.array(IV.origin_position, dtype=np.float32) - raw_guide_curve[0]
raw_guide_curve = (raw_guide_curve + shift).astype(np.float32)

sampled_guide_curve = resample_curve(raw_guide_curve, IV.curve_samples)

# =============================================================================
# OPTIONAL GH INPUT HANDLING
# =============================================================================

# --- rank_window, progress_weight, distance_weight, allowed_connections removed:
# --- no ranking, and the RL env enforces no allowed-point restriction.
_strict_termination = bool(strict_termination) if 'strict_termination' in dir() else False  # noqa: F821

# =============================================================================
# RUN
# =============================================================================

result = run_baseline_ga_direct(                                            # +++
    frame_stock        = frame_stock,
    guide_curve        = sampled_guide_curve,
    picked_frame       = [int(v) for v in picked_frame],      # noqa: F821 (GH input)
    picked_target      = [int(v) for v in picked_target],     # noqa: F821 (GH input)
    picked_candidate   = [int(v) for v in picked_candidate],  # noqa: F821 (GH input)
    picked_mirror      = [int(v) for v in picked_mirror],     # noqa: F821 (GH input)
    strict_termination = _strict_termination,
)

# =============================================================================
# OUTPUT CONVERSION — unchanged from GH_Baseline_GA_Calling_Script.py
# =============================================================================

def _point_tuples_to_tree(nested_tuples):
    # list[list[(x, z)]] -> Point3d tree, one branch per outer entry, XZ-plane.
    nested_points = [
        [rg.Point3d(x, 0.0, z) for (x, z) in branch]
        for branch in nested_tuples
    ]
    return th.list_to_tree(nested_points)

def _bridge_connections_to_tuples(bike_bridge):
    # Flattens bike_bridge.connections into one coordinate list per polyline.
    # Each entry resolves to 2 or 3 points depending on BikeBridge's pruning.
    triples_out = []
    for connection_set in bike_bridge.connections:
        for triple in connection_set:
            resolved_points = [
                (float(bike_bridge.points[frame_idx][local_idx][0]),
                 float(bike_bridge.points[frame_idx][local_idx][1]))
                for frame_idx, local_idx in triple
            ]
            triples_out.append(resolved_points)
    return triples_out

def _tube_to_tuples(bike_bridge, per_frame_local_indices):
    # Resolves a BikeBridge per-tube index property into one branch per frame.
    branches_out = []
    for frame_idx, local_indices in enumerate(per_frame_local_indices):
        frame_points = bike_bridge.points[frame_idx]
        branch = [
            (float(frame_points[local_idx][0]), float(frame_points[local_idx][1]))
            for local_idx in local_indices
        ]
        branches_out.append(branch)
    return branches_out

def _support_to_point(bike_bridge, support_id):
    # Resolves a BikeBridge support id (frame_idx, local_idx) to one Point3d.
    frame_idx, local_idx = support_id
    x, z = bike_bridge.points[frame_idx][local_idx]
    return rg.Point3d(float(x), 0.0, float(z))

def _tension_lines_to_tuples(bike_bridge):
    # Resolves bike_bridge.tension_lines into one 2-point branch per line.
    branches_out = []
    for id_a, id_b in bike_bridge.tension_lines:
        points = []
        for frame_idx, local_idx in (id_a, id_b):
            x, z = bike_bridge.points[frame_idx][local_idx]
            points.append((float(x), float(z)))
        branches_out.append(points)
    return branches_out

def _load_points_to_list(bike_bridge):
    # Resolves bike_bridge.load_points into a flat Point3d list (empty if load_valid is False).
    points_out = []
    for frame_idx, local_idx in bike_bridge.load_points:
        x, z = bike_bridge.points[frame_idx][local_idx]
        points_out.append(rg.Point3d(float(x), 0.0, float(z)))
    return points_out

placed_frames_out = _point_tuples_to_tree(
    placed_frames_to_point_tuples(result.placed_frames)
)

action_log_out = th.list_to_tree(result.action_log)

remaining_options_out = list(result.remaining_options)   # always empty in this variant

guide_curve_out = [rg.Point3d(float(x), 0.0, float(z)) for (x, z) in sampled_guide_curve]

if result.bike_bridge is not None:
    bridge_points_out = _point_tuples_to_tree(
        bridge_points_to_tuples(result.bike_bridge)
    )
    connections_out = _point_tuples_to_tree(
        _bridge_connections_to_tuples(result.bike_bridge)
    )
    tt_out = _point_tuples_to_tree(_tube_to_tuples(result.bike_bridge, result.bike_bridge.top_tubes))
    ht_out = _point_tuples_to_tree(_tube_to_tuples(result.bike_bridge, result.bike_bridge.head_tubes))
    dt_out = _point_tuples_to_tree(_tube_to_tuples(result.bike_bridge, result.bike_bridge.down_tubes))
    cs_out = _point_tuples_to_tree(_tube_to_tuples(result.bike_bridge, result.bike_bridge.chain_stays))
    ss_out = _point_tuples_to_tree(_tube_to_tuples(result.bike_bridge, result.bike_bridge.seat_stays))
    st_out = _point_tuples_to_tree(_tube_to_tuples(result.bike_bridge, result.bike_bridge.seat_tubes))
    pin_out = _support_to_point(result.bike_bridge, result.bike_bridge.pin)
    roller_out = _support_to_point(result.bike_bridge, result.bike_bridge.roller)
    tension_cable_out = _point_tuples_to_tree(_tension_lines_to_tuples(result.bike_bridge))
    load_points_out = _load_points_to_list(result.bike_bridge)
else:
    bridge_points_out = _point_tuples_to_tree([])
    connections_out    = _point_tuples_to_tree([])
    tt_out = _point_tuples_to_tree([])
    ht_out = _point_tuples_to_tree([])
    dt_out = _point_tuples_to_tree([])
    cs_out = _point_tuples_to_tree([])
    ss_out = _point_tuples_to_tree([])
    st_out = _point_tuples_to_tree([])
    pin_out = None
    roller_out = None
    tension_cable_out = _point_tuples_to_tree([])
    load_points_out = []

reuse_skips        = result.tally.reuse_skips
no_progress_skips  = result.tally.no_progress_skips    # always 0 in this variant
no_intersect_skips = result.tally.no_intersect_skips
terminated         = result.tally.terminated
true_termination   = result.tally.true_termination
overshot           = result.tally.overshot
steps_completed    = result.tally.steps_completed

# =============================================================================
# IV Outputs
# =============================================================================
deck_range_1         = IV.deck_range[0]
deck_range_2         = IV.deck_range[1]
deck_range           = [deck_range_1, deck_range_2]
tributary_width      = IV.tributary_width
termination_vicinity = IV.termination_vicinity
# ---------- end py3 ----------
geo = Geometry(py3.placed_frames_out)
pline = PolyLine(Vertices=geo, Closed=True)

# ----
# Pre-FEA Visualizer
intcrv = Interpolate(Vertices=py3.guide_curve_out, Degree=3, Periodic=False, KnotStyle=1)  # -> Curve, Length, Domain
item = ListItem(List=py3.guide_curve_out, Index=-1, Wrap=True)
pl = ConstructPlane(Origin=item, XAxis=Vector(1, 0, 0), YAxis=Vector(0, 0, 1))
cir = Circle(Plane=pl, Radius=py3.termination_vicinity)
preview = CustomPreview(
    Geometry=intcrv.Curve,
    Material={diffuse=RGB(221, 160, 221), emission=RGB(66, 48, 66), shine=0.5, specular=RGB(255, 255, 255), transparency=0})
preview_2 = CustomPreview(
    Geometry=cir,
    Material={diffuse=RGB(221, 160, 221), emission=RGB(66, 48, 66), shine=0.5, specular=RGB(255, 255, 255), transparency=0})
