# Grasshopper definition Metre_Model_Testing.gh (Grasshopper 1.0.8)
# plug-ins: Karamba3D

# ----
# Connection Material
number_slider = Slider(0.5, range=0..10)
matselect = MaterialSelectionKaramba3D(menu=[dropdown(1), dropdown(4)])
crosec = CrossSectionKaramba3D(
    FamilyNameOfCrossSection="DefaultCroSec",
    Material=matselect,
    Diameter_cm=Slider(3, range=0..10),
    WallThickness_cm=number_slider,
    mode="Circular Hollow")

X = UnitX(Factor=Slider(0.2, range=0..1))
pt = Point(Point(30, 0, 20))
move = Move(Geometry=pt, Motion=X)  # -> Geometry, Transform
ln = Line(StartPoint=pt, EndPoint=move.Geometry)

neg = Negative(Value=Slider(1, range=0..100))
vec = VectorXYZ(XComponent=0, YComponent=0, ZComponent=neg)  # -> Vector, Length
supp = SupportKaramba3D(PosInd=pt, Ct_kN_m=Vector(0, 0, 0), Cr_kNm_rad=Vector(0, 0, 0), menu=[buttons(on, on, on, on, on, on)])
loads = LoadsKaramba3D(ForceVector=vec.Vector, Local=False, PosInd=move.Geometry, LCase="LC0", mode="Point")
lineelem = CreateLinearElementKaramba3D(
    Line=ln,
    CrossSection=crosec,
    LimitDistance_m=0.005,
    BucklingLengthY_m=-1,
    BucklingLengthZ_m=-1,
    BucklingLengthLT_m=-1,
    Bending=True,
    ToPolylineMaxAngle=0.25,
    ToPolylineTolerance=0.1,
    ToPolylineMaxEdgeLength=0.25,
    New=True,
    Remove=True,
    mode="LineToBeam")  # -> Element, Points, Info
assemble = AssembleModelKaramba3D(Elem=lineelem.Element, Support=supp, Load=loads, LimitDistance_m=0.005)  # -> Model, Info, Mass_kg, CentreOfGravity, LoadCaseNames
pt_2 = Point(Point(700, 0, 495.9070573))
pt_3 = Point(Point(700, 0, 500))
pdecon = Deconstruct(Point=pt_3)  # -> XComponent, YComponent, ZComponent
pdecon_2 = Deconstruct(Point=pt_2)  # -> XComponent, YComponent, ZComponent
analyse = AnalyseKaramba3D(Model=assemble.Model)  # -> AnalysedModel, MaximumDisplacement_cm, ResultingForce_kN, ChangeOfElasticEnergy_kNm
subtraction = Subtraction(A=pdecon.ZComponent, B=pdecon_2.ZComponent)
modelview = ModelViewKaramba3D(Model=analyse.AnalysedModel)  # -> Model, DeformedMesh, DeformedAxes, DeformedModel, MaximumDeformation
panel = Panel(subtraction)
panel_2 = Panel(modelview.MaximumDeformation)
utilization = UtilizationOfElementsKaramba3D(
    AnalysedModel=analyse.AnalysedModel,
    NumberOfSamplePoints=3,
    ElasticDesign=True,
    GammaM0=1,
    GammaM1=1.1,
    SwayFrame=True,
    WithDetails=False,
    mode="Beams")  # -> Model, Utilization, SigMax_kN_cm², SigMin_kN_cm², TauMax_kN_cm², UtilN, UtilVy, UtilVz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
beamview = BeamViewKaramba3D(Model=modelview.Model)  # -> Model, MeshesOfRenderedBeams, DeformedBeamAxes, LegendColours, LegendTags
item = ListItem(List=beamview.LegendTags, Index=[0, -1], Wrap=True)
cull_i = CullIndex(List=beamview.LegendTags, Indices=[0, -1], Wrap=True)
panel_3 = Panel(utilization.SigMax_kN_cm²)
panel_4 = Panel(utilization.SigMin_kN_cm²)
num = Number(cull_i)
ins = InsertItems(List=num, Item=item, Indices=[0, -1], Wrap=True)
legend = Legend(Colour=beamview.LegendColours, Tags=ins, LegendType=1)
