# Grasshopper definition Quick Trib Width Calc.gh (Grasshopper 1.0.8)

pt = Point(Point(5000, 0, 5000))
pt_2 = Point(Point(7600, 0, 5000))
ln = Line(StartPoint=pt, EndPoint=pt_2)
divide = DivideCurve(Curve=ln, Count=Slider(10, range=0..10), Kinks=False)  # -> Points, Tangents, Parameters
shatter = Shatter(Curve=ln, Parameters=divide.Parameters)
panel = Panel("""1.30
0.866
0.650
0.520
0.433
0.371
0.325""")
item = ListItem(List=shatter, Index=1, Wrap=True)
len = Length(Curve=item)
division = Division(A=len, B="1000")
panel_2 = Panel(division)
