# Grasshopper definition Reward testing.gh (Grasshopper 1.0.8)

geo = Geometry([Point(-130.6378236, 0, 523.9596922), Point(390.024685, 0, 581.9817177), Point(406.3262259, 0, 523.2002601), Point(0, 0, 0), Point(-398.9047505, 0, 70)])
pline = PolyLine(Vertices=geo, Closed=True)
pdecon = Deconstruct(Point=geo)  # -> XComponent, YComponent, ZComponent
avr = Average(Input=pdecon.XComponent)
avr_2 = Average(Input=pdecon.ZComponent)
area = Area(Geometry=pline)  # -> Area, Centroid
pt = ConstructPoint(XCoordinate=avr, YCoordinate=0, ZCoordinate=avr_2)
crv = Curve(<curve referenced from the Rhino model>)
divide = DivideCurve(Curve=crv, Count=99, Kinks=False)  # -> Points, Tangents, Parameters
pt_2 = Point(Point(2862.493808, 0, 648.8491103))
dist = Distance(PointA=divide.Points, PointB=pt_2)
ln = Line(StartPoint=pt, EndPoint=pt_2)
move = Move(Geometry=pline, Motion=ln)  # -> Geometry, Transform
sort = SortList(Keys=dist, ValuesA=divide.Points)  # -> Keys, ValuesA
item = ListItem(List=sort.Keys, Index=0, Wrap=True)
item_2 = ListItem(List=sort.ValuesA, Index=0, Wrap=True)
ln_2 = Line(StartPoint=item_2, EndPoint=pt_2)
num = Number("600")
expression = Expression(nearest_distance=item, distance_threshold=num, Expression="1.0 - (nearest_distance / distance_threshold)")
panel = Panel(expression)
