# Grasshopper definition Trib Width Multiob Analysis.gh (Grasshopper 1.0.8)
# plug-ins: Pufferfish

# Ran with 10 options and no action wrapping again
trib_width_analysis = Data(Tree({0}: [8.246486269, "20", 8.720374396, 1.743427413, "20", "20"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], {1}: [389.3119882, "400", 240.8052753, 42.1880324, "400", "400"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], {2}: [415.1317952, "400", 235.1750515, 44.49457484, "400", "400"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], {3}: ["0.866", "0.371", "0.371", "0.371", "0.866", "0.866"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]))
bang = ExplodeTree(Data=trib_width_analysis)  # -> Branch0, Branch1, Branch2, Branch3
tstat = TreeStatistics(Tree=Tree({0;0}: [8.246486269, 389.3119882, 415.1317952, "0.866"], {0;1}: ["20", "400", "400", "0.371"], {0;2}: [8.720374396, 240.8052753, 235.1750515, "0.371"], {0;3}: [1.743427413, 42.1880324, 44.49457484, "0.371"], {0;4}: ["20", "400", "400", "0.866"], {0;5}: ["20", "400", "400", "0.866"]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))  # -> Paths, Length, Count
panel = Panel("""1.30
0.866
0.650
0.520
0.433
0.371
0.325""")
equals = Equality(FirstNumber=graft(bang.Branch3), SecondNumber=panel)  # -> simplify(Equality), Inequality
dispatch = Dispatch(List=[0, 1, 2, 3, 4, 5, 6], DispatchPattern=equals.Equality)  # -> flatten(ListA), ListB
sift = SiftPattern(List=bang.Branch0, SiftPattern=dispatch.ListA)  # -> Output0, Output1, Output2, Output3, Output4, Output5, Output6
sift_2 = SiftPattern(List=bang.Branch1, SiftPattern=dispatch.ListA)  # -> Output0, Output1, Output2, Output3, Output4, Output5, Output6
sift_3 = SiftPattern(List=bang.Branch2, SiftPattern=dispatch.ListA)  # -> Output0, Output1, Output2, Output3, Output4, Output5, Output6
entwine = Entwine(
    Branch0X=sift.Output0,
    Branch1X=sift.Output1,
    Branch2X=sift.Output2,
    Branch3X=sift.Output3,
    Branch4X=sift.Output4,
    Branch5X=sift.Output5,
    Branch6X=sift.Output6,
    FlattenInputs=False)
entwine_2 = Entwine(
    Branch0X=sift_2.Output0,
    Branch1X=sift_2.Output1,
    Branch2X=sift_2.Output2,
    Branch3X=sift_2.Output3,
    Branch4X=sift_2.Output4,
    Branch5X=sift_2.Output5,
    Branch6X=sift_2.Output6,
    FlattenInputs=False)
entwine_3 = Entwine(
    Branch0X=sift_3.Output0,
    Branch1X=sift_3.Output1,
    Branch2X=sift_3.Output2,
    Branch3X=sift_3.Output3,
    Branch4X=sift_3.Output4,
    Branch5X=sift_3.Output5,
    Branch6X=sift_3.Output6,
    FlattenInputs=False)
clean = CleanTree(RemoveNulls=True, RemoveInvalid=True, RemoveEmpty=False, Tree=entwine)
clean_2 = CleanTree(RemoveNulls=True, RemoveInvalid=True, RemoveEmpty=False, Tree=entwine_2)
clean_3 = CleanTree(RemoveNulls=True, RemoveInvalid=True, RemoveEmpty=False, Tree=entwine_3)
sort = SortList(Keys=clean)  # -> Keys, ValuesA

# ----
# Deform Values per Trib Width
data = Data(sort.Keys)
avr = Average(Input=data)  # -> flatten(ArithmeticMean)
item = ListItem(List=data, Index=0, Wrap=True)  # -> flatten(Item)
item_2 = ListItem(List=data, Index=-1, Wrap=True)  # -> flatten(Item)
panel_2 = Panel(item)
panel_3 = Panel(item_2)
panel_4 = Panel(avr)

sort_2 = SortList(Keys=clean_2)  # -> Keys, ValuesA

# ----
# Compression Values per Trib Width
data_2 = Data(sort_2.Keys)
avr_2 = Average(Input=data_2)  # -> flatten(ArithmeticMean)
item_3 = ListItem(List=data_2, Index=0, Wrap=True)  # -> flatten(Item)
item_4 = ListItem(List=data_2, Index=-1, Wrap=True)  # -> flatten(Item)
panel_5 = Panel(item_4)
panel_6 = Panel(item_3)
panel_7 = Panel(avr_2)

sort_3 = SortList(Keys=clean_3)  # -> Keys, ValuesA

# ----
# Tension Values per Trib Width
data_3 = Data(sort_3.Keys)
avr_3 = Average(Input=data_3)  # -> flatten(ArithmeticMean)
item_5 = ListItem(List=data_3, Index=0, Wrap=True)  # -> flatten(Item)
item_6 = ListItem(List=data_3, Index=-1, Wrap=True)  # -> flatten(Item)
panel_8 = Panel(item_6)
panel_9 = Panel(item_5)
panel_10 = Panel(avr_3)

series = Series(Start=0, Step=0.1, Count=101)
roundn = RoundToNearest(NumbersX=sort.Keys, NumbersY=series, RemapX=False)  # -> Nearest, Index, Difference, RemappedX
pt = Point("20000,0,0")
mindex = MemberIndex(Set=simplify(roundn.Nearest), Member=series)  # -> Index, Count
xz = XZPlane(Origin=pt)
X = UnitX(Factor=1)
line = LineSDL(Start=pt, Direction=X, Length="1000")
rectangle = Rectangle(Plane=xz, XSize="1000", YSize="1000", Radius=0)  # -> Rectangle, Length
divide = DivideCurve(Curve=line, Count=100, Kinks=False)  # -> Points, Tangents, Parameters
xz_2 = XZPlane(Origin=divide.Points)
tag = TextTag3D(Location=xz_2, Text=series, Size=3, Justification=8)
line_2 = LineSDL(Start=divide.Points, Direction=Vector(0, 0, 1), Length=mindex.Count)
end = EndPoints(Curve=line_2)  # -> Start, End
pline = PolyLine(Vertices=end.End, Closed=False)  # -> flatten(Polyline)
item_7 = ListItem(List=pline, Index=Slider(0, range=0..6), Wrap=True)
