# Grasshopper definition Karamba Bridge 2.0.gh (Grasshopper 1.0.8)
# plug-ins: Karamba3D

expected_load_points = Slider(7, range=0..10)
offset_from_edge = Slider(2000, range=0..2000)
deck_length = Slider(16, range=0..100)
main_beams = Slider(3, range=0..10)
deck_width = Slider(2.5, range=0..10)
railing_spacing = Slider(500, range=0..1000)
railing_height = Slider(1200, range=0..2000)
slat_width = Slider(75, range=0..100)
slat_spacing = Slider(5, range=0..100)
matselect = MaterialSelectionKaramba3D(menu=[dropdown(3), dropdown(1)])
multiplication = Multiplication(A=deck_length, B=1000)
multiplication_2 = Multiplication(A=deck_width, B=1000)
crosecrselect = CrossSectionRangeSelectorKaramba3D(MaximumHeight_cm=-1, MaximumWidth_cm=-1, menu=[dropdown(1), dropdown(2), dropdown(1)])
main_beam_width = Slider(100, range=0..1000)
main_beam_height = Slider(200, range=0..1000)

# ----
# Main Beams
panel = Panel("500,0,500")
pt = Point(panel)
X = UnitX(Factor=multiplication)
move = Move(Geometry=pt, Motion=X)  # -> Geometry, Transform
subtraction = Subtraction(A=main_beams, B=1)
ln = Line(StartPoint=pt, EndPoint=move.Geometry)
division = Division(A=multiplication_2, B=subtraction)
Y = UnitY(Factor=division)
arrlinear = LinearArray(Geometry=ln, Direction=Y, Count=main_beams)  # -> simplify(graft(Geometry)), Transform

stave_length = Slider(1.8, range=0..10)
stave = Slider(60, range=0..100)
railing_vertical = Slider(70, range=0..100)
railing_horizontal = Slider(80, range=0..100)
stave_thickness = Slider(8, range=0..100)
slat_height = Slider(50, range=0..100)
multiplication_3 = Multiplication(A=stave_length, B=1000)
division_2 = Division(A=main_beam_height, B=10)
Z = UnitZ(Factor=expr("-x/2", division_2))
division_3 = Division(A=main_beam_width, B=10)
division_4 = Division(A=railing_vertical, B=10)
division_5 = Division(A=Slider(114.3, range=0..1000), B=10)
division_6 = Division(A=stave_thickness, B=10)
division_7 = Division(A=slat_height, B=10)
division_8 = Division(A=railing_horizontal, B=10)
crosec = CrossSectionKaramba3D(
    FamilyNameOfCrossSection="DefaultCroSec",
    Material=matselect,
    LocalEccentricity_cm=Z,
    Height_cm=division_2,
    UpperFlangeWidth_cm=division_3,
    LowerFlangeWidth_cm=division_3,
    mode="Trapezoid")
crosec_2 = CrossSectionKaramba3D(
    FamilyNameOfCrossSection="DefaultCroSec",
    Material=matselect,
    Height_cm=division_4,
    UpperFlangeWidth_cm=division_4,
    LowerFlangeWidth_cm=division_4,
    mode="Trapezoid")
crosec_3 = CrossSectionKaramba3D(
    FamilyNameOfCrossSection="DefaultCroSec",
    Material=matselect,
    Height_cm=division_8,
    UpperFlangeWidth_cm=division_8,
    LowerFlangeWidth_cm=division_8,
    mode="Trapezoid")
crosec_4 = CrossSectionKaramba3D(FamilyNameOfCrossSection="DefaultCroSec", Height_cm=division_7, mode="Shell - Const")
crosec_5 = CrossSectionKaramba3D(
    FamilyNameOfCrossSection="DefaultCroSec",
    Material=matselect,
    Diameter_cm=division_5,
    WallThickness_cm=division_6,
    mode="Circular Hollow")
disassemble = DisassembleMaterialKaramba3D(Material=matselect)  # -> Material, TypeOfMaterial, FamilyNameOfMaterial, NameOfMaterial, ElemIdentifiers, Colour, YoungsModulusKNCm²Dir12, InPlaneShearModulus_kN_cm²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
panel_2 = Panel(disassemble.CompressiveStrengthKNCm²Dir12)

subtraction_2 = Subtraction(A=multiplication, B=offset_from_edge)
merge = Merge(Data1=offset_from_edge, Data2=subtraction_2)
eval = EvaluateLength(Curve=arrlinear.Geometry, Length=merge, Normalized=False)  # -> Point, Tangent, Parameter
shatter = Shatter(Curve=arrlinear.Geometry, Parameters=eval.Parameter)
subtraction_3 = Subtraction(A=expected_load_points, B=1)
item = ListItem(List=shatter, Index=1, Wrap=True)
divide = DivideCurve(Curve=item, Count=subtraction_3, Kinks=False)  # -> Points, Tangents, Parameters
shatter_2 = Shatter(Curve=simplify(shatter), Parameters=simplify(divide.Parameters))
trim = TrimTree(Tree=shatter_2, Depth=1)  # -> flatten(Tree)

addition = Addition(A=slat_width, B=slat_spacing)
division_9 = Division(A="1000", B=addition)
multiplication_4 = Multiplication(A=slat_width, B=division_9)
division_10 = Division(A=multiplication_4, B="1000")
division_11 = Division(A=slat_height, B="1000")
multiplication_5 = Multiplication(A=division_10, B=division_11)
m3_slats = Panel(multiplication_5)
division_12 = Division(A=railing_vertical, B=1000)
division_13 = Division(A=railing_horizontal, B=1000)

# ----
# Railing
item_2 = ListItem(List=flatten(arrlinear.Geometry), Index=[0, -1], Wrap=True)
divlength = DivideLength(Curve=item_2, Length=railing_spacing)  # -> Points, Tangents, Parameters
line = LineSDL(Start=divlength.Points, Direction=Vector(0, 0, 1), Length=railing_height)
end = EndPoints(Curve=line)  # -> Start, End
pline = PolyLine(Vertices=end.End, Closed=False)  # -> flatten(Polyline)

multiplication_6 = Multiplication(A=m3_slats, B=disassemble.SpecificWeight_kN_m³)
division_14 = Division(A=main_beam_height, B=1000)
division_15 = Division(A=main_beam_width, B=1000)
multiplication_7 = Multiplication(A=division_12, B=division_12)
division_16 = Division(A=railing_height, B=1000)
multiplication_8 = Multiplication(A=division_13, B=division_13)
pt_2 = Point(flatten(divlength.Points))
multiplication_9 = Multiplication(A=division_14, B=division_15)
multiplication_10 = Multiplication(A=multiplication_7, B=division_16)
multiplication_11 = Multiplication(A=multiplication_9, B=disassemble.SpecificWeight_kN_m³)
multiplication_12 = Multiplication(A=multiplication_10, B=disassemble.SpecificWeight_kN_m³)
multiplication_13 = Multiplication(A=multiplication_8, B=disassemble.SpecificWeight_kN_m³)
crv_cp = CurveClosestPoint(Point=pt_2, Curve=simplify(graft(trim)))  # -> Point, Parameter, Distance
multiplication_14 = Multiplication(A=Slider(0.4, range=0..1), B=0.325)

# ----
# Staves
pt_3 = Point(divide.Points)
line_2 = LineSDL(Start=pt_3, Direction=expr("-x", Vector(0, 0, 1)), Length=multiplication_3)  # -> flatten(Line)

# ----
# Deck
number_slider = Slider(100, range=0..1000)
loft = Loft(
    Curves=flatten(arrlinear.Geometry),
    Options={Adjust=False, Closed=False, LoftEnds=0, LoftSimp=0, LoftType=0, Rebuild=10, Refit=0.01})
mesh_breps = MeshBrepsKaramba3D(
    Brep=loft,
    InclusionPoints=flatten([pt_3, divlength.Points]),
    MeshResolution=number_slider,
    EdgeRefinementFactor=0.67,
    PointReduction=False,
    SmoothingStepSize=0,
    SmoothingIterations=5)  # -> Mesh, Info

# ----
# Embankment
end_2 = EndPoints(Curve=arrlinear.Geometry)  # -> Start, End
pt_4 = Point(flatten([end_2.Start, end_2.End]))

smaller = SmallerThan(FirstNumber=crv_cp.Distance, SecondNumber=0.001)  # -> SmallerThan, OrEqualTo
dispatch = Dispatch(List=crv_cp.Parameter, DispatchPattern=smaller.SmallerThan)  # -> simplify(ListA), ListB
addition_2 = Addition(A=multiplication_6, B=multiplication_11)
division_17 = Division(A=Slider(1.25, range=0..10), B=division_15)
panel_3 = Panel(addition_2)  # "kN/m2"
lng = ListLength(List=dispatch.ListA)  # -> flatten(Length)
shatter_3 = Shatter(Curve=graft(trim), Parameters=dispatch.ListA)  # -> simplify(flatten(Segments))
division_18 = Division(A=division_14, B=division_17)
multiplication_15 = Multiplication(A=division_17, B=division_15)
panel_4 = Panel("""Gravity
ULS""")
multiplication_16 = Multiplication(A=division_18, B=multiplication_15)
equals = Equality(FirstNumber=lng, SecondNumber=0)  # -> Equality, Inequality
multiplication_17 = Multiplication(A=disassemble.SpecificWeight_kN_m³, B=multiplication_16)
dispatch_2 = Dispatch(List=trim, DispatchPattern=equals.Equality)  # -> ListA, ListB
divide_2 = DivideCurve(Curve=dispatch_2.ListA, Count=2, Kinks=False)  # -> Points, Tangents, flatten(Parameters)
panel_5 = Panel(multiplication_17)
Z_2 = UnitZ(Factor=Slider(6.35, range=0..10))
end_3 = EndPoints(Curve=line_2)  # -> Start, End
shatter_4 = Shatter(Curve=dispatch_2.ListA, Parameters=divide_2.Parameters)  # -> flatten(Segments)
pt_5 = Point(end_3.End)
merge_2 = Merge(Data1=shatter_4, Data2=shatter_3)
supp = SupportKaramba3D(PosInd=pt_4, Ct_kN_m=Vector(0, 0, 0), Cr_kNm_rad=Vector(0, 0, 0), menu=[buttons(on, on, on, on, off, on)])
supp_2 = SupportKaramba3D(PosInd=pt_5, Ct_kN_m=Vector(0, 0, 0), Cr_kNm_rad=Vector(0, 0, 0), menu=[buttons(off, off, on, off, off, off)])
loads = LoadsKaramba3D(Vector=Z_2, Mesh=mesh_breps.Mesh, LCase="ULS", mode="MeshLoad -Const.", menu=[buttons(on, off, off), buttons(on, on)])
loads_2 = LoadsKaramba3D(Vector=Vector(0, 0, -1), LCase=panel_4, mode="Gravity")
lineelem = CreateLinearElementKaramba3D(
    Line=flatten(line),
    CrossSection=crosec_2,
    LimitDistance_mm=0.005,
    BucklingLengthY_mm=-1,
    BucklingLengthZ_mm=-1,
    BucklingLengthLT_mm=-1,
    Bending=True,
    ToPolylineMaxAngle=0.25,
    ToPolylineTolerance=0.1,
    ToPolylineMaxEdgeLength=0.25,
    New=True,
    Remove=True,
    mode="LineToBeam")  # -> Element, Points, Info
lineelem_2 = CreateLinearElementKaramba3D(
    Line=merge_2,
    CrossSection=crosec,
    LimitDistance_mm=0.005,
    BucklingLengthY_mm=-1,
    BucklingLengthZ_mm=-1,
    BucklingLengthLT_mm=-1,
    Bending=True,
    ToPolylineMaxAngle=0.25,
    ToPolylineTolerance=0.1,
    ToPolylineMaxEdgeLength=0.25,
    New=True,
    Remove=True,
    mode="LineToBeam")  # -> Element, Points, Info
lineelem_3 = CreateLinearElementKaramba3D(
    Line=pline,
    CrossSection=crosec_3,
    LimitDistance_mm=0.005,
    BucklingLengthY_mm=-1,
    BucklingLengthZ_mm=-1,
    BucklingLengthLT_mm=-1,
    Bending=True,
    ToPolylineMaxAngle=0.25,
    ToPolylineTolerance=0.1,
    ToPolylineMaxEdgeLength=0.25,
    New=True,
    Remove=True,
    mode="LineToBeam")  # -> Element, Points, Info
lineelem_4 = CreateLinearElementKaramba3D(
    Line=line_2,
    Identifier="Staves",
    CrossSection=crosec_5,
    LimitDistance_mm=0.005,
    BucklingLengthY_mm=-1,
    BucklingLengthZ_mm=-1,
    BucklingLengthLT_mm=-1,
    Bending=True,
    ToPolylineMaxAngle=0.25,
    ToPolylineTolerance=0.1,
    ToPolylineMaxEdgeLength=0.25,
    New=True,
    Remove=True,
    mode="LineToBeam")  # -> Element, Points, Info
surfelem = CreateSurfaceElementKaramba3D(Mesh=mesh_breps.Mesh, CrossSection=crosec_4, LimitDistance_mm=0.005, Bending=True, mode="MeshToShell")  # -> Element, Points, Info
merge_3 = Merge(Data1=flatten(loads), Data2=flatten(loads_2))
merge_4 = Merge(Data1=supp, Data2=supp_2)
merge_5 = Merge(
    Data1=lineelem_4.Element,
    Data2=lineelem_2.Element,
    Data3=surfelem.Element,
    Data4=lineelem_3.Element,
    Data5=lineelem.Element)
assemble = AssembleModelKaramba3D(Elem=merge_5, Support=merge_4, Load=merge_3, LimitDistance_mm=0.005)  # -> Model, Info, Mass_kg, CentreOfGravity, LoadCaseNames
analysethii = AnalyseThIIKaramba3D(
    Model=assemble.Model,
    UseInitialNII=True,
    NIIFromCombination=True,
    NoTensionalNII=False,
    RTolerance=1e-07,
    MaxIterations=50)  # -> AnalysedModel, MaximumDisplacement_cm, ResultingForce_kN, ChangeOfElasticEnergy_kNm
analyse = AnalyseKaramba3D(Model=assemble.Model, LoadCases="Gravity")  # -> AnalysedModel, MaximumDisplacement_cm, ResultingForce_kN, ChangeOfElasticEnergy_kNm
panel_6 = Panel("Staves")
modelview = ModelViewKaramba3D(Model=analyse.AnalysedModel)  # -> Model, DeformedMesh, DeformedAxes, DeformedModel, MaximumDeformation
panel_7 = Panel(modelview.MaximumDeformation)
utilization = UtilizationOfElementsKaramba3D(
    AnalysedModel=modelview.Model,
    NumberOfSamplePoints=3,
    ElasticDesign=True,
    GammaM0=1,
    GammaM1=1.1,
    SwayFrame=True,
    WithDetails=False,
    mode="Beams")  # -> Model, Utilization, flatten(SigMax_kN_cm²), flatten(SigMin_kN_cm²), TauMax_kN_cm², UtilN, UtilVy, UtilVz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
shellview = ShellViewKaramba3D(Model=modelview.Model, IndexOfLayer=0)  # -> Model, MeshesOfRenderedShells, LegendColours, LegendTags
beamview = BeamViewKaramba3D(Model=modelview.Model)  # -> Model, MeshesOfRenderedBeams, DeformedBeamAxes, LegendColours, LegendTags
sort = SortList(Keys=utilization.SigMax_kN_cm²)  # -> Keys, ValuesA
sort_2 = SortList(Keys=utilization.SigMin_kN_cm²)  # -> Keys, ValuesA
item_3 = ListItem(List=beamview.LegendTags, Index=0, Wrap=True)  # -> Item1, Item
item_4 = ListItem(List=beamview.LegendTags, Index=[1, 2, 3, 4, 5, 6, 7, 8, 9, 10, 11], Wrap=True)
item_5 = ListItem(List=shellview.LegendTags, Index=0, Wrap=True)  # -> Item1, Item
item_6 = ListItem(List=shellview.LegendTags, Index=[1, 2, 3, 4, 5, 6, 7, 8, 9, 10, 11], Wrap=True)
item_7 = ListItem(List=sort.Keys, Index=0, Wrap=True)  # -> Item, Item1
item_8 = ListItem(List=sort_2.Keys, Index=0, Wrap=True)  # -> Item, Item1
num = Number(item_4)
num_2 = Number(item_6)
panel_8 = Panel(item_7.Item)
panel_9 = Panel(item_7.Item1)
panel_10 = Panel(item_8.Item)
panel_11 = Panel(item_8.Item1)
merge_6 = Merge(Data1=item_3.Item, Data2=num, Data3=item_3.Item1)
merge_7 = Merge(Data1=item_5.Item, Data2=num_2, Data3=item_5.Item1)
legend = Legend(Colour=beamview.LegendColours, Tags=merge_6, LegendType=1)
legend_2 = Legend(Colour=shellview.LegendColours, Tags=merge_7, LegendType=1)
